# Grasshopper definition 001_points.gh (Grasshopper 1.0.7)
# plug-ins: HAL for Grasshopper

sessionsettings = SessionSettings()

number_slider = Slider(10, range=0..10)
number_slider_2 = Slider(10, range=0..10)

range = Range(Domain=number_slider, Steps=number_slider_2)
range_2 = Range(Domain=number_slider, Steps=number_slider_2)
range_3 = Range(Domain=number_slider, Steps=number_slider_2)
unit_z = UnitZ(Factor=range_3)
construct_point = ConstructPoint(XCoordinate=graft(range), YCoordinate=range_2, ZCoordinate=0)
move = Move(Geometry=graft(construct_point), Motion=unit_z)  # -> Geometry, Transform
list_length = ListLength(List=flatten(move.Geometry))
random = Random(Range=list_length, Number=Slider(10, range=0..10), Seed=Slider(36, range=0..100))
list_item = ListItem(List=flatten(move.Geometry), Index=random, Wrap=True)
point = Point(list_item)
