# Grasshopper definition 002_curves.gh (Grasshopper 1.0.7)
# plug-ins: HAL for Grasshopper, Bifocals

sessionsettings = SessionSettings()

number_slider = Slider(10, range=0..10)
number_slider_2 = Slider(10, range=0..10)

number_slider_3 = Slider(10, range=0..10)  # disabled
number_slider_4 = Slider(10, range=0..10)  # disabled
number_slider_5 = Slider(36, range=0..100)  # disabled
number_slider_6 = Slider(10, range=0..10)  # disabled

# ----
# Creating Parametric Curves
range = Range(Domain=number_slider, Steps=number_slider_2)
range_2 = Range(Domain=number_slider, Steps=number_slider_2)
range_3 = Range(Domain=number_slider, Steps=number_slider_2)
unit_z = UnitZ(Factor=range_3)
construct_point = ConstructPoint(XCoordinate=graft(range), YCoordinate=range_2, ZCoordinate=0)
move = Move(Geometry=graft(construct_point), Motion=unit_z)  # -> Geometry, Transform
list_length = ListLength(List=flatten(move.Geometry))
random = Random(Range=list_length, Number=Slider(10, range=0..10), Seed=Slider(36, range=0..100))
list_item = ListItem(List=flatten(move.Geometry), Index=random, Wrap=True)
point = Point(list_item)
polyline = PolyLine(Vertices=point, Closed=False)
nurbs_curve = NurbsCurve(Vertices=point, Degree=3, Periodic=False)  # -> Curve, Length, Domain
interpolate = Interpolate(Vertices=point, Degree=3, Periodic=False, KnotStyle=1)  # -> Curve, Length, Domain

# ----
# Creating Parametric Points
range_4 = Range(Domain=number_slider_3, Steps=number_slider_6)  # disabled
range_5 = Range(Domain=number_slider_3, Steps=number_slider_6)  # disabled
range_6 = Range(Domain=number_slider_3, Steps=number_slider_6)  # disabled
unit_z_2 = UnitZ(Factor=range_6)  # disabled
construct_point_2 = ConstructPoint(XCoordinate=graft(range_4), YCoordinate=range_5, ZCoordinate=0)  # disabled
move_2 = Move(Geometry=graft(construct_point_2), Motion=unit_z_2)  # -> Geometry, Transform; disabled
list_length_2 = ListLength(List=flatten(move_2.Geometry))  # disabled
random_2 = Random(Range=list_length_2, Number=number_slider_4, Seed=number_slider_5)  # disabled
list_item_2 = ListItem(List=flatten(move_2.Geometry), Index=random_2, Wrap=True)  # disabled
point_2 = Point(list_item_2)  # disabled

number_slider_7 = Slider(34, range=0..100)
number_slider_8 = Slider(10, range=0..10)

range_7 = Range(Domain=number_slider_8, Steps=number_slider_7)
range_8 = Range(Domain=number_slider_8, Steps=number_slider_7)
range_9 = Range(Domain=number_slider_8, Steps=number_slider_7)
cosine = Cosine(Value=range_9)
sine = Sine(Value=range_8)
unit_z_3 = UnitZ(Factor=range_7)
multiplication = Multiplication(A=cosine, B=Slider(1.371, range=0..10))
multiplication_2 = Multiplication(A=sine, B=Slider(1.198, range=0..10))
construct_point_3 = ConstructPoint(XCoordinate=multiplication_2, YCoordinate=multiplication, ZCoordinate=unit_z_3)
point_3 = Point(construct_point_3)
interpolate_2 = Interpolate(Vertices=point_3, Degree=3, Periodic=False, KnotStyle=1)  # -> Curve, Length, Domain
polyline_2 = PolyLine(Vertices=point_3, Closed=False)
nurbs_curve_2 = NurbsCurve(Vertices=point_3, Degree=3, Periodic=False)  # -> Curve, Length, Domain
