# Grasshopper definition 003_circles.gh (Grasshopper 1.0.7)
# plug-ins: HAL for Grasshopper, Bifocals

# Single Variable Calculus
# inspired by:
# Robert A. Adams, 2nd edition
# .gh scripts created at:
# Wickerson Studios
# 
# Principle Features:
# - emphasis on geometry
# - trigonometric and exponential functions
# - their inverse, the logarithms
# - natural logarithm, area under a curve
# - Fundamental Theorem
# - roots of equations, definite integrals
# - numerical integration
# - Romberg method, ptifalls of numerical method
# - proof by mathematical induction
# - closed, finite, intervals
# - properties of the Reimann integral
# - the Mean-Value Theorem
# - definition of the  definite integral
# - plane curves, conic sections
# - development of polar coordinates,
# plane parametric curves,
# and plane vector functions
# - integration
# - Taylor's formula and Taylor series
# - partial differentiation
# - multi variable calculus
# Looking forward, Calculus of Several Varialbles
sessionsettings = SessionSettings()

number_slider = Slider(1.198, range=0..10)  # disabled
number_slider_2 = Slider(34, range=0..100)  # disabled
number_slider_3 = Slider(10, range=0..10)  # disabled

# ----
# Creating Basic Trigonometric Curves
number_slider_4 = Slider(1.371, range=0..10)  # disabled
range = Range(Domain=number_slider_3, Steps=number_slider_2)  # disabled
range_2 = Range(Domain=number_slider_3, Steps=number_slider_2)  # disabled
range_3 = Range(Domain=number_slider_3, Steps=number_slider_2)  # disabled
cosine = Cosine(Value=range_3)  # disabled
sine = Sine(Value=range_2)  # disabled
unit_z = UnitZ(Factor=range)  # disabled
multiplication = Multiplication(A=cosine, B=number_slider_4)  # disabled
multiplication_2 = Multiplication(A=sine, B=number_slider)  # disabled
construct_point = ConstructPoint(XCoordinate=multiplication_2, YCoordinate=multiplication, ZCoordinate=unit_z)  # disabled
point = Point(construct_point)  # disabled
interpolate = Interpolate(Vertices=point, Degree=3, Periodic=False, KnotStyle=1)  # -> Curve, Length, Domain; disabled
polyline = PolyLine(Vertices=point, Closed=False)  # disabled
nurbs_curve = NurbsCurve(Vertices=point, Degree=3, Periodic=False)  # -> Curve, Length, Domain; disabled

number_slider_5 = Slider(10, range=0..10)  # disabled
number_slider_6 = Slider(10, range=0..10)  # disabled
number_slider_7 = Slider(36, range=0..100)  # disabled
number_slider_8 = Slider(10, range=0..10)  # disabled

number_slider_9 = Slider(10, range=0..10)  # disabled
number_slider_10 = Slider(10, range=0..10)  # disabled
number_slider_11 = Slider(10, range=0..10)  # disabled
number_slider_12 = Slider(36, range=0..100)  # disabled

# ----
# Creating Parametric Curves
range_4 = Range(Domain=number_slider_5, Steps=number_slider_8)  # disabled
range_5 = Range(Domain=number_slider_5, Steps=number_slider_8)  # disabled
range_6 = Range(Domain=number_slider_5, Steps=number_slider_8)  # disabled
unit_z_2 = UnitZ(Factor=range_6)  # disabled
construct_point_2 = ConstructPoint(XCoordinate=graft(range_4), YCoordinate=range_5, ZCoordinate=0)  # disabled
move = Move(Geometry=graft(construct_point_2), Motion=unit_z_2)  # -> Geometry, Transform; disabled
list_length = ListLength(List=flatten(move.Geometry))  # disabled
random = Random(Range=list_length, Number=number_slider_6, Seed=number_slider_7)  # disabled
list_item = ListItem(List=flatten(move.Geometry), Index=random, Wrap=True)  # disabled
point_2 = Point(list_item)  # disabled
polyline_2 = PolyLine(Vertices=point_2, Closed=False)  # disabled
nurbs_curve_2 = NurbsCurve(Vertices=point_2, Degree=3, Periodic=False)  # -> Curve, Length, Domain; disabled
# Functions, Limits, and Continuity
# What is Calculus?
# - analysis relationships that change with time
# - calculus measures the wya related quantities change
# - differentiation and integration
# Creating Parametric Circles
# Motion of a Falling Rock
interpolate_2 = Interpolate(Vertices=point_2, Degree=3, Periodic=False, KnotStyle=1)  # -> Curve, Length, Domain; disabled

# ----
# Creating Parametric Points
range_7 = Range(Domain=number_slider_9, Steps=number_slider_10)  # disabled
range_8 = Range(Domain=number_slider_9, Steps=number_slider_10)  # disabled
range_9 = Range(Domain=number_slider_9, Steps=number_slider_10)  # disabled
unit_z_3 = UnitZ(Factor=range_9)  # disabled
construct_point_3 = ConstructPoint(XCoordinate=graft(range_7), YCoordinate=range_8, ZCoordinate=0)  # disabled
move_2 = Move(Geometry=graft(construct_point_3), Motion=unit_z_3)  # -> Geometry, Transform; disabled
list_length_2 = ListLength(List=flatten(move_2.Geometry))  # disabled
random_2 = Random(Range=list_length_2, Number=number_slider_11, Seed=number_slider_12)  # disabled
list_item_2 = ListItem(List=flatten(move_2.Geometry), Index=random_2, Wrap=True)  # disabled
point_3 = Point(list_item_2)  # disabled
