# Grasshopper definition 005_intervals.gh (Grasshopper 1.0.7)
# plug-ins: HAL for Grasshopper, Bifocals

# Single Variable Calculus
# inspired by:
# Robert A. Adams, 2nd edition
# .gh scripts created at:
# Wickerson Studios
# 
# Principle Features:
# - emphasis on geometry
# - trigonometric and exponential functions
# - their inverse, the logarithms
# - natural logarithm, area under a curve
# - Fundamental Theorem
# - roots of equations, definite integrals
# - numerical integration
# - Romberg method, ptifalls of numerical method
# - proof by mathematical induction
# - closed, finite, intervals
# - properties of the Reimann integral
# - the Mean-Value Theorem
# - definition of the  definite integral
# - plane curves, conic sections
# - development of polar coordinates,
# plane parametric curves,
# and plane vector functions
# - integration
# - Taylor's formula and Taylor series
# - partial differentiation
# - multi variable calculus
# Looking forward, Calculus of Several Varialbles
sessionsettings = SessionSettings()

number_slider = Slider(1.198, range=0..10)  # disabled
number_slider_2 = Slider(34, range=0..100)  # disabled
number_slider_3 = Slider(10, range=0..10)  # disabled

# ----
# Creating Basic Trigonometric Curves
number_slider_4 = Slider(1.371, range=0..10)  # disabled
range = Range(Domain=number_slider_3, Steps=number_slider_2)  # disabled
range_2 = Range(Domain=number_slider_3, Steps=number_slider_2)  # disabled
range_3 = Range(Domain=number_slider_3, Steps=number_slider_2)  # disabled
cosine = Cosine(Value=range_3)  # disabled
sine = Sine(Value=range_2)  # disabled
unit_z = UnitZ(Factor=range)  # disabled
multiplication = Multiplication(A=cosine, B=number_slider_4)  # disabled
multiplication_2 = Multiplication(A=sine, B=number_slider)  # disabled
construct_point = ConstructPoint(XCoordinate=multiplication_2, YCoordinate=multiplication, ZCoordinate=unit_z)  # disabled
point = Point(construct_point)  # disabled
interpolate = Interpolate(Vertices=point, Degree=3, Periodic=False, KnotStyle=1)  # -> Curve, Length, Domain; disabled
polyline = PolyLine(Vertices=point, Closed=False)  # disabled
nurbs_curve = NurbsCurve(Vertices=point, Degree=3, Periodic=False)  # -> Curve, Length, Domain; disabled

number_slider_5 = Slider(10, range=0..10)  # disabled
number_slider_6 = Slider(10, range=0..10)  # disabled
number_slider_7 = Slider(36, range=0..100)  # disabled
number_slider_8 = Slider(10, range=0..10)  # disabled

number_slider_9 = Slider(10, range=0..10)  # disabled
number_slider_10 = Slider(10, range=0..10)  # disabled
number_slider_11 = Slider(10, range=0..10)  # disabled
number_slider_12 = Slider(36, range=0..100)  # disabled

# ----
# Creating Parametric Curves
range_4 = Range(Domain=number_slider_5, Steps=number_slider_8)  # disabled
range_5 = Range(Domain=number_slider_5, Steps=number_slider_8)  # disabled
range_6 = Range(Domain=number_slider_5, Steps=number_slider_8)  # disabled
unit_z_2 = UnitZ(Factor=range_6)  # disabled
construct_point_2 = ConstructPoint(XCoordinate=graft(range_4), YCoordinate=range_5, ZCoordinate=0)  # disabled
move = Move(Geometry=graft(construct_point_2), Motion=unit_z_2)  # -> Geometry, Transform; disabled
list_length = ListLength(List=flatten(move.Geometry))  # disabled
random = Random(Range=list_length, Number=number_slider_6, Seed=number_slider_7)  # disabled
list_item = ListItem(List=flatten(move.Geometry), Index=random, Wrap=True)  # disabled
point_2 = Point(list_item)  # disabled
polyline_2 = PolyLine(Vertices=point_2, Closed=False)  # disabled
nurbs_curve_2 = NurbsCurve(Vertices=point_2, Degree=3, Periodic=False)  # -> Curve, Length, Domain; disabled
# Functions, Limits, and Continuity
# What is Calculus?
# - analysis relationships that change with time
# - calculus measures the way related quantities change
# - differentiation and integration
# Motion of a Falling Rock
# consider
# height (in metres) of rock t seconds
# dorpped from ho is function h(t)
# 
# h(t) = ho - 4.9t^2
# graph y = h(t)
# differentiation allows you to find new function
# h'(t) and call the derivative of h with respect to t
# h'(t) = -9.8t
# this represents the rate of vhange of the height
# of the rock, its velocity in metres/seconds
interpolate_2 = Interpolate(Vertices=point_2, Degree=3, Periodic=False, KnotStyle=1)  # -> Curve, Length, Domain; disabled

# ----
# Creating Parametric Points
range_7 = Range(Domain=number_slider_9, Steps=number_slider_10)  # disabled
range_8 = Range(Domain=number_slider_9, Steps=number_slider_10)  # disabled
range_9 = Range(Domain=number_slider_9, Steps=number_slider_10)  # disabled
unit_z_3 = UnitZ(Factor=range_9)  # disabled
construct_point_3 = ConstructPoint(XCoordinate=graft(range_7), YCoordinate=range_8, ZCoordinate=0)  # disabled
move_2 = Move(Geometry=graft(construct_point_3), Motion=unit_z_3)  # -> Geometry, Transform; disabled
list_length_2 = ListLength(List=flatten(move_2.Geometry))  # disabled
random_2 = Random(Range=list_length_2, Number=number_slider_11, Seed=number_slider_12)  # disabled
list_item_2 = ListItem(List=flatten(move_2.Geometry), Index=random_2, Wrap=True)  # disabled
point_3 = Point(list_item_2)  # disabled

# ----
# Motion of a Falling Rock
ho = Slider(5, range=0.01..5)  # disabled
t = Slider(0.41, range=0.01..1.25)  # disabled
panel = Panel("2")  # disabled
panel_2 = Panel("5")  # disabled
panel_3 = Panel("48")  # disabled
range_10 = Range(Domain=panel, Steps=panel_3)  # disabled
range_11 = Range(Domain=t, Steps=panel_3)  # disabled
range_12 = Range(Domain=panel_2, Steps=panel_3)  # disabled
expression = Expression(t=range_11, ho=ho, Expression="ho -4.9*(t^2)")  # disabled
construct_point_4 = ConstructPoint(XCoordinate=range_10, YCoordinate=0, ZCoordinate=0)  # disabled
construct_point_5 = ConstructPoint(XCoordinate=0, YCoordinate=range_12, ZCoordinate=0)  # disabled
construct_point_6 = ConstructPoint(XCoordinate=range_11, YCoordinate=expression, ZCoordinate=0)  # disabled
interpolate_3 = Interpolate(Vertices=construct_point_6, Degree=3, Periodic=False, KnotStyle=1)  # -> Curve, Length, Domain; disabled
interpolate_4 = Interpolate(Vertices=construct_point_4, Degree=3, Periodic=False, KnotStyle=1)  # -> Curve, Length, Domain; disabled
interpolate_5 = Interpolate(Vertices=construct_point_5, Degree=3, Periodic=False, KnotStyle=1)  # -> Curve, Length, Domain; disabled
curve_middle = CurveMiddle(Curve=interpolate_4.Curve)  # disabled
curve_middle_2 = CurveMiddle(Curve=interpolate_5.Curve)  # disabled
curve_middle_3 = CurveMiddle(Curve=interpolate_3.Curve)  # disabled
end_points = EndPoints(Curve=interpolate_3.Curve)  # -> Start, End; disabled
number_slider_13 = Slider(0.2, range=0..1)  # disabled
panel_4 = Panel("   y = h(t)")  # disabled
panel_5 = Panel("t")  # disabled
panel_6 = Panel("y    ")  # disabled
panel_7 = Panel("ho   ")  # disabled
text_tag_3d = TextTag3D(Location=curve_middle, Text=panel_5, Size=number_slider_13, Justification=3)  # disabled
text_tag_3d_2 = TextTag3D(Location=curve_middle_2, Text=panel_6, Size=number_slider_13, Justification=6)  # disabled
text_tag_3d_3 = TextTag3D(Location=end_points.Start, Text=panel_7, Size=number_slider_13, Justification=6)  # disabled
text_tag_3d_4 = TextTag3D(Location=curve_middle_3, Text=panel_4, Size=number_slider_13, Justification=7)  # disabled
panel_8 = Panel("1")  # disabled
panel_9 = Panel(".1")  # disabled
negative = Negative(Value=panel_9)  # disabled
evaluate_curve = EvaluateCurve(Curve=reparameterize(interpolate_3.Curve), Parameter=panel_8)  # -> Point, Tangent, Angle; disabled
offset_curve = OffsetCurve(Curve=interpolate_4.Curve, Distance=panel_9, Corners=1)  # disabled
offset_curve_2 = OffsetCurve(Curve=interpolate_5.Curve, Distance=negative, Corners=1)  # disabled
circle = Circle(Plane=end_points.End, Radius=panel_9)  # disabled
# Independently invented by Newton and Leibniz
# -Newton's motivation was a desire to
# analyze motion of moving objects
# - using calculus he formulated
# laws of motion and gravitation
# - drew from Kepler's empirical data
# Newton used calculus to study the cosmos
# - many "laws of nature" are expressed
# as equations and thier solutions are at the
# heart of calculus
# - Newton's second law:
# Force = mass * acceleration
# - acceleration, -9.8m/sec^2 is the rate of change
# the derivative of the velocity is the rate of change
# the derivative of the height function
# lines and curves were seen as paths traced by moving points
# - geometric concepts of tangency and area
# - differentiation  finds tangent lines
# - integration finds areas of regions with curved boundaries
# - concepts of real numbers, coordinate systems
# and function
# - concept of limit, an opperation on functions
# - this distinguishes calculus, THE LIMIT
loft = Loft(
    Curves=flatten([interpolate_4.Curve, offset_curve]),
    Options={Adjust=False, Closed=False, LoftEnds=0, LoftSimp=0, LoftType=0, Rebuild=10, Refit=0.01})  # disabled
loft_2 = Loft(
    Curves=flatten([interpolate_5.Curve, offset_curve_2]),
    Options={Adjust=False, Closed=False, LoftEnds=0, LoftSimp=0, LoftType=0, Rebuild=10, Refit=0.01})  # disabled
boundary_surfaces = BoundarySurfaces(Edges=circle)  # disabled
vector_display = VectorDisplay(Anchor=evaluate_curve.Point, Vector=evaluate_curve.Tangent)  # disabled

panel_10 = Panel(".05")  # disabled

# ----
# The Real Line and the Cartesian Plane
# - real numbers are expressible in decimal form
# - real numbers can be represented
# geometrically as points on a number line
# (the real line)
# - IR symbol
number_slider_14 = Slider(3, range=0..10)  # disabled
# Properties of the real number system
# fall into three categories:
# algebraic properties, ordered properties and completeness
# - real numbers may be added, subtracted,
#  multiplied, devided (except by "0")
# to produce more real numbers
# - the usual laws of arithmetic are satisfied
# - Order properties refer to order
# - Completeness states that there can be no holes
# in the real line, every point corresponds
# to a real number
# 
# Three special subsets are:
# the natrual numbers, (1, 2, 3, ...)
# the integers (0, +-1, +-2, ...)
# the rational numbers can be expressed at
# real numbers m/n where m and n are integers,
# and n != 0
# - rational numbers terminate or end in string
# of repeating digits over and over
# _ the rational numbers  do not pocess
# the completeness property
# -  i.e. Sqrt(2)
# - this provides an appropriate setting
# for studying the limits and therefore, CALCULUS
expression_2 = Expression(Expression="Sqrt(2)")  # disabled
negative_2 = Negative(Value=number_slider_14)  # disabled
construct_domain = ConstructDomain(DomainStart=negative_2, DomainEnd=number_slider_14)  # disabled
expression_3 = Expression(Expression="2^½")  # disabled
expression_4 = Expression(Expression="π")  # disabled
panel_11 = Panel("Sqrt(2)")  # disabled
panel_12 = Panel("4")  # disabled
panel_13 = Panel("pi")  # disabled
panel_14 = Panel("-3/4")  # disabled
panel_15 = Panel("1")  # disabled
panel_16 = Panel("3")  # disabled
panel_17 = Panel("-2")  # disabled
panel_18 = Panel("-1")  # disabled
panel_19 = Panel("0")  # disabled
panel_20 = Panel("2")  # disabled
panel_21 = Panel("1/3")  # disabled
range_13 = Range(Domain=construct_domain, Steps=10)  # disabled
construct_point_7 = ConstructPoint(XCoordinate=range_13, YCoordinate=0, ZCoordinate=0)  # disabled
merge = Merge(
    Data1=panel_17,
    Data2=panel_18,
    Data3=panel_14,
    Data4=panel_19,
    Data5=panel_21,
    Data6=panel_15,
    Data7=panel_11,
    Data8=panel_20,
    Data9=panel_16,
    Data10=panel_13,
    Data11=panel_12)  # disabled
polyline_3 = PolyLine(Vertices=construct_point_7, Closed=False)  # disabled
boolean_toggle = BooleanToggle(True)  # disabled
panel_22 = Panel("_____")  # disabled
construct_point_8 = ConstructPoint(XCoordinate=merge, YCoordinate=0, ZCoordinate=0)  # disabled
panel_23 = Panel(".5")  # disabled
concatenate = Concatenate(FragmentA=panel_22, FragmentB=merge)  # disabled
end_points_2 = EndPoints(Curve=reparameterize(polyline_3))  # -> Start, End; disabled
pi = Pi(Factor=panel_23)  # disabled
circle_2 = Circle(Plane=construct_point_8, Radius=panel_10)  # disabled
negative_3 = Negative(Value=pi)  # disabled
vector_2pt = Vector2Pt(PointA=end_points_2.Start, PointB=end_points_2.End, Unitize=boolean_toggle)  # -> Vector, Length; disabled
boundary_surfaces_2 = BoundarySurfaces(Edges=circle_2)  # disabled
vector_display_2 = VectorDisplay(Anchor=end_points_2.End, Vector=vector_2pt.Vector)  # disabled
rotate_plane = RotatePlane(Plane=boundary_surfaces_2, Angle=negative_3)  # disabled
panel_24 = Panel(".12")  # disabled
# Intervals:
# - this is a subset of the real line
# - it contains atleast two numbers
# - it contains all real numbers
# between any tow of its elements
# - i.e. x such that x > 6
# - i.e. y such that y != 0 is not an interval
# (it is two intervals)
# - closed interval from a to b, denoted [a, b]
# consitsts of all real numbers x satisfying
# a <= x <=b
# - open interval from a to b, denoted (a, b)
# consists of all real numbers x satisfying
# a < x < b
# - note the use of small dots and open "holes"
# - the whole real line my be regarded as
# an interval: IR = (-infinity, infinity) or (-∞, ∞)
text_tag_3d_5 = TextTag3D(Location=rotate_plane, Text=concatenate, Size=panel_24, Justification=7)  # disabled

# ----
# Intervals
# the Real Line
number_slider_15 = Slider(5, range=0..10)
negative_4 = Negative(Value=number_slider_15)
construct_domain_2 = ConstructDomain(DomainStart=negative_4, DomainEnd=number_slider_15)
range_14 = Range(Domain=construct_domain_2, Steps="48")
construct_point_9 = ConstructPoint(XCoordinate=range_14, YCoordinate=0, ZCoordinate=0)
polyline_4 = PolyLine(Vertices=construct_point_9, Closed=False)
end_points_3 = EndPoints(Curve=polyline_4)  # -> Start, End
construct_point_10 = ConstructPoint(XCoordinate=0, YCoordinate=0, ZCoordinate=0)
vector_2pt_2 = Vector2Pt(PointA=construct_point_10, PointB=end_points_3.End, Unitize=Toggle(False))  # -> Vector, Length
negative_5 = Negative(Value=vector_2pt_2.Vector)
vector_display_3 = VectorDisplay(Anchor=construct_point_10, Vector=negative_5)
vector_display_4 = VectorDisplay(Anchor=construct_point_10, Vector=vector_2pt_2.Vector)

# ----
# a <= x < b
panel_25 = Panel("[a,b)")

# ----
# closed and open intervals
panel_26 = Panel("(a,b]")
panel_27 = Panel("[a,b]")
panel_28 = Panel("(a,b)")
characters = Characters(Text=panel_25)  # -> Result, Unicode
list_item_3 = ListItem(List=characters.Result, Index=0, Wrap=True)  # -> Item1, Item
panel_29 = Panel(list_item_3.Item)
panel_30 = Panel(list_item_3.Item1)
ghpython_script = GhPythonScript(closed_open=panel_29, a=Slider(-3.12, range=-5..5), b=Slider(3.28, range=-5..5), open_closed=panel_30)  # -> out, smallest_pt, smallest_circle, smallest_surface, largest_pt, largest_circle, largest_surface
# ---------- ghpython_script: Python ----------
__author__ = "Sculpture"
__version__ = "2021.07.11"

import rhinoscriptsyntax as rs

#a must be less than and not equal to b to be an interval
if (a < b):
    if (closed_open == "["):
        smallest_pt = rs.CreatePoint(a, 0, 0)
        smallest_circle = rs.AddCircle(smallest_pt, 0.1)
        smallest_surface = rs.AddPlanarSrf(smallest_circle)
    elif (closed_open == "("):
        smallest_pt = rs.CreatePoint(a, 0, 0)
        smallest_circle = rs.AddCircle(smallest_pt, 0.1)
        
    if (open_closed == "]"):
        largest_pt = rs.CreatePoint(b, 0, 0)
        largest_circle = rs.AddCircle(largest_pt, 0.1)
        largest_surface = rs.AddPlanarSrf(largest_circle)
    elif (open_closed == ")"):
        largest_pt = rs.CreatePoint(b, 0, 0)
        largest_circle = rs.AddCircle(largest_pt, 0.1)
# ---------- end ghpython_script ----------
point_4 = Point(ghpython_script.largest_pt)
point_5 = Point(ghpython_script.smallest_pt)
circle_3 = Circle(ghpython_script.smallest_circle)
surface = Surface(ghpython_script.smallest_surface)
circle_4 = Circle(ghpython_script.largest_circle)
surface_2 = Surface(ghpython_script.largest_surface)
deconstruct = Deconstruct(Point=point_5)  # -> XComponent, YComponent, ZComponent
deconstruct_2 = Deconstruct(Point=point_4)  # -> XComponent, YComponent, ZComponent
negative_6 = Negative(Value="5")
merge_2 = Merge(Data1=deconstruct.XComponent, Data2=deconstruct_2.XComponent, Data3="0", Data4=negative_6, Data5="5")
construct_point_11 = ConstructPoint(XCoordinate=merge_2, YCoordinate=0, ZCoordinate=0)
negative_7 = Negative(Value=".5")
concatenate_2 = Concatenate(FragmentA="_____", FragmentB=construct_point_11)
pi_2 = Pi(Factor=negative_7)
rotate_plane_2 = RotatePlane(Plane=construct_point_11, Angle=pi_2)
text_tag_3d_6 = TextTag3D(Location=rotate_plane_2, Text=concatenate_2, Size=".12", Justification=7)

# ----
# Creating Parametric Circles
vector_display_ex = VectorDisplayEx(Colour=RGB(0, 0, 0), Width=2)
