# Grasshopper definition 010_coordinates_and_graphs.gh (Grasshopper 1.0.7)
# plug-ins: HAL for Grasshopper, Bifocals

# Single Variable Calculus
# inspired by:
# Robert A. Adams, 2nd edition
# .gh scripts created at:
# Wickerson Studios
# 
# Principle Features:
# - emphasis on geometry
# - trigonometric and exponential functions
# - their inverse, the logarithms
# - natural logarithm, area under a curve
# - Fundamental Theorem
# - roots of equations, definite integrals
# - numerical integration
# - Romberg method, ptifalls of numerical method
# - proof by mathematical induction
# - closed, finite, intervals
# - properties of the Reimann integral
# - the Mean-Value Theorem
# - definition of the  definite integral
# - plane curves, conic sections
# - development of polar coordinates,
# plane parametric curves,
# and plane vector functions
# - integration
# - Taylor's formula and Taylor series
# - partial differentiation
# - multi variable calculus
# Looking forward, Calculus of Several Varialbles
sessionsettings = SessionSettings()

number_slider = Slider(1.198, range=0..10)  # disabled
number_slider_2 = Slider(34, range=0..100)  # disabled
number_slider_3 = Slider(10, range=0..10)  # disabled

# ----
# Creating Basic Trigonometric Curves
number_slider_4 = Slider(1.371, range=0..10)  # disabled
range = Range(Domain=number_slider_3, Steps=number_slider_2)  # disabled
range_2 = Range(Domain=number_slider_3, Steps=number_slider_2)  # disabled
range_3 = Range(Domain=number_slider_3, Steps=number_slider_2)  # disabled
cosine = Cosine(Value=range_3)  # disabled
sine = Sine(Value=range_2)  # disabled
unit_z = UnitZ(Factor=range)  # disabled
multiplication = Multiplication(A=cosine, B=number_slider_4)  # disabled
multiplication_2 = Multiplication(A=sine, B=number_slider)  # disabled
construct_point = ConstructPoint(XCoordinate=multiplication_2, YCoordinate=multiplication, ZCoordinate=unit_z)  # disabled
point = Point(construct_point)  # disabled
interpolate = Interpolate(Vertices=point, Degree=3, Periodic=False, KnotStyle=1)  # -> Curve, Length, Domain; disabled
polyline = PolyLine(Vertices=point, Closed=False)  # disabled
nurbs_curve = NurbsCurve(Vertices=point, Degree=3, Periodic=False)  # -> Curve, Length, Domain; disabled

number_slider_5 = Slider(10, range=0..10)  # disabled
number_slider_6 = Slider(10, range=0..10)  # disabled
number_slider_7 = Slider(36, range=0..100)  # disabled
number_slider_8 = Slider(10, range=0..10)  # disabled

number_slider_9 = Slider(10, range=0..10)  # disabled
number_slider_10 = Slider(10, range=0..10)  # disabled
number_slider_11 = Slider(10, range=0..10)  # disabled
number_slider_12 = Slider(36, range=0..100)  # disabled

# ----
# Creating Parametric Curves
range_4 = Range(Domain=number_slider_5, Steps=number_slider_8)  # disabled
range_5 = Range(Domain=number_slider_5, Steps=number_slider_8)  # disabled
range_6 = Range(Domain=number_slider_5, Steps=number_slider_8)  # disabled
unit_z_2 = UnitZ(Factor=range_6)  # disabled
construct_point_2 = ConstructPoint(XCoordinate=graft(range_4), YCoordinate=range_5, ZCoordinate=0)  # disabled
move = Move(Geometry=graft(construct_point_2), Motion=unit_z_2)  # -> Geometry, Transform; disabled
list_length = ListLength(List=flatten(move.Geometry))  # disabled
random = Random(Range=list_length, Number=number_slider_6, Seed=number_slider_7)  # disabled
list_item = ListItem(List=flatten(move.Geometry), Index=random, Wrap=True)  # disabled
point_2 = Point(list_item)  # disabled
polyline_2 = PolyLine(Vertices=point_2, Closed=False)  # disabled
nurbs_curve_2 = NurbsCurve(Vertices=point_2, Degree=3, Periodic=False)  # -> Curve, Length, Domain; disabled
# Functions, Limits, and Continuity
# What is Calculus?
# - analysis relationships that change with time
# - calculus measures the way related quantities change
# - differentiation and integration
# Motion of a Falling Rock
# consider
# height (in metres) of rock t seconds
# dorpped from ho is function h(t)
# 
# h(t) = ho - 4.9t^2
# graph y = h(t)
# differentiation allows you to find new function
# h'(t) and call the derivative of h with respect to t
# h'(t) = -9.8t
# this represents the rate of vhange of the height
# of the rock, its velocity in metres/seconds
interpolate_2 = Interpolate(Vertices=point_2, Degree=3, Periodic=False, KnotStyle=1)  # -> Curve, Length, Domain; disabled

# ----
# Creating Parametric Points
range_7 = Range(Domain=number_slider_9, Steps=number_slider_10)  # disabled
range_8 = Range(Domain=number_slider_9, Steps=number_slider_10)  # disabled
range_9 = Range(Domain=number_slider_9, Steps=number_slider_10)  # disabled
unit_z_3 = UnitZ(Factor=range_9)  # disabled
construct_point_3 = ConstructPoint(XCoordinate=graft(range_7), YCoordinate=range_8, ZCoordinate=0)  # disabled
move_2 = Move(Geometry=graft(construct_point_3), Motion=unit_z_3)  # -> Geometry, Transform; disabled
list_length_2 = ListLength(List=flatten(move_2.Geometry))  # disabled
random_2 = Random(Range=list_length_2, Number=number_slider_11, Seed=number_slider_12)  # disabled
list_item_2 = ListItem(List=flatten(move_2.Geometry), Index=random_2, Wrap=True)  # disabled
point_3 = Point(list_item_2)  # disabled

# ----
# Motion of a Falling Rock
ho = Slider(5, range=0.01..5)  # disabled
t = Slider(0.41, range=0.01..1.25)  # disabled
panel = Panel("2")  # disabled
panel_2 = Panel("5")  # disabled
panel_3 = Panel("48")  # disabled
range_10 = Range(Domain=panel, Steps=panel_3)  # disabled
range_11 = Range(Domain=t, Steps=panel_3)  # disabled
range_12 = Range(Domain=panel_2, Steps=panel_3)  # disabled
expression = Expression(t=range_11, ho=ho, Expression="ho -4.9*(t^2)")  # disabled
construct_point_4 = ConstructPoint(XCoordinate=range_10, YCoordinate=0, ZCoordinate=0)  # disabled
construct_point_5 = ConstructPoint(XCoordinate=0, YCoordinate=range_12, ZCoordinate=0)  # disabled
construct_point_6 = ConstructPoint(XCoordinate=range_11, YCoordinate=expression, ZCoordinate=0)  # disabled
interpolate_3 = Interpolate(Vertices=construct_point_6, Degree=3, Periodic=False, KnotStyle=1)  # -> Curve, Length, Domain; disabled
interpolate_4 = Interpolate(Vertices=construct_point_4, Degree=3, Periodic=False, KnotStyle=1)  # -> Curve, Length, Domain; disabled
interpolate_5 = Interpolate(Vertices=construct_point_5, Degree=3, Periodic=False, KnotStyle=1)  # -> Curve, Length, Domain; disabled
curve_middle = CurveMiddle(Curve=interpolate_4.Curve)  # disabled
curve_middle_2 = CurveMiddle(Curve=interpolate_5.Curve)  # disabled
curve_middle_3 = CurveMiddle(Curve=interpolate_3.Curve)  # disabled
end_points = EndPoints(Curve=interpolate_3.Curve)  # -> Start, End; disabled
number_slider_13 = Slider(0.2, range=0..1)  # disabled
panel_4 = Panel("   y = h(t)")  # disabled
panel_5 = Panel("t")  # disabled
panel_6 = Panel("y    ")  # disabled
panel_7 = Panel("ho   ")  # disabled
text_tag_3d = TextTag3D(Location=curve_middle, Text=panel_5, Size=number_slider_13, Justification=3)  # disabled
text_tag_3d_2 = TextTag3D(Location=curve_middle_2, Text=panel_6, Size=number_slider_13, Justification=6)  # disabled
text_tag_3d_3 = TextTag3D(Location=end_points.Start, Text=panel_7, Size=number_slider_13, Justification=6)  # disabled
text_tag_3d_4 = TextTag3D(Location=curve_middle_3, Text=panel_4, Size=number_slider_13, Justification=7)  # disabled
panel_8 = Panel("1")  # disabled
panel_9 = Panel(".1")  # disabled
negative = Negative(Value=panel_9)  # disabled
evaluate_curve = EvaluateCurve(Curve=reparameterize(interpolate_3.Curve), Parameter=panel_8)  # -> Point, Tangent, Angle; disabled
offset_curve = OffsetCurve(Curve=interpolate_4.Curve, Distance=panel_9, Corners=1)  # disabled
offset_curve_2 = OffsetCurve(Curve=interpolate_5.Curve, Distance=negative, Corners=1)  # disabled
circle = Circle(Plane=end_points.End, Radius=panel_9)  # disabled
# Independently invented by Newton and Leibniz
# -Newton's motivation was a desire to
# analyze motion of moving objects
# - using calculus he formulated
# laws of motion and gravitation
# - drew from Kepler's empirical data
# Newton used calculus to study the cosmos
# - many "laws of nature" are expressed
# as equations and thier solutions are at the
# heart of calculus
# - Newton's second law:
# Force = mass * acceleration
# - acceleration, -9.8m/sec^2 is the rate of change
# the derivative of the velocity is the rate of change
# the derivative of the height function
# lines and curves were seen as paths traced by moving points
# - geometric concepts of tangency and area
# - differentiation  finds tangent lines
# - integration finds areas of regions with curved boundaries
# - concepts of real numbers, coordinate systems
# and function
# - concept of limit, an opperation on functions
# - this distinguishes calculus, THE LIMIT
loft = Loft(
    Curves=flatten([interpolate_4.Curve, offset_curve]),
    Options={Adjust=False, Closed=False, LoftEnds=0, LoftSimp=0, LoftType=0, Rebuild=10, Refit=0.01})  # disabled
loft_2 = Loft(
    Curves=flatten([interpolate_5.Curve, offset_curve_2]),
    Options={Adjust=False, Closed=False, LoftEnds=0, LoftSimp=0, LoftType=0, Rebuild=10, Refit=0.01})  # disabled
boundary_surfaces = BoundarySurfaces(Edges=circle)  # disabled
vector_display = VectorDisplay(Anchor=evaluate_curve.Point, Vector=evaluate_curve.Tangent)  # disabled

panel_10 = Panel(".05")  # disabled

number_slider_14 = Slider(3, range=0..10)  # disabled
# Properties of the real number system
# fall into three categories:
# algebraic properties, ordered properties and completeness
# - real numbers may be added, subtracted,
#  multiplied, devided (except by "0")
# to produce more real numbers
# - the usual laws of arithmetic are satisfied
# - Order properties refer to order
# - Completeness states that there can be no holes
# in the real line, every point corresponds
# to a real number
# 
# Three special subsets are:
# the natrual numbers, (1, 2, 3, ...)
# the integers (0, +-1, +-2, ...)
# the rational numbers can be expressed at
# real numbers m/n where m and n are integers,
# and n != 0
# - rational numbers terminate or end in string
# of repeating digits over and over
# _ the rational numbers  do not pocess
# the completeness property
# -  i.e. Sqrt(2)
# - this provides an appropriate setting
# for studying the limits and therefore, CALCULUS
expression_2 = Expression(Expression="Sqrt(2)")  # disabled
# The Real Line and the Cartesian Plane
# - real numbers are expressible in decimal form
# - real numbers can be represented
# geometrically as points on a number line
# (the real line)
# - IR symbol
negative_2 = Negative(Value=number_slider_14)  # disabled
construct_domain = ConstructDomain(DomainStart=negative_2, DomainEnd=number_slider_14)  # disabled
expression_3 = Expression(Expression="2^½")  # disabled
expression_4 = Expression(Expression="π")  # disabled
panel_11 = Panel("Sqrt(2)")  # disabled
panel_12 = Panel("4")  # disabled
panel_13 = Panel("pi")  # disabled
panel_14 = Panel("-3/4")  # disabled
panel_15 = Panel("1")  # disabled
panel_16 = Panel("3")  # disabled
panel_17 = Panel("-2")  # disabled
panel_18 = Panel("-1")  # disabled
panel_19 = Panel("0")  # disabled
panel_20 = Panel("1/3")  # disabled
panel_21 = Panel("2")  # disabled
range_13 = Range(Domain=construct_domain, Steps=10)  # disabled
construct_point_7 = ConstructPoint(XCoordinate=range_13, YCoordinate=0, ZCoordinate=0)  # disabled
merge = Merge(
    Data1=panel_17,
    Data2=panel_18,
    Data3=panel_14,
    Data4=panel_19,
    Data5=panel_20,
    Data6=panel_15,
    Data7=panel_11,
    Data8=panel_21,
    Data9=panel_16,
    Data10=panel_13,
    Data11=panel_12)  # disabled
polyline_3 = PolyLine(Vertices=construct_point_7, Closed=False)  # disabled
boolean_toggle = BooleanToggle(True)  # disabled
panel_22 = Panel("_____")  # disabled
construct_point_8 = ConstructPoint(XCoordinate=merge, YCoordinate=0, ZCoordinate=0)  # disabled
panel_23 = Panel(".5")  # disabled
concatenate = Concatenate(FragmentA=panel_22, FragmentB=merge)  # disabled
end_points_2 = EndPoints(Curve=reparameterize(polyline_3))  # -> Start, End; disabled
pi = Pi(Factor=panel_23)  # disabled
circle_2 = Circle(Plane=construct_point_8, Radius=panel_10)  # disabled
negative_3 = Negative(Value=pi)  # disabled
vector_2pt = Vector2Pt(PointA=end_points_2.Start, PointB=end_points_2.End, Unitize=boolean_toggle)  # -> Vector, Length; disabled
boundary_surfaces_2 = BoundarySurfaces(Edges=circle_2)  # disabled
vector_display_2 = VectorDisplay(Anchor=end_points_2.End, Vector=vector_2pt.Vector)  # disabled
rotate_plane = RotatePlane(Plane=boundary_surfaces_2, Angle=negative_3)  # disabled
panel_24 = Panel(".12")  # disabled
# Intervals:
# - this is a subset of the real line
# - it contains atleast two numbers
# - it contains all real numbers
# between any tow of its elements
# - i.e. x such that x > 6
# - i.e. y such that y != 0 is not an interval
# (it is two intervals)
# - closed interval from a to b, denoted [a, b]
# consitsts of all real numbers x satisfying
# a <= x <=b
# - open interval from a to b, denoted (a, b)
# consists of all real numbers x satisfying
# a < x < b
# - note the use of small dots and open "holes"
# - the whole real line my be regarded as
# an interval: IR = (-infinity, infinity) or (-∞, ∞)
text_tag_3d_5 = TextTag3D(Location=rotate_plane, Text=concatenate, Size=panel_24, Justification=7)  # disabled

# ----
# Intervals
# the Real Line
number_slider_15 = Slider(5, range=0..10)  # disabled
negative_4 = Negative(Value=number_slider_15)  # disabled
construct_domain_2 = ConstructDomain(DomainStart=negative_4, DomainEnd=number_slider_15)  # disabled
panel_25 = Panel("48")  # disabled
range_14 = Range(Domain=construct_domain_2, Steps=panel_25)  # disabled
construct_point_9 = ConstructPoint(XCoordinate=range_14, YCoordinate=0, ZCoordinate=0)  # disabled
polyline_4 = PolyLine(Vertices=construct_point_9, Closed=False)  # disabled
boolean_toggle_2 = BooleanToggle(False)  # disabled
end_points_3 = EndPoints(Curve=polyline_4)  # -> Start, End; disabled
construct_point_10 = ConstructPoint(XCoordinate=0, YCoordinate=0, ZCoordinate=0)  # disabled
vector_2pt_2 = Vector2Pt(PointA=construct_point_10, PointB=end_points_3.End, Unitize=boolean_toggle_2)  # -> Vector, Length; disabled
negative_5 = Negative(Value=vector_2pt_2.Vector)  # disabled
vector_display_3 = VectorDisplay(Anchor=construct_point_10, Vector=negative_5)  # disabled
vector_display_4 = VectorDisplay(Anchor=construct_point_10, Vector=vector_2pt_2.Vector)  # disabled

# ----
# a <= x < b
panel_26 = Panel("[a,b)")  # disabled

# ----
# closed and open intervals
panel_27 = Panel("(a,b]")  # disabled
panel_28 = Panel("[a,b]")  # disabled
panel_29 = Panel("(a,b)")  # disabled
characters = Characters(Text=panel_26)  # -> Result, Unicode; disabled
list_item_3 = ListItem(List=characters.Result, Index=0, Wrap=True)  # -> Item1, Item; disabled
number_slider_16 = Slider(-3.12, range=-5..5)  # disabled
number_slider_17 = Slider(3.28, range=-5..5)  # disabled
panel_30 = Panel(list_item_3.Item)  # disabled
panel_31 = Panel(list_item_3.Item1)  # disabled
ghpython_script = GhPythonScript(closed_open=panel_30, a=number_slider_16, b=number_slider_17, open_closed=panel_31)  # -> out, smallest_pt, smallest_circle, smallest_surface, largest_pt, largest_circle, largest_surface; disabled
# ---------- ghpython_script: Python ----------
__author__ = "Sculpture"
__version__ = "2021.07.11"

import rhinoscriptsyntax as rs

#a must be less than and not equal to b to be an interval
if (a < b):
    if (closed_open == "["):
        smallest_pt = rs.CreatePoint(a, 0, 0)
        smallest_circle = rs.AddCircle(smallest_pt, 0.1)
        smallest_surface = rs.AddPlanarSrf(smallest_circle)
    elif (closed_open == "("):
        smallest_pt = rs.CreatePoint(a, 0, 0)
        smallest_circle = rs.AddCircle(smallest_pt, 0.1)
        
    if (open_closed == "]"):
        largest_pt = rs.CreatePoint(b, 0, 0)
        largest_circle = rs.AddCircle(largest_pt, 0.1)
        largest_surface = rs.AddPlanarSrf(largest_circle)
    elif (open_closed == ")"):
        largest_pt = rs.CreatePoint(b, 0, 0)
        largest_circle = rs.AddCircle(largest_pt, 0.1)
# ---------- end ghpython_script ----------
point_4 = Point(ghpython_script.largest_pt)  # disabled
point_5 = Point(ghpython_script.smallest_pt)  # disabled
circle_3 = Circle(ghpython_script.smallest_circle)  # disabled
surface = Surface(ghpython_script.smallest_surface)  # disabled
circle_4 = Circle(ghpython_script.largest_circle)  # disabled
surface_2 = Surface(ghpython_script.largest_surface)  # disabled
deconstruct = Deconstruct(Point=point_5)  # -> XComponent, YComponent, ZComponent; disabled
deconstruct_2 = Deconstruct(Point=point_4)  # -> XComponent, YComponent, ZComponent; disabled
panel_32 = Panel("0")  # disabled
panel_33 = Panel("5")  # disabled
negative_6 = Negative(Value=panel_33)  # disabled
merge_2 = Merge(Data1=deconstruct.XComponent, Data2=deconstruct_2.XComponent, Data3=panel_32, Data4=negative_6, Data5=panel_33)  # disabled
construct_point_11 = ConstructPoint(XCoordinate=merge_2, YCoordinate=0, ZCoordinate=0)  # disabled
panel_34 = Panel(".5")  # disabled
panel_35 = Panel("_____")  # disabled
negative_7 = Negative(Value=panel_34)  # disabled
concatenate_2 = Concatenate(FragmentA=panel_35, FragmentB=construct_point_11)  # disabled
pi_2 = Pi(Factor=negative_7)  # disabled
rotate_plane_2 = RotatePlane(Plane=construct_point_11, Angle=pi_2)  # disabled
panel_36 = Panel(".12")  # disabled
text_tag_3d_6 = TextTag3D(Location=rotate_plane_2, Text=concatenate_2, Size=panel_36, Justification=7)  # disabled

vector_display_ex = VectorDisplayEx(Colour=RGB(0, 0, 0), Width=2)  # disabled

# ----
# x-axis and y-axis
number_slider_18 = Slider(0, range=-5..5)  # disabled
number_slider_19 = Slider(3.28, range=-5..5)  # disabled
number_slider_20 = Slider(10, range=0..10)  # disabled
xy_plane = XYPlane(Origin=Point(0, 0, 0))  # disabled
construct_domain_3 = ConstructDomain(DomainStart=number_slider_18, DomainEnd=number_slider_19)  # disabled
range_15 = Range(Domain=construct_domain_3, Steps=number_slider_20)  # disabled
construct_point_12 = ConstructPoint(XCoordinate=range_15, YCoordinate=0, ZCoordinate=0)  # disabled
construct_point_13 = ConstructPoint(XCoordinate=0, YCoordinate=range_15, ZCoordinate=0)  # disabled
list_item_4 = ListItem(List=construct_point_12, Index=0, Wrap=True)  # -> Item1, Item; disabled
list_item_5 = ListItem(List=construct_point_13, Index=0, Wrap=True)  # -> Item1, Item; disabled
construct_point_14 = ConstructPoint(XCoordinate=0, YCoordinate=0, ZCoordinate=0)  # disabled
vector_2pt_3 = Vector2Pt(PointA=list_item_4.Item, PointB=list_item_4.Item1, Unitize=False)  # -> Vector, Length; disabled
vector_2pt_4 = Vector2Pt(PointA=list_item_5.Item, PointB=list_item_5.Item1, Unitize=False)  # -> Vector, Length; disabled
negative_8 = Negative(Value=vector_2pt_3.Vector)  # disabled
negative_9 = Negative(Value=vector_2pt_4.Vector)  # disabled
vector_display_5 = VectorDisplay(Anchor=construct_point_14, Vector=vector_2pt_3.Vector)  # disabled
vector_display_6 = VectorDisplay(Anchor=construct_point_14, Vector=negative_8)  # disabled
vector_display_7 = VectorDisplay(Anchor=construct_point_14, Vector=vector_2pt_4.Vector)  # disabled
vector_display_8 = VectorDisplay(Anchor=construct_point_14, Vector=negative_9)  # disabled

# ----
# change
x₂ = Slider(1.11, range=-5..5)  # disabled
x₁ = Slider(0.6, range=-5..5)  # disabled
y₁ = Slider(1.21, range=-5..5)  # disabled
y₂ = Slider(0.46, range=-5..5)  # disabled

# ----
# x-axis and y-axis
number_slider_21 = Slider(0, range=-5..5)  # disabled
number_slider_22 = Slider(3.28, range=-5..5)  # disabled
number_slider_23 = Slider(10, range=0..10)  # disabled
xy_plane_2 = XYPlane(Origin=Point(0, 0, 0))  # disabled
construct_domain_4 = ConstructDomain(DomainStart=number_slider_21, DomainEnd=number_slider_22)  # disabled
range_16 = Range(Domain=construct_domain_4, Steps=number_slider_23)  # disabled
construct_point_15 = ConstructPoint(XCoordinate=range_16, YCoordinate=0, ZCoordinate=0)  # disabled
construct_point_16 = ConstructPoint(XCoordinate=0, YCoordinate=range_16, ZCoordinate=0)  # disabled
list_item_6 = ListItem(List=construct_point_15, Index=0, Wrap=True)  # -> Item1, Item; disabled
list_item_7 = ListItem(List=construct_point_16, Index=0, Wrap=True)  # -> Item1, Item; disabled
construct_point_17 = ConstructPoint(XCoordinate=0, YCoordinate=0, ZCoordinate=0)  # disabled
vector_2pt_5 = Vector2Pt(PointA=list_item_6.Item, PointB=list_item_6.Item1, Unitize=False)  # -> Vector, Length; disabled
vector_2pt_6 = Vector2Pt(PointA=list_item_7.Item, PointB=list_item_7.Item1, Unitize=False)  # -> Vector, Length; disabled
negative_10 = Negative(Value=vector_2pt_5.Vector)  # disabled
negative_11 = Negative(Value=vector_2pt_6.Vector)  # disabled
vector_display_9 = VectorDisplay(Anchor=construct_point_17, Vector=vector_2pt_5.Vector)  # disabled
vector_display_10 = VectorDisplay(Anchor=construct_point_17, Vector=negative_10)  # disabled
vector_display_11 = VectorDisplay(Anchor=construct_point_17, Vector=vector_2pt_6.Vector)  # disabled
vector_display_12 = VectorDisplay(Anchor=construct_point_17, Vector=negative_11)  # disabled

construct_point_18 = ConstructPoint(XCoordinate=0, YCoordinate=0, ZCoordinate=0)  # disabled
panel_37 = Panel(".05")  # disabled

# ----
# Sqrt((x₂ - x₁)^2 + (y₂ - y₁)^2)
construct_point_19 = ConstructPoint(XCoordinate=x₁, YCoordinate=x₂, ZCoordinate=0)  # disabled
construct_point_20 = ConstructPoint(XCoordinate=y₁, YCoordinate=y₂, ZCoordinate=0)  # disabled
deconstruct_3 = Deconstruct(Point=construct_point_19)  # -> XComponent, YComponent, ZComponent; disabled
deconstruct_4 = Deconstruct(Point=construct_point_20)  # -> XComponent, YComponent, ZComponent; disabled
construct_point_21 = ConstructPoint(XCoordinate=deconstruct_3.XComponent, YCoordinate=0, ZCoordinate=0)  # disabled
construct_point_22 = ConstructPoint(XCoordinate=0, YCoordinate=deconstruct_3.YComponent, ZCoordinate=0)  # disabled
expression_5 = Expression(x1=x₁, x2=x₂, y1=y₁, y2=y₂, Expression="Sqrt((x2 - x1)^2 + (y2 - y1)^2)")  # disabled
construct_point_23 = ConstructPoint(XCoordinate=deconstruct_4.XComponent, YCoordinate=0, ZCoordinate=0)  # disabled
construct_point_24 = ConstructPoint(XCoordinate=0, YCoordinate=deconstruct_4.YComponent, ZCoordinate=0)  # disabled
line = Line(StartPoint=construct_point_18, EndPoint=construct_point_19)  # disabled
line_2 = Line(StartPoint=construct_point_18, EndPoint=construct_point_21)  # disabled
line_3 = Line(StartPoint=construct_point_18, EndPoint=construct_point_22)  # disabled
line_4 = Line(StartPoint=construct_point_19, EndPoint=construct_point_20)  # disabled
line_5 = Line(StartPoint=construct_point_18, EndPoint=construct_point_23)  # disabled
line_6 = Line(StartPoint=construct_point_18, EndPoint=construct_point_24)  # disabled
expression_6 = Expression(x=x₁, y=x₂, Expression="Sqrt(x^2 + y^2)")  # disabled
line_7 = Line(StartPoint=construct_point_21, EndPoint=construct_point_19)  # disabled
line_8 = Line(StartPoint=construct_point_22, EndPoint=construct_point_19)  # disabled
line_9 = Line(StartPoint=construct_point_23, EndPoint=construct_point_20)  # disabled
line_10 = Line(StartPoint=construct_point_24, EndPoint=construct_point_20)  # disabled
distance = Distance(PointA=construct_point_19, PointB=construct_point_18)  # disabled
panel_38 = Panel("""  
      D = Sqrt((x2 - x1)^2 + (y2 - y1)^2)""")  # disabled
curve_middle_4 = CurveMiddle(Curve=line)  # disabled
distance_2 = Distance(PointA=construct_point_20, PointB=construct_point_18)  # disabled
curve_middle_5 = CurveMiddle(Curve=line_4)  # disabled
panel_39 = Panel("""  
      D = Sqrt(x^2 + y^2)""")  # disabled
panel_40 = Panel(expression_6)  # disabled
panel_41 = Panel(distance)  # disabled
panel_42 = Panel(expression_5)  # disabled
panel_43 = Panel(distance_2)  # disabled
panel_44 = Panel("    P₁ = (x₁, y₁)")  # disabled
panel_45 = Panel("    P₂ = (x₂, y₂)")  # disabled
panel_46 = Panel("____")  # disabled
concatenate_3 = Concatenate(FragmentA=panel_46, FragmentB=panel_40)  # disabled
panel_47 = Panel("x₁")  # disabled
panel_48 = Panel("____")  # disabled
concatenate_4 = Concatenate(FragmentA=panel_48, FragmentB=panel_42)  # disabled
panel_49 = Panel("x₂")  # disabled
panel_50 = Panel("y₂    ")  # disabled
panel_51 = Panel(".12")  # disabled
panel_52 = Panel(".12")  # disabled
panel_53 = Panel("O    ")  # disabled
panel_54 = Panel("O    ")  # disabled
panel_55 = Panel("y₁    ")  # disabled

# ----
# Sqrt(x^2 + y^2)
x = Slider(1, range=-5..5)  # disabled
y = Slider(1.26, range=-5..5)  # disabled
construct_point_25 = ConstructPoint(XCoordinate=x, YCoordinate=y, ZCoordinate=0)  # disabled
construct_point_26 = ConstructPoint(XCoordinate=0, YCoordinate=0, ZCoordinate=0)  # disabled
deconstruct_5 = Deconstruct(Point=construct_point_25)  # -> XComponent, YComponent, ZComponent; disabled
construct_point_27 = ConstructPoint(XCoordinate=0, YCoordinate=deconstruct_5.YComponent, ZCoordinate=0)  # disabled
construct_point_28 = ConstructPoint(XCoordinate=deconstruct_5.XComponent, YCoordinate=0, ZCoordinate=0)  # disabled
line_11 = Line(StartPoint=construct_point_26, EndPoint=construct_point_25)  # disabled
line_12 = Line(StartPoint=construct_point_26, EndPoint=construct_point_28)  # disabled
line_13 = Line(StartPoint=construct_point_26, EndPoint=construct_point_27)  # disabled
expression_7 = Expression(x=x, y=y, Expression="Sqrt(x^2 + y^2)")  # disabled
distance_3 = Distance(PointA=construct_point_25, PointB=construct_point_26)  # disabled
curve_middle_6 = CurveMiddle(Curve=line_11)  # disabled
panel_56 = Panel(expression_7)  # disabled
panel_57 = Panel(distance_3)  # disabled
panel_58 = Panel("""  
      D = Sqrt(x^2 + y^2)""")  # disabled
panel_59 = Panel("____")  # disabled
panel_60 = Panel("y    ")  # disabled
panel_61 = Panel("x")  # disabled
panel_62 = Panel(".12")  # disabled
panel_63 = Panel("O    ")  # disabled
concatenate_5 = Concatenate(FragmentA=panel_59, FragmentB=panel_56)  # disabled
panel_64 = Panel("    P = (x,y)")  # disabled
text_tag_3d_7 = TextTag3D(Location=curve_middle_6, Text=concatenate_5, Size=panel_62, Justification=7)  # disabled
text_tag_3d_8 = TextTag3D(Location=curve_middle_6, Text=panel_58, Size=panel_62, Justification=7)  # disabled
text_tag_3d_9 = TextTag3D(Location=construct_point_27, Text=panel_60, Size=panel_62, Justification=9)  # disabled
text_tag_3d_10 = TextTag3D(Location=construct_point_28, Text=panel_61, Size=panel_62, Justification=7)  # disabled
text_tag_3d_11 = TextTag3D(Location=construct_point_25, Text=panel_64, Size=panel_62, Justification=7)  # disabled
text_tag_3d_12 = TextTag3D(Location=construct_point_26, Text=panel_63, Size=panel_62, Justification=3)  # disabled

# ----
# labels
text_tag_3d_13 = TextTag3D(Location=curve_middle_4, Text=concatenate_3, Size=panel_51, Justification=7)  # disabled
text_tag_3d_14 = TextTag3D(Location=curve_middle_4, Text=panel_39, Size=panel_37, Justification=7)  # disabled
text_tag_3d_15 = TextTag3D(Location=construct_point_22, Text=panel_55, Size=panel_51, Justification=9)  # disabled
text_tag_3d_16 = TextTag3D(Location=construct_point_21, Text=panel_47, Size=panel_51, Justification=7)  # disabled
text_tag_3d_17 = TextTag3D(Location=construct_point_19, Text=panel_44, Size=panel_51, Justification=7)  # disabled
text_tag_3d_18 = TextTag3D(Location=construct_point_18, Text=panel_53, Size=panel_51, Justification=3)  # disabled
text_tag_3d_19 = TextTag3D(Location=curve_middle_5, Text=concatenate_4, Size=panel_52, Justification=7)  # disabled
text_tag_3d_20 = TextTag3D(Location=curve_middle_5, Text=panel_38, Size=panel_37, Justification=7)  # disabled
text_tag_3d_21 = TextTag3D(Location=construct_point_24, Text=panel_50, Size=panel_52, Justification=9)  # disabled
text_tag_3d_22 = TextTag3D(Location=construct_point_23, Text=panel_49, Size=panel_52, Justification=7)  # disabled
text_tag_3d_23 = TextTag3D(Location=construct_point_20, Text=panel_45, Size=panel_52, Justification=7)  # disabled
text_tag_3d_24 = TextTag3D(Location=construct_point_18, Text=panel_54, Size=panel_52, Justification=3)  # disabled

# ----
# x-axis and y-axis
number_slider_24 = Slider(0, range=-5..5)
xy_plane_3 = XYPlane(Origin=Point(0, 0, 0))
construct_domain_5 = ConstructDomain(DomainStart=number_slider_24, DomainEnd=Slider(3.28, range=-5..5))
range_17 = Range(Domain=construct_domain_5, Steps=Slider(10, range=0..10))
construct_point_29 = ConstructPoint(XCoordinate=range_17, YCoordinate=0, ZCoordinate=0)
construct_point_30 = ConstructPoint(XCoordinate=0, YCoordinate=range_17, ZCoordinate=0)
list_item_8 = ListItem(List=construct_point_29, Index=0, Wrap=True)  # -> Item1, Item
list_item_9 = ListItem(List=construct_point_30, Index=0, Wrap=True)  # -> Item1, Item
construct_point_31 = ConstructPoint(XCoordinate=0, YCoordinate=0, ZCoordinate=0)
vector_2pt_7 = Vector2Pt(PointA=list_item_8.Item, PointB=list_item_8.Item1, Unitize=False)  # -> Vector, Length
vector_2pt_8 = Vector2Pt(PointA=list_item_9.Item, PointB=list_item_9.Item1, Unitize=False)  # -> Vector, Length
negative_12 = Negative(Value=vector_2pt_7.Vector)
negative_13 = Negative(Value=vector_2pt_8.Vector)
vector_display_13 = VectorDisplay(Anchor=construct_point_31, Vector=vector_2pt_7.Vector)
vector_display_14 = VectorDisplay(Anchor=construct_point_31, Vector=negative_12)
vector_display_15 = VectorDisplay(Anchor=construct_point_31, Vector=vector_2pt_8.Vector)
vector_display_16 = VectorDisplay(Anchor=construct_point_31, Vector=negative_13)

# ----
# the graph of y = x
x_2 = Slider(2, range=0..5.01)
negative_14 = Negative(Value=x_2)
panel_65 = Panel(x_2)
construct_domain_6 = ConstructDomain(DomainStart=negative_14, DomainEnd=x_2)
panel_67 = Panel(negative_14)
range_18 = Range(Domain=construct_domain_6, Steps="1")  # -> graft(Range)
panel_68 = Panel(construct_domain_6)
construct_point_32 = ConstructPoint(XCoordinate=range_18, YCoordinate=range_18, ZCoordinate=0)
construct_point_33 = ConstructPoint(XCoordinate=0, YCoordinate=0, ZCoordinate=0)
panel_69 = Panel(range_18)
deconstruct_6 = Deconstruct(Point=construct_point_32)  # -> XComponent, YComponent, ZComponent
construct_point_34 = ConstructPoint(XCoordinate=0, YCoordinate=deconstruct_6.YComponent, ZCoordinate=0)
construct_point_35 = ConstructPoint(XCoordinate=deconstruct_6.XComponent, YCoordinate=0, ZCoordinate=0)
line_14 = Line(StartPoint=construct_point_33, EndPoint=construct_point_32)
line_15 = Line(StartPoint=construct_point_33, EndPoint=construct_point_35)
line_16 = Line(StartPoint=construct_point_33, EndPoint=construct_point_34)
expression_8 = Expression(x=range_18, y=range_18, Expression="Sqrt(x^2 + y^2)")  # -> flatten(Result)
distance_4 = Distance(PointA=construct_point_32, PointB=construct_point_33)
curve_middle_7 = CurveMiddle(Curve=line_14)
evaluate_curve_2 = EvaluateCurve(Curve=reparameterize(line_14), Parameter="1")  # -> Point, Tangent, Angle
panel_70 = Panel(distance_4)
panel_71 = Panel(expression_8)
panel_72 = Panel("""0
1""")
list_item_10 = ListItem(List=evaluate_curve_2.Point, Index=panel_72, Wrap=True)  # -> Item1, Item
vector_2pt_9 = Vector2Pt(PointA=construct_point_33, PointB=construct_point_32, Unitize=Toggle(True))  # -> Vector, Length
panel_73 = Panel("""  
      D = Sqrt(x^2 + y^2)""")
concatenate_6 = Concatenate(FragmentA="____", FragmentB=panel_71)

# ----
# the graph of y = x^2
number_slider_25 = Slider(1.77, range=0..10)
negative_15 = Negative(Value=number_slider_25)
number_slider_26 = Slider(100, range=0..100)
panel_74 = Panel(number_slider_25)
construct_domain_7 = ConstructDomain(DomainStart=negative_15, DomainEnd=number_slider_25)
panel_76 = Panel(negative_15)
range_19 = Range(Domain=construct_domain_7, Steps=Slider(6, range=0..10))
panel_77 = Panel(construct_domain_7)
expression_9 = Expression(x=range_19, y=range_19, Expression="x^2")  # -> flatten(Result)
construct_point_36 = ConstructPoint(XCoordinate=0, YCoordinate=0, ZCoordinate=0)
panel_78 = Panel(range_19)
construct_point_37 = ConstructPoint(XCoordinate=range_19, YCoordinate=expression_9, ZCoordinate=0)
deconstruct_7 = Deconstruct(Point=construct_point_37)  # -> XComponent, YComponent, ZComponent
panel_79 = Panel(expression_9)
construct_point_38 = ConstructPoint(XCoordinate=0, YCoordinate=deconstruct_7.YComponent, ZCoordinate=0)
construct_point_39 = ConstructPoint(XCoordinate=deconstruct_7.XComponent, YCoordinate=0, ZCoordinate=0)
interpolate_6 = Interpolate(Vertices=construct_point_37, Degree=3, Periodic=False, KnotStyle=1)  # -> Curve, Length, Domain
line_17 = Line(StartPoint=construct_point_36, EndPoint=construct_point_39)
line_18 = Line(StartPoint=construct_point_36, EndPoint=construct_point_38)
point_on_curve = PointOnCurve(interpolate_6.Curve, parameter=0.25)
curve_middle_8 = CurveMiddle(Curve=reparameterize(interpolate_6.Curve))
point_on_curve_2 = PointOnCurve(interpolate_6.Curve, parameter=0.75)
panel_80 = Panel(interpolate_6.Length)
evaluate_curve_3 = EvaluateCurve(Curve=reparameterize(interpolate_6.Curve), Parameter="0")  # -> Point, Tangent, Angle
evaluate_curve_4 = EvaluateCurve(Curve=reparameterize(interpolate_6.Curve), Parameter="1")  # -> Point, Tangent, Angle
panel_81 = Panel("""  
      Length of y = (x^2) curve""")
negative_16 = Negative(Value=evaluate_curve_3.Tangent)
concatenate_7 = Concatenate(FragmentA="____", FragmentB=panel_80)
list_item_11 = ListItem(List=construct_point_39, Index=0, Wrap=True)  # -> Item1, Item
list_item_12 = ListItem(List=construct_point_38, Index=0, Wrap=True)

text_tag_3d_25 = TextTag3D(Location=curve_middle_7, Text=concatenate_6, Size=".12", Justification=7)
text_tag_3d_26 = TextTag3D(Location=curve_middle_7, Text=panel_73, Size=".12", Justification=7)
text_tag_3d_27 = TextTag3D(Location=construct_point_34, Text="y    ", Size=".12", Justification=9)
text_tag_3d_28 = TextTag3D(Location=construct_point_35, Text="x", Size=".12", Justification=7)
text_tag_3d_29 = TextTag3D(Location=construct_point_32, Text="    P = (x,y)", Size=".12", Justification=7)
text_tag_3d_30 = TextTag3D(Location=construct_point_33, Text="O    ", Size=".12", Justification=3)
vector_display_17 = VectorDisplay(Anchor=[list_item_10.Item1, list_item_10.Item], Vector=vector_2pt_9.Vector)
line_19 = Line(line_14)

polyline_5 = PolyLine(Vertices=construct_point_37, Closed=False)
text_tag_3d_31 = TextTag3D(Location=curve_middle_8, Text="Calculus Magic", Size=".12", Justification=1)
text_tag_3d_32 = TextTag3D(Location=point_on_curve_2, Text=[panel_81, concatenate_7], Size=".12", Justification=7)
text_tag_3d_33 = TextTag3D(Location=list_item_12, Text="y    ", Size=".12", Justification=9)
text_tag_3d_34 = TextTag3D(Location=list_item_11.Item1, Text="x", Size=".12", Justification=7)
text_tag_3d_35 = TextTag3D(Location=point_on_curve, Text="    P = (x,y)", Size=".12", Justification=7)
text_tag_3d_36 = TextTag3D(Location=construct_point_36, Text="O    ", Size=".12", Justification=3)
vector_display_18 = VectorDisplay(Anchor=evaluate_curve_3.Point, Vector=negative_16)
vector_display_19 = VectorDisplay(Anchor=evaluate_curve_4.Point, Vector=evaluate_curve_4.Tangent)
curve = Curve(interpolate_6.Curve)

# ----
# Motion of a Falling Rock
ho_2 = Slider(5, range=0.01..5)  # disabled
# The Absolute Value
# |x| = {x, if x >= 0 or x, if x < 0}
# - geometrically, |x| represents the (nonnegative)
# distance form x to 0 on the real number line
# - more generally
# |x - y| = {x - y, if x >= y or x - y, if x < y}
# - geometrically, |x - y| represents the (nonnegative)
# distance between points x and y on the real number line
# since this distance is the same as that from
# the point x - y to 0
# 
# the Absolute Value has the following properties:
# - For any real numbers a and b,
# |ab| = |a||b|
# |a +- b| <= |a| + |b| (The Triangle Inequality)
t_2 = Slider(1.08, range=0.01..1.25)  # disabled
panel_82 = Panel("2")  # disabled
panel_83 = Panel("5")  # disabled
number_slider_27 = Slider(0.2, range=0..1)  # disabled
panel_84 = Panel("   y = h(t)")  # disabled
panel_85 = Panel("t")  # disabled
panel_86 = Panel("y    ")  # disabled
panel_87 = Panel("ho   ")  # disabled
panel_88 = Panel("1")  # disabled
panel_89 = Panel(".1")  # disabled
negative_17 = Negative(Value=panel_89)  # disabled

panel_90 = Panel("100")  # disabled
panel_91 = Panel("1")  # disabled

range_20 = Range(Domain=panel_83, Steps=panel_90)  # disabled
range_21 = Range(Domain=panel_82, Steps=panel_90)  # disabled
range_22 = Range(Domain=t_2, Steps=panel_90)  # disabled
expression_10 = Expression(t=range_22, ho=ho_2, Expression="ho -4.9*(t^2)")  # disabled
construct_point_40 = ConstructPoint(XCoordinate=range_21, YCoordinate=0, ZCoordinate=0)  # disabled
construct_point_41 = ConstructPoint(XCoordinate=0, YCoordinate=range_20, ZCoordinate=0)  # disabled
interpolate_7 = Interpolate(Vertices=construct_point_40, Degree=3, Periodic=False, KnotStyle=1)  # -> Curve, Length, Domain; disabled
interpolate_8 = Interpolate(Vertices=construct_point_41, Degree=3, Periodic=False, KnotStyle=1)  # -> Curve, Length, Domain; disabled
curve_middle_9 = CurveMiddle(Curve=interpolate_7.Curve)  # disabled
curve_middle_10 = CurveMiddle(Curve=interpolate_8.Curve)  # disabled
text_tag_3d_37 = TextTag3D(Location=curve_middle_9, Text=panel_85, Size=number_slider_27, Justification=3)  # disabled
text_tag_3d_38 = TextTag3D(Location=curve_middle_10, Text=panel_86, Size=number_slider_27, Justification=6)  # disabled
offset_curve_3 = OffsetCurve(Curve=interpolate_7.Curve, Distance=panel_89, Corners=1)  # disabled
offset_curve_4 = OffsetCurve(Curve=interpolate_8.Curve, Distance=negative_17, Corners=1)  # disabled
# Coordinates and Graphs
# - the positions of all points on a plane can be measured
# with respect to a pair of perpendicular real lines
# in the plane intersecting at 0-point of each
# - x-axis conventionally is horizontal
# - y-axis conventionally is verticle
# - O denotes the origin
# - P is any point specified by an ordered
# pair (x,y) of real numbers
# - these are called the coordinates of P;
# x measureds the displacement  of P from O
# measured parallel to the x-axis
# y measured the displacement of P from O
# measured parallel to the y-axis
# - the Pythagorean Theorem proves that
# |OP| = Sqrt(x^2 + y^2)
# More generally:
# - the distance between points P₁ = (x₁,  y₁) and
# distance between P₁ = (x₁, y₁) and P₂ = (x₂, y₂) is
# Sqrt((x₂ - x₁)^2 + (y₂ - y₁)^2)
loft_3 = Loft(
    Curves=flatten([interpolate_7.Curve, offset_curve_3]),
    Options={Adjust=False, Closed=False, LoftEnds=0, LoftSimp=0, LoftType=0, Rebuild=10, Refit=0.01})  # disabled
loft_4 = Loft(
    Curves=flatten([interpolate_8.Curve, offset_curve_4]),
    Options={Adjust=False, Closed=False, LoftEnds=0, LoftSimp=0, LoftType=0, Rebuild=10, Refit=0.01})  # disabled

absolute = Absolute(Value=expression_10)  # disabled

construct_point_42 = ConstructPoint(XCoordinate=range_22, YCoordinate=absolute, ZCoordinate=0)  # disabled
interpolate_9 = Interpolate(Vertices=construct_point_42, Degree=panel_91, Periodic=False, KnotStyle=1)  # -> Curve, Length, Domain; disabled
curve_middle_11 = CurveMiddle(Curve=interpolate_9.Curve)  # disabled
end_points_4 = EndPoints(Curve=interpolate_9.Curve)  # -> Start, End; disabled
text_tag_3d_39 = TextTag3D(Location=end_points_4.Start, Text=panel_87, Size=number_slider_27, Justification=6)  # disabled
text_tag_3d_40 = TextTag3D(Location=curve_middle_11, Text=panel_84, Size=number_slider_27, Justification=7)  # disabled
evaluate_curve_5 = EvaluateCurve(Curve=reparameterize(interpolate_9.Curve), Parameter=panel_88)  # -> Point, Tangent, Angle; disabled
circle_5 = Circle(Plane=end_points_4.End, Radius=panel_89)  # disabled
boundary_surfaces_3 = BoundarySurfaces(Edges=circle_5)  # disabled
vector_display_20 = VectorDisplay(Anchor=evaluate_curve_5.Point, Vector=evaluate_curve_5.Tangent)  # disabled
