# Grasshopper definition 017_MASTER_SCRITP_the_real_line_the_cartesian_plane_WS_001.gh (Grasshopper 1.0.7)
# plug-ins: HAL for Grasshopper, Bifocals

# Introduction
# Single Variable Calculus
# inspired by:
# Robert A. Adams, 2nd edition
# .gh scripts created at:
# Wickerson Studios
# 
# Principle Features:
# - emphasis on geometry
# - trigonometric and exponential functions
# - their inverse, the logarithms
# - natural logarithm, area under a curve
# - Fundamental Theorem
# - roots of equations, definite integrals
# - numerical integration
# - Romberg method, ptifalls of numerical method
# - proof by mathematical induction
# - closed, finite, intervals
# - properties of the Reimann integral
# - the Mean-Value Theorem
# - definition of the  definite integral
# - plane curves, conic sections
# - development of polar coordinates,
# plane parametric curves,
# and plane vector functions
# - integration
# - Taylor's formula and Taylor series
# - partial differentiation
# - multi variable calculus
# Looking forward, Calculus of Several Varialbles
sessionsettings = SessionSettings()

number_slider = Slider(1.198, range=0..10)  # disabled
number_slider_2 = Slider(34, range=0..100)  # disabled
number_slider_3 = Slider(10, range=0..10)  # disabled

# ----
# Creating Basic Trigonometric Curves
number_slider_4 = Slider(1.371, range=0..10)  # disabled
range = Range(Domain=number_slider_3, Steps=number_slider_2)  # disabled
range_2 = Range(Domain=number_slider_3, Steps=number_slider_2)  # disabled
range_3 = Range(Domain=number_slider_3, Steps=number_slider_2)  # disabled
cosine = Cosine(Value=range_3)  # disabled
sine = Sine(Value=range_2)  # disabled
unit_z = UnitZ(Factor=range)  # disabled
multiplication = Multiplication(A=cosine, B=number_slider_4)  # disabled
multiplication_2 = Multiplication(A=sine, B=number_slider)  # disabled
construct_point = ConstructPoint(XCoordinate=multiplication_2, YCoordinate=multiplication, ZCoordinate=unit_z)  # disabled
point = Point(construct_point)  # disabled
interpolate = Interpolate(Vertices=point, Degree=3, Periodic=False, KnotStyle=1)  # -> Curve, Length, Domain; disabled
polyline = PolyLine(Vertices=point, Closed=False)  # disabled
nurbs_curve = NurbsCurve(Vertices=point, Degree=3, Periodic=False)  # -> Curve, Length, Domain; disabled

number_slider_5 = Slider(10, range=0..10)  # disabled
number_slider_6 = Slider(10, range=0..10)  # disabled
number_slider_7 = Slider(36, range=0..100)  # disabled
number_slider_8 = Slider(10, range=0..10)  # disabled

number_slider_9 = Slider(10, range=0..10)  # disabled
number_slider_10 = Slider(10, range=0..10)  # disabled
number_slider_11 = Slider(10, range=0..10)  # disabled
number_slider_12 = Slider(36, range=0..100)  # disabled

# ----
# Creating Parametric Curves
range_4 = Range(Domain=number_slider_5, Steps=number_slider_8)  # disabled
range_5 = Range(Domain=number_slider_5, Steps=number_slider_8)  # disabled
range_6 = Range(Domain=number_slider_5, Steps=number_slider_8)  # disabled
unit_z_2 = UnitZ(Factor=range_6)  # disabled
construct_point_2 = ConstructPoint(XCoordinate=graft(range_4), YCoordinate=range_5, ZCoordinate=0)  # disabled
move = Move(Geometry=graft(construct_point_2), Motion=unit_z_2)  # -> Geometry, Transform; disabled
list_length = ListLength(List=flatten(move.Geometry))  # disabled
random = Random(Range=list_length, Number=number_slider_6, Seed=number_slider_7)  # disabled
list_item = ListItem(List=flatten(move.Geometry), Index=random, Wrap=True)  # disabled
point_2 = Point(list_item)  # disabled
polyline_2 = PolyLine(Vertices=point_2, Closed=False)  # disabled
nurbs_curve_2 = NurbsCurve(Vertices=point_2, Degree=3, Periodic=False)  # -> Curve, Length, Domain; disabled
# Functions, Limits, and Continuity
# What is Calculus?
# - analysis relationships that change with time
# - calculus measures the way related quantities change
# - differentiation and integration
# Motion of a Falling Rock
# consider
# height (in metres) of rock t seconds
# dorpped from ho is function h(t)
# 
# h(t) = ho - 4.9t^2
# graph y = h(t)
# differentiation allows you to find new function
# h'(t) and call the derivative of h with respect to t
# h'(t) = -9.8t
# this represents the rate of vhange of the height
# of the rock, its velocity in metres/seconds
interpolate_2 = Interpolate(Vertices=point_2, Degree=3, Periodic=False, KnotStyle=1)  # -> Curve, Length, Domain; disabled

# ----
# Creating Parametric Points
range_7 = Range(Domain=number_slider_9, Steps=number_slider_10)  # disabled
range_8 = Range(Domain=number_slider_9, Steps=number_slider_10)  # disabled
range_9 = Range(Domain=number_slider_9, Steps=number_slider_10)  # disabled
unit_z_3 = UnitZ(Factor=range_9)  # disabled
construct_point_3 = ConstructPoint(XCoordinate=graft(range_7), YCoordinate=range_8, ZCoordinate=0)  # disabled
move_2 = Move(Geometry=graft(construct_point_3), Motion=unit_z_3)  # -> Geometry, Transform; disabled
list_length_2 = ListLength(List=flatten(move_2.Geometry))  # disabled
random_2 = Random(Range=list_length_2, Number=number_slider_11, Seed=number_slider_12)  # disabled
list_item_2 = ListItem(List=flatten(move_2.Geometry), Index=random_2, Wrap=True)  # disabled
# 1.1
point_3 = Point(list_item_2)  # disabled

# ----
# Motion of a Falling Rock
ho = Slider(5, range=0.01..5)  # disabled
t = Slider(0.41, range=0.01..1.25)  # disabled
panel = Panel("2")  # disabled
panel_2 = Panel("5")  # disabled
panel_3 = Panel("48")  # disabled
range_10 = Range(Domain=panel, Steps=panel_3)  # disabled
range_11 = Range(Domain=t, Steps=panel_3)  # disabled
range_12 = Range(Domain=panel_2, Steps=panel_3)  # disabled
expression = Expression(t=range_11, ho=ho, Expression="ho -4.9*(t^2)")  # disabled
construct_point_4 = ConstructPoint(XCoordinate=range_10, YCoordinate=0, ZCoordinate=0)  # disabled
construct_point_5 = ConstructPoint(XCoordinate=0, YCoordinate=range_12, ZCoordinate=0)  # disabled
construct_point_6 = ConstructPoint(XCoordinate=range_11, YCoordinate=expression, ZCoordinate=0)  # disabled
interpolate_3 = Interpolate(Vertices=construct_point_6, Degree=3, Periodic=False, KnotStyle=1)  # -> Curve, Length, Domain; disabled
interpolate_4 = Interpolate(Vertices=construct_point_4, Degree=3, Periodic=False, KnotStyle=1)  # -> Curve, Length, Domain; disabled
interpolate_5 = Interpolate(Vertices=construct_point_5, Degree=3, Periodic=False, KnotStyle=1)  # -> Curve, Length, Domain; disabled
curve_middle = CurveMiddle(Curve=interpolate_4.Curve)  # disabled
curve_middle_2 = CurveMiddle(Curve=interpolate_5.Curve)  # disabled
curve_middle_3 = CurveMiddle(Curve=interpolate_3.Curve)  # disabled
end_points = EndPoints(Curve=interpolate_3.Curve)  # -> Start, End; disabled
number_slider_13 = Slider(0.2, range=0..1)  # disabled
panel_4 = Panel("   y = h(t)")  # disabled
panel_5 = Panel("t")  # disabled
panel_6 = Panel("y    ")  # disabled
panel_7 = Panel("ho   ")  # disabled
text_tag_3d = TextTag3D(Location=curve_middle, Text=panel_5, Size=number_slider_13, Justification=3)  # disabled
text_tag_3d_2 = TextTag3D(Location=curve_middle_2, Text=panel_6, Size=number_slider_13, Justification=6)  # disabled
text_tag_3d_3 = TextTag3D(Location=end_points.Start, Text=panel_7, Size=number_slider_13, Justification=6)  # disabled
text_tag_3d_4 = TextTag3D(Location=curve_middle_3, Text=panel_4, Size=number_slider_13, Justification=7)  # disabled
panel_8 = Panel("1")  # disabled
panel_9 = Panel(".1")  # disabled
negative = Negative(Value=panel_9)  # disabled
evaluate_curve = EvaluateCurve(Curve=reparameterize(interpolate_3.Curve), Parameter=panel_8)  # -> Point, Tangent, Angle; disabled
offset_curve = OffsetCurve(Curve=interpolate_4.Curve, Distance=panel_9, Corners=1)  # disabled
offset_curve_2 = OffsetCurve(Curve=interpolate_5.Curve, Distance=negative, Corners=1)  # disabled
circle = Circle(Plane=end_points.End, Radius=panel_9)  # disabled
# Independently invented by Newton and Leibniz
# -Newton's motivation was a desire to
# analyze motion of moving objects
# - using calculus he formulated
# laws of motion and gravitation
# - drew from Kepler's empirical data
# Newton used calculus to study the cosmos
# - many "laws of nature" are expressed
# as equations and thier solutions are at the
# heart of calculus
# - Newton's second law:
# Force = mass * acceleration
# - acceleration, -9.8m/sec^2 is the rate of change
# the derivative of the velocity is the rate of change
# the derivative of the height function
# lines and curves were seen as paths traced by moving points
# - geometric concepts of tangency and area
# - differentiation  finds tangent lines
# - integration finds areas of regions with curved boundaries
# - concepts of real numbers, coordinate systems
# and function
# - concept of limit, an opperation on functions
# - this distinguishes calculus, THE LIMIT
loft = Loft(
    Curves=flatten([interpolate_4.Curve, offset_curve]),
    Options={Adjust=False, Closed=False, LoftEnds=0, LoftSimp=0, LoftType=0, Rebuild=10, Refit=0.01})  # disabled
loft_2 = Loft(
    Curves=flatten([interpolate_5.Curve, offset_curve_2]),
    Options={Adjust=False, Closed=False, LoftEnds=0, LoftSimp=0, LoftType=0, Rebuild=10, Refit=0.01})  # disabled
boundary_surfaces = BoundarySurfaces(Edges=circle)  # disabled
vector_display = VectorDisplay(Anchor=evaluate_curve.Point, Vector=evaluate_curve.Tangent)  # disabled

panel_10 = Panel(".05")  # disabled

number_slider_14 = Slider(3, range=0..10)  # disabled
# Properties of the real number system
# fall into three categories:
# algebraic properties, ordered properties and completeness
# - real numbers may be added, subtracted,
#  multiplied, devided (except by "0")
# to produce more real numbers
# - the usual laws of arithmetic are satisfied
# - Order properties refer to order
# - Completeness states that there can be no holes
# in the real line, every point corresponds
# to a real number
# 
# Three special subsets are:
# the natrual numbers, (1, 2, 3, ...)
# the integers (0, +-1, +-2, ...)
# the rational numbers can be expressed at
# real numbers m/n where m and n are integers,
# and n != 0
# - rational numbers terminate or end in string
# of repeating digits over and over
# _ the rational numbers  do not pocess
# the completeness property
# -  i.e. Sqrt(2)
# - this provides an appropriate setting
# for studying the limits and therefore, CALCULUS
expression_2 = Expression(Expression="Sqrt(2)")  # disabled
# 1.2
# The Real Line and the Cartesian Plane
# - real numbers are expressible in decimal form
# - real numbers can be represented
# geometrically as points on a number line
# (the real line)
# - IR symbol
negative_2 = Negative(Value=number_slider_14)  # disabled
construct_domain = ConstructDomain(DomainStart=negative_2, DomainEnd=number_slider_14)  # disabled
expression_3 = Expression(Expression="2^½")  # disabled
expression_4 = Expression(Expression="π")  # disabled
panel_11 = Panel("Sqrt(2)")  # disabled
panel_12 = Panel("4")  # disabled
panel_13 = Panel("pi")  # disabled
panel_14 = Panel("-3/4")  # disabled
panel_15 = Panel("1")  # disabled
panel_16 = Panel("3")  # disabled
panel_17 = Panel("-2")  # disabled
panel_18 = Panel("-1")  # disabled
panel_19 = Panel("0")  # disabled
panel_20 = Panel("1/3")  # disabled
panel_21 = Panel("2")  # disabled
range_13 = Range(Domain=construct_domain, Steps=10)  # disabled
construct_point_7 = ConstructPoint(XCoordinate=range_13, YCoordinate=0, ZCoordinate=0)  # disabled
merge = Merge(
    Data1=panel_17,
    Data2=panel_18,
    Data3=panel_14,
    Data4=panel_19,
    Data5=panel_20,
    Data6=panel_15,
    Data7=panel_11,
    Data8=panel_21,
    Data9=panel_16,
    Data10=panel_13,
    Data11=panel_12)  # disabled
polyline_3 = PolyLine(Vertices=construct_point_7, Closed=False)  # disabled
boolean_toggle = BooleanToggle(True)  # disabled
panel_22 = Panel("_____")  # disabled
construct_point_8 = ConstructPoint(XCoordinate=merge, YCoordinate=0, ZCoordinate=0)  # disabled
panel_23 = Panel(".5")  # disabled
concatenate = Concatenate(FragmentA=panel_22, FragmentB=merge)  # disabled
end_points_2 = EndPoints(Curve=reparameterize(polyline_3))  # -> Start, End; disabled
pi = Pi(Factor=panel_23)  # disabled
circle_2 = Circle(Plane=construct_point_8, Radius=panel_10)  # disabled
negative_3 = Negative(Value=pi)  # disabled
vector_2pt = Vector2Pt(PointA=end_points_2.Start, PointB=end_points_2.End, Unitize=boolean_toggle)  # -> Vector, Length; disabled
boundary_surfaces_2 = BoundarySurfaces(Edges=circle_2)  # disabled
vector_display_2 = VectorDisplay(Anchor=end_points_2.End, Vector=vector_2pt.Vector)  # disabled
rotate_plane = RotatePlane(Plane=boundary_surfaces_2, Angle=negative_3)  # disabled
panel_24 = Panel(".12")  # disabled
# Intervals:
# - this is a subset of the real line
# - it contains atleast two numbers
# - it contains all real numbers
# between any tow of its elements
# - i.e. x such that x > 6
# - i.e. y such that y != 0 is not an interval
# (it is two intervals)
# - closed interval from a to b, denoted [a, b]
# consitsts of all real numbers x satisfying
# a <= x <=b
# - open interval from a to b, denoted (a, b)
# consists of all real numbers x satisfying
# a < x < b
# - note the use of small dots and open "holes"
# - the whole real line my be regarded as
# an interval: IR = (-infinity, infinity) or (-∞, ∞)
text_tag_3d_5 = TextTag3D(Location=rotate_plane, Text=concatenate, Size=panel_24, Justification=7)  # disabled

# ----
# Intervals
# the Real Line
number_slider_15 = Slider(5, range=0..10)  # disabled
negative_4 = Negative(Value=number_slider_15)  # disabled
construct_domain_2 = ConstructDomain(DomainStart=negative_4, DomainEnd=number_slider_15)  # disabled
panel_25 = Panel("48")  # disabled
range_14 = Range(Domain=construct_domain_2, Steps=panel_25)  # disabled
construct_point_9 = ConstructPoint(XCoordinate=range_14, YCoordinate=0, ZCoordinate=0)  # disabled
polyline_4 = PolyLine(Vertices=construct_point_9, Closed=False)  # disabled
boolean_toggle_2 = BooleanToggle(False)  # disabled
end_points_3 = EndPoints(Curve=polyline_4)  # -> Start, End; disabled
construct_point_10 = ConstructPoint(XCoordinate=0, YCoordinate=0, ZCoordinate=0)  # disabled
vector_2pt_2 = Vector2Pt(PointA=construct_point_10, PointB=end_points_3.End, Unitize=boolean_toggle_2)  # -> Vector, Length; disabled
negative_5 = Negative(Value=vector_2pt_2.Vector)  # disabled
vector_display_3 = VectorDisplay(Anchor=construct_point_10, Vector=negative_5)  # disabled
vector_display_4 = VectorDisplay(Anchor=construct_point_10, Vector=vector_2pt_2.Vector)  # disabled

# ----
# a <= x < b
panel_26 = Panel("[a,b)")  # disabled

# ----
# closed and open intervals
panel_27 = Panel("(a,b]")  # disabled
panel_28 = Panel("[a,b]")  # disabled
panel_29 = Panel("(a,b)")  # disabled
characters = Characters(Text=panel_26)  # -> Result, Unicode; disabled
list_item_3 = ListItem(List=characters.Result, Index=0, Wrap=True)  # -> Item1, Item; disabled
number_slider_16 = Slider(-3.12, range=-5..5)  # disabled
number_slider_17 = Slider(3.28, range=-5..5)  # disabled
panel_30 = Panel(list_item_3.Item)  # disabled
panel_31 = Panel(list_item_3.Item1)  # disabled
ghpython_script = GhPythonScript(closed_open=panel_30, a=number_slider_16, b=number_slider_17, open_closed=panel_31)  # -> out, smallest_pt, smallest_circle, smallest_surface, largest_pt, largest_circle, largest_surface; disabled
# ---------- ghpython_script: Python ----------
__author__ = "Sculpture"
__version__ = "2021.07.11"

import rhinoscriptsyntax as rs

#a must be less than and not equal to b to be an interval
if (a < b):
    if (closed_open == "["):
        smallest_pt = rs.CreatePoint(a, 0, 0)
        smallest_circle = rs.AddCircle(smallest_pt, 0.1)
        smallest_surface = rs.AddPlanarSrf(smallest_circle)
    elif (closed_open == "("):
        smallest_pt = rs.CreatePoint(a, 0, 0)
        smallest_circle = rs.AddCircle(smallest_pt, 0.1)
        
    if (open_closed == "]"):
        largest_pt = rs.CreatePoint(b, 0, 0)
        largest_circle = rs.AddCircle(largest_pt, 0.1)
        largest_surface = rs.AddPlanarSrf(largest_circle)
    elif (open_closed == ")"):
        largest_pt = rs.CreatePoint(b, 0, 0)
        largest_circle = rs.AddCircle(largest_pt, 0.1)
# ---------- end ghpython_script ----------
point_4 = Point(ghpython_script.largest_pt)  # disabled
point_5 = Point(ghpython_script.smallest_pt)  # disabled
circle_3 = Circle(ghpython_script.smallest_circle)  # disabled
surface = Surface(ghpython_script.smallest_surface)  # disabled
circle_4 = Circle(ghpython_script.largest_circle)  # disabled
surface_2 = Surface(ghpython_script.largest_surface)  # disabled
deconstruct = Deconstruct(Point=point_5)  # -> XComponent, YComponent, ZComponent; disabled
deconstruct_2 = Deconstruct(Point=point_4)  # -> XComponent, YComponent, ZComponent; disabled
panel_32 = Panel("0")  # disabled
panel_33 = Panel("5")  # disabled
negative_6 = Negative(Value=panel_33)  # disabled
merge_2 = Merge(Data1=deconstruct.XComponent, Data2=deconstruct_2.XComponent, Data3=panel_32, Data4=negative_6, Data5=panel_33)  # disabled
construct_point_11 = ConstructPoint(XCoordinate=merge_2, YCoordinate=0, ZCoordinate=0)  # disabled
panel_34 = Panel(".5")  # disabled
panel_35 = Panel("_____")  # disabled
negative_7 = Negative(Value=panel_34)  # disabled
concatenate_2 = Concatenate(FragmentA=panel_35, FragmentB=construct_point_11)  # disabled
pi_2 = Pi(Factor=negative_7)  # disabled
rotate_plane_2 = RotatePlane(Plane=construct_point_11, Angle=pi_2)  # disabled
panel_36 = Panel(".12")  # disabled
text_tag_3d_6 = TextTag3D(Location=rotate_plane_2, Text=concatenate_2, Size=panel_36, Justification=7)  # disabled

vector_display_ex = VectorDisplayEx(Colour=RGB(0, 0, 0), Width=2)  # disabled

# ----
# x-axis and y-axis
number_slider_18 = Slider(0, range=-5..5)  # disabled
number_slider_19 = Slider(3.28, range=-5..5)  # disabled
number_slider_20 = Slider(10, range=0..10)  # disabled
xy_plane = XYPlane(Origin=Point(0, 0, 0))  # disabled
construct_domain_3 = ConstructDomain(DomainStart=number_slider_18, DomainEnd=number_slider_19)  # disabled
range_15 = Range(Domain=construct_domain_3, Steps=number_slider_20)  # disabled
construct_point_12 = ConstructPoint(XCoordinate=range_15, YCoordinate=0, ZCoordinate=0)  # disabled
construct_point_13 = ConstructPoint(XCoordinate=0, YCoordinate=range_15, ZCoordinate=0)  # disabled
list_item_4 = ListItem(List=construct_point_12, Index=0, Wrap=True)  # -> Item1, Item; disabled
list_item_5 = ListItem(List=construct_point_13, Index=0, Wrap=True)  # -> Item1, Item; disabled
construct_point_14 = ConstructPoint(XCoordinate=0, YCoordinate=0, ZCoordinate=0)  # disabled
vector_2pt_3 = Vector2Pt(PointA=list_item_4.Item, PointB=list_item_4.Item1, Unitize=False)  # -> Vector, Length; disabled
vector_2pt_4 = Vector2Pt(PointA=list_item_5.Item, PointB=list_item_5.Item1, Unitize=False)  # -> Vector, Length; disabled
negative_8 = Negative(Value=vector_2pt_3.Vector)  # disabled
negative_9 = Negative(Value=vector_2pt_4.Vector)  # disabled
vector_display_5 = VectorDisplay(Anchor=construct_point_14, Vector=vector_2pt_3.Vector)  # disabled
vector_display_6 = VectorDisplay(Anchor=construct_point_14, Vector=negative_8)  # disabled
vector_display_7 = VectorDisplay(Anchor=construct_point_14, Vector=vector_2pt_4.Vector)  # disabled
vector_display_8 = VectorDisplay(Anchor=construct_point_14, Vector=negative_9)  # disabled

# ----
# change
x₂ = Slider(1.11, range=-5..5)  # disabled
x₁ = Slider(0.6, range=-5..5)  # disabled
y₁ = Slider(1.21, range=-5..5)  # disabled
y₂ = Slider(0.46, range=-5..5)  # disabled

# ----
# x-axis and y-axis
number_slider_21 = Slider(0, range=-5..5)  # disabled
number_slider_22 = Slider(3.28, range=-5..5)  # disabled
number_slider_23 = Slider(10, range=0..10)  # disabled
xy_plane_2 = XYPlane(Origin=Point(0, 0, 0))  # disabled
construct_domain_4 = ConstructDomain(DomainStart=number_slider_21, DomainEnd=number_slider_22)  # disabled
range_16 = Range(Domain=construct_domain_4, Steps=number_slider_23)  # disabled
construct_point_15 = ConstructPoint(XCoordinate=range_16, YCoordinate=0, ZCoordinate=0)  # disabled
construct_point_16 = ConstructPoint(XCoordinate=0, YCoordinate=range_16, ZCoordinate=0)  # disabled
list_item_6 = ListItem(List=construct_point_15, Index=0, Wrap=True)  # -> Item1, Item; disabled
list_item_7 = ListItem(List=construct_point_16, Index=0, Wrap=True)  # -> Item1, Item; disabled
construct_point_17 = ConstructPoint(XCoordinate=0, YCoordinate=0, ZCoordinate=0)  # disabled
vector_2pt_5 = Vector2Pt(PointA=list_item_6.Item, PointB=list_item_6.Item1, Unitize=False)  # -> Vector, Length; disabled
vector_2pt_6 = Vector2Pt(PointA=list_item_7.Item, PointB=list_item_7.Item1, Unitize=False)  # -> Vector, Length; disabled
negative_10 = Negative(Value=vector_2pt_5.Vector)  # disabled
negative_11 = Negative(Value=vector_2pt_6.Vector)  # disabled
vector_display_9 = VectorDisplay(Anchor=construct_point_17, Vector=vector_2pt_5.Vector)  # disabled
vector_display_10 = VectorDisplay(Anchor=construct_point_17, Vector=negative_10)  # disabled
vector_display_11 = VectorDisplay(Anchor=construct_point_17, Vector=vector_2pt_6.Vector)  # disabled
vector_display_12 = VectorDisplay(Anchor=construct_point_17, Vector=negative_11)  # disabled

construct_point_18 = ConstructPoint(XCoordinate=0, YCoordinate=0, ZCoordinate=0)  # disabled
panel_37 = Panel(".05")  # disabled

# ----
# Sqrt((x₂ - x₁)^2 + (y₂ - y₁)^2)
construct_point_19 = ConstructPoint(XCoordinate=x₁, YCoordinate=x₂, ZCoordinate=0)  # disabled
construct_point_20 = ConstructPoint(XCoordinate=y₁, YCoordinate=y₂, ZCoordinate=0)  # disabled
deconstruct_3 = Deconstruct(Point=construct_point_19)  # -> XComponent, YComponent, ZComponent; disabled
deconstruct_4 = Deconstruct(Point=construct_point_20)  # -> XComponent, YComponent, ZComponent; disabled
construct_point_21 = ConstructPoint(XCoordinate=deconstruct_3.XComponent, YCoordinate=0, ZCoordinate=0)  # disabled
construct_point_22 = ConstructPoint(XCoordinate=0, YCoordinate=deconstruct_3.YComponent, ZCoordinate=0)  # disabled
expression_5 = Expression(x1=x₁, x2=x₂, y1=y₁, y2=y₂, Expression="Sqrt((x2 - x1)^2 + (y2 - y1)^2)")  # disabled
construct_point_23 = ConstructPoint(XCoordinate=deconstruct_4.XComponent, YCoordinate=0, ZCoordinate=0)  # disabled
construct_point_24 = ConstructPoint(XCoordinate=0, YCoordinate=deconstruct_4.YComponent, ZCoordinate=0)  # disabled
line = Line(StartPoint=construct_point_18, EndPoint=construct_point_19)  # disabled
line_2 = Line(StartPoint=construct_point_18, EndPoint=construct_point_21)  # disabled
line_3 = Line(StartPoint=construct_point_18, EndPoint=construct_point_22)  # disabled
line_4 = Line(StartPoint=construct_point_19, EndPoint=construct_point_20)  # disabled
line_5 = Line(StartPoint=construct_point_18, EndPoint=construct_point_23)  # disabled
line_6 = Line(StartPoint=construct_point_18, EndPoint=construct_point_24)  # disabled
expression_6 = Expression(x=x₁, y=x₂, Expression="Sqrt(x^2 + y^2)")  # disabled
line_7 = Line(StartPoint=construct_point_21, EndPoint=construct_point_19)  # disabled
line_8 = Line(StartPoint=construct_point_22, EndPoint=construct_point_19)  # disabled
line_9 = Line(StartPoint=construct_point_23, EndPoint=construct_point_20)  # disabled
line_10 = Line(StartPoint=construct_point_24, EndPoint=construct_point_20)  # disabled
distance = Distance(PointA=construct_point_19, PointB=construct_point_18)  # disabled
panel_38 = Panel("""  
      D = Sqrt((x2 - x1)^2 + (y2 - y1)^2)""")  # disabled
curve_middle_4 = CurveMiddle(Curve=line)  # disabled
distance_2 = Distance(PointA=construct_point_20, PointB=construct_point_18)  # disabled
curve_middle_5 = CurveMiddle(Curve=line_4)  # disabled
panel_39 = Panel("""  
      D = Sqrt(x^2 + y^2)""")  # disabled
panel_40 = Panel(expression_6)  # disabled
panel_41 = Panel(distance)  # disabled
panel_42 = Panel(expression_5)  # disabled
panel_43 = Panel(distance_2)  # disabled
panel_44 = Panel("    P₁ = (x₁, y₁)")  # disabled
panel_45 = Panel("    P₂ = (x₂, y₂)")  # disabled
panel_46 = Panel("____")  # disabled
concatenate_3 = Concatenate(FragmentA=panel_46, FragmentB=panel_40)  # disabled
panel_47 = Panel("x₁")  # disabled
panel_48 = Panel("____")  # disabled
concatenate_4 = Concatenate(FragmentA=panel_48, FragmentB=panel_42)  # disabled
panel_49 = Panel("x₂")  # disabled
panel_50 = Panel("y₂    ")  # disabled
panel_51 = Panel(".12")  # disabled
panel_52 = Panel(".12")  # disabled
panel_53 = Panel("O    ")  # disabled
panel_54 = Panel("O    ")  # disabled
panel_55 = Panel("y₁    ")  # disabled

# ----
# Sqrt(x^2 + y^2)
x = Slider(1, range=-5..5)  # disabled
y = Slider(1.26, range=-5..5)  # disabled
construct_point_25 = ConstructPoint(XCoordinate=x, YCoordinate=y, ZCoordinate=0)  # disabled
construct_point_26 = ConstructPoint(XCoordinate=0, YCoordinate=0, ZCoordinate=0)  # disabled
deconstruct_5 = Deconstruct(Point=construct_point_25)  # -> XComponent, YComponent, ZComponent; disabled
construct_point_27 = ConstructPoint(XCoordinate=0, YCoordinate=deconstruct_5.YComponent, ZCoordinate=0)  # disabled
construct_point_28 = ConstructPoint(XCoordinate=deconstruct_5.XComponent, YCoordinate=0, ZCoordinate=0)  # disabled
line_11 = Line(StartPoint=construct_point_26, EndPoint=construct_point_25)  # disabled
line_12 = Line(StartPoint=construct_point_26, EndPoint=construct_point_28)  # disabled
line_13 = Line(StartPoint=construct_point_26, EndPoint=construct_point_27)  # disabled
expression_7 = Expression(x=x, y=y, Expression="Sqrt(x^2 + y^2)")  # disabled
distance_3 = Distance(PointA=construct_point_25, PointB=construct_point_26)  # disabled
curve_middle_6 = CurveMiddle(Curve=line_11)  # disabled
panel_56 = Panel(expression_7)  # disabled
panel_57 = Panel(distance_3)  # disabled
panel_58 = Panel("""  
      D = Sqrt(x^2 + y^2)""")  # disabled
panel_59 = Panel("____")  # disabled
panel_60 = Panel("y    ")  # disabled
panel_61 = Panel("x")  # disabled
panel_62 = Panel(".12")  # disabled
panel_63 = Panel("O    ")  # disabled
concatenate_5 = Concatenate(FragmentA=panel_59, FragmentB=panel_56)  # disabled
panel_64 = Panel("    P = (x,y)")  # disabled
text_tag_3d_7 = TextTag3D(Location=curve_middle_6, Text=concatenate_5, Size=panel_62, Justification=7)  # disabled
text_tag_3d_8 = TextTag3D(Location=curve_middle_6, Text=panel_58, Size=panel_62, Justification=7)  # disabled
text_tag_3d_9 = TextTag3D(Location=construct_point_27, Text=panel_60, Size=panel_62, Justification=9)  # disabled
text_tag_3d_10 = TextTag3D(Location=construct_point_28, Text=panel_61, Size=panel_62, Justification=7)  # disabled
text_tag_3d_11 = TextTag3D(Location=construct_point_25, Text=panel_64, Size=panel_62, Justification=7)  # disabled
text_tag_3d_12 = TextTag3D(Location=construct_point_26, Text=panel_63, Size=panel_62, Justification=3)  # disabled

# ----
# labels
text_tag_3d_13 = TextTag3D(Location=curve_middle_4, Text=concatenate_3, Size=panel_51, Justification=7)  # disabled
text_tag_3d_14 = TextTag3D(Location=curve_middle_4, Text=panel_39, Size=panel_37, Justification=7)  # disabled
text_tag_3d_15 = TextTag3D(Location=construct_point_22, Text=panel_55, Size=panel_51, Justification=9)  # disabled
text_tag_3d_16 = TextTag3D(Location=construct_point_21, Text=panel_47, Size=panel_51, Justification=7)  # disabled
text_tag_3d_17 = TextTag3D(Location=construct_point_19, Text=panel_44, Size=panel_51, Justification=7)  # disabled
text_tag_3d_18 = TextTag3D(Location=construct_point_18, Text=panel_53, Size=panel_51, Justification=3)  # disabled
text_tag_3d_19 = TextTag3D(Location=curve_middle_5, Text=concatenate_4, Size=panel_52, Justification=7)  # disabled
text_tag_3d_20 = TextTag3D(Location=curve_middle_5, Text=panel_38, Size=panel_37, Justification=7)  # disabled
text_tag_3d_21 = TextTag3D(Location=construct_point_24, Text=panel_50, Size=panel_52, Justification=9)  # disabled
text_tag_3d_22 = TextTag3D(Location=construct_point_23, Text=panel_49, Size=panel_52, Justification=7)  # disabled
text_tag_3d_23 = TextTag3D(Location=construct_point_20, Text=panel_45, Size=panel_52, Justification=7)  # disabled
text_tag_3d_24 = TextTag3D(Location=construct_point_18, Text=panel_54, Size=panel_52, Justification=3)  # disabled

# ----
# x-axis and y-axis
number_slider_24 = Slider(0, range=-5..5)  # disabled
number_slider_25 = Slider(3.28, range=-5..5)  # disabled
number_slider_26 = Slider(10, range=0..10)  # disabled
xy_plane_3 = XYPlane(Origin=Point(0, 0, 0))  # disabled
construct_domain_5 = ConstructDomain(DomainStart=number_slider_24, DomainEnd=number_slider_25)  # disabled
range_17 = Range(Domain=construct_domain_5, Steps=number_slider_26)  # disabled
construct_point_29 = ConstructPoint(XCoordinate=range_17, YCoordinate=0, ZCoordinate=0)  # disabled
construct_point_30 = ConstructPoint(XCoordinate=0, YCoordinate=range_17, ZCoordinate=0)  # disabled
list_item_8 = ListItem(List=construct_point_29, Index=0, Wrap=True)  # -> Item1, Item; disabled
list_item_9 = ListItem(List=construct_point_30, Index=0, Wrap=True)  # -> Item1, Item; disabled
construct_point_31 = ConstructPoint(XCoordinate=0, YCoordinate=0, ZCoordinate=0)  # disabled
vector_2pt_7 = Vector2Pt(PointA=list_item_8.Item, PointB=list_item_8.Item1, Unitize=False)  # -> Vector, Length; disabled
vector_2pt_8 = Vector2Pt(PointA=list_item_9.Item, PointB=list_item_9.Item1, Unitize=False)  # -> Vector, Length; disabled
negative_12 = Negative(Value=vector_2pt_7.Vector)  # disabled
negative_13 = Negative(Value=vector_2pt_8.Vector)  # disabled
vector_display_13 = VectorDisplay(Anchor=construct_point_31, Vector=vector_2pt_7.Vector)  # disabled
vector_display_14 = VectorDisplay(Anchor=construct_point_31, Vector=negative_12)  # disabled
vector_display_15 = VectorDisplay(Anchor=construct_point_31, Vector=vector_2pt_8.Vector)  # disabled
vector_display_16 = VectorDisplay(Anchor=construct_point_31, Vector=negative_13)  # disabled

# ----
# the graph of y = x
x_2 = Slider(2, range=0..5.01)  # disabled
negative_14 = Negative(Value=x_2)  # disabled
panel_65 = Panel(x_2)  # disabled
construct_domain_6 = ConstructDomain(DomainStart=negative_14, DomainEnd=x_2)  # disabled
panel_66 = Panel("1")  # disabled
panel_68 = Panel(negative_14)  # disabled
range_18 = Range(Domain=construct_domain_6, Steps=panel_66)  # -> graft(Range); disabled
panel_69 = Panel(construct_domain_6)  # disabled
construct_point_32 = ConstructPoint(XCoordinate=range_18, YCoordinate=range_18, ZCoordinate=0)  # disabled
construct_point_33 = ConstructPoint(XCoordinate=0, YCoordinate=0, ZCoordinate=0)  # disabled
panel_70 = Panel(range_18)  # disabled
deconstruct_6 = Deconstruct(Point=construct_point_32)  # -> XComponent, YComponent, ZComponent; disabled
construct_point_34 = ConstructPoint(XCoordinate=0, YCoordinate=deconstruct_6.YComponent, ZCoordinate=0)  # disabled
construct_point_35 = ConstructPoint(XCoordinate=deconstruct_6.XComponent, YCoordinate=0, ZCoordinate=0)  # disabled
line_14 = Line(StartPoint=construct_point_33, EndPoint=construct_point_32)  # disabled
line_15 = Line(StartPoint=construct_point_33, EndPoint=construct_point_35)  # disabled
line_16 = Line(StartPoint=construct_point_33, EndPoint=construct_point_34)  # disabled
expression_8 = Expression(x=range_18, y=range_18, Expression="Sqrt(x^2 + y^2)")  # -> flatten(Result); disabled
distance_4 = Distance(PointA=construct_point_32, PointB=construct_point_33)  # disabled
curve_middle_7 = CurveMiddle(Curve=line_14)  # disabled
panel_71 = Panel("1")  # disabled
evaluate_curve_2 = EvaluateCurve(Curve=reparameterize(line_14), Parameter=panel_71)  # -> Point, Tangent, Angle; disabled
boolean_toggle_3 = BooleanToggle(True)  # disabled
panel_72 = Panel(distance_4)  # disabled
panel_73 = Panel(expression_8)  # disabled
panel_74 = Panel("""0
1""")  # disabled
panel_75 = Panel(".12")  # disabled
list_item_10 = ListItem(List=evaluate_curve_2.Point, Index=panel_74, Wrap=True)  # -> Item1, Item; disabled
vector_2pt_9 = Vector2Pt(PointA=construct_point_33, PointB=construct_point_32, Unitize=boolean_toggle_3)  # -> Vector, Length; disabled
panel_76 = Panel("y    ")  # disabled
panel_77 = Panel("    P = (x,y)")  # disabled
panel_78 = Panel("____")  # disabled
panel_79 = Panel("""  
      D = Sqrt(x^2 + y^2)""")  # disabled
panel_80 = Panel("x")  # disabled
panel_81 = Panel("O    ")  # disabled
concatenate_6 = Concatenate(FragmentA=panel_78, FragmentB=panel_73)  # disabled

# ----
# the graph of y = x^2
number_slider_27 = Slider(1.77, range=0..10)  # disabled
negative_15 = Negative(Value=number_slider_27)  # disabled
number_slider_28 = Slider(6, range=0..10)  # disabled
number_slider_29 = Slider(100, range=0..100)  # disabled
panel_82 = Panel(number_slider_27)  # disabled
construct_domain_7 = ConstructDomain(DomainStart=negative_15, DomainEnd=number_slider_27)  # disabled
panel_84 = Panel(negative_15)  # disabled
range_19 = Range(Domain=construct_domain_7, Steps=number_slider_28)  # disabled
panel_85 = Panel(construct_domain_7)  # disabled
expression_9 = Expression(x=range_19, y=range_19, Expression="x^2")  # -> flatten(Result); disabled
construct_point_36 = ConstructPoint(XCoordinate=0, YCoordinate=0, ZCoordinate=0)  # disabled
panel_86 = Panel(range_19)  # disabled
construct_point_37 = ConstructPoint(XCoordinate=range_19, YCoordinate=expression_9, ZCoordinate=0)  # disabled
deconstruct_7 = Deconstruct(Point=construct_point_37)  # -> XComponent, YComponent, ZComponent; disabled
panel_87 = Panel(expression_9)  # disabled
construct_point_38 = ConstructPoint(XCoordinate=0, YCoordinate=deconstruct_7.YComponent, ZCoordinate=0)  # disabled
construct_point_39 = ConstructPoint(XCoordinate=deconstruct_7.XComponent, YCoordinate=0, ZCoordinate=0)  # disabled
interpolate_6 = Interpolate(Vertices=construct_point_37, Degree=3, Periodic=False, KnotStyle=1)  # -> Curve, Length, Domain; disabled
line_17 = Line(StartPoint=construct_point_36, EndPoint=construct_point_39)  # disabled
line_18 = Line(StartPoint=construct_point_36, EndPoint=construct_point_38)  # disabled
point_on_curve = PointOnCurve(interpolate_6.Curve, parameter=0.25)  # disabled
curve_middle_8 = CurveMiddle(Curve=reparameterize(interpolate_6.Curve))  # disabled
point_on_curve_2 = PointOnCurve(interpolate_6.Curve, parameter=0.75)  # disabled
panel_88 = Panel(interpolate_6.Length)  # disabled
panel_89 = Panel("0")  # disabled
panel_90 = Panel("1")  # disabled
evaluate_curve_3 = EvaluateCurve(Curve=reparameterize(interpolate_6.Curve), Parameter=panel_89)  # -> Point, Tangent, Angle; disabled
evaluate_curve_4 = EvaluateCurve(Curve=reparameterize(interpolate_6.Curve), Parameter=panel_90)  # -> Point, Tangent, Angle; disabled
panel_91 = Panel(".12")  # disabled
panel_92 = Panel("""  
      Length of y = (x^2) curve""")  # disabled
negative_16 = Negative(Value=evaluate_curve_3.Tangent)  # disabled
panel_93 = Panel("    P = (x,y)")  # disabled
panel_94 = Panel("____")  # disabled
panel_95 = Panel("y    ")  # disabled
panel_96 = Panel("x")  # disabled
panel_97 = Panel("O    ")  # disabled
concatenate_7 = Concatenate(FragmentA=panel_94, FragmentB=panel_88)  # disabled
list_item_11 = ListItem(List=construct_point_39, Index=0, Wrap=True)  # -> Item1, Item; disabled
list_item_12 = ListItem(List=construct_point_38, Index=0, Wrap=True)  # disabled
panel_98 = Panel("Calculus Magic")  # disabled

# ----
# Creating Circles and estimating circumference:
# 
# x² + y² = Coefficient
# x² + y² = 0
# x² + y² = 1
# x² + y² = 4
# x² + y² = 9
# x² + y² = 16
# x² + y² = 25
# x² + y² = 36
# x² + y² = 49
# x² + y² = 64
# x² + y² = 81
# x² + y² = 100
number_slider_30 = Slider(2, range=0..5)  # disabled
panel_99 = Panel("""0
1
4
9
16
25
36
49
64
81
100""")  # disabled
list_item_13 = ListItem(List=panel_99, Index=number_slider_30, Wrap=True)  # disabled
square_root = SquareRoot(Value=list_item_13)  # disabled
panel_100 = Panel(square_root)  # disabled
negative_17 = Negative(Value=panel_100)  # disabled
panel_101 = Panel(panel_100)  # disabled
number_slider_31 = Slider(100, range=2..100)  # disabled
construct_domain_8 = ConstructDomain(DomainStart=negative_17, DomainEnd=panel_100)  # disabled
panel_103 = Panel(negative_17)  # disabled
range_20 = Range(Domain=construct_domain_8, Steps=number_slider_31)  # -> flatten(Range); disabled
expression_10 = Expression(x=range_20, C=list_item_13, Expression="Sqrt(C - x^2)")  # disabled
panel_104 = Panel(construct_domain_8)  # disabled
panel_105 = Panel("-1")  # disabled
multiplication_3 = Multiplication(A=expression_10, B=panel_105)  # disabled
panel_106 = Panel(range_20)  # disabled
construct_point_40 = ConstructPoint(XCoordinate=range_20, YCoordinate=expression_10, ZCoordinate=0)  # disabled
construct_point_41 = ConstructPoint(XCoordinate=range_20, YCoordinate=multiplication_3, ZCoordinate=0)  # disabled
construct_point_42 = ConstructPoint(XCoordinate=0, YCoordinate=0, ZCoordinate=0)  # disabled
panel_107 = Panel(expression_10)  # disabled
interpolate_7 = Interpolate(Vertices=construct_point_40, Degree=3, Periodic=False, KnotStyle=1)  # -> Curve, Length, Domain; disabled
interpolate_8 = Interpolate(Vertices=construct_point_41, Degree=3, Periodic=False, KnotStyle=1)  # -> Curve, Length, Domain; disabled
deconstruct_8 = Deconstruct(Point=construct_point_40)  # -> XComponent, YComponent, ZComponent; disabled
join_curves = JoinCurves(Curves=[interpolate_8.Curve, interpolate_7.Curve], Preserve=False)  # disabled
construct_point_43 = ConstructPoint(XCoordinate=0, YCoordinate=deconstruct_8.YComponent, ZCoordinate=0)  # disabled
construct_point_44 = ConstructPoint(XCoordinate=deconstruct_8.XComponent, YCoordinate=0, ZCoordinate=0)  # disabled
curve_middle_9 = CurveMiddle(Curve=join_curves)  # disabled
point_on_curve_3 = PointOnCurve(join_curves, parameter=0.75)  # disabled
length = Length(Curve=join_curves)  # disabled
point_on_curve_4 = PointOnCurve(join_curves, parameter=0.669)  # disabled
point_on_curve_5 = PointOnCurve(join_curves, parameter=0.553)  # disabled
point_on_curve_6 = PointOnCurve(join_curves, parameter=0.396)  # disabled
panel_108 = Panel("0")  # disabled
panel_109 = Panel("1")  # disabled
line_19 = Line(StartPoint=construct_point_42, EndPoint=construct_point_44)  # disabled
line_20 = Line(StartPoint=construct_point_42, EndPoint=construct_point_43)  # disabled
panel_110 = Panel(length)  # disabled
evaluate_curve_5 = EvaluateCurve(Curve=reparameterize(join_curves), Parameter=panel_108)  # -> Point, Tangent, Angle; disabled
evaluate_curve_6 = EvaluateCurve(Curve=reparameterize(join_curves), Parameter=panel_109)  # -> Point, Tangent, Angle; disabled
panel_111 = Panel(".12")  # disabled
panel_112 = Panel("""  
      Circumference of 
      y = Sqrt(C + x^2) 
      circle""")  # disabled
negative_18 = Negative(Value=evaluate_curve_5.Tangent)  # disabled
panel_113 = Panel("y    ")  # disabled
panel_114 = Panel("    P = (x,y)")  # disabled
panel_115 = Panel("O    ")  # disabled
panel_116 = Panel("____")  # disabled
panel_117 = Panel("x")  # disabled
concatenate_8 = Concatenate(FragmentA=panel_116, FragmentB=panel_110)  # disabled
list_item_14 = ListItem(List=construct_point_44, Index=0, Wrap=True)  # -> Item1, Item; disabled
list_item_15 = ListItem(List=construct_point_43, Index=0, Wrap=True)  # disabled
panel_118 = Panel("     creating circles")  # disabled

text_tag_3d_25 = TextTag3D(Location=curve_middle_7, Text=concatenate_6, Size=panel_75, Justification=7)  # disabled
text_tag_3d_26 = TextTag3D(Location=curve_middle_7, Text=panel_79, Size=panel_75, Justification=7)  # disabled
text_tag_3d_27 = TextTag3D(Location=construct_point_34, Text=panel_76, Size=panel_75, Justification=9)  # disabled
text_tag_3d_28 = TextTag3D(Location=construct_point_35, Text=panel_80, Size=panel_75, Justification=7)  # disabled
text_tag_3d_29 = TextTag3D(Location=construct_point_32, Text=panel_77, Size=panel_75, Justification=7)  # disabled
text_tag_3d_30 = TextTag3D(Location=construct_point_33, Text=panel_81, Size=panel_75, Justification=3)  # disabled
vector_display_17 = VectorDisplay(Anchor=[list_item_10.Item1, list_item_10.Item], Vector=vector_2pt_9.Vector)  # disabled
line_21 = Line(line_14)  # disabled

polyline_5 = PolyLine(Vertices=construct_point_37, Closed=False)  # disabled
text_tag_3d_31 = TextTag3D(Location=curve_middle_8, Text=panel_98, Size=panel_91, Justification=1)  # disabled
text_tag_3d_32 = TextTag3D(Location=point_on_curve_2, Text=[panel_92, concatenate_7], Size=panel_91, Justification=7)  # disabled
text_tag_3d_33 = TextTag3D(Location=list_item_12, Text=panel_95, Size=panel_91, Justification=9)  # disabled
text_tag_3d_34 = TextTag3D(Location=list_item_11.Item1, Text=panel_96, Size=panel_91, Justification=7)  # disabled
text_tag_3d_35 = TextTag3D(Location=point_on_curve, Text=panel_93, Size=panel_91, Justification=7)  # disabled
text_tag_3d_36 = TextTag3D(Location=construct_point_36, Text=panel_97, Size=panel_91, Justification=3)  # disabled
vector_display_18 = VectorDisplay(Anchor=evaluate_curve_3.Point, Vector=negative_16)  # disabled
vector_display_19 = VectorDisplay(Anchor=evaluate_curve_4.Point, Vector=evaluate_curve_4.Tangent)  # disabled
curve = Curve(interpolate_6.Curve)  # disabled

# ----
# playful geometry
point_6 = Point([construct_point_40, construct_point_41])  # disabled
deconstruct_9 = Deconstruct(Point=point_6)  # -> XComponent, YComponent, ZComponent; disabled
number = Number(expression_10)  # disabled
number_2 = Number(multiplication_3)  # disabled
number_3 = Number(range_20)  # disabled
number_4 = Number([number_3, number])  # disabled
number_5 = Number([number, number_2])  # disabled
number_6 = Number([number_3, number])  # disabled
construct_point_45 = ConstructPoint(XCoordinate=deconstruct_9.YComponent, YCoordinate=deconstruct_9.XComponent, ZCoordinate=number_3)  # disabled
construct_point_46 = ConstructPoint(XCoordinate=number_6, YCoordinate=number_4, ZCoordinate=number)  # disabled
construct_point_47 = ConstructPoint(XCoordinate=deconstruct_9.YComponent, YCoordinate=deconstruct_9.XComponent, ZCoordinate=number_3)  # disabled
interpolate_9 = Interpolate(Vertices=construct_point_46, Degree=3, Periodic=False, KnotStyle=1)  # -> Curve, Length, Domain; disabled
interpolate_10 = Interpolate(Vertices=construct_point_47, Degree=3, Periodic=False, KnotStyle=1)  # -> Curve, Length, Domain; disabled
interpolate_11 = Interpolate(Vertices=construct_point_45, Degree=3, Periodic=False, KnotStyle=1)  # -> Curve, Length, Domain; disabled
loft_3 = Loft(
    Curves=[interpolate_11.Curve, interpolate_10.Curve],
    Options={Adjust=False, Closed=False, LoftEnds=0, LoftSimp=0, LoftType=0, Rebuild=10, Refit=0.01})  # disabled
loft_4 = Loft(
    Curves=[interpolate_9.Curve, interpolate_10.Curve],
    Options={Adjust=False, Closed=False, LoftEnds=0, LoftSimp=0, LoftType=0, Rebuild=10, Refit=0.01})  # disabled

polyline_6 = PolyLine(Vertices=construct_point_40, Closed=False)  # disabled
boundary_surfaces_3 = BoundarySurfaces(Edges=join_curves)  # disabled
text_tag_3d_37 = TextTag3D(Location=point_on_curve_5, Text=panel_118, Size=panel_111, Justification=1)  # disabled
text_tag_3d_38 = TextTag3D(Location=point_on_curve_6, Text=[panel_112, concatenate_8], Size=panel_111, Justification=7)  # disabled
text_tag_3d_39 = TextTag3D(Location=point_on_curve_3, Text=panel_100, Size=panel_111, Justification=3)  # disabled
text_tag_3d_40 = TextTag3D(Location=list_item_14.Item1, Text=panel_100, Size=panel_111, Justification=2)  # disabled
text_tag_3d_41 = TextTag3D(Location=point_on_curve_4, Text=panel_114, Size=panel_111, Justification=7)  # disabled
text_tag_3d_42 = TextTag3D(Location=construct_point_42, Text=panel_115, Size=panel_111, Justification=3)  # disabled
vector_display_20 = VectorDisplay(Anchor=evaluate_curve_5.Point, Vector=negative_18)  # disabled
vector_display_21 = VectorDisplay(Anchor=evaluate_curve_6.Point, Vector=evaluate_curve_6.Tangent)  # disabled
curve_2 = Curve(join_curves)  # disabled
area = Area(Geometry=boundary_surfaces_3)  # -> Area, Centroid; disabled

panel_119 = Panel(area.Area)  # disabled

# ----
# x-axis and y-axis
number_slider_32 = Slider(0, range=-5..5)  # disabled
number_slider_33 = Slider(3.34, range=-5..5)  # disabled
# Point-Slope Equation of a Straight Line:
# y = y₁ + m(x - x₁)
# - this is called the point-slope form
# of teh equation for a straight line
# - useful for studying tangent lines
# - a horizontal line through P₁ has slope 0
# and equation y = y₁
# - a vertical line through P₂ has an infinite slope,
# so equation is x = x₁
# An equation of the form
# Ax + By + C = 0
# is called a linear equation provided A and B are not both 0
# and slope -A/B otherwise
# - two lines are parallel if they have the same slope
# - they are perpendicular if the product of their
# slopes is -1
# - other forms of equations of straight lines are:
# - the slope-y-intercept form:
# y = mx + b
# - this is a straight line with slope m
# and y-intercept b: that is
# it passes through the point (0, b)
# - the two-intercept form:
# (x/a)+(y/b)=1
# -this line has x-intercept a and y-intercept b;
# it passes through the points (a, 0) and (0, b)
number_slider_34 = Slider(10, range=0..10)  # disabled
# Slope:
# - any nonvertical straight line in the plane
# has the property that the ratio
# m = (y₂ + y₁ )/(x₂ - x₁)
# has the same value for every pair of points
# P₁ = (x₁, y₁) and P₂ = (x₂, y₂)
# on the line
# - the value of m is the slope of the line
# - see example, similar triangles
xy_plane_4 = XYPlane(Origin=Point(0, 0, 0))  # disabled
construct_domain_9 = ConstructDomain(DomainStart=number_slider_32, DomainEnd=number_slider_33)  # disabled
range_21 = Range(Domain=construct_domain_9, Steps=number_slider_34)  # disabled
construct_point_48 = ConstructPoint(XCoordinate=range_21, YCoordinate=0, ZCoordinate=0)  # disabled
construct_point_49 = ConstructPoint(XCoordinate=0, YCoordinate=range_21, ZCoordinate=0)  # disabled
list_item_16 = ListItem(List=construct_point_48, Index=0, Wrap=True)  # -> Item1, Item; disabled
list_item_17 = ListItem(List=construct_point_49, Index=0, Wrap=True)  # -> Item1, Item; disabled
construct_point_50 = ConstructPoint(XCoordinate=0, YCoordinate=0, ZCoordinate=0)  # disabled
vector_2pt_10 = Vector2Pt(PointA=list_item_16.Item, PointB=list_item_16.Item1, Unitize=False)  # -> Vector, Length; disabled
vector_2pt_11 = Vector2Pt(PointA=list_item_17.Item, PointB=list_item_17.Item1, Unitize=False)  # -> Vector, Length; disabled
negative_19 = Negative(Value=vector_2pt_10.Vector)  # disabled
negative_20 = Negative(Value=vector_2pt_11.Vector)  # disabled
vector_display_22 = VectorDisplay(Anchor=construct_point_50, Vector=vector_2pt_10.Vector)  # disabled
vector_display_23 = VectorDisplay(Anchor=construct_point_50, Vector=negative_19)  # disabled
vector_display_24 = VectorDisplay(Anchor=construct_point_50, Vector=vector_2pt_11.Vector)  # disabled
vector_display_25 = VectorDisplay(Anchor=construct_point_50, Vector=negative_20)  # disabled

# ----
# x-axis and y-axis
number_slider_35 = Slider(-5, range=-5..5)  # disabled
number_slider_36 = Slider(5, range=-5..5)  # disabled
number_slider_37 = Slider(10, range=0..10)  # disabled
xy_plane_5 = XYPlane(Origin=Point(0, 0, 0))  # disabled
construct_domain_10 = ConstructDomain(DomainStart=number_slider_35, DomainEnd=number_slider_36)  # disabled
range_22 = Range(Domain=construct_domain_10, Steps=number_slider_37)  # disabled
construct_point_51 = ConstructPoint(XCoordinate=range_22, YCoordinate=0, ZCoordinate=0)  # disabled
construct_point_52 = ConstructPoint(XCoordinate=0, YCoordinate=range_22, ZCoordinate=0)  # disabled
list_item_18 = ListItem(List=construct_point_51, Index=0, Wrap=True)  # -> Item1, Item; disabled
list_item_19 = ListItem(List=construct_point_52, Index=0, Wrap=True)  # -> Item1, Item; disabled
construct_point_53 = ConstructPoint(XCoordinate=0, YCoordinate=0, ZCoordinate=0)  # disabled
vector_2pt_12 = Vector2Pt(PointA=list_item_18.Item, PointB=list_item_18.Item1, Unitize=False)  # -> Vector, Length; disabled
vector_2pt_13 = Vector2Pt(PointA=list_item_19.Item, PointB=list_item_19.Item1, Unitize=False)  # -> Vector, Length; disabled
negative_21 = Negative(Value=vector_2pt_12.Vector)  # disabled
negative_22 = Negative(Value=vector_2pt_13.Vector)  # disabled
vector_display_26 = VectorDisplay(Anchor=construct_point_53, Vector=vector_2pt_12.Vector)  # disabled
vector_display_27 = VectorDisplay(Anchor=construct_point_53, Vector=negative_21)  # disabled
vector_display_28 = VectorDisplay(Anchor=construct_point_53, Vector=vector_2pt_13.Vector)  # disabled
vector_display_29 = VectorDisplay(Anchor=construct_point_53, Vector=negative_22)  # disabled

x_3 = Slider(2.15, range=-5..5)  # disabled
A = Slider(-1.044, range=-5..5)  # disabled
B = Slider(1.921, range=-5..5)  # disabled
C = Slider(-3.38, range=-5..5)  # disabled

x_4 = Slider(3, range=-5..5)
A_2 = Slider(1, range=-5..5)
C_2 = Slider(5, range=0..5)
B_2 = Slider(0, range=-5..5)

x_5 = Slider(-3, range=-5..5)  # disabled
A_3 = Slider(0.563, range=-5..5)  # disabled
C_3 = Slider(1.13, range=-15..15)  # disabled
B_3 = Slider(0, range=-5..5)  # disabled

# ----
# x-axis and y-axis
number_slider_38 = Slider(5, range=-5..5)  # disabled
negative_23 = Negative(Value=number_slider_38)  # disabled
number_slider_39 = Slider(10, range=0..10)  # disabled
xy_plane_6 = XYPlane(Origin=Point(0, 0, 0))  # disabled
construct_domain_11 = ConstructDomain(DomainStart=negative_23, DomainEnd=number_slider_38)  # disabled
range_23 = Range(Domain=construct_domain_11, Steps=number_slider_39)  # disabled
construct_point_54 = ConstructPoint(XCoordinate=range_23, YCoordinate=0, ZCoordinate=0)  # disabled
construct_point_55 = ConstructPoint(XCoordinate=0, YCoordinate=range_23, ZCoordinate=0)  # disabled
list_item_20 = ListItem(List=construct_point_54, Index=0, Wrap=True)  # -> Item1, Item; disabled
list_item_21 = ListItem(List=construct_point_55, Index=0, Wrap=True)  # -> Item1, Item; disabled
construct_point_56 = ConstructPoint(XCoordinate=0, YCoordinate=0, ZCoordinate=0)  # disabled
vector_2pt_14 = Vector2Pt(PointA=list_item_20.Item, PointB=list_item_20.Item1, Unitize=False)  # -> Vector, Length; disabled
vector_2pt_15 = Vector2Pt(PointA=list_item_21.Item, PointB=list_item_21.Item1, Unitize=False)  # -> Vector, Length; disabled
negative_24 = Negative(Value=vector_2pt_14.Vector)  # disabled
negative_25 = Negative(Value=vector_2pt_15.Vector)  # disabled
vector_display_30 = VectorDisplay(Anchor=construct_point_56, Vector=vector_2pt_14.Vector)  # disabled
vector_display_31 = VectorDisplay(Anchor=construct_point_56, Vector=negative_24)  # disabled
vector_display_32 = VectorDisplay(Anchor=construct_point_56, Vector=vector_2pt_15.Vector)  # disabled
vector_display_33 = VectorDisplay(Anchor=construct_point_56, Vector=negative_25)  # disabled

x_6 = Slider(5, range=-5..5)  # disabled
A_4 = Slider(-3.514, range=-5..5)  # disabled
C_4 = Slider(-1.69, range=-15..15)  # disabled
B_4 = Slider(2.11, range=-5..5)  # disabled

number_slider_40 = Slider(5, range=0..10)  # disabled
number_slider_41 = Slider(5, range=0..10)  # disabled
number_slider_42 = Slider(5, range=0..10)  # disabled
panel_120 = Panel("x^2 + y^2 - 2*x + 4*y = 4")  # disabled
panel_121 = Panel("(x - 1)^2 + (y + 2)^2 = 1 + 4 + 4 = 9 = 3^2")  # disabled
panel_122 = Panel("y = Sqrt(9 - (x - 1)^2) - 2 ")  # disabled
panel_123 = Panel("5")  # disabled
A_5 = Slider(1, range=-5..5)  # disabled
B_5 = Slider(-0.42, range=-3..3.01)  # disabled
A_6 = Slider(1, range=-3..3.01)  # disabled
negative_26 = Negative(Value=number_slider_40)  # disabled
negative_27 = Negative(Value=number_slider_41)  # disabled
negative_28 = Negative(Value=panel_123)  # disabled
negative_29 = Negative(Value=number_slider_42)  # disabled
number_slider_43 = Slider(100, range=0..100)  # disabled
number_slider_44 = Slider(100, range=0..100)  # disabled
number_slider_45 = Slider(100, range=0..100)  # disabled
number_slider_46 = Slider(100, range=0..100)  # disabled
construct_domain_12 = ConstructDomain(DomainStart=negative_26, DomainEnd=number_slider_40)  # disabled
construct_domain_13 = ConstructDomain(DomainStart=negative_27, DomainEnd=number_slider_41)  # disabled
construct_domain_14 = ConstructDomain(DomainStart=negative_28, DomainEnd=panel_123)  # disabled
construct_domain_15 = ConstructDomain(DomainStart=negative_29, DomainEnd=number_slider_42)  # disabled
A_7 = Slider(-1, range=-3..3.01)  # disabled
B_6 = Slider(0.66, range=-3..3.01)  # disabled
number_slider_47 = Slider(-2, range=-5..5)  # disabled
number_slider_48 = Slider(-3, range=-5..5)  # disabled
range_24 = Range(Domain=construct_domain_12, Steps=number_slider_43)  # disabled
range_25 = Range(Domain=construct_domain_13, Steps=number_slider_44)  # disabled
range_26 = Range(Domain=construct_domain_14, Steps=number_slider_45)  # disabled
range_27 = Range(Domain=construct_domain_15, Steps=number_slider_46)  # disabled
expression_11 = Expression(x=range_26, A=A_7, B=B_6, Cx=number_slider_47, Cy=number_slider_48, Expression="(Sqrt(9 - (A * x - Cx)^2) - Cy)/B ")  # disabled
expression_12 = Expression(x=range_26, A=A_7, B=B_6, Cx=number_slider_47, Cy=number_slider_48, Expression="(Sqrt(9 - (A * x - Cx)^2) + Cy)/B ")  # disabled
expression_13 = Expression(x=range_25, A=A_6, B=B_5, Expression="(Sqrt(9 - (A * x - 1)^2) - 2)/B ")  # disabled
expression_14 = Expression(x=range_25, A=A_6, B=B_5, Expression="(Sqrt(9 - (A * x - 1)^2) + 2)/B ")  # disabled
expression_15 = Expression(x=range_27, A=A_5, Expression="Sqrt(9 - (A * x - 1)^2) - 2 ")  # disabled
expression_16 = Expression(x=range_27, A=A_5, Expression="Sqrt(9 - (A * x - 1)^2) + 2 ")  # disabled
expression_17 = Expression(x=range_24, Expression="Sqrt(9 - (x - 1)^2) + 2 ")  # disabled
expression_18 = Expression(x=range_24, Expression="Sqrt(9 - (x - 1)^2) - 2 ")  # disabled
negative_30 = Negative(Value=expression_17)  # disabled
negative_31 = Negative(Value=expression_12)  # disabled
negative_32 = Negative(Value=expression_16)  # disabled
negative_33 = Negative(Value=expression_14)  # disabled
boolean_toggle_4 = BooleanToggle(False)  # disabled
construct_point_57 = ConstructPoint(XCoordinate=range_24, YCoordinate=expression_18, ZCoordinate=0)  # disabled
construct_point_58 = ConstructPoint(XCoordinate=range_24, YCoordinate=negative_30, ZCoordinate=0)  # disabled
construct_point_59 = ConstructPoint(XCoordinate=range_27, YCoordinate=expression_15, ZCoordinate=0)  # disabled
construct_point_60 = ConstructPoint(XCoordinate=range_27, YCoordinate=negative_32, ZCoordinate=0)  # disabled
construct_point_61 = ConstructPoint(XCoordinate=range_25, YCoordinate=expression_13, ZCoordinate=0)  # disabled
construct_point_62 = ConstructPoint(XCoordinate=range_25, YCoordinate=negative_33, ZCoordinate=0)  # disabled
construct_point_63 = ConstructPoint(XCoordinate=range_26, YCoordinate=expression_11, ZCoordinate=0)  # disabled
construct_point_64 = ConstructPoint(XCoordinate=range_26, YCoordinate=negative_31, ZCoordinate=0)  # disabled
interpolate_12 = Interpolate(Vertices=construct_point_57, Degree=3, Periodic=False, KnotStyle=1)  # -> Curve, Length, Domain; disabled
interpolate_13 = Interpolate(Vertices=construct_point_58, Degree=3, Periodic=False, KnotStyle=1)  # -> Curve, Length, Domain; disabled
interpolate_14 = Interpolate(Vertices=construct_point_59, Degree=3, Periodic=boolean_toggle_4, KnotStyle=1)  # -> Curve, Length, Domain; disabled
interpolate_15 = Interpolate(Vertices=construct_point_60, Degree=3, Periodic=boolean_toggle_4, KnotStyle=1)  # -> Curve, Length, Domain; disabled
interpolate_16 = Interpolate(Vertices=construct_point_61, Degree=3, Periodic=boolean_toggle_4, KnotStyle=1)  # -> Curve, Length, Domain; disabled
interpolate_17 = Interpolate(Vertices=construct_point_62, Degree=3, Periodic=boolean_toggle_4, KnotStyle=1)  # -> Curve, Length, Domain; disabled
interpolate_18 = Interpolate(Vertices=construct_point_63, Degree=3, Periodic=boolean_toggle_4, KnotStyle=1)  # -> Curve, Length, Domain; disabled
interpolate_19 = Interpolate(Vertices=construct_point_64, Degree=3, Periodic=boolean_toggle_4, KnotStyle=1)  # -> Curve, Length, Domain; disabled
join_curves_2 = JoinCurves(Curves=[interpolate_12.Curve, interpolate_13.Curve], Preserve=False)  # disabled
join_curves_3 = JoinCurves(Curves=[interpolate_14.Curve, interpolate_15.Curve], Preserve=False)  # disabled
join_curves_4 = JoinCurves(Curves=[interpolate_16.Curve, interpolate_17.Curve], Preserve=False)  # disabled
join_curves_5 = JoinCurves(Curves=[interpolate_18.Curve, interpolate_19.Curve], Preserve=False)  # disabled

panel_124 = Panel("-2")  # disabled
panel_125 = Panel("1")  # disabled
number_slider_49 = Slider(3, range=0..10)  # disabled
construct_point_65 = ConstructPoint(XCoordinate=panel_125, YCoordinate=panel_124, ZCoordinate=0)  # disabled
circle_5 = Circle(Plane=construct_point_65, Radius=number_slider_49)  # disabled

# ----
# x-axis and y-axis
# Creating a parabola with vertex at (2, -4) and a vertical axis
# or
# identifying the graph of the equation
# y = x^2 -  4x
# note the equation can be written
# y = (x -2)^2 - 4
number_slider_50 = Slider(15, range=-15..15)  # disabled
negative_34 = Negative(Value=number_slider_50)  # disabled
number_slider_51 = Slider(10, range=0..10)  # disabled
xy_plane_7 = XYPlane(Origin=Point(0, 0, 0))  # disabled
construct_domain_16 = ConstructDomain(DomainStart=negative_34, DomainEnd=number_slider_50)  # disabled
range_28 = Range(Domain=construct_domain_16, Steps=number_slider_51)  # disabled
construct_point_66 = ConstructPoint(XCoordinate=range_28, YCoordinate=0, ZCoordinate=0)  # disabled
construct_point_67 = ConstructPoint(XCoordinate=0, YCoordinate=range_28, ZCoordinate=0)  # disabled
list_item_22 = ListItem(List=construct_point_66, Index=0, Wrap=True)  # -> Item1, Item; disabled
list_item_23 = ListItem(List=construct_point_67, Index=0, Wrap=True)  # -> Item1, Item; disabled
construct_point_68 = ConstructPoint(XCoordinate=0, YCoordinate=0, ZCoordinate=0)  # disabled
vector_2pt_16 = Vector2Pt(PointA=list_item_22.Item, PointB=list_item_22.Item1, Unitize=False)  # -> Vector, Length; disabled
vector_2pt_17 = Vector2Pt(PointA=list_item_23.Item, PointB=list_item_23.Item1, Unitize=False)  # -> Vector, Length; disabled
negative_35 = Negative(Value=vector_2pt_16.Vector)  # disabled
negative_36 = Negative(Value=vector_2pt_17.Vector)  # disabled
vector_display_34 = VectorDisplay(Anchor=construct_point_68, Vector=vector_2pt_16.Vector)  # disabled
vector_display_35 = VectorDisplay(Anchor=construct_point_68, Vector=negative_35)  # disabled
vector_display_36 = VectorDisplay(Anchor=construct_point_68, Vector=vector_2pt_17.Vector)  # disabled
vector_display_37 = VectorDisplay(Anchor=construct_point_68, Vector=negative_36)  # disabled

# ----
# Note: there is no parabola tool in vanilla grasshopper*
panel_126 = Panel("-2")  # disabled
panel_127 = Panel("1")  # disabled
number_slider_52 = Slider(3, range=0..10)  # disabled
construct_point_69 = ConstructPoint(XCoordinate=panel_127, YCoordinate=panel_126, ZCoordinate=0)  # disabled
circle_6 = Circle(Plane=construct_point_69, Radius=number_slider_52)  # disabled

panel_128 = Panel("x^2 - 4")  # disabled
panel_129 = Panel("A(x - B)^2 - C")  # disabled
panel_130 = Panel("(x - 2)^2 - 4")  # disabled
number_slider_53 = Slider(5, range=0..10)  # disabled
number_slider_54 = Slider(5, range=0..10)  # disabled
number_slider_55 = Slider(5, range=0..10)  # disabled
A_8 = Slider(-0.15, range=-5..5)  # disabled
B_7 = Slider(-0.18, range=-3..3.01)  # disabled
A_9 = Slider(0.3, range=-3..3.01)  # disabled
C_5 = Slider(-1.49, range=-5..5)  # disabled
negative_37 = Negative(Value=number_slider_53)  # disabled
negative_38 = Negative(Value=number_slider_54)  # disabled
negative_39 = Negative(Value=number_slider_55)  # disabled
number_slider_56 = Slider(100, range=0..100)  # disabled
number_slider_57 = Slider(100, range=0..100)  # disabled
number_slider_58 = Slider(100, range=0..100)  # disabled
construct_domain_17 = ConstructDomain(DomainStart=negative_37, DomainEnd=number_slider_53)  # disabled
construct_domain_18 = ConstructDomain(DomainStart=negative_38, DomainEnd=number_slider_54)  # disabled
construct_domain_19 = ConstructDomain(DomainStart=negative_39, DomainEnd=number_slider_55)  # disabled
range_29 = Range(Domain=construct_domain_17, Steps=number_slider_56)  # disabled
range_30 = Range(Domain=construct_domain_18, Steps=number_slider_57)  # disabled
range_31 = Range(Domain=construct_domain_19, Steps=number_slider_58)  # disabled
expression_19 = Expression(x=range_30, A=A_9, B=B_7, C=C_5, Expression="A*(x - B)^2 - C ")  # disabled
expression_20 = Expression(x=range_30, A=A_9, B=B_7, C=C_5, Expression="A*(x - B)^2 - C ")  # disabled
expression_21 = Expression(x=range_31, A=A_8, Expression="A*(x - 2)^2 - 4")  # disabled
expression_22 = Expression(x=range_31, A=A_8, Expression="A*(x - 2)^2 - 4  ")  # disabled
expression_23 = Expression(x=range_29, Expression="(x - 2)^2 - 4 ")  # disabled
expression_24 = Expression(x=range_29, Expression="(x - 2)^2 - 4 ")  # disabled
negative_40 = Negative(Value=expression_24)  # disabled
negative_41 = Negative(Value=expression_22)  # disabled
negative_42 = Negative(Value=expression_19)  # disabled
boolean_toggle_5 = BooleanToggle(False)  # disabled
construct_point_70 = ConstructPoint(XCoordinate=range_29, YCoordinate=expression_23, ZCoordinate=0)  # disabled
construct_point_71 = ConstructPoint(XCoordinate=range_29, YCoordinate=negative_40, ZCoordinate=0)  # disabled
construct_point_72 = ConstructPoint(XCoordinate=range_31, YCoordinate=expression_21, ZCoordinate=0)  # disabled
construct_point_73 = ConstructPoint(XCoordinate=range_31, YCoordinate=negative_41, ZCoordinate=0)  # disabled
construct_point_74 = ConstructPoint(XCoordinate=range_30, YCoordinate=expression_20, ZCoordinate=0)  # disabled
construct_point_75 = ConstructPoint(XCoordinate=range_30, YCoordinate=negative_42, ZCoordinate=0)  # disabled
interpolate_20 = Interpolate(Vertices=construct_point_70, Degree=3, Periodic=False, KnotStyle=1)  # -> Curve, Length, Domain; disabled
interpolate_21 = Interpolate(Vertices=construct_point_71, Degree=3, Periodic=False, KnotStyle=1)  # -> Curve, Length, Domain; disabled
interpolate_22 = Interpolate(Vertices=construct_point_72, Degree=3, Periodic=boolean_toggle_5, KnotStyle=1)  # -> Curve, Length, Domain; disabled
interpolate_23 = Interpolate(Vertices=construct_point_73, Degree=3, Periodic=boolean_toggle_5, KnotStyle=1)  # -> Curve, Length, Domain; disabled
interpolate_24 = Interpolate(Vertices=construct_point_74, Degree=3, Periodic=boolean_toggle_5, KnotStyle=1)  # -> Curve, Length, Domain; disabled
interpolate_25 = Interpolate(Vertices=construct_point_75, Degree=3, Periodic=boolean_toggle_5, KnotStyle=1)  # -> Curve, Length, Domain; disabled
join_curves_6 = JoinCurves(Curves=[interpolate_24.Curve, interpolate_25.Curve], Preserve=False)  # disabled
join_curves_7 = JoinCurves(Curves=[interpolate_22.Curve, interpolate_23.Curve], Preserve=False)  # disabled
join_curves_8 = JoinCurves(Curves=[interpolate_20.Curve, interpolate_21.Curve], Preserve=False)  # disabled

# ----
# Motion of a Falling Rock
ho_2 = Slider(5, range=0.01..5)  # disabled
# The Absolute Value
# |x| = {x, if x >= 0 or x, if x < 0}
# - geometrically, |x| represents the (nonnegative)
# distance form x to 0 on the real number line
# - more generally
# |x - y| = {x - y, if x >= y or x - y, if x < y}
# - geometrically, |x - y| represents the (nonnegative)
# distance between points x and y on the real number line
# since this distance is the same as that from
# the point x - y to 0
# 
# the Absolute Value has the following properties:
# - For any real numbers a and b,
# |ab| = |a||b|
# |a +- b| <= |a| + |b| (The Triangle Inequality)
t_2 = Slider(1.08, range=0.01..1.25)  # disabled
panel_131 = Panel("2")  # disabled
panel_132 = Panel("5")  # disabled
number_slider_59 = Slider(0.2, range=0..1)  # disabled
panel_133 = Panel("   y = h(t)")  # disabled
panel_134 = Panel("t")  # disabled
panel_135 = Panel("y    ")  # disabled
panel_136 = Panel("ho   ")  # disabled
panel_137 = Panel("1")  # disabled
panel_138 = Panel(".1")  # disabled
negative_43 = Negative(Value=panel_138)  # disabled

panel_139 = Panel("100")  # disabled
panel_140 = Panel("1")  # disabled

range_32 = Range(Domain=panel_132, Steps=panel_139)  # disabled
range_33 = Range(Domain=panel_131, Steps=panel_139)  # disabled
range_34 = Range(Domain=t_2, Steps=panel_139)  # disabled
expression_25 = Expression(t=range_34, ho=ho_2, Expression="ho -4.9*(t^2)")  # disabled
construct_point_76 = ConstructPoint(XCoordinate=range_33, YCoordinate=0, ZCoordinate=0)  # disabled
construct_point_77 = ConstructPoint(XCoordinate=0, YCoordinate=range_32, ZCoordinate=0)  # disabled
interpolate_26 = Interpolate(Vertices=construct_point_76, Degree=3, Periodic=False, KnotStyle=1)  # -> Curve, Length, Domain; disabled
interpolate_27 = Interpolate(Vertices=construct_point_77, Degree=3, Periodic=False, KnotStyle=1)  # -> Curve, Length, Domain; disabled
curve_middle_10 = CurveMiddle(Curve=interpolate_26.Curve)  # disabled
curve_middle_11 = CurveMiddle(Curve=interpolate_27.Curve)  # disabled
text_tag_3d_43 = TextTag3D(Location=curve_middle_10, Text=panel_134, Size=number_slider_59, Justification=3)  # disabled
text_tag_3d_44 = TextTag3D(Location=curve_middle_11, Text=panel_135, Size=number_slider_59, Justification=6)  # disabled
offset_curve_3 = OffsetCurve(Curve=interpolate_26.Curve, Distance=panel_138, Corners=1)  # disabled
offset_curve_4 = OffsetCurve(Curve=interpolate_27.Curve, Distance=negative_43, Corners=1)  # disabled
# Coordinates and Graphs
# - the positions of all points on a plane can be measured
# with respect to a pair of perpendicular real lines
# in the plane intersecting at 0-point of each
# - x-axis conventionally is horizontal
# - y-axis conventionally is verticle
# - O denotes the origin
# - P is any point specified by an ordered
# pair (x,y) of real numbers
# - these are called the coordinates of P;
# x measureds the displacement  of P from O
# measured parallel to the x-axis
# y measured the displacement of P from O
# measured parallel to the y-axis
# - the Pythagorean Theorem proves that
# |OP| = Sqrt(x^2 + y^2)
# More generally:
# - the distance between points P₁ = (x₁,  y₁) and
# distance between P₁ = (x₁, y₁) and P₂ = (x₂, y₂) is
# Sqrt((x₂ - x₁)^2 + (y₂ - y₁)^2)
loft_5 = Loft(
    Curves=flatten([interpolate_26.Curve, offset_curve_3]),
    Options={Adjust=False, Closed=False, LoftEnds=0, LoftSimp=0, LoftType=0, Rebuild=10, Refit=0.01})  # disabled
loft_6 = Loft(
    Curves=flatten([interpolate_27.Curve, offset_curve_4]),
    Options={Adjust=False, Closed=False, LoftEnds=0, LoftSimp=0, LoftType=0, Rebuild=10, Refit=0.01})  # disabled

absolute = Absolute(Value=expression_25)  # disabled

construct_point_78 = ConstructPoint(XCoordinate=range_34, YCoordinate=absolute, ZCoordinate=0)  # disabled
interpolate_28 = Interpolate(Vertices=construct_point_78, Degree=panel_140, Periodic=False, KnotStyle=1)  # -> Curve, Length, Domain; disabled
curve_middle_12 = CurveMiddle(Curve=interpolate_28.Curve)  # disabled
end_points_4 = EndPoints(Curve=interpolate_28.Curve)  # -> Start, End; disabled
text_tag_3d_45 = TextTag3D(Location=end_points_4.Start, Text=panel_136, Size=number_slider_59, Justification=6)  # disabled
text_tag_3d_46 = TextTag3D(Location=curve_middle_12, Text=panel_133, Size=number_slider_59, Justification=7)  # disabled
evaluate_curve_7 = EvaluateCurve(Curve=reparameterize(interpolate_28.Curve), Parameter=panel_137)  # -> Point, Tangent, Angle; disabled
circle_7 = Circle(Plane=end_points_4.End, Radius=panel_138)  # disabled
boundary_surfaces_4 = BoundarySurfaces(Edges=circle_7)  # disabled
vector_display_38 = VectorDisplay(Anchor=evaluate_curve_7.Point, Vector=evaluate_curve_7.Tangent)  # disabled

# ----
# similar triangles (slope)
number_slider_60 = Slider(0, range=-10..11)  # disabled
number_slider_61 = Slider(-1, range=-10..11)  # disabled
number_slider_62 = Slider(2, range=-10..11)  # disabled
number_slider_63 = Slider(-5, range=-10..11)  # disabled
number_slider_64 = Slider(-4, range=-10..11)  # disabled
number_slider_65 = Slider(-3, range=-10..11)  # disabled
number_slider_66 = Slider(-3, range=-10..11)  # disabled
number_slider_67 = Slider(4, range=-10..11)  # disabled
construct_point_79 = ConstructPoint(XCoordinate=number_slider_65, YCoordinate=number_slider_66, ZCoordinate=0)  # disabled
construct_point_80 = ConstructPoint(XCoordinate=number_slider_67, YCoordinate=number_slider_62, ZCoordinate=0)  # disabled
construct_point_81 = ConstructPoint(XCoordinate=number_slider_60, YCoordinate=number_slider_61, ZCoordinate=0)  # disabled
construct_point_82 = ConstructPoint(XCoordinate=number_slider_63, YCoordinate=number_slider_64, ZCoordinate=0)  # disabled
deconstruct_10 = Deconstruct(Point=construct_point_79)  # -> XComponent, YComponent, ZComponent; disabled
deconstruct_11 = Deconstruct(Point=construct_point_81)  # -> XComponent, YComponent, ZComponent; disabled
deconstruct_12 = Deconstruct(Point=construct_point_80)  # -> XComponent, YComponent, ZComponent; disabled
deconstruct_13 = Deconstruct(Point=construct_point_82)  # -> XComponent, YComponent, ZComponent; disabled
construct_point_83 = ConstructPoint(XCoordinate=deconstruct_11.XComponent, YCoordinate=deconstruct_10.YComponent, ZCoordinate=0)  # disabled
construct_point_84 = ConstructPoint(XCoordinate=deconstruct_12.XComponent, YCoordinate=deconstruct_13.YComponent, ZCoordinate=0)  # disabled
ghpython_script_2 = GhPythonScript(
    y2=deconstruct_10.YComponent,
    y1=deconstruct_11.YComponent,
    x2=deconstruct_10.XComponent,
    x1=deconstruct_11.XComponent,
    y_prime2=deconstruct_12.YComponent,
    y_prime1=deconstruct_13.YComponent,
    x_prime2=deconstruct_12.XComponent,
    x_prime1=deconstruct_13.XComponent)  # -> out, slope; inputs y2: Int32, y1: Int32, x2: Int32, x1: Int32, y_prime2: Int32, y_prime1: Int32, x_prime2: Int32, x_prime1: Int32; disabled
# ---------- ghpython_script_2: Python ----------
__author__ = "Sculpture"
__version__ = "2021.07.13"

import rhinoscriptsyntax as rs
if (y2 - y1)/(x2 - x1) == (y_prime2 - y_prime1)/(x_prime2 - x_prime1):
    slope = True
else:
    slope = False
# ---------- end ghpython_script_2 ----------
panel_141 = Panel(ghpython_script_2.slope)  # disabled
line_22 = Line(StartPoint=construct_point_79, EndPoint=construct_point_81)  # disabled
line_23 = Line(StartPoint=construct_point_80, EndPoint=construct_point_82)  # disabled
line_24 = Line(StartPoint=construct_point_83, EndPoint=construct_point_79)  # disabled
line_25 = Line(StartPoint=construct_point_81, EndPoint=construct_point_83)  # disabled
line_26 = Line(StartPoint=construct_point_84, EndPoint=construct_point_82)  # disabled
line_27 = Line(StartPoint=construct_point_80, EndPoint=construct_point_84)  # disabled
panel_142 = Panel("  Equal Slope :")  # disabled
curve_middle_13 = CurveMiddle(Curve=line_23)  # disabled
join_curves_9 = JoinCurves(Curves=[line_23, line_26, line_27], Preserve=False)  # disabled
join_curves_10 = JoinCurves(Curves=[line_22, line_24, line_25], Preserve=False)  # disabled
concatenate_9 = Concatenate(FragmentA=panel_142, FragmentB=panel_141)  # disabled

point_on_curve_7 = PointOnCurve(line_23, parameter=0.647)  # disabled

text_tag_3d_47 = TextTag3D(Location=point_on_curve_7, Text=concatenate_9, Size=1, Justification=7)  # disabled

# ----
# x-axis and y-axis
number_slider_68 = Slider(5, range=-5..5)
xy_plane_8 = XYPlane(Origin=Point(0, 0, 0))
construct_point_85 = ConstructPoint(XCoordinate=0, YCoordinate=0, ZCoordinate=0)

negative_44 = Negative(Value=number_slider_68)

construct_domain_20 = ConstructDomain(DomainStart=negative_44, DomainEnd=number_slider_68)
range_35 = Range(Domain=construct_domain_20, Steps=Slider(10, range=0..10))
construct_point_86 = ConstructPoint(XCoordinate=range_35, YCoordinate=0, ZCoordinate=0)
construct_point_87 = ConstructPoint(XCoordinate=0, YCoordinate=range_35, ZCoordinate=0)
list_item_24 = ListItem(List=construct_point_86, Index=0, Wrap=True)  # -> Item1, Item
list_item_25 = ListItem(List=construct_point_87, Index=0, Wrap=True)  # -> Item1, Item
vector_2pt_18 = Vector2Pt(PointA=list_item_24.Item, PointB=list_item_24.Item1, Unitize=False)  # -> Vector, Length
vector_2pt_19 = Vector2Pt(PointA=list_item_25.Item, PointB=list_item_25.Item1, Unitize=False)  # -> Vector, Length
negative_45 = Negative(Value=vector_2pt_18.Vector)
negative_46 = Negative(Value=vector_2pt_19.Vector)
vector_display_39 = VectorDisplay(Anchor=construct_point_85, Vector=vector_2pt_18.Vector)
vector_display_40 = VectorDisplay(Anchor=construct_point_85, Vector=negative_45)
vector_display_41 = VectorDisplay(Anchor=construct_point_85, Vector=vector_2pt_19.Vector)
vector_display_42 = VectorDisplay(Anchor=construct_point_85, Vector=negative_46)

# ----
# x-axis and y-axis
number_slider_69 = Slider(5, range=-5..5)  # disabled
number_slider_70 = Slider(10, range=0..10)  # disabled
xy_plane_9 = XYPlane(Origin=Point(0, 0, 0))  # disabled
construct_point_88 = ConstructPoint(XCoordinate=0, YCoordinate=0, ZCoordinate=0)  # disabled

negative_47 = Negative(Value=number_slider_69)  # disabled

construct_domain_21 = ConstructDomain(DomainStart=negative_47, DomainEnd=number_slider_69)  # disabled
range_36 = Range(Domain=construct_domain_21, Steps=number_slider_70)  # disabled
construct_point_89 = ConstructPoint(XCoordinate=range_36, YCoordinate=0, ZCoordinate=0)  # disabled
construct_point_90 = ConstructPoint(XCoordinate=0, YCoordinate=range_36, ZCoordinate=0)  # disabled
list_item_26 = ListItem(List=construct_point_89, Index=0, Wrap=True)  # -> Item1, Item; disabled
list_item_27 = ListItem(List=construct_point_90, Index=0, Wrap=True)  # -> Item1, Item; disabled
vector_2pt_20 = Vector2Pt(PointA=list_item_26.Item, PointB=list_item_26.Item1, Unitize=False)  # -> Vector, Length; disabled
vector_2pt_21 = Vector2Pt(PointA=list_item_27.Item, PointB=list_item_27.Item1, Unitize=False)  # -> Vector, Length; disabled
negative_48 = Negative(Value=vector_2pt_20.Vector)  # disabled
negative_49 = Negative(Value=vector_2pt_21.Vector)  # disabled
vector_display_43 = VectorDisplay(Anchor=construct_point_88, Vector=vector_2pt_20.Vector)  # disabled
vector_display_44 = VectorDisplay(Anchor=construct_point_88, Vector=negative_48)  # disabled
vector_display_45 = VectorDisplay(Anchor=construct_point_88, Vector=vector_2pt_21.Vector)  # disabled
vector_display_46 = VectorDisplay(Anchor=construct_point_88, Vector=negative_49)  # disabled

# ----
# Wickerson Studios Geometry
number_slider_71 = Slider(15, range=0..15)
number_slider_72 = Slider(5.691, range=0..10)
construct_domain_22 = ConstructDomain(DomainStart=0, DomainEnd=number_slider_71)
range_37 = Range(Domain=construct_domain_22, Steps=Slider(1, range=0..10))
xz_plane = XZPlane(Origin=Point(0, 0, 0))
number_slider_73 = Slider(100, range=0..100)
number_slider_74 = Slider(1, range=0..2)

# ----
# graphing equations
# y = (-(A*x + C))/B
negative_50 = Negative(Value=x_3)  # disabled
construct_domain_23 = ConstructDomain(DomainStart=negative_50, DomainEnd=x_3)  # disabled
panel_143 = Panel("1")  # disabled
range_38 = Range(Domain=construct_domain_23, Steps=panel_143)  # disabled
panel_144 = Panel(".5")  # disabled
panel_145 = Panel("    y = (-(A*x + C))/B")  # disabled
panel_146 = Panel("x")  # disabled
panel_147 = Panel("y    ")  # disabled
panel_148 = Panel(".12")  # disabled

# ----
# expression node
expression_26 = Expression(x=range_38, A=A, B=B, C=C, Expression="(-(A*x + C))/B")  # disabled
panel_149 = Panel(expression_26)  # disabled
construct_point_91 = ConstructPoint(XCoordinate=range_38, YCoordinate=expression_26, ZCoordinate=0)  # disabled
explode_tree = ExplodeTree(Data=graft(construct_point_91))  # -> Branch0, Branch1; disabled
line_28 = Line(StartPoint=explode_tree.Branch0, EndPoint=explode_tree.Branch1)  # disabled

# ----
# python node
ghpython_script_3 = GhPythonScript(x=range_38, A=A, B=B, C=C)  # -> out, y; disabled
# ---------- ghpython_script_3: Python ----------
__author__ = "Sculpture"
__version__ = "2021.07.13"

import rhinoscriptsyntax as rs
if B != 0:
    y = (-(A*x + C))/B
    
else:
    print("divided by 0: error")
# ---------- end ghpython_script_3 ----------
panel_150 = Panel(ghpython_script_3.out)  # disabled
construct_point_92 = ConstructPoint(XCoordinate=range_38, YCoordinate=ghpython_script_3.y, ZCoordinate=0)  # disabled
explode_tree_2 = ExplodeTree(Data=graft(construct_point_92))  # -> Branch0, Branch1; disabled
line_29 = Line(StartPoint=explode_tree_2.Branch0, EndPoint=explode_tree_2.Branch1)  # disabled

# ----
# any P₁ = (x₁, y₁)
number_slider_75 = Slider(0.24, range=0..1)  # disabled
evaluate_curve_8 = EvaluateCurve(Curve=reparameterize(line_29), Parameter=number_slider_75)  # -> Point, Tangent, Angle; disabled
panel_151 = Panel(evaluate_curve_8.Point)  # disabled
text_tag_3d_48 = TextTag3D(Location=evaluate_curve_8.Point, Text=panel_151, Size=panel_148, Justification=7)  # disabled

evaluate_curve_9 = EvaluateCurve(Curve=reparameterize(line_29), Parameter=panel_144)  # -> Point, Tangent, Angle; disabled
deconstruct_14 = Deconstruct(Point=construct_point_92)  # -> XComponent, YComponent, ZComponent; disabled
deconstruct_15 = Deconstruct(Point=construct_point_92)  # -> XComponent, YComponent, ZComponent; disabled
construct_point_93 = ConstructPoint(XCoordinate=deconstruct_14.XComponent, YCoordinate=0, ZCoordinate=0)  # disabled
construct_point_94 = ConstructPoint(XCoordinate=0, YCoordinate=deconstruct_15.YComponent, ZCoordinate=0)  # disabled
point_on_curve_8 = PointOnCurve(line_29, parameter=0.843)  # disabled
list_item_28 = ListItem(List=construct_point_93, Index=0, Wrap=True)  # -> Item1, Item; disabled
list_item_29 = ListItem(List=construct_point_94, Index=0, Wrap=True)  # -> Item1, Item; disabled
point_7 = Point(list_item_28.Item1)  # disabled
point_8 = Point(list_item_29.Item1)  # disabled

# ----
# y-intercept
panel_152 = Panel(evaluate_curve_9.Point)  # disabled

text_tag_3d_49 = TextTag3D(Location=point_7, Text=panel_146, Size=panel_148, Justification=1)  # disabled
text_tag_3d_50 = TextTag3D(Location=point_8, Text=panel_147, Size=panel_148, Justification=9)  # disabled
text_tag_3d_51 = TextTag3D(Location=point_on_curve_8, Text=panel_145, Size=panel_148, Justification=7)  # disabled
text_tag_3d_52 = TextTag3D(Location=evaluate_curve_9.Point, Text=panel_152, Size=panel_148, Justification=7)  # disabled
text_tag_3d_53 = TextTag3D(Location=evaluate_curve_9.Point, Text=panel_152, Size=panel_148, Justification=7)  # disabled

# ----
# Quadratic Equation in Standard Form:
# ax2 + bx + c = 0 ·
# Quadratic Equations can be factored · Quadratic Formula:
# x = −b ± √(b2 − 4ac) 2a
# graphing equations
negative_51 = Negative(Value=x_4)
construct_domain_24 = ConstructDomain(DomainStart=negative_51, DomainEnd=x_4)
range_39 = Range(Domain=construct_domain_24, Steps=Slider(20, range=0..20))
expression_27 = Expression(x=range_39, A=A_2, B=B_2, C=C_2, Expression="Sqrt(C - B*x - A*x^2)")
negative_52 = Negative(Value=expression_27)

addition = Addition(A=expression_27, B=number_slider_72)
addition_2 = Addition(A=negative_52, B=number_slider_72)

# ----
# graphing equations
# y = A*x² + B*x + C
negative_53 = Negative(Value=x_5)  # disabled
construct_domain_25 = ConstructDomain(DomainStart=negative_53, DomainEnd=x_5)  # disabled
number_slider_76 = Slider(20, range=0..20)  # disabled
range_40 = Range(Domain=construct_domain_25, Steps=number_slider_76)  # disabled
panel_153 = Panel(".5")  # disabled
panel_154 = Panel("    y = A*x^2 + B*x + C")  # disabled
panel_155 = Panel("___________")  # disabled
panel_156 = Panel("x")  # disabled
panel_157 = Panel("y    ")  # disabled
panel_158 = Panel(".2")  # disabled

# ----
# expression node
expression_28 = Expression(x=range_39, A=A_2, B=B_2, C=C_2, Expression="Sqrt(C - x^2)")
panel_159 = Panel(expression_27)
construct_point_95 = ConstructPoint(XCoordinate=range_39, YCoordinate=addition, ZCoordinate=0)

construct_point_96 = ConstructPoint(XCoordinate=range_39, YCoordinate=addition_2, ZCoordinate=range_37)  # -> reverse(Point)
list_item_30 = ListItem(List=construct_point_95, Index=0, Wrap=True)  # -> Item1, Item
list_item_31 = ListItem(List=construct_point_96, Index=0, Wrap=True)  # -> Item1, Item
interpolate_29 = Interpolate(Vertices=[construct_point_95, construct_point_96], Degree=3, Periodic=Toggle(True), KnotStyle=1)  # -> Curve, Length, Domain
line_30 = Line(StartPoint=list_item_31.Item1, EndPoint=list_item_31.Item)
deconstruct_16 = Deconstruct(Point=construct_point_96)  # -> XComponent, YComponent, ZComponent
deconstruct_17 = Deconstruct(Point=construct_point_96)  # -> XComponent, YComponent, ZComponent
construct_point_97 = ConstructPoint(XCoordinate=deconstruct_16.XComponent, YCoordinate=0, ZCoordinate=0)
construct_point_98 = ConstructPoint(XCoordinate=0, YCoordinate=deconstruct_17.YComponent, ZCoordinate=0)
point_on_curve_9 = PointOnCurve(interpolate_29.Curve, parameter=0.039)
list_item_32 = ListItem(List=construct_point_97, Index=0, Wrap=True)  # -> Item1, Item
list_item_33 = ListItem(List=construct_point_98, Index=0, Wrap=True)  # -> Item1, Item
point_9 = Point(list_item_32.Item1)
point_10 = Point(list_item_33.Item1)

mirror = Mirror(Geometry=interpolate_29.Curve, Plane=xz_plane)  # -> Geometry, Transform
loft_7 = Loft(
    Curves=[interpolate_29.Curve, mirror.Geometry],
    Options={Adjust=False, Closed=False, LoftEnds=0, LoftSimp=0, LoftType=0, Rebuild=10, Refit=0.01})
surface_3 = Surface(reparameterize(loft_7))
divide_surface = DivideSurface(Surface=surface_3, UCount=number_slider_73, VCount=number_slider_73)  # -> Points, Normals, Parameters
negative_54 = Negative(Value=divide_surface.Normals)
amplitude = Amplitude(Vector=negative_54, Amplitude=Slider(1.59, range=0..10))
move_3 = Move(Geometry=divide_surface.Points, Motion=amplitude)  # -> Geometry, Transform
surface_from_points = SurfaceFromPoints(Points=flatten(move_3.Geometry), UCount=expr("x+1", number_slider_73), Interpolate=False)
deconstruct_brep = DeconstructBrep(Brep=surface_from_points)  # -> Faces, Edges, Vertices
deconstruct_brep_2 = DeconstructBrep(Brep=loft_7)  # -> Faces, Edges, Vertices
list_item_34 = ListItem(List=deconstruct_brep_2.Edges, Index=number_slider_74, Wrap=True)  # -> Item1, Item, Item1_2
list_item_35 = ListItem(List=deconstruct_brep.Edges, Index=number_slider_74, Wrap=True)  # -> Item1, Item, Item1_2
curve_3 = Curve(list_item_34.Item)
curve_4 = Curve(list_item_34.Item1_2)
curve_5 = Curve(list_item_35.Item)
curve_6 = Curve(list_item_35.Item1_2)
loft_8 = Loft(
    Curves=flatten([curve_3, curve_5]),
    Options={Adjust=False, Closed=False, LoftEnds=0, LoftSimp=0, LoftType=0, Rebuild=10, Refit=0.01})
loft_9 = Loft(
    Curves=flatten([curve_4, curve_6]),
    Options={Adjust=False, Closed=False, LoftEnds=0, LoftSimp=0, LoftType=0, Rebuild=10, Refit=0.01})
merge_3 = Merge(Data1=loft_8, Data2=loft_9, Data3=surface_from_points, Data4=loft_7)  # -> flatten(Result)
brep_join = BrepJoin(Breps=merge_3)  # -> Breps, Closed

line_31 = Line(StartPoint=list_item_30.Item1, EndPoint=list_item_30.Item)

# ----
# any P₁ = (x₁, y₁)
number_slider_77 = Slider(0.94, range=0..1)
evaluate_curve_10 = EvaluateCurve(Curve=reparameterize(interpolate_29.Curve), Parameter=number_slider_77)  # -> Point, Tangent, Angle
panel_160 = Panel(evaluate_curve_10.Point)
text_tag_3d_54 = TextTag3D(Location=evaluate_curve_10.Point, Text=panel_160, Size=".12", Justification=7)

text_tag_3d_55 = TextTag3D(Location=point_9, Text="x", Size=".12", Justification=1)
text_tag_3d_56 = TextTag3D(Location=point_10, Text="y    ", Size=".12", Justification=9)
text_tag_3d_57 = TextTag3D(Location=point_on_curve_9, Text="    y = +- Sqrt(C - B*x - A*x^2)", Size=".12", Justification=7)

# ----
# expression node
expression_29 = Expression(x=range_40, A=A_3, B=B_3, C=C_3, Expression="A*x² + B*x + C")  # disabled
construct_point_99 = ConstructPoint(XCoordinate=range_40, YCoordinate=expression_29, ZCoordinate=0)  # disabled
panel_161 = Panel(expression_29)  # disabled

negative_55 = Negative(Value=expression_29)  # disabled
construct_point_100 = ConstructPoint(XCoordinate=range_40, YCoordinate=negative_55, ZCoordinate=0)  # disabled
list_item_36 = ListItem(List=construct_point_99, Index=0, Wrap=True)  # -> Item1, Item; disabled
list_item_37 = ListItem(List=construct_point_100, Index=0, Wrap=True)  # -> Item1, Item; disabled
interpolate_30 = Interpolate(Vertices=construct_point_99, Degree=3, Periodic=False, KnotStyle=1)  # -> Curve, Length, Domain; disabled
interpolate_31 = Interpolate(Vertices=construct_point_100, Degree=3, Periodic=False, KnotStyle=1)  # -> Curve, Length, Domain; disabled
evaluate_curve_11 = EvaluateCurve(Curve=reparameterize([interpolate_31.Curve, interpolate_30.Curve]), Parameter=panel_153)  # -> Point, Tangent, Angle; disabled
line_32 = Line(StartPoint=list_item_37.Item1, EndPoint=list_item_37.Item)  # disabled
deconstruct_18 = Deconstruct(Point=construct_point_100)  # -> XComponent, YComponent, ZComponent; disabled
deconstruct_19 = Deconstruct(Point=construct_point_100)  # -> XComponent, YComponent, ZComponent; disabled
construct_point_101 = ConstructPoint(XCoordinate=deconstruct_18.XComponent, YCoordinate=0, ZCoordinate=0)  # disabled
construct_point_102 = ConstructPoint(XCoordinate=0, YCoordinate=deconstruct_19.YComponent, ZCoordinate=0)  # disabled
point_on_curve_10 = PointOnCurve(interpolate_30.Curve, parameter=0.843)  # disabled
point_on_curve_11 = PointOnCurve(interpolate_31.Curve, parameter=0.843)  # disabled
list_item_38 = ListItem(List=construct_point_101, Index=0, Wrap=True)  # -> Item1, Item; disabled
list_item_39 = ListItem(List=construct_point_102, Index=0, Wrap=True)  # -> Item1, Item; disabled
point_11 = Point(list_item_38.Item1)  # disabled
point_12 = Point(list_item_39.Item1)  # disabled

# ----
# any P₁ = (x₁, y₁)
number_slider_78 = Slider(0.73, range=0..1)  # disabled
evaluate_curve_12 = EvaluateCurve(Curve=reparameterize([interpolate_31.Curve, interpolate_30.Curve]), Parameter=number_slider_78)  # -> Point, Tangent, Angle; disabled
panel_162 = Panel(evaluate_curve_12.Point)  # disabled
text_tag_3d_58 = TextTag3D(Location=evaluate_curve_12.Point, Text=panel_162, Size=panel_158, Justification=7)  # disabled

line_33 = Line(StartPoint=list_item_36.Item1, EndPoint=list_item_36.Item)  # disabled

# ----
# y-intercept
panel_163 = Panel(evaluate_curve_11.Point)  # disabled

concatenate_10 = Concatenate(FragmentA=panel_155, FragmentB=panel_163)  # disabled

text_tag_3d_59 = TextTag3D(Location=point_11, Text=panel_156, Size=panel_158, Justification=1)  # disabled
text_tag_3d_60 = TextTag3D(Location=point_12, Text=panel_157, Size=panel_158, Justification=9)  # disabled
text_tag_3d_61 = TextTag3D(Location=[point_on_curve_10, point_on_curve_11], Text=panel_154, Size=panel_158, Justification=7)  # disabled
text_tag_3d_62 = TextTag3D(Location=evaluate_curve_11.Point, Text=concatenate_10, Size=panel_158, Justification=7)  # disabled
text_tag_3d_63 = TextTag3D(Location=evaluate_curve_11.Point, Text=concatenate_10, Size=panel_158, Justification=7)  # disabled

# ----
# graphing equations
negative_56 = Negative(Value=x_6)  # disabled
construct_domain_26 = ConstructDomain(DomainStart=negative_56, DomainEnd=x_6)  # disabled
number_slider_79 = Slider(20, range=0..20)  # disabled
range_41 = Range(Domain=construct_domain_26, Steps=number_slider_79)  # disabled
expression_30 = Expression(x=range_41, A=A_4, B=B_4, C=C_4, Expression="Sqrt(25 - (x + 1)^2)")  # disabled
expression_31 = Expression(x=range_41, A=A_4, B=B_4, C=C_4, Expression="Sqrt(25 - (x^2)) + 3")  # disabled
expression_32 = Expression(x=range_41, A=A_4, B=B_4, C=C_4, Expression="Sqrt(x^2 + x*A + 2)")  # disabled
expression_33 = Expression(x=range_41, A=A_4, B=B_4, C=C_4, Expression="Sqrt(16 - x^2)")  # disabled
expression_34 = Expression(x=range_41, A=A_4, B=B_4, C=C_4, Expression="Sqrt(25 - x^2)")  # disabled
expression_35 = Expression(x=range_41, A=A_4, B=B_4, C=C_4, Expression="2 + (x - 1)/3")  # disabled
expression_36 = Expression(x=range_41, A=A_4, B=B_4, C=C_4, Expression="x^2 + x*2 + 2")  # disabled
expression_37 = Expression(x=range_41, A=A_4, B=B_4, C=C_4, Expression="1 - x^2")  # disabled
expression_38 = Expression(x=range_41, A=A_4, B=B_4, C=C_4, Expression="2 - x")  # disabled
expression_39 = Expression(x=range_41, A=A_4, B=B_4, C=C_4, Expression="-1")  # disabled
negative_57 = Negative(Value=expression_32)  # disabled
construct_point_103 = ConstructPoint(XCoordinate=range_41, YCoordinate=negative_57, ZCoordinate=0)  # disabled
boolean_toggle_6 = BooleanToggle(False)  # disabled
boolean_toggle_7 = BooleanToggle(False)  # disabled
panel_164 = Panel(".5")  # disabled
list_item_40 = ListItem(List=construct_point_103, Index=0, Wrap=True)  # -> Item1, Item; disabled
interpolate_32 = Interpolate(Vertices=construct_point_103, Degree=3, Periodic=boolean_toggle_6, KnotStyle=1)  # -> Curve, Length, Domain; disabled
line_34 = Line(StartPoint=list_item_40.Item1, EndPoint=list_item_40.Item)  # disabled
deconstruct_20 = Deconstruct(Point=construct_point_103)  # -> XComponent, YComponent, ZComponent; disabled
deconstruct_21 = Deconstruct(Point=construct_point_103)  # -> XComponent, YComponent, ZComponent; disabled
panel_165 = Panel("    y = A*x^2 + B*x + C")  # disabled
panel_166 = Panel("___________")  # disabled
panel_167 = Panel("x")  # disabled
construct_point_104 = ConstructPoint(XCoordinate=deconstruct_20.XComponent, YCoordinate=0, ZCoordinate=0)  # disabled
panel_168 = Panel("y    ")  # disabled
construct_point_105 = ConstructPoint(XCoordinate=0, YCoordinate=deconstruct_21.YComponent, ZCoordinate=0)  # disabled
panel_169 = Panel(".2")  # disabled
point_on_curve_12 = PointOnCurve(interpolate_32.Curve, parameter=0.843)  # disabled
list_item_41 = ListItem(List=construct_point_104, Index=0, Wrap=True)  # -> Item1, Item; disabled
list_item_42 = ListItem(List=construct_point_105, Index=0, Wrap=True)  # -> Item1, Item; disabled
point_13 = Point(list_item_41.Item1)  # disabled
point_14 = Point(list_item_42.Item1)  # disabled

# ----
# expression node
expression_40 = Expression(x=range_41, A=A_4, B=B_4, C=C_4, Expression="2*x-1")  # disabled
construct_point_106 = ConstructPoint(XCoordinate=range_41, YCoordinate=expression_32, ZCoordinate=0)  # disabled
panel_170 = Panel(expression_32)  # disabled

# ----
# any P₁ = (x₁, y₁)
number_slider_80 = Slider(0, range=0..1)  # disabled

list_item_43 = ListItem(List=construct_point_106, Index=0, Wrap=True)  # -> Item1, Item; disabled
interpolate_33 = Interpolate(Vertices=construct_point_106, Degree=3, Periodic=boolean_toggle_7, KnotStyle=1)  # -> Curve, Length, Domain; disabled
evaluate_curve_13 = EvaluateCurve(Curve=reparameterize([interpolate_32.Curve, interpolate_33.Curve]), Parameter=panel_164)  # -> Point, Tangent, Angle; disabled
point_on_curve_13 = PointOnCurve(interpolate_33.Curve, parameter=0.843)  # disabled

line_35 = Line(StartPoint=list_item_43.Item1, EndPoint=list_item_43.Item)  # disabled

evaluate_curve_14 = EvaluateCurve(Curve=reparameterize([interpolate_32.Curve, interpolate_33.Curve]), Parameter=number_slider_80)  # -> Point, Tangent, Angle; disabled
panel_171 = Panel(evaluate_curve_14.Point)  # disabled
text_tag_3d_64 = TextTag3D(Location=evaluate_curve_14.Point, Text=panel_171, Size=panel_169, Justification=7)  # disabled

# ----
# y-intercept
panel_172 = Panel(evaluate_curve_13.Point)  # disabled

concatenate_11 = Concatenate(FragmentA=panel_166, FragmentB=panel_172)  # disabled

text_tag_3d_65 = TextTag3D(Location=point_13, Text=panel_167, Size=panel_169, Justification=1)  # disabled
text_tag_3d_66 = TextTag3D(Location=point_14, Text=panel_168, Size=panel_169, Justification=9)  # disabled
text_tag_3d_67 = TextTag3D(Location=[point_on_curve_13, point_on_curve_12], Text=panel_165, Size=panel_169, Justification=7)  # disabled
text_tag_3d_68 = TextTag3D(Location=evaluate_curve_13.Point, Text=concatenate_11, Size=panel_169, Justification=7)  # disabled
# Creating a circle at center (1, -2)
# with radius 3 with the circle node
# or
# identifying the graph of the equation
# x^2 + y^2 - (2 * x) + (4 * y) = 4
# observe that x^2 - 2 * x contains the first
# of two terms of the perfect square
# (x - 1)^2 = x^2 - (2 * x) +1
# hence
# x^2-2x = (x-1)^2-1
# similarly
# y^2 + (4 * y) = (y +2 )^2 - 4
# Hence the equation can be written
# (x - 1)^2 + (y + 2)^2 = 1 + 4 + 4 = 9 = 3^2
# This says the the distance from the point (x, y)
# to the point (1, -2) is equal to 3
# Hence the equation represents a circle
# of radius 3 centered ot the point (1, -2)
text_tag_3d_69 = TextTag3D(Location=evaluate_curve_13.Point, Text=concatenate_11, Size=panel_169, Justification=7)  # disabled
