# Grasshopper definition 018_Functions_definition.gh (Grasshopper 1.0.7)
# plug-ins: HAL for Grasshopper, Pufferfish

# 1.3
# Functions:
# alt + 159 = ƒ
# Definition of a Function
# - a function ƒ is a rule that assigns to each element x
# in some set D(ƒ) (called the domain of ƒ)
# a unique object ƒ(x) called the value of ƒ at x
# - let's assume that our functions consist of real numbers
# and that the values of our functions are also real numbers
# - domain 𝐷(ƒ)
# - the squaring function on IR is the function
# ƒ that assigns to each real number x
# its square, x²:
# ƒ(x) = x², for x in IR
# - the domain of ƒ is the set of all real numbers:
# 𝐷(ƒ) = IR
# - it is common to refer to the function loosely as ƒ(x)
# - the squaring function is often simply
# called the function x²
# - another way of denoting the function is:
# ƒ : x → ƒ(x)
# - this reads as "the function ƒ that takes x to ƒ(x)
# - the squaring function can be donated:
# ƒ : x → x²
# or even more simply
# x → x²
# - this required that the domain be specified
# - if the functio g is defined by
# g(x) = x² for -1 <= x < 2,
# then g is not the same function as ƒ
# because g and ƒ have different domains
# - we don't want to specify for real numbers and real values
# The Domain Convention:
# The Domain Convention:
# - Unless the domain of a function ƒ is given explicity,
# we assume that it is the largest set of real numbers
# for which ƒ(x) makes sense as a real number
# - x² has domain all real numbers
# 1/x² has domain all real numbers except 0
# 
# The Range of a Function
# - the range of function ƒ is the set of
# all real numbers that are
# values of the function: that is
# it is the set of all numbers y such that
# y = ƒ(x) for some x in D(ƒ).
# the range of ƒ is denotes at R(ƒ)
# 
# The Graph of a Function
# - the graph of a function ƒ is the graph
# of the equation y = ƒ(x) in the Cartesian plane
# Thus it is the set of all points with coordinates
# (x, ƒ(x)), where x belongs to D(ƒ)
sessionsettings = SessionSettings()

# ----
# Illustrate the domain, range and graph of function ƒ
# - note that the domain of the function ƒ can be
# regarded as the set of points on the x-axis
# and the range as a set on the y-axis
# - note that the graph of the function is such that any vertical
# line through a point in the domain meets the graph
# at exactly one point (because ƒ(x)
# IS A UNIQUE NUMBER FOR EACH X
# the horizontal line through this point
# on the graph meets the y-axis at ƒ(x)
# Thus ƒ(x) is the vertical displacement of that point
# on the graph
# x-axis and y-axis
xy_plane = XYPlane(Origin=Point(0, 0, 0))
range = Range(Domain="5", Steps=10)
construct_point = ConstructPoint(XCoordinate=range, YCoordinate=0, ZCoordinate=0)
construct_point_2 = ConstructPoint(XCoordinate=0, YCoordinate=range, ZCoordinate=0)
list_item = ListItem(List=construct_point, Index=0, Wrap=True)  # -> Item1, Item
list_item_2 = ListItem(List=construct_point_2, Index=0, Wrap=True)  # -> Item1, Item
construct_point_3 = ConstructPoint(XCoordinate=0, YCoordinate=0, ZCoordinate=0)
vector_2pt = Vector2Pt(PointA=list_item.Item, PointB=list_item.Item1, Unitize=False)  # -> Vector, Length
vector_2pt_2 = Vector2Pt(PointA=list_item_2.Item, PointB=list_item_2.Item1, Unitize=False)  # -> Vector, Length
negative = Negative(Value=vector_2pt.Vector)
negative_2 = Negative(Value=vector_2pt_2.Vector)
vector_display = VectorDisplay(Anchor=construct_point_3, Vector=vector_2pt.Vector)
vector_display_2 = VectorDisplay(Anchor=construct_point_3, Vector=negative)
vector_display_3 = VectorDisplay(Anchor=construct_point_3, Vector=vector_2pt_2.Vector)
vector_display_4 = VectorDisplay(Anchor=construct_point_3, Vector=negative_2)

# ----
# illustrates the domain, range and graph of a function
number_slider = Slider(1.959, range=0..4)
construct_domain = ConstructDomain(DomainStart=number_slider, DomainEnd=Slider(4, range=0..4))
A = Slider(0.1, range=0..0.1)
range_2 = Range(Domain=construct_domain, Steps=10)
expression = Expression(x=range_2, A=A, B=Slider(1, range=0..10), Expression="A*x^2 + B")
construct_point_4 = ConstructPoint(XCoordinate=range_2, YCoordinate=expression, ZCoordinate=0)
construct_point_5 = ConstructPoint(XCoordinate=range_2, YCoordinate=0, ZCoordinate=0)
construct_point_6 = ConstructPoint(XCoordinate=0, YCoordinate=expression, ZCoordinate=0)
interpolate = Interpolate(Vertices=construct_point_4, Degree=3, Periodic=False, KnotStyle=1)  # -> Curve, Length, Domain
interpolate_2 = Interpolate(Vertices=construct_point_5, Degree=3, Periodic=False, KnotStyle=1)  # -> Curve, Length, Domain
interpolate_3 = Interpolate(Vertices=construct_point_6, Degree=3, Periodic=False, KnotStyle=1)  # -> Curve, Length, Domain
curve_middle = CurveMiddle(Curve=interpolate_2.Curve)
curve_middle_2 = CurveMiddle(Curve=interpolate_3.Curve)
point_on_curve = PointOnCurve(interpolate.Curve, parameter=0.241)
end_points = EndPoints(Curve=interpolate.Curve)  # -> Start, End
end_points_2 = EndPoints(Curve=interpolate_2.Curve)  # -> Start, End
end_points_3 = EndPoints(Curve=interpolate_3.Curve)  # -> Start, End
deconstruct = Deconstruct(Point=graft(point_on_curve))  # -> XComponent, YComponent, ZComponent
construct_point_7 = ConstructPoint(XCoordinate=0, YCoordinate=deconstruct.YComponent, ZCoordinate=0)
construct_point_8 = ConstructPoint(XCoordinate=deconstruct.XComponent, YCoordinate=0, ZCoordinate=0)
line = Line(StartPoint=construct_point_7, EndPoint=point_on_curve)
line_2 = Line(StartPoint=construct_point_8, EndPoint=point_on_curve)
line_3 = Line(StartPoint=end_points_2.Start, EndPoint=end_points.Start)
line_4 = Line(StartPoint=end_points_3.Start, EndPoint=end_points.Start)
line_5 = Line(StartPoint=end_points_2.End, EndPoint=end_points.End)
line_6 = Line(StartPoint=end_points_3.End, EndPoint=end_points.End)
panel = Panel("""    
     y = f(x)""")
offset_curve = OffsetCurve(
    Curve=[interpolate.Curve, interpolate_2.Curve, interpolate_3.Curve],
    Plane=PlaneXY(0, 0, 0),
    Distance=".06",
    BothSides=False,
    Kinks=0,
    CapType=1)
boundary_surfaces = BoundarySurfaces(Edges=offset_curve)
text_tag_3d = TextTag3D(Location=curve_middle_2, Text="     R(f)     ", Size=".12", Justification=1)
text_tag_3d_2 = TextTag3D(Location=curve_middle, Text="D(f)", Size=".12", Justification=7)
text_tag_3d_3 = TextTag3D(Location=point_on_curve, Text=panel, Size=".12", Justification=7)
text_tag_3d_4 = TextTag3D(Location=construct_point_7, Text="f(x)     ", Size=".12", Justification=6)
text_tag_3d_5 = TextTag3D(Location=construct_point_8, Text="x", Size=".12", Justification=7)
