# Grasshopper definition 023_the_Signum_Function.gh (Grasshopper 1.0.7)
# plug-ins: HAL for Grasshopper, Pufferfish

# 1.3
# Functions:
# alt + 159 = ƒ
# Definition of a Function
# - a function ƒ is a rule that assigns to each element x
# in some set D(ƒ) (called the domain of ƒ)
# a unique object ƒ(x) called the value of ƒ at x
# - let's assume that our functions consist of real numbers
# and that the values of our functions are also real numbers
# - domain 𝐷(ƒ)
# - the squaring function on IR is the function
# ƒ that assigns to each real number x
# its square, x²:
# ƒ(x) = x², for x in IR
# - the domain of ƒ is the set of all real numbers:
# 𝐷(ƒ) = IR
# - it is common to refer to the function loosely as ƒ(x)
# - the squaring function is often simply
# called the function x²
# - another way of denoting the function is:
# ƒ : x → ƒ(x)
# - this reads as "the function ƒ that takes x to ƒ(x)
# - the squaring function can be donated:
# ƒ : x → x²
# or even more simply
# x → x²
# - this required that the domain be specified
# - if the functio g is defined by
# g(x) = x² for -1 <= x < 2,
# then g is not the same function as ƒ
# because g and ƒ have different domains
# - we don't want to specify for real numbers and real values
# The Domain Convention:
# The Domain Convention:
# - Unless the domain of a function ƒ is given explicity,
# we assume that it is the largest set of real numbers
# for which ƒ(x) makes sense as a real number
# - x² has domain all real numbers
# 1/x² has domain all real numbers except 0
# 
# The Range of a Function
# - the range of function ƒ is the set of
# all real numbers that are
# values of the function: that is
# it is the set of all numbers y such that
# y = ƒ(x) for some x in D(ƒ).
# the range of ƒ is denotes at R(ƒ)
# 
# The Graph of a Function
# - the graph of a function ƒ is the graph
# of the equation y = ƒ(x) in the Cartesian plane
# Thus it is the set of all points with coordinates
# (x, ƒ(x)), where x belongs to D(ƒ)
sessionsettings = SessionSettings()

# ----
# ƒ(x) = x²
number_slider = Slider(2.489, range=0..4)  # disabled
negative = Negative(Value=number_slider)  # disabled
construct_domain = ConstructDomain(DomainStart=negative, DomainEnd=number_slider)  # disabled
A = Slider(0.1, range=0..0.1)  # disabled
number_slider_2 = Slider(0, range=0..10)  # disabled
range = Range(Domain=construct_domain, Steps=10)  # disabled
panel = Panel("1")  # disabled
expression = Expression(x=range, A=panel, B=number_slider_2, Expression="A*x^2 + B")  # disabled
construct_point = ConstructPoint(XCoordinate=range, YCoordinate=expression, ZCoordinate=0)  # disabled
construct_point_2 = ConstructPoint(XCoordinate=range, YCoordinate=0, ZCoordinate=0)  # disabled
construct_point_3 = ConstructPoint(XCoordinate=0, YCoordinate=expression, ZCoordinate=0)  # disabled
interpolate = Interpolate(Vertices=construct_point, Degree=3, Periodic=False, KnotStyle=1)  # -> Curve, Length, Domain; disabled
interpolate_2 = Interpolate(Vertices=construct_point_2, Degree=3, Periodic=False, KnotStyle=1)  # -> Curve, Length, Domain; disabled
interpolate_3 = Interpolate(Vertices=construct_point_3, Degree=3, Periodic=False, KnotStyle=1)  # -> Curve, Length, Domain; disabled
curve_middle = CurveMiddle(Curve=interpolate_2.Curve)  # disabled
point_on_curve = PointOnCurve(interpolate.Curve, parameter=0.814)  # disabled
end_points = EndPoints(Curve=interpolate.Curve)  # -> Start, End; disabled
end_points_2 = EndPoints(Curve=interpolate_2.Curve)  # -> Start, End; disabled
end_points_3 = EndPoints(Curve=interpolate_3.Curve)  # -> Start, End; disabled
deconstruct = Deconstruct(Point=graft(point_on_curve))  # -> XComponent, YComponent, ZComponent; disabled
construct_point_4 = ConstructPoint(XCoordinate=0, YCoordinate=deconstruct.YComponent, ZCoordinate=0)  # disabled
construct_point_5 = ConstructPoint(XCoordinate=deconstruct.XComponent, YCoordinate=0, ZCoordinate=0)  # disabled
panel_2 = Panel(".12")  # disabled
line = Line(StartPoint=construct_point_4, EndPoint=point_on_curve)  # disabled
line_2 = Line(StartPoint=construct_point_5, EndPoint=point_on_curve)  # disabled
line_3 = Line(StartPoint=end_points_2.Start, EndPoint=end_points.Start)  # disabled
line_4 = Line(StartPoint=end_points_3.Start, EndPoint=end_points.Start)  # disabled
line_5 = Line(StartPoint=end_points_2.End, EndPoint=end_points.End)  # disabled
line_6 = Line(StartPoint=end_points_3.End, EndPoint=end_points.End)  # disabled
panel_3 = Panel(".06")  # disabled
panel_4 = Panel("     y    ")  # disabled
panel_5 = Panel("x")  # disabled
panel_6 = Panel("""    
     y = f(x)""")  # disabled
panel_7 = Panel("f(x)     ")  # disabled
panel_8 = Panel("x")  # disabled
offset_curve = OffsetCurve(Curve=interpolate.Curve, Plane=PlaneXY(0, 0, 0), Distance=panel_3, BothSides=False, Kinks=0, CapType=1)  # disabled
boundary_surfaces = BoundarySurfaces(Edges=offset_curve)  # disabled
text_tag_3d = TextTag3D(Location=end_points_3.End, Text=panel_4, Size=panel_2, Justification=6)  # disabled
text_tag_3d_2 = TextTag3D(Location=end_points_2.End, Text=panel_5, Size=panel_2, Justification=7)  # disabled
text_tag_3d_3 = TextTag3D(Location=point_on_curve, Text=panel_6, Size=panel_2, Justification=7)  # disabled
text_tag_3d_4 = TextTag3D(Location=construct_point_4, Text=panel_7, Size=panel_2, Justification=6)  # disabled
text_tag_3d_5 = TextTag3D(Location=construct_point_5, Text=panel_8, Size=panel_2, Justification=7)  # disabled

# ----
# Illustrate the domain, range and graph of function ƒ
# - note that the domain of the function ƒ can be
# regarded as the set of points on the x-axis
# and the range as a set on the y-axis
# - note that the graph of the function is such that any vertical
# line through a point in the domain meets the graph
# at exactly one point (because ƒ(x)
# IS A UNIQUE NUMBER FOR EACH X
# the horizontal line through this point
# on the graph meets the y-axis at ƒ(x)
# Thus ƒ(x) is the vertical displacement of that point
# on the graph
# x-axis and y-axis
xy_plane = XYPlane(Origin=Point(0, 0, 0))
range_2 = Range(Domain="5", Steps=10)
construct_point_6 = ConstructPoint(XCoordinate=range_2, YCoordinate=0, ZCoordinate=0)
construct_point_7 = ConstructPoint(XCoordinate=0, YCoordinate=range_2, ZCoordinate=0)
list_item = ListItem(List=construct_point_6, Index=0, Wrap=True)  # -> Item1, Item
list_item_2 = ListItem(List=construct_point_7, Index=0, Wrap=True)  # -> Item1, Item
construct_point_8 = ConstructPoint(XCoordinate=0, YCoordinate=0, ZCoordinate=0)
vector_2pt = Vector2Pt(PointA=list_item.Item, PointB=list_item.Item1, Unitize=False)  # -> Vector, Length
vector_2pt_2 = Vector2Pt(PointA=list_item_2.Item, PointB=list_item_2.Item1, Unitize=False)  # -> Vector, Length
negative_2 = Negative(Value=vector_2pt.Vector)
negative_3 = Negative(Value=vector_2pt_2.Vector)
vector_display = VectorDisplay(Anchor=construct_point_8, Vector=vector_2pt.Vector)
vector_display_2 = VectorDisplay(Anchor=construct_point_8, Vector=negative_2)
vector_display_3 = VectorDisplay(Anchor=construct_point_8, Vector=vector_2pt_2.Vector)
vector_display_4 = VectorDisplay(Anchor=construct_point_8, Vector=negative_3)

boolean_toggle = BooleanToggle(True)  # disabled

# ----
# illustrates the domain, range and graph of a function
number_slider_3 = Slider(1.959, range=0..4)  # disabled
number_slider_4 = Slider(4, range=0..4)  # disabled
construct_domain_2 = ConstructDomain(DomainStart=number_slider_3, DomainEnd=number_slider_4)  # disabled
A_2 = Slider(0.1, range=0..0.1)  # disabled
number_slider_5 = Slider(1, range=0..10)  # disabled
range_3 = Range(Domain=construct_domain_2, Steps=10)  # disabled
expression_2 = Expression(x=range_3, A=A_2, B=number_slider_5, Expression="A*x^2 + B")  # disabled
construct_point_9 = ConstructPoint(XCoordinate=range_3, YCoordinate=expression_2, ZCoordinate=0)  # disabled
construct_point_10 = ConstructPoint(XCoordinate=range_3, YCoordinate=0, ZCoordinate=0)  # disabled
construct_point_11 = ConstructPoint(XCoordinate=0, YCoordinate=expression_2, ZCoordinate=0)  # disabled
interpolate_4 = Interpolate(Vertices=construct_point_9, Degree=3, Periodic=False, KnotStyle=1)  # -> Curve, Length, Domain; disabled
interpolate_5 = Interpolate(Vertices=construct_point_10, Degree=3, Periodic=False, KnotStyle=1)  # -> Curve, Length, Domain; disabled
interpolate_6 = Interpolate(Vertices=construct_point_11, Degree=3, Periodic=False, KnotStyle=1)  # -> Curve, Length, Domain; disabled
curve_middle_2 = CurveMiddle(Curve=interpolate_5.Curve)  # disabled
curve_middle_3 = CurveMiddle(Curve=interpolate_6.Curve)  # disabled
point_on_curve_2 = PointOnCurve(interpolate_4.Curve, parameter=0.241)  # disabled
end_points_4 = EndPoints(Curve=interpolate_4.Curve)  # -> Start, End; disabled
end_points_5 = EndPoints(Curve=interpolate_5.Curve)  # -> Start, End; disabled
end_points_6 = EndPoints(Curve=interpolate_6.Curve)  # -> Start, End; disabled
deconstruct_2 = Deconstruct(Point=graft(point_on_curve_2))  # -> XComponent, YComponent, ZComponent; disabled
construct_point_12 = ConstructPoint(XCoordinate=0, YCoordinate=deconstruct_2.YComponent, ZCoordinate=0)  # disabled
construct_point_13 = ConstructPoint(XCoordinate=deconstruct_2.XComponent, YCoordinate=0, ZCoordinate=0)  # disabled
panel_9 = Panel(".12")  # disabled
line_7 = Line(StartPoint=construct_point_12, EndPoint=point_on_curve_2)  # disabled
line_8 = Line(StartPoint=construct_point_13, EndPoint=point_on_curve_2)  # disabled
line_9 = Line(StartPoint=end_points_5.Start, EndPoint=end_points_4.Start)  # disabled
line_10 = Line(StartPoint=end_points_6.Start, EndPoint=end_points_4.Start)  # disabled
line_11 = Line(StartPoint=end_points_5.End, EndPoint=end_points_4.End)  # disabled
line_12 = Line(StartPoint=end_points_6.End, EndPoint=end_points_4.End)  # disabled
panel_10 = Panel(".06")  # disabled
panel_11 = Panel("     R(f)     ")  # disabled
panel_12 = Panel("D(f)")  # disabled
panel_13 = Panel("""    
     y = f(x)""")  # disabled
panel_14 = Panel("f(x)     ")  # disabled
panel_15 = Panel("x")  # disabled
offset_curve_2 = OffsetCurve(
    Curve=[interpolate_4.Curve, interpolate_5.Curve, interpolate_6.Curve],
    Plane=PlaneXY(0, 0, 0),
    Distance=panel_10,
    BothSides=boolean_toggle,
    Kinks=0,
    CapType=1)  # disabled
boundary_surfaces_2 = BoundarySurfaces(Edges=offset_curve_2)  # disabled
text_tag_3d_6 = TextTag3D(Location=curve_middle_3, Text=panel_11, Size=panel_9, Justification=1)  # disabled
text_tag_3d_7 = TextTag3D(Location=curve_middle_2, Text=panel_12, Size=panel_9, Justification=7)  # disabled
text_tag_3d_8 = TextTag3D(Location=point_on_curve_2, Text=panel_13, Size=panel_9, Justification=7)  # disabled
text_tag_3d_9 = TextTag3D(Location=construct_point_12, Text=panel_14, Size=panel_9, Justification=6)  # disabled
text_tag_3d_10 = TextTag3D(Location=construct_point_13, Text=panel_15, Size=panel_9, Justification=7)  # disabled

# ----
# ghPython
number_slider_6 = Slider(4, range=0..14)  # disabled
negative_4 = Negative(Value=number_slider_6)  # disabled
number_slider_7 = Slider(100, range=0..100)  # disabled
construct_domain_3 = ConstructDomain(DomainStart=negative_4, DomainEnd=number_slider_6)  # disabled
range_4 = Range(Domain=construct_domain_3, Steps=number_slider_7)  # disabled
ghpython_script = GhPythonScript(numList=range_4)  # -> out, numListX, numListY, y1, y2; inputs numList: list; disabled
# ---------- ghpython_script: Python ----------
__author__ = "Sculpture"
__version__ = "2021.07.15"

import rhinoscriptsyntax as rs

numbers1 = []
numListX = []
numbers2 = []
numListY = []

for valX in numList:
    if valX > 1:
        numListX.append(valX)
        numbers1.append(1/(valX - 1))
        y1 = numbers1
print numListX
    
for valY in numList:
    if valY < 1:
        numListY.append(valY)
        numbers2.append(1/(valY - 1))
        y2 = numbers2
print numListY
# ---------- end ghpython_script ----------
construct_point_14 = ConstructPoint(XCoordinate=ghpython_script.numListX, YCoordinate=ghpython_script.y1, ZCoordinate=0)  # disabled
construct_point_15 = ConstructPoint(XCoordinate=ghpython_script.numListY, YCoordinate=ghpython_script.y2, ZCoordinate=0)  # disabled
interpolate_7 = Interpolate(Vertices=construct_point_14, Degree=3, Periodic=False, KnotStyle=1)  # -> Curve, Length, Domain; disabled
interpolate_8 = Interpolate(Vertices=construct_point_15, Degree=3, Periodic=False, KnotStyle=1)  # -> Curve, Length, Domain; disabled

# ----
# C#
number_slider_8 = Slider(4, range=0..14)  # disabled
negative_5 = Negative(Value=number_slider_8)  # disabled
number_slider_9 = Slider(100, range=0..100)  # disabled
construct_domain_4 = ConstructDomain(DomainStart=negative_5, DomainEnd=number_slider_8)  # disabled
range_5 = Range(Domain=construct_domain_4, Steps=number_slider_9)  # disabled
l_02_foreachloop = L_02_ForeachLoop(numList=range_5)  # -> out, function; inputs numList: list of Double, func: Double; disabled
# ---------- l_02_foreachloop: C# usings ----------
using System.IO;
using System.Linq;
using System.Data;
using System.Drawing;
using System.Reflection;
using System.Windows.Forms;
using System.Xml;
using System.Xml.Linq;
using System.Runtime.InteropServices;

using Rhino.DocObjects;
using Rhino.Collections;
using GH_IO;
using GH_IO.Serialization;
# ---------- l_02_foreachloop: C# ----------
    List<double> numbers = new List<double>();

    foreach(double val in numList)
      numbers.Add(1 / (val - 1));

    function = numbers;
# ---------- end l_02_foreachloop ----------
construct_point_16 = ConstructPoint(XCoordinate=range_5, YCoordinate=l_02_foreachloop.function, ZCoordinate=0)  # disabled
interpolate_9 = Interpolate(Vertices=construct_point_16, Degree=3, Periodic=False, KnotStyle=1)  # -> Curve, Length, Domain; disabled

# ----
# S(x) = 1/(x - 1)
number_slider_10 = Slider(4, range=0..14)  # disabled
number_slider_11 = Slider(100, range=0..100)  # disabled
negative_6 = Negative(Value=number_slider_10)  # disabled
construct_domain_5 = ConstructDomain(DomainStart=negative_6, DomainEnd=number_slider_10)  # disabled
panel_16 = Panel("1")  # disabled
number_slider_12 = Slider(0, range=0..10)  # disabled
range_6 = Range(Domain=construct_domain_5, Steps=number_slider_11)  # disabled
smaller_than = SmallerThan(FirstNumber=range_6, SecondNumber=panel_16)  # -> SmallerThan, OrEqualTo; disabled
larger_than = LargerThan(FirstNumber=range_6, SecondNumber=panel_16)  # -> LargerThan, OrEqualTo; disabled
cull_pattern = CullPattern(List=range_6, CullPattern=larger_than.LargerThan)  # disabled
cull_pattern_2 = CullPattern(List=range_6, CullPattern=smaller_than.SmallerThan)  # disabled
xz_plane = XZPlane(Origin=Point(0, 0, 0))  # disabled
panel_17 = Panel(".12")  # disabled
panel_18 = Panel(".06")  # disabled
panel_19 = Panel("y         ")  # disabled
panel_20 = Panel("x")  # disabled

expression_3 = Expression(x=cull_pattern, A=panel_16, B=number_slider_12, Expression="1/(x - 1)")  # disabled

expression_4 = Expression(x=cull_pattern_2, A=panel_16, B=number_slider_12, Expression="1/(x - 1)")  # disabled
panel_21 = Panel("""    
     y = S(x)""")  # disabled
panel_22 = Panel("S(x)     ")  # disabled

construct_point_17 = ConstructPoint(XCoordinate=cull_pattern, YCoordinate=expression_3, ZCoordinate=0)  # disabled
construct_point_18 = ConstructPoint(XCoordinate=expression_3, YCoordinate=0, ZCoordinate=0)  # disabled
construct_point_19 = ConstructPoint(XCoordinate=cull_pattern_2, YCoordinate=expression_4, ZCoordinate=0)  # disabled
construct_point_20 = ConstructPoint(XCoordinate=0, YCoordinate=expression_4, ZCoordinate=0)  # disabled
interpolate_10 = Interpolate(Vertices=construct_point_19, Degree=3, Periodic=False, KnotStyle=1)  # -> Curve, Length, Domain; disabled
interpolate_11 = Interpolate(Vertices=construct_point_18, Degree=3, Periodic=False, KnotStyle=1)  # -> Curve, Length, Domain; disabled
interpolate_12 = Interpolate(Vertices=construct_point_20, Degree=3, Periodic=False, KnotStyle=1)  # -> Curve, Length, Domain; disabled
interpolate_13 = Interpolate(Vertices=construct_point_17, Degree=3, Periodic=False, KnotStyle=1)  # -> Curve, Length, Domain; disabled
mirror = Mirror(Geometry=interpolate_12.Curve, Plane=xz_plane)  # -> Geometry, Transform; disabled
point_on_curve_3 = PointOnCurve(interpolate_13.Curve, parameter=0.858)  # disabled
point_on_curve_4 = PointOnCurve(interpolate_11.Curve, parameter=0.868)  # disabled
point_on_curve_5 = PointOnCurve(mirror.Geometry, parameter=0.128)  # disabled
end_points_7 = EndPoints(Curve=interpolate_13.Curve)  # -> Start, End; disabled
end_points_8 = EndPoints(Curve=interpolate_11.Curve)  # -> Start, End; disabled
end_points_9 = EndPoints(Curve=interpolate_10.Curve)  # -> Start, End; disabled
deconstruct_3 = Deconstruct(Point=graft(point_on_curve_3))  # -> XComponent, YComponent, ZComponent; disabled
construct_point_21 = ConstructPoint(XCoordinate=deconstruct_3.XComponent, YCoordinate=0, ZCoordinate=0)  # disabled
construct_point_22 = ConstructPoint(XCoordinate=0, YCoordinate=deconstruct_3.YComponent, ZCoordinate=0)  # disabled
offset_curve_3 = OffsetCurve(
    Curve=[interpolate_13.Curve, interpolate_10.Curve],
    Plane=PlaneXY(0, 0, 0),
    Distance=panel_18,
    BothSides=False,
    Kinks=0,
    CapType=1)  # disabled
line_13 = Line(StartPoint=construct_point_22, EndPoint=point_on_curve_3)  # disabled
line_14 = Line(StartPoint=construct_point_21, EndPoint=point_on_curve_3)  # disabled
boundary_surfaces_3 = BoundarySurfaces(Edges=offset_curve_3)  # disabled
text_tag_3d_11 = TextTag3D(Location=point_on_curve_5, Text=panel_19, Size=panel_17, Justification=6)  # disabled
text_tag_3d_12 = TextTag3D(Location=point_on_curve_3, Text=panel_21, Size=panel_17, Justification=7)  # disabled
text_tag_3d_13 = TextTag3D(Location=construct_point_22, Text=panel_22, Size=panel_17, Justification=6)  # disabled
text_tag_3d_14 = TextTag3D(Location=[construct_point_21, point_on_curve_4], Text=panel_20, Size=panel_17, Justification=7)  # disabled

number_slider_13 = Slider(-4, range=-4..4.001)  # disabled
number_slider_14 = Slider(4, range=0..4)  # disabled
A_3 = Slider(0.1, range=0..0.1)  # disabled
number_slider_15 = Slider(1, range=0..10)  # disabled
panel_23 = Panel("1")  # disabled
panel_24 = Panel(".12")  # disabled
panel_25 = Panel(".06")  # disabled
panel_26 = Panel("     y    ")  # disabled
panel_27 = Panel("x")  # disabled
panel_28 = Panel("x")  # disabled

# ----
# k(x) = |x|
number_slider_16 = Slider(-4, range=-4..4.001)  # disabled
number_slider_17 = Slider(4, range=0..4)  # disabled
construct_domain_6 = ConstructDomain(DomainStart=number_slider_16, DomainEnd=number_slider_17)  # disabled
A_4 = Slider(0.1, range=0..0.1)  # disabled
number_slider_18 = Slider(0, range=0..10)  # disabled
range_7 = Range(Domain=construct_domain_6, Steps=10)  # disabled
panel_29 = Panel("1")  # disabled
construct_point_23 = ConstructPoint(XCoordinate=range_7, YCoordinate=0, ZCoordinate=0)  # disabled
interpolate_14 = Interpolate(Vertices=construct_point_23, Degree=3, Periodic=False, KnotStyle=1)  # -> Curve, Length, Domain; disabled
curve_middle_4 = CurveMiddle(Curve=interpolate_14.Curve)  # disabled
end_points_10 = EndPoints(Curve=interpolate_14.Curve)  # -> Start, End; disabled
panel_30 = Panel(".12")  # disabled
panel_31 = Panel(".06")  # disabled
panel_32 = Panel("     y    ")  # disabled
panel_33 = Panel("x")  # disabled
panel_34 = Panel("x")  # disabled
text_tag_3d_15 = TextTag3D(Location=end_points_10.End, Text=panel_33, Size=panel_30, Justification=7)  # disabled

expression_5 = Expression(x=range_7, A=panel_29, B=number_slider_18, Expression="A*abs(x) + B")  # disabled
panel_35 = Panel("1")  # disabled
panel_36 = Panel("""    
     y = k(x)""")  # disabled
panel_37 = Panel("k(x)     ")  # disabled

construct_point_24 = ConstructPoint(XCoordinate=range_7, YCoordinate=expression_5, ZCoordinate=0)  # disabled
construct_point_25 = ConstructPoint(XCoordinate=0, YCoordinate=expression_5, ZCoordinate=0)  # disabled
interpolate_15 = Interpolate(Vertices=construct_point_24, Degree=panel_35, Periodic=False, KnotStyle=1)  # -> Curve, Length, Domain; disabled
interpolate_16 = Interpolate(Vertices=construct_point_25, Degree=3, Periodic=False, KnotStyle=1)  # -> Curve, Length, Domain; disabled
point_on_curve_6 = PointOnCurve(interpolate_15.Curve, parameter=0.912)  # disabled
end_points_11 = EndPoints(Curve=interpolate_15.Curve)  # -> Start, End; disabled
end_points_12 = EndPoints(Curve=interpolate_16.Curve)  # -> Start, End; disabled
deconstruct_4 = Deconstruct(Point=graft(point_on_curve_6))  # -> XComponent, YComponent, ZComponent; disabled
construct_point_26 = ConstructPoint(XCoordinate=0, YCoordinate=deconstruct_4.YComponent, ZCoordinate=0)  # disabled
construct_point_27 = ConstructPoint(XCoordinate=deconstruct_4.XComponent, YCoordinate=0, ZCoordinate=0)  # disabled
line_15 = Line(StartPoint=construct_point_26, EndPoint=point_on_curve_6)  # disabled
line_16 = Line(StartPoint=construct_point_27, EndPoint=point_on_curve_6)  # disabled
line_17 = Line(StartPoint=end_points_10.Start, EndPoint=end_points_11.Start)  # disabled
line_18 = Line(StartPoint=end_points_12.Start, EndPoint=end_points_11.Start)  # disabled
line_19 = Line(StartPoint=end_points_10.End, EndPoint=end_points_11.End)  # disabled
line_20 = Line(StartPoint=end_points_12.End, EndPoint=end_points_11.End)  # disabled
offset_curve_4 = OffsetCurve(Curve=interpolate_15.Curve, Plane=PlaneXY(0, 0, 0), Distance=panel_31, BothSides=False, Kinks=0, CapType=1)  # disabled
boundary_surfaces_4 = BoundarySurfaces(Edges=offset_curve_4)  # disabled
text_tag_3d_16 = TextTag3D(Location=end_points_12.End, Text=panel_32, Size=panel_30, Justification=6)  # disabled
text_tag_3d_17 = TextTag3D(Location=point_on_curve_6, Text=panel_36, Size=panel_30, Justification=7)  # disabled
text_tag_3d_18 = TextTag3D(Location=construct_point_26, Text=panel_37, Size=panel_30, Justification=6)  # disabled
text_tag_3d_19 = TextTag3D(Location=construct_point_27, Text=panel_34, Size=panel_30, Justification=7)  # disabled

# ----
# g(x) = x²
# for -1 <= x < 2
panel_38 = Panel("-1")  # disabled
panel_39 = Panel("2")  # disabled
panel_40 = Panel("""    
     y = g(x)""")  # disabled
panel_41 = Panel("g(x)     ")  # disabled

construct_domain_7 = ConstructDomain(DomainStart=panel_38, DomainEnd=panel_39)  # disabled
range_8 = Range(Domain=construct_domain_7, Steps=10)  # disabled
construct_point_28 = ConstructPoint(XCoordinate=range_8, YCoordinate=0, ZCoordinate=0)  # disabled
interpolate_17 = Interpolate(Vertices=construct_point_28, Degree=3, Periodic=False, KnotStyle=1)  # -> Curve, Length, Domain; disabled
curve_middle_5 = CurveMiddle(Curve=interpolate_17.Curve)  # disabled
end_points_13 = EndPoints(Curve=interpolate_17.Curve)  # -> Start, End; disabled
text_tag_3d_20 = TextTag3D(Location=end_points_13.End, Text=panel_27, Size=panel_24, Justification=7)  # disabled

expression_6 = Expression(x=range_8, A=panel_23, B=number_slider_15, Expression="A*x^2 + B")  # disabled

construct_point_29 = ConstructPoint(XCoordinate=range_8, YCoordinate=expression_6, ZCoordinate=0)  # disabled
construct_point_30 = ConstructPoint(XCoordinate=0, YCoordinate=expression_6, ZCoordinate=0)  # disabled
interpolate_18 = Interpolate(Vertices=construct_point_29, Degree=3, Periodic=False, KnotStyle=1)  # -> Curve, Length, Domain; disabled
interpolate_19 = Interpolate(Vertices=construct_point_30, Degree=3, Periodic=False, KnotStyle=1)  # -> Curve, Length, Domain; disabled
point_on_curve_7 = PointOnCurve(interpolate_18.Curve, parameter=0.814)  # disabled
end_points_14 = EndPoints(Curve=interpolate_18.Curve)  # -> Start, End; disabled
end_points_15 = EndPoints(Curve=interpolate_19.Curve)  # -> Start, End; disabled
deconstruct_5 = Deconstruct(Point=graft(point_on_curve_7))  # -> XComponent, YComponent, ZComponent; disabled
construct_point_31 = ConstructPoint(XCoordinate=0, YCoordinate=deconstruct_5.YComponent, ZCoordinate=0)  # disabled
construct_point_32 = ConstructPoint(XCoordinate=deconstruct_5.XComponent, YCoordinate=0, ZCoordinate=0)  # disabled
line_21 = Line(StartPoint=construct_point_31, EndPoint=point_on_curve_7)  # disabled
line_22 = Line(StartPoint=construct_point_32, EndPoint=point_on_curve_7)  # disabled
line_23 = Line(StartPoint=end_points_13.Start, EndPoint=end_points_14.Start)  # disabled
line_24 = Line(StartPoint=end_points_15.Start, EndPoint=end_points_14.Start)  # disabled
line_25 = Line(StartPoint=end_points_13.End, EndPoint=end_points_14.End)  # disabled
line_26 = Line(StartPoint=end_points_15.End, EndPoint=end_points_14.End)  # disabled
offset_curve_5 = OffsetCurve(Curve=interpolate_18.Curve, Plane=PlaneXY(0, 0, 0), Distance=panel_25, BothSides=False, Kinks=0, CapType=1)  # disabled
boundary_surfaces_5 = BoundarySurfaces(Edges=offset_curve_5)  # disabled
text_tag_3d_21 = TextTag3D(Location=end_points_15.End, Text=panel_26, Size=panel_24, Justification=6)  # disabled
text_tag_3d_22 = TextTag3D(Location=point_on_curve_7, Text=panel_40, Size=panel_24, Justification=7)  # disabled
text_tag_3d_23 = TextTag3D(Location=construct_point_31, Text=panel_41, Size=panel_24, Justification=6)  # disabled
text_tag_3d_24 = TextTag3D(Location=construct_point_32, Text=panel_28, Size=panel_24, Justification=7)  # disabled

circle = Circle(Plane=end_points_14.Start, Radius=panel_24)  # disabled
boundary_surfaces_6 = BoundarySurfaces(Edges=circle)  # disabled
circle_2 = Circle(Plane=end_points_14.End, Radius=panel_24)  # disabled

# ----
# y  = √x
number_slider_19 = Slider(-4, range=-4..4.001)
construct_domain_8 = ConstructDomain(DomainStart=number_slider_19, DomainEnd=Slider(4, range=0..4))
A_5 = Slider(0.1, range=0..0.1)
range_9 = Range(Domain=construct_domain_8, Steps=Slider(100, range=0..100))
construct_point_33 = ConstructPoint(XCoordinate=range_9, YCoordinate=0, ZCoordinate=0)
interpolate_20 = Interpolate(Vertices=construct_point_33, Degree=3, Periodic=False, KnotStyle=1)  # -> Curve, Length, Domain
curve_middle_6 = CurveMiddle(Curve=interpolate_20.Curve)
end_points_16 = EndPoints(Curve=interpolate_20.Curve)  # -> Start, End
text_tag_3d_25 = TextTag3D(Location=end_points_16.End, Text="x", Size=".12", Justification=7)

expression_7 = Expression(x=range_9, A="1", B=Slider(0, range=0..10), Expression="A*Sqrt(x) + B")
panel_42 = Panel("""    
     y = Sqrt(x)""")

construct_point_34 = ConstructPoint(XCoordinate=range_9, YCoordinate=expression_7, ZCoordinate=0)
construct_point_35 = ConstructPoint(XCoordinate=0, YCoordinate=expression_7, ZCoordinate=0)
interpolate_21 = Interpolate(Vertices=construct_point_34, Degree=3, Periodic=False, KnotStyle=1)  # -> Curve, Length, Domain
interpolate_22 = Interpolate(Vertices=construct_point_35, Degree=3, Periodic=False, KnotStyle=1)  # -> Curve, Length, Domain
point_on_curve_8 = PointOnCurve(interpolate_21.Curve, parameter=0.73)
end_points_17 = EndPoints(Curve=interpolate_21.Curve)  # -> Start, End
end_points_18 = EndPoints(Curve=interpolate_22.Curve)  # -> Start, End
deconstruct_6 = Deconstruct(Point=graft(point_on_curve_8))  # -> XComponent, YComponent, ZComponent
panel_43 = Panel(point_on_curve_8)
construct_point_36 = ConstructPoint(XCoordinate=0, YCoordinate=deconstruct_6.YComponent, ZCoordinate=0)
construct_point_37 = ConstructPoint(XCoordinate=deconstruct_6.XComponent, YCoordinate=0, ZCoordinate=0)
line_27 = Line(StartPoint=construct_point_36, EndPoint=point_on_curve_8)
line_28 = Line(StartPoint=construct_point_37, EndPoint=point_on_curve_8)
line_29 = Line(StartPoint=end_points_16.Start, EndPoint=end_points_17.Start)
line_30 = Line(StartPoint=end_points_18.Start, EndPoint=end_points_17.Start)
line_31 = Line(StartPoint=end_points_16.End, EndPoint=end_points_17.End)
line_32 = Line(StartPoint=end_points_18.End, EndPoint=end_points_17.End)
offset_curve_6 = OffsetCurve(Curve=interpolate_21.Curve, Plane=PlaneXY(0, 0, 0), Distance=".06", BothSides=False, Kinks=0, CapType=1)
boundary_surfaces_7 = BoundarySurfaces(Edges=offset_curve_6)
# Since sqaures of numbers cannot be negative
# the square root function √x is defined for x >= 0 only
# - the uniqueness condition in the definition of function
# requires that there be only one value of √x
# for wach value x in D(√) = [0, ∞)
# 
# By convention, the term square root and the symbol √ always
# refer to the nonnegative aquare root
# Thus, while there are two numbers whose
# square is 4,
# only one of these is called √4, namely √4 = 2
# The graph y = √x is shown
# if we want to give both solutions of the equation
# x² = a, (a > 0),
# we can indicate them as x = √a and x = -√a
# - a common mistake is to write √x² = x
# THIS IS INCORRECT unless you know beforehand
# that x >= 0
# 
# This formula is always correct:
# The Square Root of a Square
# √x² = |x|
text_tag_3d_26 = TextTag3D(Location=end_points_18.End, Text="     y    ", Size=".12", Justification=6)
text_tag_3d_27 = TextTag3D(Location=point_on_curve_8, Text=panel_42, Size=".12", Justification=7)
text_tag_3d_28 = TextTag3D(Location=construct_point_36, Text="Sqrt(x)     ", Size=".12", Justification=6)
text_tag_3d_29 = TextTag3D(Location=construct_point_37, Text="x", Size=".12", Justification=7)

# ----
# y  = √x
number_slider_20 = Slider(-4, range=-4..4.001)
construct_domain_9 = ConstructDomain(DomainStart=number_slider_20, DomainEnd=Slider(4, range=0..4))
A_6 = Slider(0.1, range=0..0.1)
range_10 = Range(Domain=construct_domain_9, Steps=Slider(100, range=0..100))
construct_point_38 = ConstructPoint(XCoordinate=range_10, YCoordinate=0, ZCoordinate=0)
interpolate_23 = Interpolate(Vertices=construct_point_38, Degree=3, Periodic=False, KnotStyle=1)  # -> Curve, Length, Domain
curve_middle_7 = CurveMiddle(Curve=interpolate_23.Curve)
end_points_19 = EndPoints(Curve=interpolate_23.Curve)  # -> Start, End
text_tag_3d_30 = TextTag3D(Location=end_points_19.End, Text="x", Size=".12", Justification=7)

expression_8 = Expression(x=range_10, A="1", B=Slider(0, range=0..10), Expression="A*Sqrt(x) + B")
panel_44 = Panel("""    
     y = Sqrt(x)""")

construct_point_39 = ConstructPoint(XCoordinate=range_10, YCoordinate=expression_8, ZCoordinate=0)
construct_point_40 = ConstructPoint(XCoordinate=0, YCoordinate=expression_8, ZCoordinate=0)
interpolate_24 = Interpolate(Vertices=construct_point_39, Degree=3, Periodic=False, KnotStyle=1)  # -> Curve, Length, Domain
interpolate_25 = Interpolate(Vertices=construct_point_40, Degree=3, Periodic=False, KnotStyle=1)  # -> Curve, Length, Domain
point_on_curve_9 = PointOnCurve(interpolate_24.Curve, parameter=0.73)
end_points_20 = EndPoints(Curve=interpolate_24.Curve)  # -> Start, End
end_points_21 = EndPoints(Curve=interpolate_25.Curve)  # -> Start, End
deconstruct_7 = Deconstruct(Point=graft(point_on_curve_9))  # -> XComponent, YComponent, ZComponent
panel_45 = Panel(point_on_curve_9)
construct_point_41 = ConstructPoint(XCoordinate=0, YCoordinate=deconstruct_7.YComponent, ZCoordinate=0)
construct_point_42 = ConstructPoint(XCoordinate=deconstruct_7.XComponent, YCoordinate=0, ZCoordinate=0)
line_33 = Line(StartPoint=construct_point_41, EndPoint=point_on_curve_9)
line_34 = Line(StartPoint=construct_point_42, EndPoint=point_on_curve_9)
line_35 = Line(StartPoint=end_points_19.Start, EndPoint=end_points_20.Start)
line_36 = Line(StartPoint=end_points_21.Start, EndPoint=end_points_20.Start)
line_37 = Line(StartPoint=end_points_19.End, EndPoint=end_points_20.End)
line_38 = Line(StartPoint=end_points_21.End, EndPoint=end_points_20.End)
offset_curve_7 = OffsetCurve(Curve=interpolate_24.Curve, Plane=PlaneXY(0, 0, 0), Distance=".06", BothSides=False, Kinks=0, CapType=1)
boundary_surfaces_8 = BoundarySurfaces(Edges=offset_curve_7)
text_tag_3d_31 = TextTag3D(Location=end_points_21.End, Text="     y    ", Size=".12", Justification=6)
text_tag_3d_32 = TextTag3D(Location=point_on_curve_9, Text=panel_44, Size=".12", Justification=7)
text_tag_3d_33 = TextTag3D(Location=construct_point_41, Text="Sqrt(x)     ", Size=".12", Justification=6)
text_tag_3d_34 = TextTag3D(Location=construct_point_42, Text="x", Size=".12", Justification=7)
