# Grasshopper definition 027_odd_and_even_functions.gh (Grasshopper 1.0.7)
# plug-ins: HAL for Grasshopper, Pufferfish

# 1.3
# Functions:
# alt + 159 = ƒ
# Definition of a Function
# - a function ƒ is a rule that assigns to each element x
# in some set D(ƒ) (called the domain of ƒ)
# a unique object ƒ(x) called the value of ƒ at x
# - let's assume that our functions consist of real numbers
# and that the values of our functions are also real numbers
# - domain 𝐷(ƒ)
# - the squaring function on IR is the function
# ƒ that assigns to each real number x
# its square, x²:
# ƒ(x) = x², for x in IR
# - the domain of ƒ is the set of all real numbers:
# 𝐷(ƒ) = IR
# - it is common to refer to the function loosely as ƒ(x)
# - the squaring function is often simply
# called the function x²
# - another way of denoting the function is:
# ƒ : x → ƒ(x)
# - this reads as "the function ƒ that takes x to ƒ(x)
# - the squaring function can be donated:
# ƒ : x → x²
# or even more simply
# x → x²
# - this required that the domain be specified
# - if the functio g is defined by
# g(x) = x² for -1 <= x < 2,
# then g is not the same function as ƒ
# because g and ƒ have different domains
# - we don't want to specify for real numbers and real values
# The Domain Convention:
# The Domain Convention:
# - Unless the domain of a function ƒ is given explicity,
# we assume that it is the largest set of real numbers
# for which ƒ(x) makes sense as a real number
# - x² has domain all real numbers
# 1/x² has domain all real numbers except 0
# 
# The Range of a Function
# - the range of function ƒ is the set of
# all real numbers that are
# values of the function: that is
# it is the set of all numbers y such that
# y = ƒ(x) for some x in D(ƒ).
# the range of ƒ is denotes at R(ƒ)
# 
# The Graph of a Function
# - the graph of a function ƒ is the graph
# of the equation y = ƒ(x) in the Cartesian plane
# Thus it is the set of all points with coordinates
# (x, ƒ(x)), where x belongs to D(ƒ)
sessionsettings = SessionSettings()

# ----
# ƒ(x) = x²
number_slider = Slider(2.489, range=0..4)  # disabled
negative = Negative(Value=number_slider)  # disabled
construct_domain = ConstructDomain(DomainStart=negative, DomainEnd=number_slider)  # disabled
A = Slider(0.1, range=0..0.1)  # disabled
number_slider_2 = Slider(0, range=0..10)  # disabled
range = Range(Domain=construct_domain, Steps=10)  # disabled
panel = Panel("1")  # disabled
expression = Expression(x=range, A=panel, B=number_slider_2, Expression="A*x^2 + B")  # disabled
construct_point = ConstructPoint(XCoordinate=range, YCoordinate=expression, ZCoordinate=0)  # disabled
construct_point_2 = ConstructPoint(XCoordinate=range, YCoordinate=0, ZCoordinate=0)  # disabled
construct_point_3 = ConstructPoint(XCoordinate=0, YCoordinate=expression, ZCoordinate=0)  # disabled
interpolate = Interpolate(Vertices=construct_point, Degree=3, Periodic=False, KnotStyle=1)  # -> Curve, Length, Domain; disabled
interpolate_2 = Interpolate(Vertices=construct_point_2, Degree=3, Periodic=False, KnotStyle=1)  # -> Curve, Length, Domain; disabled
interpolate_3 = Interpolate(Vertices=construct_point_3, Degree=3, Periodic=False, KnotStyle=1)  # -> Curve, Length, Domain; disabled
curve_middle = CurveMiddle(Curve=interpolate_2.Curve)  # disabled
point_on_curve = PointOnCurve(interpolate.Curve, parameter=0.814)  # disabled
end_points = EndPoints(Curve=interpolate.Curve)  # -> Start, End; disabled
end_points_2 = EndPoints(Curve=interpolate_2.Curve)  # -> Start, End; disabled
end_points_3 = EndPoints(Curve=interpolate_3.Curve)  # -> Start, End; disabled
deconstruct = Deconstruct(Point=graft(point_on_curve))  # -> XComponent, YComponent, ZComponent; disabled
construct_point_4 = ConstructPoint(XCoordinate=0, YCoordinate=deconstruct.YComponent, ZCoordinate=0)  # disabled
construct_point_5 = ConstructPoint(XCoordinate=deconstruct.XComponent, YCoordinate=0, ZCoordinate=0)  # disabled
panel_2 = Panel(".12")  # disabled
line = Line(StartPoint=construct_point_4, EndPoint=point_on_curve)  # disabled
line_2 = Line(StartPoint=construct_point_5, EndPoint=point_on_curve)  # disabled
line_3 = Line(StartPoint=end_points_2.Start, EndPoint=end_points.Start)  # disabled
line_4 = Line(StartPoint=end_points_3.Start, EndPoint=end_points.Start)  # disabled
line_5 = Line(StartPoint=end_points_2.End, EndPoint=end_points.End)  # disabled
line_6 = Line(StartPoint=end_points_3.End, EndPoint=end_points.End)  # disabled
panel_3 = Panel(".06")  # disabled
panel_4 = Panel("     y    ")  # disabled
panel_5 = Panel("x")  # disabled
panel_6 = Panel("""    
     y = f(x)""")  # disabled
panel_7 = Panel("f(x)     ")  # disabled
panel_8 = Panel("x")  # disabled
offset_curve = OffsetCurve(Curve=interpolate.Curve, Plane=PlaneXY(0, 0, 0), Distance=panel_3, BothSides=False, Kinks=0, CapType=1)  # disabled
boundary_surfaces = BoundarySurfaces(Edges=offset_curve)  # disabled
text_tag_3d = TextTag3D(Location=end_points_3.End, Text=panel_4, Size=panel_2, Justification=6)  # disabled
text_tag_3d_2 = TextTag3D(Location=end_points_2.End, Text=panel_5, Size=panel_2, Justification=7)  # disabled
text_tag_3d_3 = TextTag3D(Location=point_on_curve, Text=panel_6, Size=panel_2, Justification=7)  # disabled
text_tag_3d_4 = TextTag3D(Location=construct_point_4, Text=panel_7, Size=panel_2, Justification=6)  # disabled
text_tag_3d_5 = TextTag3D(Location=construct_point_5, Text=panel_8, Size=panel_2, Justification=7)  # disabled

# ----
# Illustrate the domain, range and graph of function ƒ
# - note that the domain of the function ƒ can be
# regarded as the set of points on the x-axis
# and the range as a set on the y-axis
# - note that the graph of the function is such that any vertical
# line through a point in the domain meets the graph
# at exactly one point (because ƒ(x)
# IS A UNIQUE NUMBER FOR EACH X
# the horizontal line through this point
# on the graph meets the y-axis at ƒ(x)
# Thus ƒ(x) is the vertical displacement of that point
# on the graph
# x-axis and y-axis
xy_plane = XYPlane(Origin=Point(0, 0, 0))
range_2 = Range(Domain="5", Steps=10)
construct_point_6 = ConstructPoint(XCoordinate=range_2, YCoordinate=0, ZCoordinate=0)
construct_point_7 = ConstructPoint(XCoordinate=0, YCoordinate=range_2, ZCoordinate=0)
list_item = ListItem(List=construct_point_6, Index=0, Wrap=True)  # -> Item1, Item
list_item_2 = ListItem(List=construct_point_7, Index=0, Wrap=True)  # -> Item1, Item
construct_point_8 = ConstructPoint(XCoordinate=0, YCoordinate=0, ZCoordinate=0)
vector_2pt = Vector2Pt(PointA=list_item.Item, PointB=list_item.Item1, Unitize=False)  # -> Vector, Length
vector_2pt_2 = Vector2Pt(PointA=list_item_2.Item, PointB=list_item_2.Item1, Unitize=False)  # -> Vector, Length
negative_2 = Negative(Value=vector_2pt.Vector)
negative_3 = Negative(Value=vector_2pt_2.Vector)
vector_display = VectorDisplay(Anchor=construct_point_8, Vector=vector_2pt.Vector)
vector_display_2 = VectorDisplay(Anchor=construct_point_8, Vector=negative_2)
vector_display_3 = VectorDisplay(Anchor=construct_point_8, Vector=vector_2pt_2.Vector)
vector_display_4 = VectorDisplay(Anchor=construct_point_8, Vector=negative_3)

# ----
# ghPython
number_slider_3 = Slider(4, range=0..14)  # disabled
negative_4 = Negative(Value=number_slider_3)  # disabled
number_slider_4 = Slider(100, range=0..100)  # disabled
construct_domain_2 = ConstructDomain(DomainStart=negative_4, DomainEnd=number_slider_3)  # disabled
range_3 = Range(Domain=construct_domain_2, Steps=number_slider_4)  # disabled
ghpython_script = GhPythonScript(numList=range_3)  # -> out, numListX, numListY, y1, y2; inputs numList: list; disabled
# ---------- ghpython_script: Python ----------
__author__ = "Sculpture"
__version__ = "2021.07.15"

import rhinoscriptsyntax as rs

numbers1 = []
numListX = []
numbers2 = []
numListY = []

for valX in numList:
    if valX > 1:
        numListX.append(valX)
        numbers1.append(1/(valX - 1))
        y1 = numbers1
print numListX
    
for valY in numList:
    if valY < 1:
        numListY.append(valY)
        numbers2.append(1/(valY - 1))
        y2 = numbers2
print numListY
# ---------- end ghpython_script ----------
construct_point_9 = ConstructPoint(XCoordinate=ghpython_script.numListX, YCoordinate=ghpython_script.y1, ZCoordinate=0)  # disabled
construct_point_10 = ConstructPoint(XCoordinate=ghpython_script.numListY, YCoordinate=ghpython_script.y2, ZCoordinate=0)  # disabled
interpolate_4 = Interpolate(Vertices=construct_point_9, Degree=3, Periodic=False, KnotStyle=1)  # -> Curve, Length, Domain; disabled
interpolate_5 = Interpolate(Vertices=construct_point_10, Degree=3, Periodic=False, KnotStyle=1)  # -> Curve, Length, Domain; disabled

# ----
# C#
number_slider_5 = Slider(4, range=0..14)  # disabled
negative_5 = Negative(Value=number_slider_5)  # disabled
number_slider_6 = Slider(100, range=0..100)  # disabled
construct_domain_3 = ConstructDomain(DomainStart=negative_5, DomainEnd=number_slider_5)  # disabled
range_4 = Range(Domain=construct_domain_3, Steps=number_slider_6)  # disabled
l_02_foreachloop = L_02_ForeachLoop(numList=range_4)  # -> out, function; inputs numList: list of Double, func: Double; disabled
# ---------- l_02_foreachloop: C# usings ----------
using System.IO;
using System.Linq;
using System.Data;
using System.Drawing;
using System.Reflection;
using System.Windows.Forms;
using System.Xml;
using System.Xml.Linq;
using System.Runtime.InteropServices;

using Rhino.DocObjects;
using Rhino.Collections;
using GH_IO;
using GH_IO.Serialization;
# ---------- l_02_foreachloop: C# ----------
    List<double> numbers = new List<double>();

    foreach(double val in numList)
      numbers.Add(1 / (val - 1));

    function = numbers;
# ---------- end l_02_foreachloop ----------
construct_point_11 = ConstructPoint(XCoordinate=range_4, YCoordinate=l_02_foreachloop.function, ZCoordinate=0)  # disabled
interpolate_6 = Interpolate(Vertices=construct_point_11, Degree=3, Periodic=False, KnotStyle=1)  # -> Curve, Length, Domain; disabled

boolean_toggle = BooleanToggle(True)  # disabled

# ----
# illustrates the domain, range and graph of a function
number_slider_7 = Slider(1.959, range=0..4)  # disabled
number_slider_8 = Slider(4, range=0..4)  # disabled
construct_domain_4 = ConstructDomain(DomainStart=number_slider_7, DomainEnd=number_slider_8)  # disabled
A_2 = Slider(0.1, range=0..0.1)  # disabled
number_slider_9 = Slider(1, range=0..10)  # disabled
range_5 = Range(Domain=construct_domain_4, Steps=10)  # disabled
expression_2 = Expression(x=range_5, A=A_2, B=number_slider_9, Expression="A*x^2 + B")  # disabled
construct_point_12 = ConstructPoint(XCoordinate=range_5, YCoordinate=expression_2, ZCoordinate=0)  # disabled
construct_point_13 = ConstructPoint(XCoordinate=range_5, YCoordinate=0, ZCoordinate=0)  # disabled
construct_point_14 = ConstructPoint(XCoordinate=0, YCoordinate=expression_2, ZCoordinate=0)  # disabled
interpolate_7 = Interpolate(Vertices=construct_point_12, Degree=3, Periodic=False, KnotStyle=1)  # -> Curve, Length, Domain; disabled
interpolate_8 = Interpolate(Vertices=construct_point_13, Degree=3, Periodic=False, KnotStyle=1)  # -> Curve, Length, Domain; disabled
interpolate_9 = Interpolate(Vertices=construct_point_14, Degree=3, Periodic=False, KnotStyle=1)  # -> Curve, Length, Domain; disabled
curve_middle_2 = CurveMiddle(Curve=interpolate_8.Curve)  # disabled
curve_middle_3 = CurveMiddle(Curve=interpolate_9.Curve)  # disabled
point_on_curve_2 = PointOnCurve(interpolate_7.Curve, parameter=0.241)  # disabled
end_points_4 = EndPoints(Curve=interpolate_7.Curve)  # -> Start, End; disabled
end_points_5 = EndPoints(Curve=interpolate_8.Curve)  # -> Start, End; disabled
end_points_6 = EndPoints(Curve=interpolate_9.Curve)  # -> Start, End; disabled
deconstruct_2 = Deconstruct(Point=graft(point_on_curve_2))  # -> XComponent, YComponent, ZComponent; disabled
construct_point_15 = ConstructPoint(XCoordinate=0, YCoordinate=deconstruct_2.YComponent, ZCoordinate=0)  # disabled
construct_point_16 = ConstructPoint(XCoordinate=deconstruct_2.XComponent, YCoordinate=0, ZCoordinate=0)  # disabled
panel_9 = Panel(".12")  # disabled
line_7 = Line(StartPoint=construct_point_15, EndPoint=point_on_curve_2)  # disabled
line_8 = Line(StartPoint=construct_point_16, EndPoint=point_on_curve_2)  # disabled
line_9 = Line(StartPoint=end_points_5.Start, EndPoint=end_points_4.Start)  # disabled
line_10 = Line(StartPoint=end_points_6.Start, EndPoint=end_points_4.Start)  # disabled
line_11 = Line(StartPoint=end_points_5.End, EndPoint=end_points_4.End)  # disabled
line_12 = Line(StartPoint=end_points_6.End, EndPoint=end_points_4.End)  # disabled
panel_10 = Panel(".06")  # disabled
panel_11 = Panel("     R(f)     ")  # disabled
panel_12 = Panel("D(f)")  # disabled
panel_13 = Panel("""    
     y = f(x)""")  # disabled
panel_14 = Panel("f(x)     ")  # disabled
panel_15 = Panel("x")  # disabled
offset_curve_2 = OffsetCurve(
    Curve=[interpolate_7.Curve, interpolate_9.Curve, interpolate_8.Curve],
    Plane=PlaneXY(0, 0, 0),
    Distance=panel_10,
    BothSides=boolean_toggle,
    Kinks=0,
    CapType=1)  # disabled
boundary_surfaces_2 = BoundarySurfaces(Edges=offset_curve_2)  # disabled
# Since sqaures of numbers cannot be negative
# the square root function √x is defined for x >= 0 only
# - the uniqueness condition in the definition of function
# requires that there be only one value of √x
# for wach value x in D(√) = [0, ∞)
# 
# By convention, the term square root and the symbol √ always
# refer to the nonnegative aquare root
# Thus, while there are two numbers whose
# square is 4,
# only one of these is called √4, namely √4 = 2
# The graph y = √x is shown
# if we want to give both solutions of the equation
# x² = a, (a > 0),
# we can indicate them as x = √a and x = -√a
# - a common mistake is to write √x² = x
# THIS IS INCORRECT unless you know beforehand
# that x >= 0
# 
# This formula is always correct:
# The Square Root of a Square
# √x² = |x|
text_tag_3d_6 = TextTag3D(Location=curve_middle_3, Text=panel_11, Size=panel_9, Justification=1)  # disabled
text_tag_3d_7 = TextTag3D(Location=curve_middle_2, Text=panel_12, Size=panel_9, Justification=7)  # disabled
text_tag_3d_8 = TextTag3D(Location=point_on_curve_2, Text=panel_13, Size=panel_9, Justification=7)  # disabled
text_tag_3d_9 = TextTag3D(Location=construct_point_15, Text=panel_14, Size=panel_9, Justification=6)  # disabled
text_tag_3d_10 = TextTag3D(Location=construct_point_16, Text=panel_15, Size=panel_9, Justification=7)  # disabled

# ----
# working domain sets
number_slider_10 = Slider(1, range=0..1)
number_slider_11 = Slider(4, range=0..10)
construct_domain_5 = ConstructDomain(DomainStart=number_slider_10, DomainEnd=Slider(7, range=0..10))
construct_domain_6 = ConstructDomain(DomainStart=Slider(4, range=0..10), DomainEnd=Slider(10, range=0..10))
range_6 = Range(Domain=construct_domain_5, Steps=number_slider_11)
range_7 = Range(Domain=construct_domain_6, Steps=number_slider_11)
set_difference_s = SetDifferenceS(SetA=range_6, SetB=range_7)
create_set = CreateSet(List=range_6)  # -> Set, Map
set_union = SetUnion(SetA=range_6, SetB=range_7)
set_difference = SetDifference(SetA=range_6, SetB=range_7)
set_intersection = SetIntersection(SetA=range_6, SetB=range_7)
create_set_2 = CreateSet(List=range_7)  # -> Set, Map
panel_16 = Panel(set_intersection)
panel_17 = Panel(create_set.Set)
panel_18 = Panel(create_set_2.Set)

# ----
# S(x) = 1/(x - 1)
number_slider_12 = Slider(4, range=0..14)  # disabled
number_slider_13 = Slider(100, range=0..100)  # disabled
negative_6 = Negative(Value=number_slider_12)  # disabled
construct_domain_7 = ConstructDomain(DomainStart=negative_6, DomainEnd=number_slider_12)  # disabled
panel_19 = Panel("1")  # disabled
number_slider_14 = Slider(0, range=0..10)  # disabled
range_8 = Range(Domain=construct_domain_7, Steps=number_slider_13)  # disabled
smaller_than = SmallerThan(FirstNumber=range_8, SecondNumber=panel_19)  # -> SmallerThan, OrEqualTo; disabled
larger_than = LargerThan(FirstNumber=range_8, SecondNumber=panel_19)  # -> LargerThan, OrEqualTo; disabled
cull_pattern = CullPattern(List=range_8, CullPattern=larger_than.LargerThan)  # disabled
cull_pattern_2 = CullPattern(List=range_8, CullPattern=smaller_than.SmallerThan)  # disabled
xz_plane = XZPlane(Origin=Point(0, 0, 0))  # disabled
panel_20 = Panel(".12")  # disabled
panel_21 = Panel(".06")  # disabled
panel_22 = Panel("y         ")  # disabled
panel_23 = Panel("x")  # disabled

expression_3 = Expression(x=cull_pattern, A=panel_19, B=number_slider_14, Expression="1/(x - 1)")  # disabled
panel_24 = Panel("""    
     y = S(x)""")  # disabled
panel_25 = Panel("S(x)     ")  # disabled

expression_4 = Expression(x=cull_pattern_2, A=panel_19, B=number_slider_14, Expression="1/(x - 1)")  # disabled

construct_point_17 = ConstructPoint(XCoordinate=cull_pattern, YCoordinate=expression_3, ZCoordinate=0)  # disabled
construct_point_18 = ConstructPoint(XCoordinate=expression_3, YCoordinate=0, ZCoordinate=0)  # disabled
construct_point_19 = ConstructPoint(XCoordinate=cull_pattern_2, YCoordinate=expression_4, ZCoordinate=0)  # disabled
construct_point_20 = ConstructPoint(XCoordinate=0, YCoordinate=expression_4, ZCoordinate=0)  # disabled
interpolate_10 = Interpolate(Vertices=construct_point_19, Degree=3, Periodic=False, KnotStyle=1)  # -> Curve, Length, Domain; disabled
interpolate_11 = Interpolate(Vertices=construct_point_18, Degree=3, Periodic=False, KnotStyle=1)  # -> Curve, Length, Domain; disabled
interpolate_12 = Interpolate(Vertices=construct_point_20, Degree=3, Periodic=False, KnotStyle=1)  # -> Curve, Length, Domain; disabled
interpolate_13 = Interpolate(Vertices=construct_point_17, Degree=3, Periodic=False, KnotStyle=1)  # -> Curve, Length, Domain; disabled
mirror = Mirror(Geometry=interpolate_12.Curve, Plane=xz_plane)  # -> Geometry, Transform; disabled
point_on_curve_3 = PointOnCurve(interpolate_13.Curve, parameter=0.858)  # disabled
point_on_curve_4 = PointOnCurve(interpolate_11.Curve, parameter=0.868)  # disabled
point_on_curve_5 = PointOnCurve(mirror.Geometry, parameter=0.128)  # disabled
end_points_7 = EndPoints(Curve=interpolate_13.Curve)  # -> Start, End; disabled
end_points_8 = EndPoints(Curve=interpolate_11.Curve)  # -> Start, End; disabled
end_points_9 = EndPoints(Curve=interpolate_10.Curve)  # -> Start, End; disabled
deconstruct_3 = Deconstruct(Point=graft(point_on_curve_3))  # -> XComponent, YComponent, ZComponent; disabled
construct_point_21 = ConstructPoint(XCoordinate=deconstruct_3.XComponent, YCoordinate=0, ZCoordinate=0)  # disabled
construct_point_22 = ConstructPoint(XCoordinate=0, YCoordinate=deconstruct_3.YComponent, ZCoordinate=0)  # disabled
offset_curve_3 = OffsetCurve(
    Curve=[interpolate_13.Curve, interpolate_10.Curve],
    Plane=PlaneXY(0, 0, 0),
    Distance=panel_21,
    BothSides=False,
    Kinks=0,
    CapType=1)  # disabled
line_13 = Line(StartPoint=construct_point_22, EndPoint=point_on_curve_3)  # disabled
line_14 = Line(StartPoint=construct_point_21, EndPoint=point_on_curve_3)  # disabled
boundary_surfaces_3 = BoundarySurfaces(Edges=offset_curve_3)  # disabled
text_tag_3d_11 = TextTag3D(Location=point_on_curve_5, Text=panel_22, Size=panel_20, Justification=6)  # disabled
text_tag_3d_12 = TextTag3D(Location=point_on_curve_3, Text=panel_24, Size=panel_20, Justification=7)  # disabled
text_tag_3d_13 = TextTag3D(Location=construct_point_22, Text=panel_25, Size=panel_20, Justification=6)  # disabled
text_tag_3d_14 = TextTag3D(Location=[construct_point_21, point_on_curve_4], Text=panel_23, Size=panel_20, Justification=7)  # disabled

number_slider_15 = Slider(-4, range=-4..4.001)  # disabled
number_slider_16 = Slider(4, range=0..4)  # disabled
A_3 = Slider(0.1, range=0..0.1)  # disabled
number_slider_17 = Slider(1, range=0..10)  # disabled
panel_26 = Panel("1")  # disabled
panel_27 = Panel(".12")  # disabled
panel_28 = Panel(".06")  # disabled
panel_29 = Panel("     y    ")  # disabled
panel_30 = Panel("x")  # disabled
panel_31 = Panel("x")  # disabled

# ----
# k(x) = |x|
number_slider_18 = Slider(-4, range=-4..4.001)  # disabled
number_slider_19 = Slider(4, range=0..4)  # disabled
construct_domain_8 = ConstructDomain(DomainStart=number_slider_18, DomainEnd=number_slider_19)  # disabled
A_4 = Slider(0.1, range=0..0.1)  # disabled
number_slider_20 = Slider(0, range=0..10)  # disabled
range_9 = Range(Domain=construct_domain_8, Steps=10)  # disabled
panel_32 = Panel("1")  # disabled
construct_point_23 = ConstructPoint(XCoordinate=range_9, YCoordinate=0, ZCoordinate=0)  # disabled
interpolate_14 = Interpolate(Vertices=construct_point_23, Degree=3, Periodic=False, KnotStyle=1)  # -> Curve, Length, Domain; disabled
curve_middle_4 = CurveMiddle(Curve=interpolate_14.Curve)  # disabled
end_points_10 = EndPoints(Curve=interpolate_14.Curve)  # -> Start, End; disabled
panel_33 = Panel(".12")  # disabled
panel_34 = Panel(".06")  # disabled
panel_35 = Panel("     y    ")  # disabled
panel_36 = Panel("x")  # disabled
panel_37 = Panel("x")  # disabled
text_tag_3d_15 = TextTag3D(Location=end_points_10.End, Text=panel_36, Size=panel_33, Justification=7)  # disabled

expression_5 = Expression(x=range_9, A=panel_32, B=number_slider_20, Expression="A*abs(x) + B")  # disabled
panel_38 = Panel("1")  # disabled
panel_39 = Panel("""    
     y = k(x)""")  # disabled
panel_40 = Panel("k(x)     ")  # disabled

construct_point_24 = ConstructPoint(XCoordinate=range_9, YCoordinate=expression_5, ZCoordinate=0)  # disabled
construct_point_25 = ConstructPoint(XCoordinate=0, YCoordinate=expression_5, ZCoordinate=0)  # disabled
interpolate_15 = Interpolate(Vertices=construct_point_24, Degree=panel_38, Periodic=False, KnotStyle=1)  # -> Curve, Length, Domain; disabled
interpolate_16 = Interpolate(Vertices=construct_point_25, Degree=3, Periodic=False, KnotStyle=1)  # -> Curve, Length, Domain; disabled
point_on_curve_6 = PointOnCurve(interpolate_15.Curve, parameter=0.912)  # disabled
end_points_11 = EndPoints(Curve=interpolate_15.Curve)  # -> Start, End; disabled
end_points_12 = EndPoints(Curve=interpolate_16.Curve)  # -> Start, End; disabled
deconstruct_4 = Deconstruct(Point=graft(point_on_curve_6))  # -> XComponent, YComponent, ZComponent; disabled
construct_point_26 = ConstructPoint(XCoordinate=0, YCoordinate=deconstruct_4.YComponent, ZCoordinate=0)  # disabled
construct_point_27 = ConstructPoint(XCoordinate=deconstruct_4.XComponent, YCoordinate=0, ZCoordinate=0)  # disabled
line_15 = Line(StartPoint=construct_point_26, EndPoint=point_on_curve_6)  # disabled
line_16 = Line(StartPoint=construct_point_27, EndPoint=point_on_curve_6)  # disabled
line_17 = Line(StartPoint=end_points_10.Start, EndPoint=end_points_11.Start)  # disabled
line_18 = Line(StartPoint=end_points_12.Start, EndPoint=end_points_11.Start)  # disabled
line_19 = Line(StartPoint=end_points_10.End, EndPoint=end_points_11.End)  # disabled
line_20 = Line(StartPoint=end_points_12.End, EndPoint=end_points_11.End)  # disabled
offset_curve_4 = OffsetCurve(Curve=interpolate_15.Curve, Plane=PlaneXY(0, 0, 0), Distance=panel_34, BothSides=False, Kinks=0, CapType=1)  # disabled
boundary_surfaces_4 = BoundarySurfaces(Edges=offset_curve_4)  # disabled
text_tag_3d_16 = TextTag3D(Location=end_points_12.End, Text=panel_35, Size=panel_33, Justification=6)  # disabled
text_tag_3d_17 = TextTag3D(Location=point_on_curve_6, Text=panel_39, Size=panel_33, Justification=7)  # disabled
text_tag_3d_18 = TextTag3D(Location=construct_point_26, Text=panel_40, Size=panel_33, Justification=6)  # disabled
text_tag_3d_19 = TextTag3D(Location=construct_point_27, Text=panel_37, Size=panel_33, Justification=7)  # disabled

# ----
# g(x) = x²
# for -1 <= x < 2
panel_41 = Panel("-1")  # disabled
panel_42 = Panel("2")  # disabled
panel_43 = Panel("""    
     y = g(x)""")  # disabled
panel_44 = Panel("g(x)     ")  # disabled

construct_domain_9 = ConstructDomain(DomainStart=panel_41, DomainEnd=panel_42)  # disabled
range_10 = Range(Domain=construct_domain_9, Steps=10)  # disabled
construct_point_28 = ConstructPoint(XCoordinate=range_10, YCoordinate=0, ZCoordinate=0)  # disabled
interpolate_17 = Interpolate(Vertices=construct_point_28, Degree=3, Periodic=False, KnotStyle=1)  # -> Curve, Length, Domain; disabled
curve_middle_5 = CurveMiddle(Curve=interpolate_17.Curve)  # disabled
end_points_13 = EndPoints(Curve=interpolate_17.Curve)  # -> Start, End; disabled
text_tag_3d_20 = TextTag3D(Location=end_points_13.End, Text=panel_30, Size=panel_27, Justification=7)  # disabled

expression_6 = Expression(x=range_10, A=panel_26, B=number_slider_17, Expression="A*x^2 + B")  # disabled

construct_point_29 = ConstructPoint(XCoordinate=range_10, YCoordinate=expression_6, ZCoordinate=0)  # disabled
construct_point_30 = ConstructPoint(XCoordinate=0, YCoordinate=expression_6, ZCoordinate=0)  # disabled
interpolate_18 = Interpolate(Vertices=construct_point_29, Degree=3, Periodic=False, KnotStyle=1)  # -> Curve, Length, Domain; disabled
interpolate_19 = Interpolate(Vertices=construct_point_30, Degree=3, Periodic=False, KnotStyle=1)  # -> Curve, Length, Domain; disabled
point_on_curve_7 = PointOnCurve(interpolate_18.Curve, parameter=0.814)  # disabled
end_points_14 = EndPoints(Curve=interpolate_18.Curve)  # -> Start, End; disabled
end_points_15 = EndPoints(Curve=interpolate_19.Curve)  # -> Start, End; disabled
deconstruct_5 = Deconstruct(Point=graft(point_on_curve_7))  # -> XComponent, YComponent, ZComponent; disabled
construct_point_31 = ConstructPoint(XCoordinate=0, YCoordinate=deconstruct_5.YComponent, ZCoordinate=0)  # disabled
construct_point_32 = ConstructPoint(XCoordinate=deconstruct_5.XComponent, YCoordinate=0, ZCoordinate=0)  # disabled
line_21 = Line(StartPoint=construct_point_31, EndPoint=point_on_curve_7)  # disabled
line_22 = Line(StartPoint=construct_point_32, EndPoint=point_on_curve_7)  # disabled
line_23 = Line(StartPoint=end_points_13.Start, EndPoint=end_points_14.Start)  # disabled
line_24 = Line(StartPoint=end_points_15.Start, EndPoint=end_points_14.Start)  # disabled
line_25 = Line(StartPoint=end_points_13.End, EndPoint=end_points_14.End)  # disabled
line_26 = Line(StartPoint=end_points_15.End, EndPoint=end_points_14.End)  # disabled
offset_curve_5 = OffsetCurve(Curve=interpolate_18.Curve, Plane=PlaneXY(0, 0, 0), Distance=panel_28, BothSides=False, Kinks=0, CapType=1)  # disabled
boundary_surfaces_5 = BoundarySurfaces(Edges=offset_curve_5)  # disabled
text_tag_3d_21 = TextTag3D(Location=end_points_15.End, Text=panel_29, Size=panel_27, Justification=6)  # disabled
text_tag_3d_22 = TextTag3D(Location=point_on_curve_7, Text=panel_43, Size=panel_27, Justification=7)  # disabled
text_tag_3d_23 = TextTag3D(Location=construct_point_31, Text=panel_44, Size=panel_27, Justification=6)  # disabled
text_tag_3d_24 = TextTag3D(Location=construct_point_32, Text=panel_31, Size=panel_27, Justification=7)  # disabled

circle = Circle(Plane=end_points_14.Start, Radius=panel_27)  # disabled
boundary_surfaces_6 = BoundarySurfaces(Edges=circle)  # disabled
circle_2 = Circle(Plane=end_points_14.End, Radius=panel_27)  # disabled

# ----
# y  = √x
number_slider_21 = Slider(-4, range=-4..4.001)  # disabled
number_slider_22 = Slider(4, range=0..4)  # disabled
number_slider_23 = Slider(100, range=0..100)  # disabled
construct_domain_10 = ConstructDomain(DomainStart=number_slider_21, DomainEnd=number_slider_22)  # disabled
A_5 = Slider(0.1, range=0..0.1)  # disabled
number_slider_24 = Slider(0, range=0..10)  # disabled
range_11 = Range(Domain=construct_domain_10, Steps=number_slider_23)  # disabled
panel_45 = Panel("1")  # disabled
construct_point_33 = ConstructPoint(XCoordinate=range_11, YCoordinate=0, ZCoordinate=0)  # disabled
interpolate_20 = Interpolate(Vertices=construct_point_33, Degree=3, Periodic=False, KnotStyle=1)  # -> Curve, Length, Domain; disabled
curve_middle_6 = CurveMiddle(Curve=interpolate_20.Curve)  # disabled
end_points_16 = EndPoints(Curve=interpolate_20.Curve)  # -> Start, End; disabled
panel_46 = Panel(".12")  # disabled
panel_47 = Panel(".06")  # disabled
panel_48 = Panel("     y    ")  # disabled
panel_49 = Panel("x")  # disabled
panel_50 = Panel("x")  # disabled
text_tag_3d_25 = TextTag3D(Location=end_points_16.End, Text=panel_49, Size=panel_46, Justification=7)  # disabled

expression_7 = Expression(x=range_11, A=panel_45, B=number_slider_24, Expression="A*Sqrt(x) + B")  # disabled
panel_51 = Panel("""    
     y = Sqrt(x)""")  # disabled
panel_52 = Panel("Sqrt(x)     ")  # disabled

construct_point_34 = ConstructPoint(XCoordinate=range_11, YCoordinate=expression_7, ZCoordinate=0)  # disabled
construct_point_35 = ConstructPoint(XCoordinate=0, YCoordinate=expression_7, ZCoordinate=0)  # disabled
interpolate_21 = Interpolate(Vertices=construct_point_34, Degree=3, Periodic=False, KnotStyle=1)  # -> Curve, Length, Domain; disabled
interpolate_22 = Interpolate(Vertices=construct_point_35, Degree=3, Periodic=False, KnotStyle=1)  # -> Curve, Length, Domain; disabled
point_on_curve_8 = PointOnCurve(interpolate_21.Curve, parameter=0.73)  # disabled
end_points_17 = EndPoints(Curve=interpolate_21.Curve)  # -> Start, End; disabled
end_points_18 = EndPoints(Curve=interpolate_22.Curve)  # -> Start, End; disabled
deconstruct_6 = Deconstruct(Point=graft(point_on_curve_8))  # -> XComponent, YComponent, ZComponent; disabled
panel_53 = Panel(point_on_curve_8)  # disabled
construct_point_36 = ConstructPoint(XCoordinate=0, YCoordinate=deconstruct_6.YComponent, ZCoordinate=0)  # disabled
construct_point_37 = ConstructPoint(XCoordinate=deconstruct_6.XComponent, YCoordinate=0, ZCoordinate=0)  # disabled
line_27 = Line(StartPoint=construct_point_36, EndPoint=point_on_curve_8)  # disabled
line_28 = Line(StartPoint=construct_point_37, EndPoint=point_on_curve_8)  # disabled
line_29 = Line(StartPoint=end_points_16.Start, EndPoint=end_points_17.Start)  # disabled
line_30 = Line(StartPoint=end_points_18.Start, EndPoint=end_points_17.Start)  # disabled
line_31 = Line(StartPoint=end_points_16.End, EndPoint=end_points_17.End)  # disabled
line_32 = Line(StartPoint=end_points_18.End, EndPoint=end_points_17.End)  # disabled
offset_curve_6 = OffsetCurve(Curve=interpolate_21.Curve, Plane=PlaneXY(0, 0, 0), Distance=panel_47, BothSides=False, Kinks=0, CapType=1)  # disabled
boundary_surfaces_7 = BoundarySurfaces(Edges=offset_curve_6)  # disabled
text_tag_3d_26 = TextTag3D(Location=end_points_18.End, Text=panel_48, Size=panel_46, Justification=6)  # disabled
text_tag_3d_27 = TextTag3D(Location=point_on_curve_8, Text=panel_51, Size=panel_46, Justification=7)  # disabled
text_tag_3d_28 = TextTag3D(Location=construct_point_36, Text=panel_52, Size=panel_46, Justification=6)  # disabled
text_tag_3d_29 = TextTag3D(Location=construct_point_37, Text=panel_50, Size=panel_46, Justification=7)  # disabled

# ----
# the Signum Function:
# - Latin for "sign"
# the value of sgn x indicates whether x is positive
# or negative
# - the domain of sgn consists of all real numbers
# except zero
# - ero is not regarded as positive or negative
# but the range of sgn consists of only two numbers
# -1 and 1
# see graph of sgn below:
# y  = x/|x| = {1 if x > 0, -1 if x > 0}
number_slider_25 = Slider(0.001, range=0.001..4)  # disabled
number_slider_26 = Slider(4, range=0..4)  # disabled
negative_7 = Negative(Value=number_slider_25)  # disabled
negative_8 = Negative(Value=number_slider_26)  # disabled
construct_domain_11 = ConstructDomain(DomainStart=number_slider_25, DomainEnd=number_slider_26)  # disabled
construct_domain_12 = ConstructDomain(DomainStart=negative_7, DomainEnd=negative_8)  # disabled
number_slider_27 = Slider(100, range=0..1000000)  # disabled
panel_54 = Panel("2")  # disabled
A_6 = Slider(0.1, range=0..0.1)  # disabled
number_slider_28 = Slider(0, range=0..10)  # disabled
division = Division(A=number_slider_27, B=panel_54)  # disabled
range_12 = Range(Domain=[construct_domain_11, construct_domain_12], Steps=number_slider_27)  # disabled
panel_55 = Panel("1")  # disabled
cull_index = CullIndex(List=range_12, Indices=division, Wrap=True)  # disabled
construct_point_38 = ConstructPoint(XCoordinate=range_12, YCoordinate=0, ZCoordinate=0)  # disabled
interpolate_23 = Interpolate(Vertices=construct_point_38, Degree=3, Periodic=False, KnotStyle=1)  # -> Curve, Length, Domain; disabled
curve_middle_7 = CurveMiddle(Curve=interpolate_23.Curve)  # disabled
end_points_19 = EndPoints(Curve=interpolate_23.Curve)  # -> Start, End; disabled
panel_56 = Panel(".12")  # disabled
panel_57 = Panel(".06")  # disabled
panel_58 = Panel("     y    ")  # disabled
panel_59 = Panel("x")  # disabled
panel_60 = Panel("x")  # disabled
text_tag_3d_30 = TextTag3D(Location=end_points_19.End, Text=panel_59, Size=panel_56, Justification=7)  # disabled

expression_8 = Expression(x=cull_index, A=panel_55, B=number_slider_28, Expression="A*(x/abs(x)) + B")  # disabled
panel_61 = Panel("""    
     y = x/|x|""")  # disabled
panel_62 = Panel("x/|x|      ")  # disabled

construct_point_39 = ConstructPoint(XCoordinate=cull_index, YCoordinate=expression_8, ZCoordinate=0)  # disabled
interpolate_24 = Interpolate(Vertices=construct_point_39, Degree=3, Periodic=False, KnotStyle=1)  # -> Curve, Length, Domain; disabled
construct_point_40 = ConstructPoint(XCoordinate=0, YCoordinate=expression_8, ZCoordinate=0)  # disabled
interpolate_25 = Interpolate(Vertices=construct_point_40, Degree=3, Periodic=False, KnotStyle=1)  # -> Curve, Length, Domain; disabled
point_on_curve_9 = PointOnCurve(interpolate_24.Curve, parameter=0.523)  # disabled
end_points_20 = EndPoints(Curve=interpolate_24.Curve)  # -> Start, End; disabled
end_points_21 = EndPoints(Curve=interpolate_25.Curve)  # -> Start, End; disabled
deconstruct_7 = Deconstruct(Point=graft(point_on_curve_9))  # -> XComponent, YComponent, ZComponent; disabled
panel_63 = Panel(point_on_curve_9)  # disabled
construct_point_41 = ConstructPoint(XCoordinate=0, YCoordinate=deconstruct_7.YComponent, ZCoordinate=0)  # disabled
construct_point_42 = ConstructPoint(XCoordinate=deconstruct_7.XComponent, YCoordinate=0, ZCoordinate=0)  # disabled
line_33 = Line(StartPoint=construct_point_41, EndPoint=point_on_curve_9)  # disabled
line_34 = Line(StartPoint=construct_point_42, EndPoint=point_on_curve_9)  # disabled
line_35 = Line(StartPoint=end_points_19.Start, EndPoint=end_points_20.Start)  # disabled
line_36 = Line(StartPoint=end_points_21.Start, EndPoint=end_points_20.Start)  # disabled
line_37 = Line(StartPoint=end_points_19.End, EndPoint=end_points_20.End)  # disabled
line_38 = Line(StartPoint=end_points_21.End, EndPoint=end_points_20.End)  # disabled
offset_curve_7 = OffsetCurve(Curve=interpolate_24.Curve, Plane=PlaneXY(0, 0, 0), Distance=panel_57, BothSides=False, Kinks=0, CapType=1)  # disabled
boundary_surfaces_8 = BoundarySurfaces(Edges=offset_curve_7)  # disabled
text_tag_3d_31 = TextTag3D(Location=end_points_21.End, Text=panel_58, Size=panel_56, Justification=6)  # disabled
# By using a scientific calculator
# we can calculate approx values
# If we plot these values and try to draw a curve through them
# we may miss the cusp
# (an infinitely sharp point) at the origin
# Usless we calculate near x = 0
# we would likely miss a very important feature
# By using calculus we will not miss these features
# and without having to calculate many coordinates
text_tag_3d_32 = TextTag3D(Location=point_on_curve_9, Text=panel_61, Size=panel_56, Justification=7)  # disabled
text_tag_3d_33 = TextTag3D(Location=construct_point_41, Text=panel_62, Size=panel_56, Justification=6)  # disabled
text_tag_3d_34 = TextTag3D(Location=construct_point_42, Text=panel_60, Size=panel_56, Justification=7)  # disabled

curve = Curve(interpolate_24.Curve)  # disabled
dispatch = Dispatch(List=flatten(curve), DispatchPattern=[True, False])  # -> ListA, ListB; disabled
end_points_22 = EndPoints(Curve=dispatch.ListA)  # -> Start, End; disabled
end_points_23 = EndPoints(Curve=dispatch.ListB)  # -> Start, End; disabled

circle_3 = Circle(Plane=end_points_23.Start, Radius=panel_56)  # disabled
circle_4 = Circle(Plane=end_points_22.Start, Radius=panel_56)  # disabled

# ----
# more complicated functions have serious drawbacks
# when having to complete laborious computations
# "reasonable curves"
# ƒ(x) = x^(2/3)
number_slider_29 = Slider(0.001, range=0.001..4)  # disabled
number_slider_30 = Slider(4, range=0..4)  # disabled
negative_9 = Negative(Value=number_slider_30)  # disabled
negative_10 = Negative(Value=number_slider_29)  # disabled
construct_domain_13 = ConstructDomain(DomainStart=negative_9, DomainEnd=negative_10)  # disabled
construct_domain_14 = ConstructDomain(DomainStart=number_slider_29, DomainEnd=number_slider_30)  # disabled
number_slider_31 = Slider(28, range=0..100)  # disabled
A_7 = Slider(0.1, range=0..0.1)  # disabled
number_slider_32 = Slider(0, range=0..10)  # disabled
panel_64 = Panel("1")  # disabled
range_13 = Range(Domain=construct_domain_13, Steps=number_slider_31)  # disabled
range_14 = Range(Domain=construct_domain_14, Steps=number_slider_31)  # disabled
construct_point_43 = ConstructPoint(XCoordinate=range_14, YCoordinate=0, ZCoordinate=0)  # disabled
interpolate_26 = Interpolate(Vertices=construct_point_43, Degree=3, Periodic=False, KnotStyle=1)  # -> Curve, Length, Domain; disabled
curve_middle_8 = CurveMiddle(Curve=interpolate_26.Curve)  # disabled
end_points_24 = EndPoints(Curve=interpolate_26.Curve)  # -> Start, End; disabled
panel_65 = Panel(".12")  # disabled
boolean_toggle_2 = BooleanToggle(True)  # disabled
panel_66 = Panel(".03")  # disabled
panel_67 = Panel("     y    ")  # disabled
panel_68 = Panel("x")  # disabled
panel_69 = Panel("x")  # disabled
text_tag_3d_35 = TextTag3D(Location=end_points_24.End, Text=panel_68, Size=panel_65, Justification=7)  # disabled

expression_9 = Expression(x=range_14, A=panel_64, B=number_slider_32, Expression="A*(x^(2/3)) + B")  # disabled
reverse_list = ReverseList(List=range_13)  # disabled
panel_70 = Panel("""    
     ƒ(x) = x^(2/3)""")  # disabled
panel_71 = Panel("x^(2/3)")  # disabled

construct_point_44 = ConstructPoint(XCoordinate=range_14, YCoordinate=expression_9, ZCoordinate=0)  # disabled
construct_point_45 = ConstructPoint(XCoordinate=reverse_list, YCoordinate=expression_9, ZCoordinate=0)  # disabled
interpolate_27 = Interpolate(Vertices=construct_point_45, Degree=3, Periodic=False, KnotStyle=1)  # -> Curve, Length, Domain; disabled
interpolate_28 = Interpolate(Vertices=construct_point_44, Degree=3, Periodic=False, KnotStyle=1)  # -> Curve, Length, Domain; disabled
construct_point_46 = ConstructPoint(XCoordinate=0, YCoordinate=expression_9, ZCoordinate=0)  # disabled
interpolate_29 = Interpolate(Vertices=construct_point_46, Degree=3, Periodic=False, KnotStyle=1)  # -> Curve, Length, Domain; disabled
point_on_curve_10 = PointOnCurve(interpolate_28.Curve, parameter=0.523)  # disabled
end_points_25 = EndPoints(Curve=interpolate_28.Curve)  # -> Start, End; disabled
end_points_26 = EndPoints(Curve=interpolate_29.Curve)  # -> Start, End; disabled
deconstruct_8 = Deconstruct(Point=graft(point_on_curve_10))  # -> XComponent, YComponent, ZComponent; disabled
panel_72 = Panel(point_on_curve_10)  # disabled
construct_point_47 = ConstructPoint(XCoordinate=0, YCoordinate=deconstruct_8.YComponent, ZCoordinate=0)  # disabled
construct_point_48 = ConstructPoint(XCoordinate=deconstruct_8.XComponent, YCoordinate=0, ZCoordinate=0)  # disabled
line_39 = Line(StartPoint=construct_point_47, EndPoint=point_on_curve_10)  # disabled
line_40 = Line(StartPoint=construct_point_48, EndPoint=point_on_curve_10)  # disabled
line_41 = Line(StartPoint=end_points_24.Start, EndPoint=end_points_25.Start)  # disabled
line_42 = Line(StartPoint=end_points_26.Start, EndPoint=end_points_25.Start)  # disabled
line_43 = Line(StartPoint=end_points_24.End, EndPoint=end_points_25.End)  # disabled
line_44 = Line(StartPoint=end_points_26.End, EndPoint=end_points_25.End)  # disabled
offset_curve_8 = OffsetCurve(
    Curve=[interpolate_27.Curve, interpolate_28.Curve],
    Plane=PlaneXY(0, 0, 0),
    Distance=panel_66,
    BothSides=boolean_toggle_2,
    Kinks=0,
    CapType=1)  # disabled
boundary_surfaces_9 = BoundarySurfaces(Edges=offset_curve_8)  # disabled
text_tag_3d_36 = TextTag3D(Location=end_points_26.End, Text=panel_67, Size=panel_65, Justification=6)  # disabled
text_tag_3d_37 = TextTag3D(Location=point_on_curve_10, Text=panel_70, Size=panel_65, Justification=7)  # disabled
text_tag_3d_38 = TextTag3D(Location=construct_point_47, Text=panel_71, Size=panel_65, Justification=6)  # disabled
text_tag_3d_39 = TextTag3D(Location=construct_point_48, Text=panel_69, Size=panel_65, Justification=7)  # disabled

curve_2 = Curve([interpolate_27.Curve, interpolate_28.Curve])  # disabled
dispatch_2 = Dispatch(List=flatten(curve_2), DispatchPattern=[True, False])  # -> ListA, ListB; disabled
end_points_27 = EndPoints(Curve=dispatch_2.ListA)  # -> Start, End; disabled
end_points_28 = EndPoints(Curve=dispatch_2.ListB)  # -> Start, End; disabled

circle_5 = Circle(Plane=end_points_28.Start, Radius=panel_65)  # disabled
# Operations on Functions:
# - like numbers, functions can be added, subtracted,
# multiplied, and devided (except when the
# denominator is 0)
# to produce new functions
# - If ƒ and g are functions, then for every x
#  that belongs to both ƒ and g we define:
# 
# (ƒ + g)(x) = ƒ(x) + g(x)
# (ƒ - g)(x) = ƒ(x) - g(x)
# (ƒg)(x) = ƒ(x)g(x)
# (ƒ/g)(x) = ƒ(x)/g(x) where g(x) != 0
# 
# if c is a real number then
# (cƒ)(x) = cf(x)
# 
# be watchful of domains when performing operations
# - since D(ƒ) = [-1, ∞) and D(g) = (-∞, 0)∪(0,∞),
# therefore we have
# D(ƒ + g) = D(ƒ - g) = D(ƒ * g)= [-1, 0)∪(0,∞)
# and
# D(ƒ / g)= [-1, 0)∪(0, 1)∪(1, ∞)
# note g(0) is not defined
# 
# There is another method, called composition,
# by which functions can be combined to form new functions
# 
# Composition of Functions:
# - the composition of two functions ƒ and g is another function,
# denoted ƒ ⚬ g(x) = ƒ(g(x))
# for every x for which ƒ(g(x)) makes sense.
# Thus D(ƒ ⚬ g) consists of all numbers
# x in D(g) such that g(x) is in D(ƒ)
circle_6 = Circle(Plane=end_points_27.Start, Radius=panel_65)  # disabled

# ----
# ƒ ◦ g(x) = ƒ(g(x)) = Sqrt(g(x) = Sqrt(x + 1)
# D(ƒ ◦ g) = [-1, ∞)
number_slider_33 = Slider(4, range=0..4)  # disabled
# ƒ(x) = Sqrt(x) and g(x) = x + 1
# we can calculate the following compositions:
panel_73 = Panel("-1")  # disabled
construct_domain_15 = ConstructDomain(DomainStart=panel_73, DomainEnd=number_slider_33)  # disabled
number_slider_34 = Slider(100, range=0..100)  # disabled
number_slider_35 = Slider(1, range=0..10)  # disabled
A_8 = Slider(0.1, range=0..0.1)  # disabled
number_slider_36 = Slider(0, range=-5..5)  # disabled
range_15 = Range(Domain=construct_domain_15, Steps=number_slider_34)  # disabled
panel_74 = Panel("1")  # disabled
construct_point_49 = ConstructPoint(XCoordinate=range_15, YCoordinate=0, ZCoordinate=0)  # disabled
interpolate_30 = Interpolate(Vertices=construct_point_49, Degree=3, Periodic=False, KnotStyle=1)  # -> Curve, Length, Domain; disabled
curve_middle_9 = CurveMiddle(Curve=interpolate_30.Curve)  # disabled
end_points_29 = EndPoints(Curve=interpolate_30.Curve)  # -> Start, End; disabled
panel_75 = Panel(".12")  # disabled
boolean_toggle_3 = BooleanToggle(True)  # disabled
panel_76 = Panel(".03")  # disabled
panel_77 = Panel("     y    ")  # disabled
panel_78 = Panel("x")  # disabled
panel_79 = Panel("x")  # disabled
text_tag_3d_40 = TextTag3D(Location=end_points_29.End, Text=panel_78, Size=panel_75, Justification=7)  # disabled

# ----
# ƒ ◦ ƒ(x) = ƒ(ƒ(x)) = Sqrt(ƒ(x)) = Sqrt(Sqrt(x)) = x^(1/4)
# D(ƒ ◦ ƒ) = [0, ∞)
number_slider_37 = Slider(4, range=0..4)  # disabled
panel_80 = Panel("-1")  # disabled
construct_domain_16 = ConstructDomain(DomainStart=panel_80, DomainEnd=number_slider_37)  # disabled
number_slider_38 = Slider(100, range=0..100)  # disabled
number_slider_39 = Slider(1, range=0..10)  # disabled
A_9 = Slider(0.1, range=0..0.1)  # disabled
number_slider_40 = Slider(0, range=-5..5)  # disabled
range_16 = Range(Domain=construct_domain_16, Steps=number_slider_38)  # disabled
construct_point_50 = ConstructPoint(XCoordinate=range_16, YCoordinate=0, ZCoordinate=0)  # disabled
interpolate_31 = Interpolate(Vertices=construct_point_50, Degree=3, Periodic=False, KnotStyle=1)  # -> Curve, Length, Domain; disabled
curve_middle_10 = CurveMiddle(Curve=interpolate_31.Curve)  # disabled
end_points_30 = EndPoints(Curve=interpolate_31.Curve)  # -> Start, End; disabled
panel_82 = Panel(".12")  # disabled
boolean_toggle_4 = BooleanToggle(True)  # disabled
panel_83 = Panel(".03")  # disabled
panel_84 = Panel("     y    ")  # disabled
panel_85 = Panel("x")  # disabled
panel_86 = Panel("x")  # disabled
text_tag_3d_41 = TextTag3D(Location=end_points_30.End, Text=panel_85, Size=panel_82, Justification=7)  # disabled

# ----
# g ◦ g(x) = g(g(x)) = g(x) + 1 = (x + 1) + 1 = x + 2
# D(g ◦ g) = IR
number_slider_41 = Slider(4, range=0..4)  # disabled
panel_87 = Panel("-1")  # disabled
number_slider_42 = Slider(100, range=0..100)  # disabled
number_slider_43 = Slider(1, range=0..10)  # disabled
A_10 = Slider(0.1, range=0..0.1)  # disabled
number_slider_44 = Slider(0, range=-5..5)  # disabled
panel_89 = Panel(".12")  # disabled
boolean_toggle_5 = BooleanToggle(True)  # disabled
panel_90 = Panel(".03")  # disabled
panel_91 = Panel("     y    ")  # disabled
panel_92 = Panel("x")  # disabled
panel_93 = Panel("x")  # disabled

negative_11 = Negative(Value=number_slider_41)  # disabled

# ----
# g ◦ ƒ  ◦ g(x) = g(ƒ(g(x))) = ƒ(g(x)) + 1 = Sqrt(x + 1) + 1
# D(g ◦ ƒ  ◦ g(x)) = (-1, ∞)
number_slider_45 = Slider(4, range=0..4)  # disabled
panel_94 = Panel("-1")  # disabled
construct_domain_17 = ConstructDomain(DomainStart=panel_94, DomainEnd=number_slider_45)  # disabled
number_slider_46 = Slider(100, range=0..100)  # disabled
number_slider_47 = Slider(1, range=0..10)  # disabled
A_11 = Slider(0.1, range=0..0.1)  # disabled
number_slider_48 = Slider(0, range=-5..5)  # disabled
range_17 = Range(Domain=construct_domain_17, Steps=number_slider_46)  # disabled
construct_point_51 = ConstructPoint(XCoordinate=range_17, YCoordinate=0, ZCoordinate=0)  # disabled
interpolate_32 = Interpolate(Vertices=construct_point_51, Degree=3, Periodic=False, KnotStyle=1)  # -> Curve, Length, Domain; disabled
curve_middle_11 = CurveMiddle(Curve=interpolate_32.Curve)  # disabled
end_points_31 = EndPoints(Curve=interpolate_32.Curve)  # -> Start, End; disabled
panel_96 = Panel(".12")  # disabled
boolean_toggle_6 = BooleanToggle(True)  # disabled
panel_97 = Panel(".03")  # disabled
panel_98 = Panel("     y    ")  # disabled
panel_99 = Panel("x")  # disabled
panel_100 = Panel("x")  # disabled
text_tag_3d_42 = TextTag3D(Location=end_points_31.End, Text=panel_99, Size=panel_96, Justification=7)  # disabled

# ----
# g ◦ ƒ(x) = g(ƒ(x)) = ƒ(x) + 1 = Sqrt(x) + 1
# D(g ◦ ƒ) = [0, ∞)
number_slider_49 = Slider(4, range=0..4)  # disabled
panel_101 = Panel("0")  # disabled
construct_domain_18 = ConstructDomain(DomainStart=panel_101, DomainEnd=number_slider_49)  # disabled
number_slider_50 = Slider(100, range=0..100)  # disabled
number_slider_51 = Slider(0.64, range=0..10)  # disabled
A_12 = Slider(0.1, range=0..0.1)  # disabled
number_slider_52 = Slider(0, range=-5..5)  # disabled
range_18 = Range(Domain=construct_domain_18, Steps=number_slider_50)  # disabled
construct_point_52 = ConstructPoint(XCoordinate=range_18, YCoordinate=0, ZCoordinate=0)  # disabled
interpolate_33 = Interpolate(Vertices=construct_point_52, Degree=3, Periodic=False, KnotStyle=1)  # -> Curve, Length, Domain; disabled
curve_middle_12 = CurveMiddle(Curve=interpolate_33.Curve)  # disabled
end_points_32 = EndPoints(Curve=interpolate_33.Curve)  # -> Start, End; disabled
panel_103 = Panel(".12")  # disabled
boolean_toggle_7 = BooleanToggle(True)  # disabled
panel_104 = Panel(".03")  # disabled
panel_105 = Panel("     y    ")  # disabled
panel_106 = Panel("x")  # disabled
panel_107 = Panel("x")  # disabled
text_tag_3d_43 = TextTag3D(Location=end_points_32.End, Text=panel_106, Size=panel_103, Justification=7)  # disabled

construct_domain_19 = ConstructDomain(DomainStart=negative_11, DomainEnd=number_slider_41)  # disabled
range_19 = Range(Domain=construct_domain_19, Steps=number_slider_42)  # disabled
construct_point_53 = ConstructPoint(XCoordinate=range_19, YCoordinate=0, ZCoordinate=0)  # disabled
interpolate_34 = Interpolate(Vertices=construct_point_53, Degree=3, Periodic=False, KnotStyle=1)  # -> Curve, Length, Domain; disabled
curve_middle_13 = CurveMiddle(Curve=interpolate_34.Curve)  # disabled
end_points_33 = EndPoints(Curve=interpolate_34.Curve)  # -> Start, End; disabled
text_tag_3d_44 = TextTag3D(Location=end_points_33.End, Text=panel_92, Size=panel_89, Justification=7)  # disabled

expression_10 = Expression(x=range_19, A=number_slider_43, Expression="A * (x + 2)")  # disabled
curve_3 = Curve()  # disabled
dispatch_3 = Dispatch(List=flatten(curve_3), DispatchPattern=[True, False])  # -> ListA, ListB; disabled
end_points_34 = EndPoints(Curve=dispatch_3.ListA)  # -> Start, End; disabled
end_points_35 = EndPoints(Curve=dispatch_3.ListB)  # -> Start, End; disabled
panel_108 = Panel("""    
     g ◦ g(x) = A * (x + 2)""")  # disabled
panel_109 = Panel("A * (x + 2)")  # disabled

construct_point_54 = ConstructPoint(XCoordinate=range_19, YCoordinate=expression_10, ZCoordinate=0)  # disabled
interpolate_35 = Interpolate(Vertices=construct_point_54, Degree=3, Periodic=False, KnotStyle=1)  # -> Curve, Length, Domain; disabled
construct_point_55 = ConstructPoint(XCoordinate=0, YCoordinate=expression_10, ZCoordinate=0)  # disabled
interpolate_36 = Interpolate(Vertices=construct_point_55, Degree=3, Periodic=False, KnotStyle=1)  # -> Curve, Length, Domain; disabled
point_on_curve_11 = PointOnCurve(interpolate_35.Curve, parameter=0.711)  # disabled
end_points_36 = EndPoints(Curve=interpolate_35.Curve)  # -> Start, End; disabled
end_points_37 = EndPoints(Curve=interpolate_36.Curve)  # -> Start, End; disabled
deconstruct_9 = Deconstruct(Point=graft(point_on_curve_11))  # -> XComponent, YComponent, ZComponent; disabled
panel_110 = Panel(point_on_curve_11)  # disabled
construct_point_56 = ConstructPoint(XCoordinate=0, YCoordinate=deconstruct_9.YComponent, ZCoordinate=0)  # disabled
construct_point_57 = ConstructPoint(XCoordinate=deconstruct_9.XComponent, YCoordinate=0, ZCoordinate=0)  # disabled
line_45 = Line(StartPoint=construct_point_56, EndPoint=point_on_curve_11)  # disabled
line_46 = Line(StartPoint=construct_point_57, EndPoint=point_on_curve_11)  # disabled
line_47 = Line(StartPoint=end_points_33.Start, EndPoint=end_points_36.Start)  # disabled
line_48 = Line(StartPoint=end_points_37.Start, EndPoint=end_points_36.Start)  # disabled
line_49 = Line(StartPoint=end_points_33.End, EndPoint=end_points_36.End)  # disabled
line_50 = Line(StartPoint=end_points_37.End, EndPoint=end_points_36.End)  # disabled
offset_curve_9 = OffsetCurve(Curve=interpolate_35.Curve, Plane=PlaneXY(0, 0, 0), Distance=panel_90, BothSides=boolean_toggle_5, Kinks=0, CapType=1)  # disabled
boundary_surfaces_10 = BoundarySurfaces(Edges=offset_curve_9)  # disabled
circle_7 = Circle(Plane=end_points_35.Start, Radius=panel_89)  # disabled
text_tag_3d_45 = TextTag3D(Location=end_points_37.End, Text=panel_91, Size=panel_89, Justification=6)  # disabled
text_tag_3d_46 = TextTag3D(Location=point_on_curve_11, Text=panel_108, Size=panel_89, Justification=7)  # disabled
text_tag_3d_47 = TextTag3D(Location=construct_point_56, Text=panel_109, Size=panel_89, Justification=6)  # disabled
text_tag_3d_48 = TextTag3D(Location=construct_point_57, Text=panel_93, Size=panel_89, Justification=7)  # disabled
circle_8 = Circle(Plane=end_points_34.Start, Radius=panel_89)  # disabled

expression_11 = Expression(x=range_15, A=number_slider_35, Expression="A * (Sqrt(x + 1))")  # disabled
panel_111 = Panel("""    
     ƒ ◦ g(x) = A * (Sqrt(x + 1))""")  # disabled
panel_112 = Panel("A * (Sqrt(x + 1))")  # disabled

expression_12 = Expression(x=range_16, A=number_slider_39, Expression="A * (Sqrt(Sqrt(x)))")  # disabled
dispatch_4 = Dispatch(DispatchPattern=[True, False])  # -> ListA, ListB; disabled
end_points_38 = EndPoints(Curve=dispatch_4.ListB)  # -> Start, End; disabled
panel_113 = Panel("""    
     ƒ ◦ ƒ(x) = A * (x^(1/4))""")  # disabled
panel_114 = Panel("A * ((Sqrt(Sqrt(x)))")  # disabled

expression_13 = Expression(x=range_18, A=number_slider_51, Expression="A * (Sqrt(x) + 1)")  # disabled
dispatch_5 = Dispatch(DispatchPattern=[True, False])  # -> ListA, ListB; disabled
end_points_39 = EndPoints(Curve=dispatch_5.ListB)  # -> Start, End; disabled
panel_115 = Panel("""    
     g ◦ ƒ(x) = A * (Sqrt(x) + 1)""")  # disabled
panel_116 = Panel("A * (Sqrt(x) + 1)")  # disabled

expression_14 = Expression(x=range_17, A=number_slider_47, Expression="A * (Sqrt(x + 1) + 1)")  # disabled
panel_117 = Panel("""    
     g ◦ f ◦ g(x) = A * (Sqrt(x + 1) + 1)""")  # disabled
panel_118 = Panel("A * (Sqrt(x + 1) + 1)")  # disabled

construct_point_58 = ConstructPoint(XCoordinate=range_15, YCoordinate=expression_11, ZCoordinate=0)  # disabled
interpolate_37 = Interpolate(Vertices=construct_point_58, Degree=3, Periodic=False, KnotStyle=1)  # -> Curve, Length, Domain; disabled
construct_point_59 = ConstructPoint(XCoordinate=0, YCoordinate=expression_11, ZCoordinate=0)  # disabled
interpolate_38 = Interpolate(Vertices=construct_point_59, Degree=3, Periodic=False, KnotStyle=1)  # -> Curve, Length, Domain; disabled
point_on_curve_12 = PointOnCurve(interpolate_37.Curve, parameter=1)  # disabled
end_points_40 = EndPoints(Curve=interpolate_37.Curve)  # -> Start, End; disabled
end_points_41 = EndPoints(Curve=interpolate_38.Curve)  # -> Start, End; disabled
deconstruct_10 = Deconstruct(Point=graft(point_on_curve_12))  # -> XComponent, YComponent, ZComponent; disabled
panel_119 = Panel(point_on_curve_12)  # disabled
construct_point_60 = ConstructPoint(XCoordinate=0, YCoordinate=deconstruct_10.YComponent, ZCoordinate=0)  # disabled
construct_point_61 = ConstructPoint(XCoordinate=deconstruct_10.XComponent, YCoordinate=0, ZCoordinate=0)  # disabled
line_51 = Line(StartPoint=construct_point_60, EndPoint=point_on_curve_12)  # disabled
line_52 = Line(StartPoint=construct_point_61, EndPoint=point_on_curve_12)  # disabled
line_53 = Line(StartPoint=end_points_29.Start, EndPoint=end_points_40.Start)  # disabled
line_54 = Line(StartPoint=end_points_41.Start, EndPoint=end_points_40.Start)  # disabled
line_55 = Line(StartPoint=end_points_29.End, EndPoint=end_points_40.End)  # disabled
line_56 = Line(StartPoint=end_points_41.End, EndPoint=end_points_40.End)  # disabled
offset_curve_10 = OffsetCurve(Curve=interpolate_37.Curve, Plane=PlaneXY(0, 0, 0), Distance=panel_76, BothSides=boolean_toggle_3, Kinks=0, CapType=1)  # disabled
boundary_surfaces_11 = BoundarySurfaces(Edges=offset_curve_10)  # disabled
text_tag_3d_49 = TextTag3D(Location=end_points_41.End, Text=panel_77, Size=panel_75, Justification=6)  # disabled
text_tag_3d_50 = TextTag3D(Location=point_on_curve_12, Text=panel_111, Size=panel_75, Justification=7)  # disabled
text_tag_3d_51 = TextTag3D(Location=construct_point_60, Text=panel_112, Size=panel_75, Justification=6)  # disabled
text_tag_3d_52 = TextTag3D(Location=construct_point_61, Text=panel_79, Size=panel_75, Justification=7)  # disabled

curve_4 = Curve(interpolate_37.Curve)  # disabled
dispatch_6 = Dispatch(List=flatten(curve_4), DispatchPattern=[True, False])  # -> ListA, ListB; disabled
end_points_42 = EndPoints(Curve=dispatch_6.ListB)  # -> Start, End; disabled
end_points_43 = EndPoints(Curve=curve_4)  # -> Start, End; disabled

circle_9 = Circle(Plane=end_points_42.Start, Radius=panel_75)  # disabled
circle_10 = Circle(Plane=end_points_43.Start, Radius=panel_75)  # disabled
# if H(x) = (1 - x)/(1 + x)
# calculate H ◦ H(x) and specify its domain
# 
# H ◦ H(x) = (1 - H(x))/(1 + H(x)) =
# 
# (1 - ((1 - x)/(1 + x)) / (1 + ((1 - x)/(1 + x))) =
# 
# (1 + x - 1 + x)/(1 + x + 1 - x) = x,
# 
# forvided that x != -1
# the domain of H ◦ H(x) is
# (-∞, -1) U (-1, ∞) because H(x) is not
# defined for x = -1, neither is H(H(x))
boundary_surfaces_12 = BoundarySurfaces(Edges=circle_10)  # disabled

construct_point_62 = ConstructPoint(XCoordinate=range_18, YCoordinate=expression_13, ZCoordinate=0)  # disabled
interpolate_39 = Interpolate(Vertices=construct_point_62, Degree=3, Periodic=False, KnotStyle=1)  # -> Curve, Length, Domain; disabled
construct_point_63 = ConstructPoint(XCoordinate=0, YCoordinate=expression_13, ZCoordinate=0)  # disabled
interpolate_40 = Interpolate(Vertices=construct_point_63, Degree=3, Periodic=False, KnotStyle=1)  # -> Curve, Length, Domain; disabled
point_on_curve_13 = PointOnCurve(interpolate_39.Curve, parameter=1)  # disabled
end_points_44 = EndPoints(Curve=interpolate_39.Curve)  # -> Start, End; disabled
end_points_45 = EndPoints(Curve=interpolate_40.Curve)  # -> Start, End; disabled
deconstruct_11 = Deconstruct(Point=graft(point_on_curve_13))  # -> XComponent, YComponent, ZComponent; disabled
panel_120 = Panel(point_on_curve_13)  # disabled
construct_point_64 = ConstructPoint(XCoordinate=0, YCoordinate=deconstruct_11.YComponent, ZCoordinate=0)  # disabled
construct_point_65 = ConstructPoint(XCoordinate=deconstruct_11.XComponent, YCoordinate=0, ZCoordinate=0)  # disabled
line_57 = Line(StartPoint=construct_point_64, EndPoint=point_on_curve_13)  # disabled
line_58 = Line(StartPoint=construct_point_65, EndPoint=point_on_curve_13)  # disabled
line_59 = Line(StartPoint=end_points_32.Start, EndPoint=end_points_44.Start)  # disabled
line_60 = Line(StartPoint=end_points_45.Start, EndPoint=end_points_44.Start)  # disabled
line_61 = Line(StartPoint=end_points_32.End, EndPoint=end_points_44.End)  # disabled
line_62 = Line(StartPoint=end_points_45.End, EndPoint=end_points_44.End)  # disabled
circle_11 = Circle(Plane=end_points_39.Start, Radius=panel_103)  # disabled
offset_curve_11 = OffsetCurve(Curve=interpolate_39.Curve, Plane=PlaneXY(0, 0, 0), Distance=panel_104, BothSides=boolean_toggle_7, Kinks=0, CapType=1)  # disabled
boundary_surfaces_13 = BoundarySurfaces(Edges=offset_curve_11)  # disabled
text_tag_3d_53 = TextTag3D(Location=end_points_45.End, Text=panel_105, Size=panel_103, Justification=6)  # disabled
text_tag_3d_54 = TextTag3D(Location=point_on_curve_13, Text=panel_115, Size=panel_103, Justification=7)  # disabled
text_tag_3d_55 = TextTag3D(Location=construct_point_64, Text=panel_116, Size=panel_103, Justification=6)  # disabled
text_tag_3d_56 = TextTag3D(Location=construct_point_65, Text=panel_107, Size=panel_103, Justification=7)  # disabled

curve_5 = Curve(interpolate_39.Curve)  # disabled
end_points_46 = EndPoints(Curve=curve_5)  # -> Start, End; disabled

circle_12 = Circle(Plane=end_points_46.Start, Radius=panel_103)  # disabled
boundary_surfaces_14 = BoundarySurfaces(Edges=circle_12)  # disabled

construct_point_66 = ConstructPoint(XCoordinate=range_16, YCoordinate=expression_12, ZCoordinate=0)  # disabled
interpolate_41 = Interpolate(Vertices=construct_point_66, Degree=3, Periodic=False, KnotStyle=1)  # -> Curve, Length, Domain; disabled
construct_point_67 = ConstructPoint(XCoordinate=0, YCoordinate=expression_12, ZCoordinate=0)  # disabled
interpolate_42 = Interpolate(Vertices=construct_point_67, Degree=3, Periodic=False, KnotStyle=1)  # -> Curve, Length, Domain; disabled
point_on_curve_14 = PointOnCurve(interpolate_41.Curve, parameter=0.596)  # disabled
end_points_47 = EndPoints(Curve=interpolate_41.Curve)  # -> Start, End; disabled
end_points_48 = EndPoints(Curve=interpolate_42.Curve)  # -> Start, End; disabled
deconstruct_12 = Deconstruct(Point=graft(point_on_curve_14))  # -> XComponent, YComponent, ZComponent; disabled
panel_121 = Panel(point_on_curve_14)  # disabled
construct_point_68 = ConstructPoint(XCoordinate=0, YCoordinate=deconstruct_12.YComponent, ZCoordinate=0)  # disabled
construct_point_69 = ConstructPoint(XCoordinate=deconstruct_12.XComponent, YCoordinate=0, ZCoordinate=0)  # disabled
line_63 = Line(StartPoint=construct_point_68, EndPoint=point_on_curve_14)  # disabled
line_64 = Line(StartPoint=construct_point_69, EndPoint=point_on_curve_14)  # disabled
line_65 = Line(StartPoint=end_points_30.Start, EndPoint=end_points_47.Start)  # disabled
line_66 = Line(StartPoint=end_points_48.Start, EndPoint=end_points_47.Start)  # disabled
line_67 = Line(StartPoint=end_points_30.End, EndPoint=end_points_47.End)  # disabled
line_68 = Line(StartPoint=end_points_48.End, EndPoint=end_points_47.End)  # disabled
circle_13 = Circle(Plane=end_points_38.Start, Radius=panel_82)  # disabled
offset_curve_12 = OffsetCurve(Curve=interpolate_41.Curve, Plane=PlaneXY(0, 0, 0), Distance=panel_83, BothSides=boolean_toggle_4, Kinks=0, CapType=1)  # disabled
boundary_surfaces_15 = BoundarySurfaces(Edges=offset_curve_12)  # disabled
text_tag_3d_57 = TextTag3D(Location=end_points_48.End, Text=panel_84, Size=panel_82, Justification=6)  # disabled
text_tag_3d_58 = TextTag3D(Location=point_on_curve_14, Text=panel_113, Size=panel_82, Justification=7)  # disabled
text_tag_3d_59 = TextTag3D(Location=construct_point_68, Text=panel_114, Size=panel_82, Justification=6)  # disabled
text_tag_3d_60 = TextTag3D(Location=construct_point_69, Text=panel_86, Size=panel_82, Justification=7)  # disabled

curve_6 = Curve(interpolate_41.Curve)  # disabled
end_points_49 = EndPoints(Curve=curve_6)  # -> Start, End; disabled

circle_14 = Circle(Plane=end_points_49.Start, Radius=panel_82)  # disabled
boundary_surfaces_16 = BoundarySurfaces(Edges=circle_14)  # disabled

construct_point_70 = ConstructPoint(XCoordinate=range_17, YCoordinate=expression_14, ZCoordinate=0)  # disabled
interpolate_43 = Interpolate(Vertices=construct_point_70, Degree=3, Periodic=False, KnotStyle=1)  # -> Curve, Length, Domain; disabled
construct_point_71 = ConstructPoint(XCoordinate=0, YCoordinate=expression_14, ZCoordinate=0)  # disabled
interpolate_44 = Interpolate(Vertices=construct_point_71, Degree=3, Periodic=False, KnotStyle=1)  # -> Curve, Length, Domain; disabled
point_on_curve_15 = PointOnCurve(interpolate_43.Curve, parameter=0.862)  # disabled
end_points_50 = EndPoints(Curve=interpolate_43.Curve)  # -> Start, End; disabled
end_points_51 = EndPoints(Curve=interpolate_44.Curve)  # -> Start, End; disabled
deconstruct_13 = Deconstruct(Point=graft(point_on_curve_15))  # -> XComponent, YComponent, ZComponent; disabled
panel_122 = Panel(point_on_curve_15)  # disabled
construct_point_72 = ConstructPoint(XCoordinate=0, YCoordinate=deconstruct_13.YComponent, ZCoordinate=0)  # disabled
construct_point_73 = ConstructPoint(XCoordinate=deconstruct_13.XComponent, YCoordinate=0, ZCoordinate=0)  # disabled
line_69 = Line(StartPoint=construct_point_72, EndPoint=point_on_curve_15)  # disabled
line_70 = Line(StartPoint=construct_point_73, EndPoint=point_on_curve_15)  # disabled
line_71 = Line(StartPoint=end_points_31.Start, EndPoint=end_points_50.Start)  # disabled
line_72 = Line(StartPoint=end_points_51.Start, EndPoint=end_points_50.Start)  # disabled
line_73 = Line(StartPoint=end_points_31.End, EndPoint=end_points_50.End)  # disabled
line_74 = Line(StartPoint=end_points_51.End, EndPoint=end_points_50.End)  # disabled
offset_curve_13 = OffsetCurve(Curve=interpolate_43.Curve, Plane=PlaneXY(0, 0, 0), Distance=panel_97, BothSides=boolean_toggle_6, Kinks=0, CapType=1)  # disabled
boundary_surfaces_17 = BoundarySurfaces(Edges=offset_curve_13)  # disabled
text_tag_3d_61 = TextTag3D(Location=end_points_51.End, Text=panel_98, Size=panel_96, Justification=6)  # disabled
text_tag_3d_62 = TextTag3D(Location=point_on_curve_15, Text=panel_117, Size=panel_96, Justification=7)  # disabled
text_tag_3d_63 = TextTag3D(Location=construct_point_72, Text=panel_118, Size=panel_96, Justification=6)  # disabled
text_tag_3d_64 = TextTag3D(Location=construct_point_73, Text=panel_100, Size=panel_96, Justification=7)  # disabled

curve_7 = Curve(interpolate_43.Curve)  # disabled
dispatch_7 = Dispatch(List=flatten(curve_7), DispatchPattern=[True, False])  # -> ListA, ListB; disabled
end_points_52 = EndPoints(Curve=curve_7)  # -> Start, End; disabled
end_points_53 = EndPoints(Curve=dispatch_7.ListB)  # -> Start, End; disabled

circle_15 = Circle(Plane=end_points_53.Start, Radius=panel_96)  # disabled
circle_16 = Circle(Plane=end_points_52.Start, Radius=panel_96)  # disabled

# ----
# ƒ ◦ g(x) = ƒ(g(x)) = Sqrt(g(x) = Sqrt(x + 1)
# D(ƒ ◦ g) = [-1, ∞)
number_slider_53 = Slider(4, range=0..4)  # disabled
number_slider_54 = Slider(1.934, range=-5..5)  # disabled
negative_12 = Negative(Value=number_slider_53)  # disabled
construct_domain_20 = ConstructDomain(DomainStart=negative_12, DomainEnd=number_slider_54)  # disabled
construct_domain_21 = ConstructDomain(DomainStart=number_slider_54, DomainEnd=number_slider_53)  # disabled
number_slider_55 = Slider(100, range=0..100)  # disabled
number_slider_56 = Slider(1, range=0..10)  # disabled
range_20 = Range(Domain=construct_domain_21, Steps=number_slider_55)  # disabled
range_21 = Range(Domain=construct_domain_20, Steps=number_slider_55)  # disabled
construct_point_74 = ConstructPoint(XCoordinate=range_21, YCoordinate=0, ZCoordinate=0)  # disabled
construct_point_75 = ConstructPoint(XCoordinate=range_20, YCoordinate=0, ZCoordinate=0)  # disabled
interpolate_45 = Interpolate(Vertices=construct_point_74, Degree=3, Periodic=False, KnotStyle=1)  # -> Curve, Length, Domain; disabled
interpolate_46 = Interpolate(Vertices=construct_point_75, Degree=3, Periodic=False, KnotStyle=1)  # -> Curve, Length, Domain; disabled
curve_middle_14 = CurveMiddle(Curve=interpolate_45.Curve)  # disabled
end_points_54 = EndPoints(Curve=interpolate_45.Curve)  # -> Start, End; disabled
curve_middle_15 = CurveMiddle(Curve=interpolate_46.Curve)  # disabled
end_points_55 = EndPoints(Curve=interpolate_46.Curve)  # -> Start, End; disabled
panel_125 = Panel(".12")  # disabled
boolean_toggle_8 = BooleanToggle(True)  # disabled
panel_126 = Panel(".12")  # disabled
boolean_toggle_9 = BooleanToggle(True)  # disabled
panel_127 = Panel(".03")  # disabled
panel_128 = Panel(".03")  # disabled
panel_129 = Panel("     y    ")  # disabled
panel_130 = Panel("x")  # disabled
panel_131 = Panel("x")  # disabled
panel_132 = Panel("     y    ")  # disabled
panel_133 = Panel("x")  # disabled
panel_134 = Panel("x")  # disabled
text_tag_3d_65 = TextTag3D(Location=end_points_54.End, Text=panel_130, Size=panel_125, Justification=7)  # disabled
text_tag_3d_66 = TextTag3D(Location=end_points_55.End, Text=panel_133, Size=panel_126, Justification=7)  # disabled

expression_15 = Expression(x=range_21, A=number_slider_56, Expression="A * x")  # disabled
expression_16 = Expression(x=range_20, A=number_slider_56, Expression="A * x")  # disabled
panel_135 = Panel("""    
     H(x) = A * x""")  # disabled
panel_136 = Panel("A * x")  # disabled
panel_137 = Panel("""    
     H(x) = A * x""")  # disabled
panel_138 = Panel("A * x")  # disabled

construct_point_76 = ConstructPoint(XCoordinate=range_21, YCoordinate=expression_15, ZCoordinate=0)  # disabled
construct_point_77 = ConstructPoint(XCoordinate=range_20, YCoordinate=expression_16, ZCoordinate=0)  # disabled
interpolate_47 = Interpolate(Vertices=construct_point_76, Degree=3, Periodic=False, KnotStyle=1)  # -> Curve, Length, Domain; disabled
interpolate_48 = Interpolate(Vertices=construct_point_77, Degree=3, Periodic=False, KnotStyle=1)  # -> Curve, Length, Domain; disabled
construct_point_78 = ConstructPoint(XCoordinate=0, YCoordinate=expression_15, ZCoordinate=0)  # disabled
construct_point_79 = ConstructPoint(XCoordinate=0, YCoordinate=expression_16, ZCoordinate=0)  # disabled
interpolate_49 = Interpolate(Vertices=construct_point_78, Degree=3, Periodic=False, KnotStyle=1)  # -> Curve, Length, Domain; disabled
interpolate_50 = Interpolate(Vertices=construct_point_79, Degree=3, Periodic=False, KnotStyle=1)  # -> Curve, Length, Domain; disabled
point_on_curve_16 = PointOnCurve(interpolate_47.Curve, parameter=0.629)  # disabled
point_on_curve_17 = PointOnCurve(interpolate_48.Curve, parameter=0.629)  # disabled
end_points_56 = EndPoints(Curve=interpolate_47.Curve)  # -> Start, End; disabled
end_points_57 = EndPoints(Curve=interpolate_49.Curve)  # -> Start, End; disabled
end_points_58 = EndPoints(Curve=interpolate_48.Curve)  # -> Start, End; disabled
end_points_59 = EndPoints(Curve=interpolate_50.Curve)  # -> Start, End; disabled
deconstruct_14 = Deconstruct(Point=graft(point_on_curve_16))  # -> XComponent, YComponent, ZComponent; disabled
panel_139 = Panel(point_on_curve_16)  # disabled
deconstruct_15 = Deconstruct(Point=graft(point_on_curve_17))  # -> XComponent, YComponent, ZComponent; disabled
panel_140 = Panel(point_on_curve_17)  # disabled
construct_point_80 = ConstructPoint(XCoordinate=0, YCoordinate=deconstruct_14.YComponent, ZCoordinate=0)  # disabled
construct_point_81 = ConstructPoint(XCoordinate=deconstruct_14.XComponent, YCoordinate=0, ZCoordinate=0)  # disabled
construct_point_82 = ConstructPoint(XCoordinate=0, YCoordinate=deconstruct_15.YComponent, ZCoordinate=0)  # disabled
construct_point_83 = ConstructPoint(XCoordinate=deconstruct_15.XComponent, YCoordinate=0, ZCoordinate=0)  # disabled
line_75 = Line(StartPoint=construct_point_80, EndPoint=point_on_curve_16)  # disabled
line_76 = Line(StartPoint=construct_point_81, EndPoint=point_on_curve_16)  # disabled
line_77 = Line(StartPoint=end_points_54.Start, EndPoint=end_points_56.Start)  # disabled
line_78 = Line(StartPoint=end_points_57.Start, EndPoint=end_points_56.Start)  # disabled
line_79 = Line(StartPoint=end_points_54.End, EndPoint=end_points_56.End)  # disabled
line_80 = Line(StartPoint=end_points_57.End, EndPoint=end_points_56.End)  # disabled
line_81 = Line(StartPoint=construct_point_82, EndPoint=point_on_curve_17)  # disabled
line_82 = Line(StartPoint=construct_point_83, EndPoint=point_on_curve_17)  # disabled
line_83 = Line(StartPoint=end_points_55.Start, EndPoint=end_points_58.Start)  # disabled
line_84 = Line(StartPoint=end_points_59.End, EndPoint=end_points_58.End)  # disabled
line_85 = Line(StartPoint=end_points_59.Start, EndPoint=end_points_58.Start)  # disabled
line_86 = Line(StartPoint=end_points_55.End, EndPoint=end_points_58.End)  # disabled
offset_curve_14 = OffsetCurve(Curve=interpolate_47.Curve, Plane=PlaneXY(0, 0, 0), Distance=panel_127, BothSides=boolean_toggle_8, Kinks=0, CapType=1)  # disabled
offset_curve_15 = OffsetCurve(Curve=interpolate_48.Curve, Plane=PlaneXY(0, 0, 0), Distance=panel_128, BothSides=boolean_toggle_9, Kinks=0, CapType=1)  # disabled
boundary_surfaces_18 = BoundarySurfaces(Edges=offset_curve_14)  # disabled
text_tag_3d_67 = TextTag3D(Location=end_points_57.End, Text=panel_129, Size=panel_125, Justification=6)  # disabled
text_tag_3d_68 = TextTag3D(Location=point_on_curve_16, Text=panel_135, Size=panel_125, Justification=7)  # disabled
text_tag_3d_69 = TextTag3D(Location=construct_point_80, Text=panel_136, Size=panel_125, Justification=6)  # disabled
text_tag_3d_70 = TextTag3D(Location=construct_point_81, Text=panel_131, Size=panel_125, Justification=7)  # disabled
boundary_surfaces_19 = BoundarySurfaces(Edges=offset_curve_15)  # disabled
text_tag_3d_71 = TextTag3D(Location=end_points_59.End, Text=panel_132, Size=panel_126, Justification=6)  # disabled
text_tag_3d_72 = TextTag3D(Location=point_on_curve_17, Text=panel_137, Size=panel_126, Justification=7)  # disabled
text_tag_3d_73 = TextTag3D(Location=construct_point_82, Text=panel_138, Size=panel_126, Justification=6)  # disabled
text_tag_3d_74 = TextTag3D(Location=construct_point_83, Text=panel_134, Size=panel_126, Justification=7)  # disabled

curve_8 = Curve(interpolate_47.Curve)  # disabled
dispatch_8 = Dispatch(List=flatten(curve_8), DispatchPattern=[True, False])  # -> ListA, ListB; disabled
curve_9 = Curve(interpolate_48.Curve)  # disabled
dispatch_9 = Dispatch(List=flatten(curve_9), DispatchPattern=[True, False])  # -> ListA, ListB; disabled
end_points_60 = EndPoints(Curve=dispatch_8.ListB)  # -> Start, End; disabled
end_points_61 = EndPoints(Curve=curve_8)  # -> Start, End; disabled
end_points_62 = EndPoints(Curve=dispatch_9.ListB)  # -> Start, End; disabled
end_points_63 = EndPoints(Curve=curve_9)  # -> Start, End; disabled

circle_17 = Circle(Plane=end_points_60.Start, Radius=panel_125)  # disabled
circle_18 = Circle(Plane=end_points_62.Start, Radius=panel_126)  # disabled
# Odd and Even Functions:
# - graphs of a function will have certain kinds of symetry
# - the simplest kind  relates the value of
# ƒ at -1 to its value at x
# 
# Suppose that -x belongs to D(ƒ)
# we say that ƒ is an odd function if
# ƒ(-x) = -ƒ(x) for every x in D(ƒ)
# we say that ƒ is an even function if
# ƒ(-x) = ƒ(x) for every x in D(ƒ)
# 
# Odd powers of x such as x, x^3, x^5,...,x^(-1), x^(-3),... are odd functions
# even powers are even functions
# The absolute value function |x| is an even function
# any function which depends only on x^2
# is an even function of x
# 
# Note:
# the graph of an odd function is symetric about the origin
# a line drawn from any point on the graph
# passing through the origin will come to
# another point on the graph
# 
# the graph of an even functon is symetric about the y-axis
# a perpendicular line drawn from any point
# on the graph perpendicular to the y-axis will continue the same distance to another
# point on the graph
# 
# Note that an odd function defined at x = 0
# must vanish (=0) there
# because f(0) = f(-0) = -f(0) implies
# 2ƒ(0) = 0, and so ƒ(0) = 0
# Exercises:
circle_19 = Circle(Plane=end_points_61.End, Radius=panel_125)  # disabled
circle_20 = Circle(Plane=end_points_63.Start, Radius=panel_126)  # disabled
