# Grasshopper definition 029_exercises.gh (Grasshopper 1.0.7)
# plug-ins: HAL for Grasshopper, Pufferfish

# 1.3
# Functions:
# alt + 159 = ƒ
# Definition of a Function
# - a function ƒ is a rule that assigns to each element x
# in some set D(ƒ) (called the domain of ƒ)
# a unique object ƒ(x) called the value of ƒ at x
# - let's assume that our functions consist of real numbers
# and that the values of our functions are also real numbers
# - domain 𝐷(ƒ)
# - the squaring function on IR is the function
# ƒ that assigns to each real number x
# its square, x²:
# ƒ(x) = x², for x in IR
# - the domain of ƒ is the set of all real numbers:
# 𝐷(ƒ) = IR
# - it is common to refer to the function loosely as ƒ(x)
# - the squaring function is often simply
# called the function x²
# - another way of denoting the function is:
# ƒ : x → ƒ(x)
# - this reads as "the function ƒ that takes x to ƒ(x)
# - the squaring function can be donated:
# ƒ : x → x²
# or even more simply
# x → x²
# - this required that the domain be specified
# - if the functio g is defined by
# g(x) = x² for -1 <= x < 2,
# then g is not the same function as ƒ
# because g and ƒ have different domains
# - we don't want to specify for real numbers and real values
# The Domain Convention:
sessionsettings = SessionSettings()

# ----
# ƒ(x) = x²
# The Domain Convention:
# - Unless the domain of a function ƒ is given explicity,
# we assume that it is the largest set of real numbers
# for which ƒ(x) makes sense as a real number
# - x² has domain all real numbers
# 1/x² has domain all real numbers except 0
# 
# The Range of a Function
# - the range of function ƒ is the set of
# all real numbers that are
# values of the function: that is
# it is the set of all numbers y such that
# y = ƒ(x) for some x in D(ƒ).
# the range of ƒ is denotes at R(ƒ)
# 
# The Graph of a Function
# - the graph of a function ƒ is the graph
# of the equation y = ƒ(x) in the Cartesian plane
# Thus it is the set of all points with coordinates
# (x, ƒ(x)), where x belongs to D(ƒ)
number_slider = Slider(2.489, range=0..4)  # disabled
negative = Negative(Value=number_slider)  # disabled
construct_domain = ConstructDomain(DomainStart=negative, DomainEnd=number_slider)  # disabled
A = Slider(0.1, range=0..0.1)  # disabled
number_slider_2 = Slider(0, range=0..10)  # disabled
range = Range(Domain=construct_domain, Steps=10)  # disabled
panel = Panel("1")  # disabled
expression = Expression(x=range, A=panel, B=number_slider_2, Expression="A*x^2 + B")  # disabled
construct_point = ConstructPoint(XCoordinate=range, YCoordinate=expression, ZCoordinate=0)  # disabled
construct_point_2 = ConstructPoint(XCoordinate=range, YCoordinate=0, ZCoordinate=0)  # disabled
construct_point_3 = ConstructPoint(XCoordinate=0, YCoordinate=expression, ZCoordinate=0)  # disabled
interpolate = Interpolate(Vertices=construct_point, Degree=3, Periodic=False, KnotStyle=1)  # -> Curve, Length, Domain; disabled
interpolate_2 = Interpolate(Vertices=construct_point_2, Degree=3, Periodic=False, KnotStyle=1)  # -> Curve, Length, Domain; disabled
interpolate_3 = Interpolate(Vertices=construct_point_3, Degree=3, Periodic=False, KnotStyle=1)  # -> Curve, Length, Domain; disabled
curve_middle = CurveMiddle(Curve=interpolate_2.Curve)  # disabled
point_on_curve = PointOnCurve(interpolate.Curve, parameter=0.814)  # disabled
end_points = EndPoints(Curve=interpolate.Curve)  # -> Start, End; disabled
end_points_2 = EndPoints(Curve=interpolate_2.Curve)  # -> Start, End; disabled
end_points_3 = EndPoints(Curve=interpolate_3.Curve)  # -> Start, End; disabled
deconstruct = Deconstruct(Point=graft(point_on_curve))  # -> XComponent, YComponent, ZComponent; disabled
construct_point_4 = ConstructPoint(XCoordinate=0, YCoordinate=deconstruct.YComponent, ZCoordinate=0)  # disabled
construct_point_5 = ConstructPoint(XCoordinate=deconstruct.XComponent, YCoordinate=0, ZCoordinate=0)  # disabled
panel_2 = Panel(".12")  # disabled
line = Line(StartPoint=construct_point_4, EndPoint=point_on_curve)  # disabled
line_2 = Line(StartPoint=construct_point_5, EndPoint=point_on_curve)  # disabled
line_3 = Line(StartPoint=end_points_2.Start, EndPoint=end_points.Start)  # disabled
line_4 = Line(StartPoint=end_points_3.Start, EndPoint=end_points.Start)  # disabled
line_5 = Line(StartPoint=end_points_2.End, EndPoint=end_points.End)  # disabled
line_6 = Line(StartPoint=end_points_3.End, EndPoint=end_points.End)  # disabled
panel_3 = Panel(".06")  # disabled
panel_4 = Panel("     y    ")  # disabled
panel_5 = Panel("x")  # disabled
panel_6 = Panel("""    
     y = f(x)""")  # disabled
panel_7 = Panel("f(x)     ")  # disabled
panel_8 = Panel("x")  # disabled
offset_curve = OffsetCurve(Curve=interpolate.Curve, Plane=PlaneXY(0, 0, 0), Distance=panel_3, BothSides=False, Kinks=0, CapType=1)  # disabled
boundary_surfaces = BoundarySurfaces(Edges=offset_curve)  # disabled
text_tag_3d = TextTag3D(Location=end_points_3.End, Text=panel_4, Size=panel_2, Justification=6)  # disabled
text_tag_3d_2 = TextTag3D(Location=end_points_2.End, Text=panel_5, Size=panel_2, Justification=7)  # disabled
text_tag_3d_3 = TextTag3D(Location=point_on_curve, Text=panel_6, Size=panel_2, Justification=7)  # disabled
text_tag_3d_4 = TextTag3D(Location=construct_point_4, Text=panel_7, Size=panel_2, Justification=6)  # disabled
text_tag_3d_5 = TextTag3D(Location=construct_point_5, Text=panel_8, Size=panel_2, Justification=7)  # disabled

# ----
# Illustrate the domain, range and graph of function ƒ
# - note that the domain of the function ƒ can be
# regarded as the set of points on the x-axis
# and the range as a set on the y-axis
# - note that the graph of the function is such that any vertical
# line through a point in the domain meets the graph
# at exactly one point (because ƒ(x)
# IS A UNIQUE NUMBER FOR EACH X
# the horizontal line through this point
# on the graph meets the y-axis at ƒ(x)
# Thus ƒ(x) is the vertical displacement of that point
# on the graph
# x-axis and y-axis
xy_plane = XYPlane(Origin=Point(0, 0, 0))
range_2 = Range(Domain="5", Steps=10)
construct_point_6 = ConstructPoint(XCoordinate=range_2, YCoordinate=0, ZCoordinate=0)
construct_point_7 = ConstructPoint(XCoordinate=0, YCoordinate=range_2, ZCoordinate=0)
list_item = ListItem(List=construct_point_6, Index=0, Wrap=True)  # -> Item1, Item
list_item_2 = ListItem(List=construct_point_7, Index=0, Wrap=True)  # -> Item1, Item
construct_point_8 = ConstructPoint(XCoordinate=0, YCoordinate=0, ZCoordinate=0)
vector_2pt = Vector2Pt(PointA=list_item.Item, PointB=list_item.Item1, Unitize=False)  # -> Vector, Length
vector_2pt_2 = Vector2Pt(PointA=list_item_2.Item, PointB=list_item_2.Item1, Unitize=False)  # -> Vector, Length
negative_2 = Negative(Value=vector_2pt.Vector)
negative_3 = Negative(Value=vector_2pt_2.Vector)
vector_display = VectorDisplay(Anchor=construct_point_8, Vector=vector_2pt.Vector)
vector_display_2 = VectorDisplay(Anchor=construct_point_8, Vector=negative_2)
vector_display_3 = VectorDisplay(Anchor=construct_point_8, Vector=vector_2pt_2.Vector)
vector_display_4 = VectorDisplay(Anchor=construct_point_8, Vector=negative_3)

# ----
# ghPython
number_slider_3 = Slider(4, range=0..14)  # disabled
negative_4 = Negative(Value=number_slider_3)  # disabled
number_slider_4 = Slider(100, range=0..100)  # disabled
construct_domain_2 = ConstructDomain(DomainStart=negative_4, DomainEnd=number_slider_3)  # disabled
range_3 = Range(Domain=construct_domain_2, Steps=number_slider_4)  # disabled
ghpython_script = GhPythonScript(numList=range_3)  # -> out, numListX, numListY, y1, y2; inputs numList: list; disabled
# ---------- ghpython_script: Python ----------
__author__ = "Sculpture"
__version__ = "2021.07.15"

import rhinoscriptsyntax as rs

numbers1 = []
numListX = []
numbers2 = []
numListY = []

for valX in numList:
    if valX > 1:
        numListX.append(valX)
        numbers1.append(1/(valX - 1))
        y1 = numbers1
print numListX
    
for valY in numList:
    if valY < 1:
        numListY.append(valY)
        numbers2.append(1/(valY - 1))
        y2 = numbers2
print numListY
# ---------- end ghpython_script ----------
construct_point_9 = ConstructPoint(XCoordinate=ghpython_script.numListX, YCoordinate=ghpython_script.y1, ZCoordinate=0)  # disabled
construct_point_10 = ConstructPoint(XCoordinate=ghpython_script.numListY, YCoordinate=ghpython_script.y2, ZCoordinate=0)  # disabled
interpolate_4 = Interpolate(Vertices=construct_point_9, Degree=3, Periodic=False, KnotStyle=1)  # -> Curve, Length, Domain; disabled
interpolate_5 = Interpolate(Vertices=construct_point_10, Degree=3, Periodic=False, KnotStyle=1)  # -> Curve, Length, Domain; disabled

# ----
# C#
number_slider_5 = Slider(4, range=0..14)  # disabled
negative_5 = Negative(Value=number_slider_5)  # disabled
number_slider_6 = Slider(100, range=0..100)  # disabled
construct_domain_3 = ConstructDomain(DomainStart=negative_5, DomainEnd=number_slider_5)  # disabled
range_4 = Range(Domain=construct_domain_3, Steps=number_slider_6)  # disabled
l_02_foreachloop = L_02_ForeachLoop(numList=range_4)  # -> out, function; inputs numList: list of Double, func: Double; disabled
# ---------- l_02_foreachloop: C# usings ----------
using System.IO;
using System.Linq;
using System.Data;
using System.Drawing;
using System.Reflection;
using System.Windows.Forms;
using System.Xml;
using System.Xml.Linq;
using System.Runtime.InteropServices;

using Rhino.DocObjects;
using Rhino.Collections;
using GH_IO;
using GH_IO.Serialization;
# ---------- l_02_foreachloop: C# ----------
    List<double> numbers = new List<double>();

    foreach(double val in numList)
      numbers.Add(1 / (val - 1));

    function = numbers;
# ---------- end l_02_foreachloop ----------
construct_point_11 = ConstructPoint(XCoordinate=range_4, YCoordinate=l_02_foreachloop.function, ZCoordinate=0)  # disabled
interpolate_6 = Interpolate(Vertices=construct_point_11, Degree=3, Periodic=False, KnotStyle=1)  # -> Curve, Length, Domain; disabled

boolean_toggle = BooleanToggle(True)  # disabled

# ----
# illustrates the domain, range and graph of a function
number_slider_7 = Slider(1.959, range=0..4)  # disabled
number_slider_8 = Slider(4, range=0..4)  # disabled
construct_domain_4 = ConstructDomain(DomainStart=number_slider_7, DomainEnd=number_slider_8)  # disabled
A_2 = Slider(0.1, range=0..0.1)  # disabled
number_slider_9 = Slider(1, range=0..10)  # disabled
range_5 = Range(Domain=construct_domain_4, Steps=10)  # disabled
expression_2 = Expression(x=range_5, A=A_2, B=number_slider_9, Expression="A*x^2 + B")  # disabled
construct_point_12 = ConstructPoint(XCoordinate=range_5, YCoordinate=expression_2, ZCoordinate=0)  # disabled
construct_point_13 = ConstructPoint(XCoordinate=range_5, YCoordinate=0, ZCoordinate=0)  # disabled
construct_point_14 = ConstructPoint(XCoordinate=0, YCoordinate=expression_2, ZCoordinate=0)  # disabled
interpolate_7 = Interpolate(Vertices=construct_point_12, Degree=3, Periodic=False, KnotStyle=1)  # -> Curve, Length, Domain; disabled
interpolate_8 = Interpolate(Vertices=construct_point_13, Degree=3, Periodic=False, KnotStyle=1)  # -> Curve, Length, Domain; disabled
interpolate_9 = Interpolate(Vertices=construct_point_14, Degree=3, Periodic=False, KnotStyle=1)  # -> Curve, Length, Domain; disabled
curve_middle_2 = CurveMiddle(Curve=interpolate_8.Curve)  # disabled
curve_middle_3 = CurveMiddle(Curve=interpolate_9.Curve)  # disabled
point_on_curve_2 = PointOnCurve(interpolate_7.Curve, parameter=0.241)  # disabled
end_points_4 = EndPoints(Curve=interpolate_7.Curve)  # -> Start, End; disabled
end_points_5 = EndPoints(Curve=interpolate_8.Curve)  # -> Start, End; disabled
end_points_6 = EndPoints(Curve=interpolate_9.Curve)  # -> Start, End; disabled
deconstruct_2 = Deconstruct(Point=graft(point_on_curve_2))  # -> XComponent, YComponent, ZComponent; disabled
construct_point_15 = ConstructPoint(XCoordinate=0, YCoordinate=deconstruct_2.YComponent, ZCoordinate=0)  # disabled
construct_point_16 = ConstructPoint(XCoordinate=deconstruct_2.XComponent, YCoordinate=0, ZCoordinate=0)  # disabled
panel_9 = Panel(".12")  # disabled
line_7 = Line(StartPoint=construct_point_15, EndPoint=point_on_curve_2)  # disabled
line_8 = Line(StartPoint=construct_point_16, EndPoint=point_on_curve_2)  # disabled
line_9 = Line(StartPoint=end_points_5.Start, EndPoint=end_points_4.Start)  # disabled
line_10 = Line(StartPoint=end_points_6.Start, EndPoint=end_points_4.Start)  # disabled
line_11 = Line(StartPoint=end_points_5.End, EndPoint=end_points_4.End)  # disabled
line_12 = Line(StartPoint=end_points_6.End, EndPoint=end_points_4.End)  # disabled
panel_10 = Panel(".06")  # disabled
panel_11 = Panel("     R(f)     ")  # disabled
panel_12 = Panel("D(f)")  # disabled
panel_13 = Panel("""    
     y = f(x)""")  # disabled
panel_14 = Panel("f(x)     ")  # disabled
panel_15 = Panel("x")  # disabled
offset_curve_2 = OffsetCurve(
    Curve=[interpolate_7.Curve, interpolate_9.Curve, interpolate_8.Curve],
    Plane=PlaneXY(0, 0, 0),
    Distance=panel_10,
    BothSides=boolean_toggle,
    Kinks=0,
    CapType=1)  # disabled
boundary_surfaces_2 = BoundarySurfaces(Edges=offset_curve_2)  # disabled
# Since sqaures of numbers cannot be negative
# the square root function √x is defined for x >= 0 only
# - the uniqueness condition in the definition of function
# requires that there be only one value of √x
# for wach value x in D(√) = [0, ∞)
# 
# By convention, the term square root and the symbol √ always
# refer to the nonnegative aquare root
# Thus, while there are two numbers whose
# square is 4,
# only one of these is called √4, namely √4 = 2
# The graph y = √x is shown
# if we want to give both solutions of the equation
# x² = a, (a > 0),
# we can indicate them as x = √a and x = -√a
# - a common mistake is to write √x² = x
# THIS IS INCORRECT unless you know beforehand
# that x >= 0
# 
# This formula is always correct:
# The Square Root of a Square
# √x² = |x|
text_tag_3d_6 = TextTag3D(Location=curve_middle_3, Text=panel_11, Size=panel_9, Justification=1)  # disabled
text_tag_3d_7 = TextTag3D(Location=curve_middle_2, Text=panel_12, Size=panel_9, Justification=7)  # disabled
text_tag_3d_8 = TextTag3D(Location=point_on_curve_2, Text=panel_13, Size=panel_9, Justification=7)  # disabled
text_tag_3d_9 = TextTag3D(Location=construct_point_15, Text=panel_14, Size=panel_9, Justification=6)  # disabled
text_tag_3d_10 = TextTag3D(Location=construct_point_16, Text=panel_15, Size=panel_9, Justification=7)  # disabled

# ----
# working domain sets
number_slider_10 = Slider(1, range=0..1)
number_slider_11 = Slider(4, range=0..10)
construct_domain_5 = ConstructDomain(DomainStart=number_slider_10, DomainEnd=Slider(7, range=0..10))
construct_domain_6 = ConstructDomain(DomainStart=Slider(4, range=0..10), DomainEnd=Slider(10, range=0..10))
range_6 = Range(Domain=construct_domain_5, Steps=number_slider_11)
range_7 = Range(Domain=construct_domain_6, Steps=number_slider_11)
set_difference_s = SetDifferenceS(SetA=range_6, SetB=range_7)
create_set = CreateSet(List=range_6)  # -> Set, Map
set_union = SetUnion(SetA=range_6, SetB=range_7)
set_difference = SetDifference(SetA=range_6, SetB=range_7)
set_intersection = SetIntersection(SetA=range_6, SetB=range_7)
create_set_2 = CreateSet(List=range_7)  # -> Set, Map
panel_16 = Panel(set_intersection)
panel_17 = Panel(create_set.Set)
panel_18 = Panel(create_set_2.Set)

number_slider_12 = Slider(16, range=0..100)  # disabled
number_slider_13 = Slider(4, range=0..4)  # disabled
negative_6 = Negative(Value=number_slider_13)  # disabled
construct_domain_7 = ConstructDomain(DomainStart=negative_6, DomainEnd=number_slider_13)  # disabled
range_8 = Range(Domain=construct_domain_7, Steps=number_slider_12)  # disabled

number_slider_14 = Slider(16, range=0..100)  # disabled
# Exercises:
# Single Domains
number_slider_15 = Slider(4, range=0..4)  # disabled
negative_7 = Negative(Value=number_slider_15)  # disabled
construct_domain_8 = ConstructDomain(DomainStart=negative_7, DomainEnd=number_slider_15)  # disabled
range_9 = Range(Domain=construct_domain_8, Steps=number_slider_14)  # disabled

number_slider_16 = Slider(16, range=0..100)  # disabled
number_slider_17 = Slider(4, range=0..4)  # disabled
negative_8 = Negative(Value=number_slider_17)  # disabled
construct_domain_9 = ConstructDomain(DomainStart=negative_8, DomainEnd=number_slider_17)  # disabled
range_10 = Range(Domain=construct_domain_9, Steps=number_slider_16)  # disabled

number_slider_18 = Slider(4, range=0..4)  # disabled
number_slider_19 = Slider(24, range=0..100)  # disabled
panel_19 = Panel("2")  # disabled
construct_domain_10 = ConstructDomain(DomainStart=panel_19, DomainEnd=number_slider_18)  # disabled
# ƒ(x) = Sqrt(x - 2)
range_11 = Range(Domain=construct_domain_10, Steps=number_slider_19)  # disabled

# ----
# ƒ(x) = Sqrt(1 - x^2)
panel_20 = Panel("0")  # disabled
number_slider_20 = Slider(48, range=0..100)  # disabled

number_slider_21 = Slider(4, range=0..4)  # disabled
negative_9 = Negative(Value=number_slider_21)  # disabled
construct_domain_11 = ConstructDomain(DomainStart=negative_9, DomainEnd=number_slider_21)  # disabled
range_12 = Range(Domain=construct_domain_11, Steps=number_slider_20)  # disabled

# ----
# ƒ(x) = (x - 2)^2 - B)
number_slider_22 = Slider(48, range=0..100)  # disabled

number_slider_23 = Slider(4, range=0..4)  # disabled
negative_10 = Negative(Value=number_slider_23)  # disabled
construct_domain_12 = ConstructDomain(DomainStart=negative_10, DomainEnd=number_slider_23)  # disabled
range_13 = Range(Domain=construct_domain_12, Steps=number_slider_22)  # disabled

# ----
# ƒ(x) = 1/(x^2 + B)
number_slider_24 = Slider(48, range=0..100)  # disabled

number_slider_25 = Slider(4, range=0..4)  # disabled
negative_11 = Negative(Value=number_slider_25)  # disabled
construct_domain_13 = ConstructDomain(DomainStart=negative_11, DomainEnd=number_slider_25)  # disabled
range_14 = Range(Domain=construct_domain_13, Steps=number_slider_24)  # disabled

# ----
# ƒ(x) = 2 - x
number_slider_26 = Slider(1, range=0..10)  # disabled
number_slider_27 = Slider(0, range=0..10)  # disabled
panel_21 = Panel("A * (2 - x)")  # disabled
expression_3 = Expression(x=range_8, A=number_slider_26, B=number_slider_27, Expression="A * (2 - x)")  # disabled

number_slider_28 = Slider(1, range=0..10)  # disabled
number_slider_29 = Slider(0, range=0..10)  # disabled
expression_4 = Expression(x=range_11, A=number_slider_28, B=number_slider_29, Expression="A * (Sqrt(x - 2))")  # disabled
panel_22 = Panel("""A * (Sqrt(x - 2))
       """)  # disabled

# ----
# ƒ(x) = 5
number_slider_30 = Slider(1, range=0..10)  # disabled
number_slider_31 = Slider(0, range=0..10)  # disabled
panel_23 = Panel(""" 
     A * 5 + B""")  # disabled
expression_5 = Expression(x=range_9, A=number_slider_30, B=number_slider_31, Expression="A * 5 + B")  # disabled

# ----
# ƒ(x) = 2 - x^2
number_slider_32 = Slider(1, range=0..10)  # disabled
number_slider_33 = Slider(0, range=0..10)  # disabled
panel_24 = Panel("A * (2 - x^2)")  # disabled
expression_6 = Expression(x=range_10, A=number_slider_32, B=number_slider_33, Expression="A * (2 - x^2)")  # disabled

number_slider_34 = Slider(3, range=0..10)  # disabled
number_slider_35 = Slider(1, range=0..10)  # disabled
expression_7 = Expression(x=range_12, A=number_slider_35, B=number_slider_34, Expression="A * (Sqrt(B^2 - x^2))")  # disabled
panel_25 = Panel("""     A * (Sqrt(B^2 - x^2))
         for  -B <= x <= B""")  # disabled

number_slider_36 = Slider(4, range=0..10)  # disabled
number_slider_37 = Slider(0.26, range=0..10)  # disabled
expression_8 = Expression(x=range_13, A=number_slider_37, B=number_slider_36, Expression="A * ((x - 2)^2 - B)")  # disabled
panel_26 = Panel("     A * ((x - 2)^2 - B)")  # disabled

number_slider_38 = Slider(0.823, range=0..10)  # disabled
number_slider_39 = Slider(3.27, range=0..10)  # disabled
expression_9 = Expression(x=range_14, A=number_slider_39, B=number_slider_38, Expression="A * (1/(x^2 + B))")  # disabled
panel_27 = Panel("     A * (1/(x^2 + B))")  # disabled

construct_point_17 = ConstructPoint(XCoordinate=range_8, YCoordinate=expression_3, ZCoordinate=0)  # disabled
construct_point_18 = ConstructPoint(XCoordinate=range_8, YCoordinate=0, ZCoordinate=0)  # disabled
construct_point_19 = ConstructPoint(XCoordinate=0, YCoordinate=range_8, ZCoordinate=0)  # disabled
interpolate_10 = Interpolate(Vertices=construct_point_18, Degree=3, Periodic=False, KnotStyle=1)  # -> Curve, Length, Domain; disabled
interpolate_11 = Interpolate(Vertices=construct_point_19, Degree=3, Periodic=False, KnotStyle=1)  # -> Curve, Length, Domain; disabled
interpolate_12 = Interpolate(Vertices=construct_point_17, Degree=3, Periodic=False, KnotStyle=1)  # -> Curve, Length, Domain; disabled

construct_point_20 = ConstructPoint(XCoordinate=range_9, YCoordinate=expression_5, ZCoordinate=0)  # disabled
construct_point_21 = ConstructPoint(XCoordinate=range_9, YCoordinate=0, ZCoordinate=0)  # disabled
construct_point_22 = ConstructPoint(XCoordinate=0, YCoordinate=range_9, ZCoordinate=0)  # disabled
interpolate_13 = Interpolate(Vertices=construct_point_21, Degree=3, Periodic=False, KnotStyle=1)  # -> Curve, Length, Domain; disabled
interpolate_14 = Interpolate(Vertices=construct_point_22, Degree=3, Periodic=False, KnotStyle=1)  # -> Curve, Length, Domain; disabled
interpolate_15 = Interpolate(Vertices=construct_point_20, Degree=3, Periodic=False, KnotStyle=1)  # -> Curve, Length, Domain; disabled

construct_point_23 = ConstructPoint(XCoordinate=range_11, YCoordinate=0, ZCoordinate=0)  # disabled
construct_point_24 = ConstructPoint(XCoordinate=0, YCoordinate=range_11, ZCoordinate=0)  # disabled
construct_point_25 = ConstructPoint(XCoordinate=range_11, YCoordinate=expression_4, ZCoordinate=0)  # disabled
interpolate_16 = Interpolate(Vertices=construct_point_23, Degree=3, Periodic=False, KnotStyle=1)  # -> Curve, Length, Domain; disabled
interpolate_17 = Interpolate(Vertices=construct_point_24, Degree=3, Periodic=False, KnotStyle=1)  # -> Curve, Length, Domain; disabled
interpolate_18 = Interpolate(Vertices=construct_point_25, Degree=3, Periodic=False, KnotStyle=1)  # -> Curve, Length, Domain; disabled

construct_point_26 = ConstructPoint(XCoordinate=range_10, YCoordinate=expression_6, ZCoordinate=0)  # disabled
construct_point_27 = ConstructPoint(XCoordinate=range_10, YCoordinate=0, ZCoordinate=0)  # disabled
construct_point_28 = ConstructPoint(XCoordinate=0, YCoordinate=range_10, ZCoordinate=0)  # disabled
interpolate_19 = Interpolate(Vertices=construct_point_27, Degree=3, Periodic=False, KnotStyle=1)  # -> Curve, Length, Domain; disabled
interpolate_20 = Interpolate(Vertices=construct_point_28, Degree=3, Periodic=False, KnotStyle=1)  # -> Curve, Length, Domain; disabled
interpolate_21 = Interpolate(Vertices=construct_point_26, Degree=3, Periodic=False, KnotStyle=1)  # -> Curve, Length, Domain; disabled

construct_point_29 = ConstructPoint(XCoordinate=range_12, YCoordinate=expression_7, ZCoordinate=0)  # disabled
construct_point_30 = ConstructPoint(XCoordinate=range_12, YCoordinate=0, ZCoordinate=0)  # disabled
construct_point_31 = ConstructPoint(XCoordinate=0, YCoordinate=range_12, ZCoordinate=0)  # disabled
interpolate_22 = Interpolate(Vertices=construct_point_30, Degree=3, Periodic=False, KnotStyle=1)  # -> Curve, Length, Domain; disabled
interpolate_23 = Interpolate(Vertices=construct_point_31, Degree=3, Periodic=False, KnotStyle=1)  # -> Curve, Length, Domain; disabled
interpolate_24 = Interpolate(Vertices=construct_point_29, Degree=3, Periodic=False, KnotStyle=1)  # -> Curve, Length, Domain; disabled

construct_point_32 = ConstructPoint(XCoordinate=range_13, YCoordinate=expression_8, ZCoordinate=0)  # disabled
construct_point_33 = ConstructPoint(XCoordinate=range_13, YCoordinate=0, ZCoordinate=0)  # disabled
construct_point_34 = ConstructPoint(XCoordinate=0, YCoordinate=range_13, ZCoordinate=0)  # disabled
interpolate_25 = Interpolate(Vertices=construct_point_33, Degree=3, Periodic=False, KnotStyle=1)  # -> Curve, Length, Domain; disabled
interpolate_26 = Interpolate(Vertices=construct_point_34, Degree=3, Periodic=False, KnotStyle=1)  # -> Curve, Length, Domain; disabled
interpolate_27 = Interpolate(Vertices=construct_point_32, Degree=3, Periodic=False, KnotStyle=1)  # -> Curve, Length, Domain; disabled

construct_point_35 = ConstructPoint(XCoordinate=range_14, YCoordinate=expression_9, ZCoordinate=0)  # disabled
construct_point_36 = ConstructPoint(XCoordinate=range_14, YCoordinate=0, ZCoordinate=0)  # disabled
construct_point_37 = ConstructPoint(XCoordinate=0, YCoordinate=range_14, ZCoordinate=0)  # disabled
interpolate_28 = Interpolate(Vertices=construct_point_36, Degree=3, Periodic=False, KnotStyle=1)  # -> Curve, Length, Domain; disabled
interpolate_29 = Interpolate(Vertices=construct_point_37, Degree=3, Periodic=False, KnotStyle=1)  # -> Curve, Length, Domain; disabled
interpolate_30 = Interpolate(Vertices=construct_point_35, Degree=3, Periodic=False, KnotStyle=1)  # -> Curve, Length, Domain; disabled

curve_middle_4 = CurveMiddle(Curve=interpolate_10.Curve)  # disabled
point_on_curve_3 = PointOnCurve(interpolate_12.Curve, parameter=0.821)  # disabled
end_points_7 = EndPoints(Curve=interpolate_10.Curve)  # -> Start, End; disabled
end_points_8 = EndPoints(Curve=interpolate_11.Curve)  # -> Start, End; disabled
deconstruct_3 = Deconstruct(Point=point_on_curve_3)  # -> XComponent, YComponent, ZComponent; disabled
construct_point_38 = ConstructPoint(XCoordinate=0, YCoordinate=deconstruct_3.YComponent, ZCoordinate=0)  # disabled
construct_point_39 = ConstructPoint(XCoordinate=deconstruct_3.XComponent, YCoordinate=0, ZCoordinate=0)  # disabled

curve_middle_5 = CurveMiddle(Curve=interpolate_13.Curve)  # disabled
point_on_curve_4 = PointOnCurve(interpolate_15.Curve, parameter=0.144)  # disabled
end_points_9 = EndPoints(Curve=interpolate_13.Curve)  # -> Start, End; disabled
end_points_10 = EndPoints(Curve=interpolate_14.Curve)  # -> Start, End; disabled
deconstruct_4 = Deconstruct(Point=point_on_curve_4)  # -> XComponent, YComponent, ZComponent; disabled
construct_point_40 = ConstructPoint(XCoordinate=0, YCoordinate=deconstruct_4.YComponent, ZCoordinate=0)  # disabled
construct_point_41 = ConstructPoint(XCoordinate=deconstruct_4.XComponent, YCoordinate=0, ZCoordinate=0)  # disabled

curve_middle_6 = CurveMiddle(Curve=interpolate_16.Curve)  # disabled
point_on_curve_5 = PointOnCurve(interpolate_18.Curve, parameter=1)  # disabled
end_points_11 = EndPoints(Curve=interpolate_16.Curve)  # -> Start, End; disabled
end_points_12 = EndPoints(Curve=interpolate_17.Curve)  # -> Start, End; disabled
deconstruct_5 = Deconstruct(Point=point_on_curve_5)  # -> XComponent, YComponent, ZComponent; disabled
construct_point_42 = ConstructPoint(XCoordinate=0, YCoordinate=deconstruct_5.YComponent, ZCoordinate=0)  # disabled
construct_point_43 = ConstructPoint(XCoordinate=deconstruct_5.XComponent, YCoordinate=0, ZCoordinate=0)  # disabled

curve_middle_7 = CurveMiddle(Curve=interpolate_19.Curve)  # disabled
point_on_curve_6 = PointOnCurve(interpolate_21.Curve, parameter=0.654)  # disabled
end_points_13 = EndPoints(Curve=interpolate_19.Curve)  # -> Start, End; disabled
end_points_14 = EndPoints(Curve=interpolate_20.Curve)  # -> Start, End; disabled
deconstruct_6 = Deconstruct(Point=point_on_curve_6)  # -> XComponent, YComponent, ZComponent; disabled
construct_point_44 = ConstructPoint(XCoordinate=0, YCoordinate=deconstruct_6.YComponent, ZCoordinate=0)  # disabled
construct_point_45 = ConstructPoint(XCoordinate=deconstruct_6.XComponent, YCoordinate=0, ZCoordinate=0)  # disabled

curve_middle_8 = CurveMiddle(Curve=interpolate_22.Curve)  # disabled
point_on_curve_7 = PointOnCurve(interpolate_24.Curve, parameter=0.751)  # disabled
end_points_15 = EndPoints(Curve=interpolate_22.Curve)  # -> Start, End; disabled
end_points_16 = EndPoints(Curve=interpolate_23.Curve)  # -> Start, End; disabled
deconstruct_7 = Deconstruct(Point=point_on_curve_7)  # -> XComponent, YComponent, ZComponent; disabled
construct_point_46 = ConstructPoint(XCoordinate=0, YCoordinate=deconstruct_7.YComponent, ZCoordinate=0)  # disabled
construct_point_47 = ConstructPoint(XCoordinate=deconstruct_7.XComponent, YCoordinate=0, ZCoordinate=0)  # disabled

curve_middle_9 = CurveMiddle(Curve=interpolate_25.Curve)  # disabled
end_points_17 = EndPoints(Curve=interpolate_25.Curve)  # -> Start, End; disabled
point_on_curve_8 = PointOnCurve(interpolate_27.Curve, parameter=1)  # disabled
end_points_18 = EndPoints(Curve=interpolate_26.Curve)  # -> Start, End; disabled
deconstruct_8 = Deconstruct(Point=point_on_curve_8)  # -> XComponent, YComponent, ZComponent; disabled
construct_point_48 = ConstructPoint(XCoordinate=0, YCoordinate=deconstruct_8.YComponent, ZCoordinate=0)  # disabled
construct_point_49 = ConstructPoint(XCoordinate=deconstruct_8.XComponent, YCoordinate=0, ZCoordinate=0)  # disabled

curve_middle_10 = CurveMiddle(Curve=interpolate_28.Curve)  # disabled
point_on_curve_9 = PointOnCurve(interpolate_30.Curve, parameter=0.751)  # disabled
end_points_19 = EndPoints(Curve=interpolate_28.Curve)  # -> Start, End; disabled
end_points_20 = EndPoints(Curve=interpolate_29.Curve)  # -> Start, End; disabled
deconstruct_9 = Deconstruct(Point=point_on_curve_9)  # -> XComponent, YComponent, ZComponent; disabled
construct_point_50 = ConstructPoint(XCoordinate=0, YCoordinate=deconstruct_9.YComponent, ZCoordinate=0)  # disabled
construct_point_51 = ConstructPoint(XCoordinate=deconstruct_9.XComponent, YCoordinate=0, ZCoordinate=0)  # disabled

boolean_toggle_2 = BooleanToggle(True)  # disabled
panel_28 = Panel(".03")  # disabled
offset_curve_3 = OffsetCurve(Curve=interpolate_12.Curve, Plane=PlaneXY(0, 0, 0), Distance=panel_28, BothSides=boolean_toggle_2, Kinks=0, CapType=1)  # disabled
line_13 = Line(StartPoint=construct_point_39, EndPoint=point_on_curve_3)  # disabled
line_14 = Line(StartPoint=construct_point_38, EndPoint=point_on_curve_3)  # disabled
boundary_surfaces_3 = BoundarySurfaces(Edges=offset_curve_3)  # disabled
curve = Curve(interpolate_12.Curve)  # disabled

boolean_toggle_3 = BooleanToggle(True)  # disabled
panel_29 = Panel(".03")  # disabled
offset_curve_4 = OffsetCurve(Curve=interpolate_15.Curve, Plane=PlaneXY(0, 0, 0), Distance=panel_29, BothSides=boolean_toggle_3, Kinks=0, CapType=1)  # disabled
line_15 = Line(StartPoint=construct_point_41, EndPoint=point_on_curve_4)  # disabled
line_16 = Line(StartPoint=construct_point_40, EndPoint=point_on_curve_4)  # disabled
boundary_surfaces_4 = BoundarySurfaces(Edges=offset_curve_4)  # disabled
curve_2 = Curve(interpolate_15.Curve)  # disabled

boolean_toggle_4 = BooleanToggle(True)  # disabled
panel_30 = Panel(".03")  # disabled
offset_curve_5 = OffsetCurve(Curve=interpolate_21.Curve, Plane=PlaneXY(0, 0, 0), Distance=panel_30, BothSides=boolean_toggle_4, Kinks=0, CapType=1)  # disabled
line_17 = Line(StartPoint=construct_point_45, EndPoint=point_on_curve_6)  # disabled
line_18 = Line(StartPoint=construct_point_44, EndPoint=point_on_curve_6)  # disabled
boundary_surfaces_5 = BoundarySurfaces(Edges=offset_curve_5)  # disabled
curve_3 = Curve(interpolate_21.Curve)  # disabled

panel_31 = Panel("      ƒ(x) = ")  # disabled
panel_32 = Panel("x")  # disabled
panel_33 = Panel("0         ")  # disabled
concatenate = Concatenate(FragmentA=panel_31, FragmentB=panel_22)  # disabled
panel_34 = Panel(".12")  # disabled
text_tag_3d_11 = TextTag3D(Location=point_on_curve_5, Text=concatenate, Size=panel_34, Justification=7)  # disabled
text_tag_3d_12 = TextTag3D(Location=construct_point_42, Text=panel_22, Size=panel_34, Justification=1)  # disabled
text_tag_3d_13 = TextTag3D(Location=construct_point_43, Text=panel_32, Size=panel_34, Justification=7)  # disabled
text_tag_3d_14 = TextTag3D(Location=curve_middle_6, Text=panel_33, Size=panel_34, Justification=3)  # disabled

boolean_toggle_5 = BooleanToggle(True)  # disabled
panel_35 = Panel(".03")  # disabled
offset_curve_6 = OffsetCurve(Curve=interpolate_18.Curve, Plane=PlaneXY(0, 0, 0), Distance=panel_35, BothSides=boolean_toggle_5, Kinks=0, CapType=1)  # disabled
line_19 = Line(StartPoint=construct_point_43, EndPoint=point_on_curve_5)  # disabled
boundary_surfaces_6 = BoundarySurfaces(Edges=offset_curve_6)  # disabled
line_20 = Line(StartPoint=construct_point_42, EndPoint=point_on_curve_5)  # disabled
curve_4 = Curve(interpolate_18.Curve)  # disabled

panel_36 = Panel("      ƒ(x) = ")  # disabled
panel_37 = Panel("x")  # disabled
panel_38 = Panel("0         ")  # disabled
concatenate_2 = Concatenate(FragmentA=panel_36, FragmentB=panel_25)  # disabled
panel_39 = Panel(".12")  # disabled
text_tag_3d_15 = TextTag3D(Location=point_on_curve_7, Text=concatenate_2, Size=panel_39, Justification=7)  # disabled
text_tag_3d_16 = TextTag3D(Location=construct_point_46, Text=panel_25, Size=panel_39, Justification=1)  # disabled
text_tag_3d_17 = TextTag3D(Location=construct_point_47, Text=panel_37, Size=panel_39, Justification=7)  # disabled
text_tag_3d_18 = TextTag3D(Location=curve_middle_8, Text=panel_38, Size=panel_39, Justification=3)  # disabled

panel_40 = Panel("      ƒ(x) = ")  # disabled
panel_41 = Panel("x")  # disabled
panel_42 = Panel("0         ")  # disabled
concatenate_3 = Concatenate(FragmentA=panel_40, FragmentB=panel_26)  # disabled
panel_43 = Panel(".12")  # disabled
text_tag_3d_19 = TextTag3D(Location=point_on_curve_8, Text=concatenate_3, Size=panel_43, Justification=7)  # disabled
text_tag_3d_20 = TextTag3D(Location=construct_point_48, Text=panel_26, Size=panel_43, Justification=1)  # disabled
text_tag_3d_21 = TextTag3D(Location=construct_point_49, Text=panel_41, Size=panel_43, Justification=7)  # disabled
text_tag_3d_22 = TextTag3D(Location=curve_middle_9, Text=panel_42, Size=panel_43, Justification=3)  # disabled

panel_44 = Panel("      ƒ(x) = ")  # disabled
panel_45 = Panel("x")  # disabled
panel_46 = Panel("0         ")  # disabled
concatenate_4 = Concatenate(FragmentA=panel_44, FragmentB=panel_27)  # disabled
panel_47 = Panel(".12")  # disabled
text_tag_3d_23 = TextTag3D(Location=point_on_curve_9, Text=concatenate_4, Size=panel_47, Justification=7)  # disabled
text_tag_3d_24 = TextTag3D(Location=construct_point_50, Text=panel_27, Size=panel_47, Justification=1)  # disabled
text_tag_3d_25 = TextTag3D(Location=construct_point_51, Text=panel_45, Size=panel_47, Justification=7)  # disabled
text_tag_3d_26 = TextTag3D(Location=curve_middle_10, Text=panel_46, Size=panel_47, Justification=3)  # disabled

boolean_toggle_6 = BooleanToggle(True)  # disabled
panel_48 = Panel(".03")  # disabled
offset_curve_7 = OffsetCurve(Curve=interpolate_24.Curve, Plane=PlaneXY(0, 0, 0), Distance=panel_48, BothSides=boolean_toggle_6, Kinks=0, CapType=1)  # disabled
line_21 = Line(StartPoint=construct_point_47, EndPoint=point_on_curve_7)  # disabled
line_22 = Line(StartPoint=construct_point_46, EndPoint=point_on_curve_7)  # disabled
boundary_surfaces_7 = BoundarySurfaces(Edges=offset_curve_7)  # disabled
curve_5 = Curve(interpolate_24.Curve)  # disabled

boolean_toggle_7 = BooleanToggle(True)  # disabled
panel_49 = Panel(".03")  # disabled
offset_curve_8 = OffsetCurve(Curve=interpolate_27.Curve, Plane=PlaneXY(0, 0, 0), Distance=panel_49, BothSides=boolean_toggle_7, Kinks=0, CapType=1)  # disabled
line_23 = Line(StartPoint=construct_point_49, EndPoint=point_on_curve_8)  # disabled
line_24 = Line(StartPoint=construct_point_48, EndPoint=point_on_curve_8)  # disabled
boundary_surfaces_8 = BoundarySurfaces(Edges=offset_curve_8)  # disabled
curve_6 = Curve(interpolate_27.Curve)  # disabled

boolean_toggle_8 = BooleanToggle(True)  # disabled
panel_50 = Panel(".03")  # disabled
offset_curve_9 = OffsetCurve(Curve=interpolate_30.Curve, Plane=PlaneXY(0, 0, 0), Distance=panel_50, BothSides=boolean_toggle_8, Kinks=0, CapType=1)  # disabled
line_25 = Line(StartPoint=construct_point_51, EndPoint=point_on_curve_9)  # disabled
line_26 = Line(StartPoint=construct_point_50, EndPoint=point_on_curve_9)  # disabled
boundary_surfaces_9 = BoundarySurfaces(Edges=offset_curve_9)  # disabled
curve_7 = Curve(interpolate_30.Curve)  # disabled

# ----
# ƒ(x) = (x + 1)/x
# ƒ(x) = (x + 1)/x
number_slider_40 = Slider(24, range=0..100)  # disabled
panel_51 = Panel("0")  # disabled

number_slider_41 = Slider(4, range=0..4)  # disabled
construct_domain_14 = ConstructDomain(DomainStart=panel_51, DomainEnd=number_slider_41)  # disabled
range_15 = Range(Domain=construct_domain_14, Steps=number_slider_40)  # disabled

number_slider_42 = Slider(4, range=0..4)  # disabled
negative_12 = Negative(Value=number_slider_42)  # disabled
construct_domain_15 = ConstructDomain(DomainStart=negative_12, DomainEnd=panel_51)  # disabled
range_16 = Range(Domain=construct_domain_15, Steps=number_slider_40)  # disabled

# ----
# ƒ(x) = 1/((2 + x)
# ƒ(x) = 1/((2 + x)
number_slider_43 = Slider(26, range=0..100)  # disabled
panel_52 = Panel("-2")  # disabled

number_slider_44 = Slider(4, range=0..4)  # disabled
construct_domain_16 = ConstructDomain(DomainStart=panel_52, DomainEnd=number_slider_44)  # disabled
range_17 = Range(Domain=construct_domain_16, Steps=number_slider_43)  # disabled

# ----
# Multiple Domains
number_slider_45 = Slider(4, range=0..4)  # disabled
negative_13 = Negative(Value=number_slider_45)  # disabled
construct_domain_17 = ConstructDomain(DomainStart=negative_13, DomainEnd=panel_52)  # disabled
range_18 = Range(Domain=construct_domain_17, Steps=number_slider_43)  # disabled

# ----
# ƒ(x) = x /(1 - x)
# ƒ(x) = x /(1 - x)
number_slider_46 = Slider(24, range=0..100)  # disabled
panel_53 = Panel("1")  # disabled

number_slider_47 = Slider(4, range=0..4)  # disabled
construct_domain_18 = ConstructDomain(DomainStart=panel_53, DomainEnd=number_slider_47)  # disabled
range_19 = Range(Domain=construct_domain_18, Steps=number_slider_46)  # disabled

number_slider_48 = Slider(4, range=0..4)  # disabled
negative_14 = Negative(Value=number_slider_48)  # disabled
construct_domain_19 = ConstructDomain(DomainStart=negative_14, DomainEnd=panel_53)  # disabled
range_20 = Range(Domain=construct_domain_19, Steps=number_slider_46)  # disabled

number_slider_49 = Slider(4, range=0..4)  # disabled
negative_15 = Negative(Value=number_slider_49)  # disabled
panel_54 = Panel("0")  # disabled
panel_55 = Panel("1")  # disabled
number_slider_50 = Slider(100, range=0..100)  # disabled
construct_domain_20 = ConstructDomain(DomainStart=panel_55, DomainEnd=number_slider_49)  # disabled
construct_domain_21 = ConstructDomain(DomainStart=negative_15, DomainEnd=panel_54)  # disabled
range_21 = Range(Domain=construct_domain_21, Steps=number_slider_50)  # disabled
range_22 = Range(Domain=construct_domain_20, Steps=number_slider_50)  # disabled

number_slider_51 = Slider(0, range=-4..4)  # disabled
square = Square(Value=number_slider_51)  # disabled
subtraction = Subtraction(A=square, B=number_slider_51)  # disabled
panel_56 = Panel(subtraction)  # disabled

number_slider_52 = Slider(1, range=0..10)  # disabled
number_slider_53 = Slider(0, range=0..10)  # disabled
expression_10 = Expression(x=range_17, A=number_slider_52, B=number_slider_53, Expression="A * (1/(2 + x))")  # disabled
panel_57 = Panel("""A * (1/(2 + x))
       for x > -2""")  # disabled

number_slider_54 = Slider(1, range=0..10)  # disabled
number_slider_55 = Slider(0, range=0..10)  # disabled
expression_11 = Expression(x=range_18, A=number_slider_54, B=number_slider_55, Expression="A * (1/(2 + x))")  # disabled
panel_58 = Panel("""A * (1/(2 + x))
       for x < -2""")  # disabled

number_slider_56 = Slider(1, range=0..10)  # disabled
number_slider_57 = Slider(0, range=0..10)  # disabled
expression_12 = Expression(x=range_15, A=number_slider_56, B=number_slider_57, Expression="A * ((x + 1)/x)")  # disabled
panel_59 = Panel("""A * ((x + 1)/x)
       for x > 0""")  # disabled

number_slider_58 = Slider(1, range=0..10)  # disabled
number_slider_59 = Slider(0, range=0..10)  # disabled
expression_13 = Expression(x=range_16, A=number_slider_58, B=number_slider_59, Expression="A * ((x + 1)/x)")  # disabled
panel_60 = Panel("""A * ((x + 1)/x)
       for x < 0""")  # disabled

# ----
# ƒ(x) = Sqrt(x^2 - x)
number_slider_60 = Slider(1, range=0..10)  # disabled
number_slider_61 = Slider(0, range=0..10)  # disabled
expression_14 = Expression(x=range_21, A=number_slider_60, B=number_slider_61, Expression="A * (Sqrt(x^2 - x))")  # disabled
panel_61 = Panel("""     A * (Sqrt(x^2 - x))
	for x < 1""")  # disabled

number_slider_62 = Slider(1, range=0..10)  # disabled
number_slider_63 = Slider(0, range=0..10)  # disabled
expression_15 = Expression(x=range_22, A=number_slider_60, B=number_slider_63, Expression="A * (Sqrt(x^2 - x))")  # disabled
panel_62 = Panel("""     A * (Sqrt(x^2 - x))
for x > 1""")  # disabled

number_slider_64 = Slider(1, range=0..10)  # disabled
number_slider_65 = Slider(0, range=0..10)  # disabled
expression_16 = Expression(x=range_19, A=number_slider_64, B=number_slider_65, Expression="A * (x /(1 - x))")  # disabled
panel_63 = Panel("""A * (x /(1 - x))
       for x > 1""")  # disabled

number_slider_66 = Slider(1, range=0..10)  # disabled
number_slider_67 = Slider(0, range=0..10)  # disabled
expression_17 = Expression(x=range_20, A=number_slider_66, B=number_slider_67, Expression="A * (x /(1 - x))")  # disabled
panel_64 = Panel("""A * (x /(1 - x))
       for x < 1""")  # disabled

construct_point_52 = ConstructPoint(XCoordinate=range_18, YCoordinate=expression_11, ZCoordinate=0)  # disabled
construct_point_53 = ConstructPoint(XCoordinate=range_18, YCoordinate=0, ZCoordinate=0)  # disabled
construct_point_54 = ConstructPoint(XCoordinate=0, YCoordinate=range_18, ZCoordinate=0)  # disabled
interpolate_31 = Interpolate(Vertices=construct_point_53, Degree=3, Periodic=False, KnotStyle=1)  # -> Curve, Length, Domain; disabled
interpolate_32 = Interpolate(Vertices=construct_point_54, Degree=3, Periodic=False, KnotStyle=1)  # -> Curve, Length, Domain; disabled
interpolate_33 = Interpolate(Vertices=construct_point_52, Degree=3, Periodic=False, KnotStyle=1)  # -> Curve, Length, Domain; disabled

construct_point_55 = ConstructPoint(XCoordinate=range_17, YCoordinate=expression_10, ZCoordinate=0)  # disabled
construct_point_56 = ConstructPoint(XCoordinate=range_17, YCoordinate=0, ZCoordinate=0)  # disabled
construct_point_57 = ConstructPoint(XCoordinate=0, YCoordinate=range_17, ZCoordinate=0)  # disabled
interpolate_34 = Interpolate(Vertices=construct_point_56, Degree=3, Periodic=False, KnotStyle=1)  # -> Curve, Length, Domain; disabled
interpolate_35 = Interpolate(Vertices=construct_point_57, Degree=3, Periodic=False, KnotStyle=1)  # -> Curve, Length, Domain; disabled
interpolate_36 = Interpolate(Vertices=construct_point_55, Degree=3, Periodic=False, KnotStyle=1)  # -> Curve, Length, Domain; disabled

construct_point_58 = ConstructPoint(XCoordinate=range_16, YCoordinate=expression_13, ZCoordinate=0)  # disabled
construct_point_59 = ConstructPoint(XCoordinate=range_16, YCoordinate=0, ZCoordinate=0)  # disabled
construct_point_60 = ConstructPoint(XCoordinate=0, YCoordinate=range_16, ZCoordinate=0)  # disabled
interpolate_37 = Interpolate(Vertices=construct_point_59, Degree=3, Periodic=False, KnotStyle=1)  # -> Curve, Length, Domain; disabled
interpolate_38 = Interpolate(Vertices=construct_point_60, Degree=3, Periodic=False, KnotStyle=1)  # -> Curve, Length, Domain; disabled
interpolate_39 = Interpolate(Vertices=construct_point_58, Degree=3, Periodic=False, KnotStyle=1)  # -> Curve, Length, Domain; disabled

construct_point_61 = ConstructPoint(XCoordinate=range_15, YCoordinate=expression_12, ZCoordinate=0)  # disabled
construct_point_62 = ConstructPoint(XCoordinate=range_15, YCoordinate=0, ZCoordinate=0)  # disabled
construct_point_63 = ConstructPoint(XCoordinate=0, YCoordinate=range_15, ZCoordinate=0)  # disabled
interpolate_40 = Interpolate(Vertices=construct_point_62, Degree=3, Periodic=False, KnotStyle=1)  # -> Curve, Length, Domain; disabled
interpolate_41 = Interpolate(Vertices=construct_point_63, Degree=3, Periodic=False, KnotStyle=1)  # -> Curve, Length, Domain; disabled
interpolate_42 = Interpolate(Vertices=construct_point_61, Degree=3, Periodic=False, KnotStyle=1)  # -> Curve, Length, Domain; disabled

construct_point_64 = ConstructPoint(XCoordinate=range_22, YCoordinate=expression_15, ZCoordinate=0)  # disabled
construct_point_65 = ConstructPoint(XCoordinate=range_22, YCoordinate=0, ZCoordinate=0)  # disabled
construct_point_66 = ConstructPoint(XCoordinate=0, YCoordinate=range_22, ZCoordinate=0)  # disabled
interpolate_43 = Interpolate(Vertices=construct_point_65, Degree=3, Periodic=False, KnotStyle=1)  # -> Curve, Length, Domain; disabled
interpolate_44 = Interpolate(Vertices=construct_point_66, Degree=3, Periodic=False, KnotStyle=1)  # -> Curve, Length, Domain; disabled
interpolate_45 = Interpolate(Vertices=construct_point_64, Degree=3, Periodic=False, KnotStyle=1)  # -> Curve, Length, Domain; disabled

construct_point_67 = ConstructPoint(XCoordinate=range_20, YCoordinate=expression_17, ZCoordinate=0)  # disabled
construct_point_68 = ConstructPoint(XCoordinate=range_20, YCoordinate=0, ZCoordinate=0)  # disabled
construct_point_69 = ConstructPoint(XCoordinate=0, YCoordinate=range_20, ZCoordinate=0)  # disabled
interpolate_46 = Interpolate(Vertices=construct_point_68, Degree=3, Periodic=False, KnotStyle=1)  # -> Curve, Length, Domain; disabled
interpolate_47 = Interpolate(Vertices=construct_point_69, Degree=3, Periodic=False, KnotStyle=1)  # -> Curve, Length, Domain; disabled
interpolate_48 = Interpolate(Vertices=construct_point_67, Degree=3, Periodic=False, KnotStyle=1)  # -> Curve, Length, Domain; disabled

construct_point_70 = ConstructPoint(XCoordinate=range_19, YCoordinate=expression_16, ZCoordinate=0)  # disabled
construct_point_71 = ConstructPoint(XCoordinate=range_19, YCoordinate=0, ZCoordinate=0)  # disabled
construct_point_72 = ConstructPoint(XCoordinate=0, YCoordinate=range_19, ZCoordinate=0)  # disabled
interpolate_49 = Interpolate(Vertices=construct_point_71, Degree=3, Periodic=False, KnotStyle=1)  # -> Curve, Length, Domain; disabled
interpolate_50 = Interpolate(Vertices=construct_point_72, Degree=3, Periodic=False, KnotStyle=1)  # -> Curve, Length, Domain; disabled
interpolate_51 = Interpolate(Vertices=construct_point_70, Degree=3, Periodic=False, KnotStyle=1)  # -> Curve, Length, Domain; disabled

construct_point_73 = ConstructPoint(XCoordinate=range_21, YCoordinate=expression_14, ZCoordinate=0)  # disabled
construct_point_74 = ConstructPoint(XCoordinate=range_21, YCoordinate=0, ZCoordinate=0)  # disabled
construct_point_75 = ConstructPoint(XCoordinate=0, YCoordinate=range_21, ZCoordinate=0)  # disabled
interpolate_52 = Interpolate(Vertices=construct_point_74, Degree=3, Periodic=False, KnotStyle=1)  # -> Curve, Length, Domain; disabled
interpolate_53 = Interpolate(Vertices=construct_point_75, Degree=3, Periodic=False, KnotStyle=1)  # -> Curve, Length, Domain; disabled
interpolate_54 = Interpolate(Vertices=construct_point_73, Degree=3, Periodic=False, KnotStyle=1)  # -> Curve, Length, Domain; disabled

curve_middle_11 = CurveMiddle(Curve=interpolate_34.Curve)  # disabled
point_on_curve_10 = PointOnCurve(interpolate_36.Curve, parameter=0.263)  # disabled
end_points_21 = EndPoints(Curve=interpolate_34.Curve)  # -> Start, End; disabled
end_points_22 = EndPoints(Curve=interpolate_35.Curve)  # -> Start, End; disabled
deconstruct_10 = Deconstruct(Point=point_on_curve_10)  # -> XComponent, YComponent, ZComponent; disabled
construct_point_76 = ConstructPoint(XCoordinate=0, YCoordinate=deconstruct_10.YComponent, ZCoordinate=0)  # disabled
construct_point_77 = ConstructPoint(XCoordinate=deconstruct_10.XComponent, YCoordinate=0, ZCoordinate=0)  # disabled

curve_middle_12 = CurveMiddle(Curve=interpolate_31.Curve)  # disabled
point_on_curve_11 = PointOnCurve(interpolate_33.Curve, parameter=0.317)  # disabled
end_points_23 = EndPoints(Curve=interpolate_31.Curve)  # -> Start, End; disabled
end_points_24 = EndPoints(Curve=interpolate_32.Curve)  # -> Start, End; disabled
deconstruct_11 = Deconstruct(Point=point_on_curve_11)  # -> XComponent, YComponent, ZComponent; disabled
construct_point_78 = ConstructPoint(XCoordinate=0, YCoordinate=deconstruct_11.YComponent, ZCoordinate=0)  # disabled
construct_point_79 = ConstructPoint(XCoordinate=deconstruct_11.XComponent, YCoordinate=0, ZCoordinate=0)  # disabled

curve_middle_13 = CurveMiddle(Curve=interpolate_40.Curve)  # disabled
point_on_curve_12 = PointOnCurve(interpolate_42.Curve, parameter=0.614)  # disabled
end_points_25 = EndPoints(Curve=interpolate_40.Curve)  # -> Start, End; disabled
end_points_26 = EndPoints(Curve=interpolate_41.Curve)  # -> Start, End; disabled
deconstruct_12 = Deconstruct(Point=point_on_curve_12)  # -> XComponent, YComponent, ZComponent; disabled
construct_point_80 = ConstructPoint(XCoordinate=0, YCoordinate=deconstruct_12.YComponent, ZCoordinate=0)  # disabled
construct_point_81 = ConstructPoint(XCoordinate=deconstruct_12.XComponent, YCoordinate=0, ZCoordinate=0)  # disabled

curve_middle_14 = CurveMiddle(Curve=interpolate_37.Curve)  # disabled
point_on_curve_13 = PointOnCurve(interpolate_39.Curve, parameter=0.114)  # disabled
end_points_27 = EndPoints(Curve=interpolate_37.Curve)  # -> Start, End; disabled
end_points_28 = EndPoints(Curve=interpolate_38.Curve)  # -> Start, End; disabled
deconstruct_13 = Deconstruct(Point=point_on_curve_13)  # -> XComponent, YComponent, ZComponent; disabled
construct_point_82 = ConstructPoint(XCoordinate=0, YCoordinate=deconstruct_13.YComponent, ZCoordinate=0)  # disabled
construct_point_83 = ConstructPoint(XCoordinate=deconstruct_13.XComponent, YCoordinate=0, ZCoordinate=0)  # disabled

curve_middle_15 = CurveMiddle(Curve=interpolate_43.Curve)  # disabled
end_points_29 = EndPoints(Curve=interpolate_43.Curve)  # -> Start, End; disabled
end_points_30 = EndPoints(Curve=interpolate_44.Curve)  # -> Start, End; disabled
point_on_curve_14 = PointOnCurve(interpolate_45.Curve, parameter=1)  # disabled
deconstruct_14 = Deconstruct(Point=point_on_curve_14)  # -> XComponent, YComponent, ZComponent; disabled
construct_point_84 = ConstructPoint(XCoordinate=0, YCoordinate=deconstruct_14.YComponent, ZCoordinate=0)  # disabled
construct_point_85 = ConstructPoint(XCoordinate=deconstruct_14.XComponent, YCoordinate=0, ZCoordinate=0)  # disabled

curve_middle_16 = CurveMiddle(Curve=interpolate_49.Curve)  # disabled
point_on_curve_15 = PointOnCurve(interpolate_51.Curve, parameter=0.634)  # disabled
end_points_31 = EndPoints(Curve=interpolate_49.Curve)  # -> Start, End; disabled
end_points_32 = EndPoints(Curve=interpolate_50.Curve)  # -> Start, End; disabled
deconstruct_15 = Deconstruct(Point=point_on_curve_15)  # -> XComponent, YComponent, ZComponent; disabled
construct_point_86 = ConstructPoint(XCoordinate=0, YCoordinate=deconstruct_15.YComponent, ZCoordinate=0)  # disabled
construct_point_87 = ConstructPoint(XCoordinate=deconstruct_15.XComponent, YCoordinate=0, ZCoordinate=0)  # disabled

curve_middle_17 = CurveMiddle(Curve=interpolate_46.Curve)  # disabled
point_on_curve_16 = PointOnCurve(interpolate_48.Curve, parameter=0.886)  # disabled
end_points_33 = EndPoints(Curve=interpolate_46.Curve)  # -> Start, End; disabled
end_points_34 = EndPoints(Curve=interpolate_47.Curve)  # -> Start, End; disabled
deconstruct_16 = Deconstruct(Point=point_on_curve_16)  # -> XComponent, YComponent, ZComponent; disabled
construct_point_88 = ConstructPoint(XCoordinate=0, YCoordinate=deconstruct_16.YComponent, ZCoordinate=0)  # disabled
construct_point_89 = ConstructPoint(XCoordinate=deconstruct_16.XComponent, YCoordinate=0, ZCoordinate=0)  # disabled

curve_middle_18 = CurveMiddle(Curve=interpolate_52.Curve)  # disabled
end_points_35 = EndPoints(Curve=interpolate_52.Curve)  # -> Start, End; disabled
end_points_36 = EndPoints(Curve=interpolate_53.Curve)  # -> Start, End; disabled
point_on_curve_17 = PointOnCurve(interpolate_54.Curve, parameter=0.481)  # disabled
deconstruct_17 = Deconstruct(Point=point_on_curve_17)  # -> XComponent, YComponent, ZComponent; disabled
construct_point_90 = ConstructPoint(XCoordinate=0, YCoordinate=deconstruct_17.YComponent, ZCoordinate=0)  # disabled
construct_point_91 = ConstructPoint(XCoordinate=deconstruct_17.XComponent, YCoordinate=0, ZCoordinate=0)  # disabled

panel_65 = Panel("      ƒ(x) = ")  # disabled
panel_66 = Panel("x")  # disabled
panel_67 = Panel("0         ")  # disabled
concatenate_5 = Concatenate(FragmentA=panel_65, FragmentB=panel_58)  # disabled
panel_68 = Panel(".12")  # disabled
text_tag_3d_27 = TextTag3D(Location=point_on_curve_11, Text=concatenate_5, Size=panel_68, Justification=7)  # disabled
text_tag_3d_28 = TextTag3D(Location=construct_point_78, Text=panel_58, Size=panel_68, Justification=1)  # disabled
text_tag_3d_29 = TextTag3D(Location=construct_point_79, Text=panel_66, Size=panel_68, Justification=7)  # disabled
text_tag_3d_30 = TextTag3D(Location=curve_middle_12, Text=panel_67, Size=panel_68, Justification=3)  # disabled

panel_69 = Panel("      ƒ(x) = ")  # disabled
panel_70 = Panel("x")  # disabled
panel_71 = Panel("y    ")  # disabled
panel_72 = Panel("x")  # disabled
panel_73 = Panel("0         ")  # disabled
concatenate_6 = Concatenate(FragmentA=panel_69, FragmentB=panel_57)  # disabled
panel_74 = Panel(".12")  # disabled
text_tag_3d_31 = TextTag3D(Location=point_on_curve_10, Text=concatenate_6, Size=panel_74, Justification=7)  # disabled
text_tag_3d_32 = TextTag3D(Location=construct_point_76, Text=panel_57, Size=panel_74, Justification=1)  # disabled
text_tag_3d_33 = TextTag3D(Location=end_points_22.End, Text=panel_71, Size=panel_74, Justification=6)  # disabled
text_tag_3d_34 = TextTag3D(Location=end_points_21.End, Text=panel_70, Size=panel_74, Justification=7)  # disabled
text_tag_3d_35 = TextTag3D(Location=construct_point_77, Text=panel_72, Size=panel_74, Justification=7)  # disabled
text_tag_3d_36 = TextTag3D(Location=curve_middle_11, Text=panel_73, Size=panel_74, Justification=3)  # disabled

panel_75 = Panel("      ƒ(x) = ")  # disabled
panel_76 = Panel("y    ")  # disabled
panel_77 = Panel("x")  # disabled
panel_78 = Panel("x")  # disabled
panel_79 = Panel("0         ")  # disabled
concatenate_7 = Concatenate(FragmentA=panel_75, FragmentB=panel_59)  # disabled
panel_80 = Panel(".12")  # disabled
text_tag_3d_37 = TextTag3D(Location=point_on_curve_12, Text=concatenate_7, Size=panel_80, Justification=7)  # disabled
text_tag_3d_38 = TextTag3D(Location=construct_point_80, Text=panel_59, Size=panel_80, Justification=1)  # disabled
text_tag_3d_39 = TextTag3D(Location=end_points_26.End, Text=panel_76, Size=panel_80, Justification=6)  # disabled
text_tag_3d_40 = TextTag3D(Location=end_points_25.End, Text=panel_77, Size=panel_80, Justification=7)  # disabled
text_tag_3d_41 = TextTag3D(Location=construct_point_81, Text=panel_78, Size=panel_80, Justification=7)  # disabled
text_tag_3d_42 = TextTag3D(Location=curve_middle_13, Text=panel_79, Size=panel_80, Justification=3)  # disabled

boolean_toggle_9 = BooleanToggle(True)  # disabled
panel_81 = Panel(".03")  # disabled
offset_curve_10 = OffsetCurve(
    Curve=[interpolate_39.Curve, interpolate_42.Curve],
    Plane=PlaneXY(0, 0, 0),
    Distance=panel_81,
    BothSides=boolean_toggle_9,
    Kinks=0,
    CapType=1)  # disabled
line_27 = Line(StartPoint=construct_point_83, EndPoint=point_on_curve_13)  # disabled
line_28 = Line(StartPoint=construct_point_82, EndPoint=point_on_curve_13)  # disabled
boundary_surfaces_10 = BoundarySurfaces(Edges=offset_curve_10)  # disabled
line_29 = Line(StartPoint=construct_point_80, EndPoint=point_on_curve_12)  # disabled
line_30 = Line(StartPoint=construct_point_81, EndPoint=point_on_curve_12)  # disabled
curve_8 = Curve(interpolate_39.Curve)  # disabled
curve_9 = Curve(interpolate_42.Curve)  # disabled

panel_82 = Panel("      ƒ(x) = ")  # disabled
panel_83 = Panel("x")  # disabled
panel_84 = Panel("0         ")  # disabled
concatenate_8 = Concatenate(FragmentA=panel_82, FragmentB=panel_60)  # disabled
panel_85 = Panel(".12")  # disabled
text_tag_3d_43 = TextTag3D(Location=point_on_curve_13, Text=concatenate_8, Size=panel_85, Justification=7)  # disabled
text_tag_3d_44 = TextTag3D(Location=construct_point_82, Text=panel_60, Size=panel_85, Justification=1)  # disabled
text_tag_3d_45 = TextTag3D(Location=construct_point_83, Text=panel_83, Size=panel_85, Justification=7)  # disabled
text_tag_3d_46 = TextTag3D(Location=curve_middle_14, Text=panel_84, Size=panel_85, Justification=3)  # disabled

panel_86 = Panel("      ƒ(x) = ")  # disabled
panel_87 = Panel("x")  # disabled
panel_88 = Panel("y    ")  # disabled
panel_89 = Panel("x")  # disabled
panel_90 = Panel("0         ")  # disabled
concatenate_9 = Concatenate(FragmentA=panel_86, FragmentB=panel_63)  # disabled
panel_91 = Panel(".12")  # disabled
text_tag_3d_47 = TextTag3D(Location=point_on_curve_15, Text=concatenate_9, Size=panel_91, Justification=7)  # disabled
text_tag_3d_48 = TextTag3D(Location=construct_point_86, Text=panel_63, Size=panel_91, Justification=1)  # disabled
text_tag_3d_49 = TextTag3D(Location=end_points_32.End, Text=panel_88, Size=panel_91, Justification=6)  # disabled
text_tag_3d_50 = TextTag3D(Location=end_points_31.End, Text=panel_87, Size=panel_91, Justification=7)  # disabled
text_tag_3d_51 = TextTag3D(Location=construct_point_87, Text=panel_89, Size=panel_91, Justification=7)  # disabled
text_tag_3d_52 = TextTag3D(Location=curve_middle_16, Text=panel_90, Size=panel_91, Justification=3)  # disabled

panel_92 = Panel("      ƒ(x) = ")  # disabled
panel_93 = Panel("x")  # disabled
panel_94 = Panel("0         ")  # disabled
concatenate_10 = Concatenate(FragmentA=panel_92, FragmentB=panel_62)  # disabled
panel_95 = Panel(".12")  # disabled
text_tag_3d_53 = TextTag3D(Location=point_on_curve_14, Text=concatenate_10, Size=panel_95, Justification=7)  # disabled
text_tag_3d_54 = TextTag3D(Location=construct_point_84, Text=panel_62, Size=panel_95, Justification=1)  # disabled
text_tag_3d_55 = TextTag3D(Location=construct_point_85, Text=panel_93, Size=panel_95, Justification=7)  # disabled
text_tag_3d_56 = TextTag3D(Location=curve_middle_15, Text=panel_94, Size=panel_95, Justification=3)  # disabled

boolean_toggle_10 = BooleanToggle(True)  # disabled
panel_96 = Panel(".03")  # disabled
offset_curve_11 = OffsetCurve(
    Curve=[interpolate_48.Curve, interpolate_51.Curve],
    Plane=PlaneXY(0, 0, 0),
    Distance=panel_96,
    BothSides=boolean_toggle_10,
    Kinks=0,
    CapType=1)  # disabled
line_31 = Line(StartPoint=construct_point_89, EndPoint=point_on_curve_16)  # disabled
line_32 = Line(StartPoint=construct_point_88, EndPoint=point_on_curve_16)  # disabled
boundary_surfaces_11 = BoundarySurfaces(Edges=offset_curve_11)  # disabled
line_33 = Line(StartPoint=construct_point_86, EndPoint=point_on_curve_15)  # disabled
line_34 = Line(StartPoint=construct_point_87, EndPoint=point_on_curve_15)  # disabled
curve_10 = Curve(interpolate_48.Curve)  # disabled
curve_11 = Curve(interpolate_51.Curve)  # disabled

panel_97 = Panel("      ƒ(x) = ")  # disabled
panel_98 = Panel("x")  # disabled
panel_99 = Panel("0         ")  # disabled
concatenate_11 = Concatenate(FragmentA=panel_97, FragmentB=panel_64)  # disabled
panel_100 = Panel(".12")  # disabled
text_tag_3d_57 = TextTag3D(Location=point_on_curve_16, Text=concatenate_11, Size=panel_100, Justification=7)  # disabled
text_tag_3d_58 = TextTag3D(Location=construct_point_88, Text=panel_64, Size=panel_100, Justification=1)  # disabled
text_tag_3d_59 = TextTag3D(Location=construct_point_89, Text=panel_98, Size=panel_100, Justification=7)  # disabled
text_tag_3d_60 = TextTag3D(Location=curve_middle_17, Text=panel_99, Size=panel_100, Justification=3)  # disabled

boolean_toggle_11 = BooleanToggle(True)  # disabled
panel_101 = Panel(".03")  # disabled
offset_curve_12 = OffsetCurve(
    Curve=[interpolate_33.Curve, interpolate_36.Curve],
    Plane=PlaneXY(0, 0, 0),
    Distance=panel_101,
    BothSides=boolean_toggle_11,
    Kinks=0,
    CapType=1)  # disabled
line_35 = Line(StartPoint=construct_point_79, EndPoint=point_on_curve_11)  # disabled
line_36 = Line(StartPoint=construct_point_77, EndPoint=point_on_curve_10)  # disabled
line_37 = Line(StartPoint=construct_point_78, EndPoint=point_on_curve_11)  # disabled
line_38 = Line(StartPoint=construct_point_76, EndPoint=point_on_curve_10)  # disabled
boundary_surfaces_12 = BoundarySurfaces(Edges=offset_curve_12)  # disabled
curve_12 = Curve(interpolate_33.Curve)  # disabled
curve_13 = Curve(interpolate_36.Curve)  # disabled

panel_102 = Panel("      ƒ(x) = ")  # disabled
panel_103 = Panel("x")  # disabled
panel_104 = Panel("0         ")  # disabled
concatenate_12 = Concatenate(FragmentA=panel_102, FragmentB=panel_61)  # disabled
panel_105 = Panel(".12")  # disabled
text_tag_3d_61 = TextTag3D(Location=point_on_curve_17, Text=concatenate_12, Size=panel_105, Justification=7)  # disabled
text_tag_3d_62 = TextTag3D(Location=construct_point_90, Text=panel_61, Size=panel_105, Justification=1)  # disabled
text_tag_3d_63 = TextTag3D(Location=construct_point_91, Text=panel_103, Size=panel_105, Justification=7)  # disabled
text_tag_3d_64 = TextTag3D(Location=curve_middle_18, Text=panel_104, Size=panel_105, Justification=3)  # disabled

boolean_toggle_12 = BooleanToggle(True)  # disabled
panel_106 = Panel(".03")  # disabled
offset_curve_13 = OffsetCurve(Curve=interpolate_45.Curve, Plane=PlaneXY(0, 0, 0), Distance=panel_106, BothSides=boolean_toggle_12, Kinks=0, CapType=1)  # disabled
line_39 = Line(StartPoint=construct_point_85, EndPoint=point_on_curve_14)  # disabled
line_40 = Line(StartPoint=construct_point_84, EndPoint=point_on_curve_14)  # disabled
boundary_surfaces_13 = BoundarySurfaces(Edges=offset_curve_13)  # disabled
curve_14 = Curve(interpolate_45.Curve)  # disabled

boolean_toggle_13 = BooleanToggle(True)  # disabled
panel_107 = Panel(".03")  # disabled
offset_curve_14 = OffsetCurve(Curve=interpolate_54.Curve, Plane=PlaneXY(0, 0, 0), Distance=panel_107, BothSides=boolean_toggle_13, Kinks=0, CapType=1)  # disabled
line_41 = Line(StartPoint=construct_point_91, EndPoint=point_on_curve_17)  # disabled
line_42 = Line(StartPoint=construct_point_90, EndPoint=point_on_curve_17)  # disabled
boundary_surfaces_14 = BoundarySurfaces(Edges=offset_curve_14)  # disabled
curve_15 = Curve(interpolate_54.Curve)  # disabled

number_slider_68 = Slider(5, range=0..5)
negative_16 = Negative(Value=number_slider_68)
construct_domain_22 = ConstructDomain(DomainStart=negative_16, DomainEnd=number_slider_68)
range_23 = Range(Domain=construct_domain_22, Steps=Slider(100, range=0..100))

number_slider_69 = Slider(4, range=0..4)
negative_17 = Negative(Value=number_slider_69)
construct_domain_23 = ConstructDomain(DomainStart=negative_17, DomainEnd=number_slider_69)
range_24 = Range(Domain=construct_domain_23, Steps=Slider(96, range=0..100))

number_slider_70 = Slider(2, range=0..2)
negative_18 = Negative(Value=number_slider_70)
construct_domain_24 = ConstructDomain(DomainStart=negative_18, DomainEnd=number_slider_70)
range_25 = Range(Domain=construct_domain_24, Steps=Slider(100, range=0..100))

square_2 = Square(Value=Slider(0, range=-4..4))
subtraction_2 = Subtraction(A=square_2, B="1")
# ƒ(x) = abs(x^2 - 1)
absolute = Absolute(Value=subtraction_2)
panel_108 = Panel(absolute)

number_slider_71 = Slider(3.21, range=-4..4)

number_slider_72 = Slider(2, range=0..2)
negative_19 = Negative(Value=number_slider_72)
construct_domain_25 = ConstructDomain(DomainStart=negative_19, DomainEnd=number_slider_72)
range_26 = Range(Domain=construct_domain_25, Steps=Slider(100, range=0..100))

number_slider_73 = Slider(2.38, range=-4..4)
multiplication = Multiplication(A="2", B=number_slider_73)
square_3 = Square(Value=number_slider_73)
subtraction_3 = Subtraction(A=square_3, B=multiplication)
# ƒ(x) = Sqrt(x^2 - (2 * x) + 1))
panel_109 = Panel("1")
addition = Addition(A=subtraction_3, B=panel_109)
square_root = SquareRoot(Value=addition)
panel_110 = Panel(square_root)

# ----
# watch for complex numbers
number_slider_74 = Slider(1.82, range=-4..4)
square_4 = Square(Value=number_slider_74)
# ƒ(x) = Sqrt(4 - x^2)
subtraction_4 = Subtraction(A="4", B=square_4)
square_root_2 = SquareRoot(Value=subtraction_4)
panel_111 = Panel(square_root_2)

number_slider_75 = Slider(4, range=0..4)
# Exercises:
# Single Domains
negative_20 = Negative(Value=number_slider_75)
construct_domain_26 = ConstructDomain(DomainStart=negative_20, DomainEnd=number_slider_75)
range_27 = Range(Domain=construct_domain_26, Steps=Slider(16, range=0..100))

number_slider_76 = Slider(4, range=0..4)
negative_21 = Negative(Value=number_slider_76)
construct_domain_27 = ConstructDomain(DomainStart=negative_21, DomainEnd=number_slider_76)
range_28 = Range(Domain=construct_domain_27, Steps=Slider(16, range=0..100))

number_slider_77 = Slider(2, range=0..2)
negative_22 = Negative(Value=number_slider_77)
construct_domain_28 = ConstructDomain(DomainStart=negative_22, DomainEnd=number_slider_77)
range_29 = Range(Domain=construct_domain_28, Steps=Slider(100, range=0..100))

absolute_2 = Absolute(Value=number_slider_71)
subtraction_5 = Subtraction(A=number_slider_71, B="2")
absolute_3 = Absolute(Value=subtraction_5)

panel_112 = Panel(""" 
     A * Sqrt(x^2 - (2 * x) + 1)""")
expression_18 = Expression(x=range_24, A=Slider(1, range=0..10), B=Slider(1, range=0..10), Expression="A * Sqrt(x^2 - (2 * x) + 1)")

# ----
# ƒ(x) = (abs(x) + abs(x - B))
number_slider_78 = Slider(1, range=0..10)
expression_19 = Expression(x=range_23, A=number_slider_78, B=Slider(2, range=0..10), Expression="A * (abs(x) + abs(x - B))")

panel_113 = Panel(""" 
     A * Sqrt(4 - x^2)""")
expression_20 = Expression(x=range_25, A=Slider(1, range=0..10), B=Slider(1, range=0..10), Expression="A * Sqrt(4 - x^2)")

expression_21 = Expression(x=range_26, A=Slider(1, range=0..10), B=Slider(1, range=0..10), Expression="A * abs(x^2 - 1)")

addition_2 = Addition(A=absolute_2, B=absolute_3)

# ----
# ƒ(x) = 1/(Sqrt(4 - x^2))
number_slider_79 = Slider(1, range=0..10)
expression_22 = Expression(x=range_29, A=number_slider_79, B=Slider(1, range=0..10), Expression="A * 1/Sqrt(B^2 - x^2)")

# ----
# ƒ(x) = Sqrt(abs(x))
number_slider_80 = Slider(1, range=0..10)
expression_23 = Expression(x=range_28, A=number_slider_80, B=Slider(0, range=0..10), Expression="A * Sqrt(abs(x)) + B")
panel_114 = Panel(""" 
     A * Sqrt(abs(x)) + B""")

# ----
# ƒ(x) = x^3
number_slider_81 = Slider(1, range=0..10)
panel_115 = Panel(""" 
     A * x^3 + B""")
expression_24 = Expression(x=range_27, A=number_slider_81, B=Slider(0, range=0..10), Expression="A * x^3 + B")

panel_116 = Panel(addition_2)

construct_point_92 = ConstructPoint(XCoordinate=range_23, YCoordinate=0, ZCoordinate=0)
construct_point_93 = ConstructPoint(XCoordinate=0, YCoordinate=range_23, ZCoordinate=0)
construct_point_94 = ConstructPoint(XCoordinate=range_23, YCoordinate=expression_19, ZCoordinate=0)
interpolate_55 = Interpolate(Vertices=construct_point_92, Degree=3, Periodic=False, KnotStyle=1)  # -> Curve, Length, Domain
interpolate_56 = Interpolate(Vertices=construct_point_93, Degree=3, Periodic=False, KnotStyle=1)  # -> Curve, Length, Domain
interpolate_57 = Interpolate(Vertices=construct_point_94, Degree=Slider(1, range=1..3), Periodic=False, KnotStyle=1)  # -> Curve, Length, Domain

construct_point_95 = ConstructPoint(XCoordinate=range_24, YCoordinate=0, ZCoordinate=0)
construct_point_96 = ConstructPoint(XCoordinate=0, YCoordinate=range_24, ZCoordinate=0)
construct_point_97 = ConstructPoint(XCoordinate=range_24, YCoordinate=expression_18, ZCoordinate=0)
interpolate_58 = Interpolate(Vertices=construct_point_95, Degree=3, Periodic=False, KnotStyle=1)  # -> Curve, Length, Domain
interpolate_59 = Interpolate(Vertices=construct_point_96, Degree=3, Periodic=False, KnotStyle=1)  # -> Curve, Length, Domain
interpolate_60 = Interpolate(Vertices=construct_point_97, Degree=Slider(1, range=0..1), Periodic=False, KnotStyle=1)  # -> Curve, Length, Domain

construct_point_98 = ConstructPoint(XCoordinate=range_25, YCoordinate=0, ZCoordinate=0)
construct_point_99 = ConstructPoint(XCoordinate=0, YCoordinate=range_25, ZCoordinate=0)
construct_point_100 = ConstructPoint(XCoordinate=range_25, YCoordinate=expression_20, ZCoordinate=0)
interpolate_61 = Interpolate(Vertices=construct_point_98, Degree=3, Periodic=False, KnotStyle=1)  # -> Curve, Length, Domain
interpolate_62 = Interpolate(Vertices=construct_point_99, Degree=3, Periodic=False, KnotStyle=1)  # -> Curve, Length, Domain
interpolate_63 = Interpolate(Vertices=construct_point_100, Degree=Slider(1, range=0..1), Periodic=False, KnotStyle=1)  # -> Curve, Length, Domain

construct_point_101 = ConstructPoint(XCoordinate=range_26, YCoordinate=0, ZCoordinate=0)
construct_point_102 = ConstructPoint(XCoordinate=0, YCoordinate=range_26, ZCoordinate=0)
construct_point_103 = ConstructPoint(XCoordinate=range_26, YCoordinate=expression_21, ZCoordinate=0)
interpolate_64 = Interpolate(Vertices=construct_point_101, Degree=3, Periodic=False, KnotStyle=1)  # -> Curve, Length, Domain
interpolate_65 = Interpolate(Vertices=construct_point_102, Degree=3, Periodic=False, KnotStyle=1)  # -> Curve, Length, Domain
interpolate_66 = Interpolate(Vertices=construct_point_103, Degree=Slider(1, range=1..3), Periodic=False, KnotStyle=1)  # -> Curve, Length, Domain

construct_point_104 = ConstructPoint(XCoordinate=range_27, YCoordinate=expression_24, ZCoordinate=0)
construct_point_105 = ConstructPoint(XCoordinate=range_27, YCoordinate=0, ZCoordinate=0)
construct_point_106 = ConstructPoint(XCoordinate=0, YCoordinate=range_27, ZCoordinate=0)
interpolate_67 = Interpolate(Vertices=construct_point_105, Degree=3, Periodic=False, KnotStyle=1)  # -> Curve, Length, Domain
interpolate_68 = Interpolate(Vertices=construct_point_106, Degree=3, Periodic=False, KnotStyle=1)  # -> Curve, Length, Domain
interpolate_69 = Interpolate(Vertices=construct_point_104, Degree=3, Periodic=False, KnotStyle=1)  # -> Curve, Length, Domain

construct_point_107 = ConstructPoint(XCoordinate=range_28, YCoordinate=expression_23, ZCoordinate=0)
construct_point_108 = ConstructPoint(XCoordinate=range_28, YCoordinate=0, ZCoordinate=0)
construct_point_109 = ConstructPoint(XCoordinate=0, YCoordinate=range_28, ZCoordinate=0)
interpolate_70 = Interpolate(Vertices=construct_point_108, Degree=3, Periodic=False, KnotStyle=1)  # -> Curve, Length, Domain
interpolate_71 = Interpolate(Vertices=construct_point_109, Degree=3, Periodic=False, KnotStyle=1)  # -> Curve, Length, Domain
interpolate_72 = Interpolate(Vertices=construct_point_107, Degree=3, Periodic=False, KnotStyle=1)  # -> Curve, Length, Domain

construct_point_110 = ConstructPoint(XCoordinate=range_29, YCoordinate=0, ZCoordinate=0)
construct_point_111 = ConstructPoint(XCoordinate=0, YCoordinate=range_29, ZCoordinate=0)
construct_point_112 = ConstructPoint(XCoordinate=range_29, YCoordinate=expression_22, ZCoordinate=0)
interpolate_73 = Interpolate(Vertices=construct_point_110, Degree=3, Periodic=False, KnotStyle=1)  # -> Curve, Length, Domain
interpolate_74 = Interpolate(Vertices=construct_point_111, Degree=3, Periodic=False, KnotStyle=1)  # -> Curve, Length, Domain
interpolate_75 = Interpolate(Vertices=construct_point_112, Degree=3, Periodic=False, KnotStyle=1)  # -> Curve, Length, Domain

curve_middle_19 = CurveMiddle(Curve=interpolate_55.Curve)
point_on_curve_18 = PointOnCurve(interpolate_57.Curve, parameter=0.78)
end_points_37 = EndPoints(Curve=interpolate_55.Curve)  # -> Start, End
end_points_38 = EndPoints(Curve=interpolate_56.Curve)  # -> Start, End
deconstruct_18 = Deconstruct(Point=point_on_curve_18)  # -> XComponent, YComponent, ZComponent
construct_point_113 = ConstructPoint(XCoordinate=0, YCoordinate=deconstruct_18.YComponent, ZCoordinate=0)
construct_point_114 = ConstructPoint(XCoordinate=deconstruct_18.XComponent, YCoordinate=0, ZCoordinate=0)

curve_middle_20 = CurveMiddle(Curve=interpolate_58.Curve)
point_on_curve_19 = PointOnCurve(interpolate_60.Curve, parameter=0.909)
end_points_39 = EndPoints(Curve=interpolate_58.Curve)  # -> Start, End
end_points_40 = EndPoints(Curve=interpolate_59.Curve)  # -> Start, End
deconstruct_19 = Deconstruct(Point=point_on_curve_19)  # -> XComponent, YComponent, ZComponent
construct_point_115 = ConstructPoint(XCoordinate=0, YCoordinate=deconstruct_19.YComponent, ZCoordinate=0)
construct_point_116 = ConstructPoint(XCoordinate=deconstruct_19.XComponent, YCoordinate=0, ZCoordinate=0)

curve_middle_21 = CurveMiddle(Curve=interpolate_61.Curve)
point_on_curve_20 = PointOnCurve(interpolate_63.Curve, parameter=0.862)
end_points_41 = EndPoints(Curve=interpolate_61.Curve)  # -> Start, End
end_points_42 = EndPoints(Curve=interpolate_62.Curve)  # -> Start, End
deconstruct_20 = Deconstruct(Point=point_on_curve_20)  # -> XComponent, YComponent, ZComponent
construct_point_117 = ConstructPoint(XCoordinate=0, YCoordinate=deconstruct_20.YComponent, ZCoordinate=0)
construct_point_118 = ConstructPoint(XCoordinate=deconstruct_20.XComponent, YCoordinate=0, ZCoordinate=0)

curve_middle_22 = CurveMiddle(Curve=interpolate_64.Curve)
point_on_curve_21 = PointOnCurve(interpolate_66.Curve, parameter=0.78)
end_points_43 = EndPoints(Curve=interpolate_64.Curve)  # -> Start, End
end_points_44 = EndPoints(Curve=interpolate_65.Curve)  # -> Start, End
deconstruct_21 = Deconstruct(Point=point_on_curve_21)  # -> XComponent, YComponent, ZComponent
construct_point_119 = ConstructPoint(XCoordinate=0, YCoordinate=deconstruct_21.YComponent, ZCoordinate=0)
construct_point_120 = ConstructPoint(XCoordinate=deconstruct_21.XComponent, YCoordinate=0, ZCoordinate=0)

curve_middle_23 = CurveMiddle(Curve=interpolate_67.Curve)
point_on_curve_22 = PointOnCurve(interpolate_69.Curve, parameter=0.527)
end_points_45 = EndPoints(Curve=interpolate_67.Curve)  # -> Start, End
end_points_46 = EndPoints(Curve=interpolate_68.Curve)  # -> Start, End
deconstruct_22 = Deconstruct(Point=point_on_curve_22)  # -> XComponent, YComponent, ZComponent
construct_point_121 = ConstructPoint(XCoordinate=0, YCoordinate=deconstruct_22.YComponent, ZCoordinate=0)
construct_point_122 = ConstructPoint(XCoordinate=deconstruct_22.XComponent, YCoordinate=0, ZCoordinate=0)

curve_middle_24 = CurveMiddle(Curve=interpolate_70.Curve)
point_on_curve_23 = PointOnCurve(interpolate_72.Curve, parameter=0.527)
end_points_47 = EndPoints(Curve=interpolate_70.Curve)  # -> Start, End
end_points_48 = EndPoints(Curve=interpolate_71.Curve)  # -> Start, End
deconstruct_23 = Deconstruct(Point=point_on_curve_23)  # -> XComponent, YComponent, ZComponent
construct_point_123 = ConstructPoint(XCoordinate=0, YCoordinate=deconstruct_23.YComponent, ZCoordinate=0)
construct_point_124 = ConstructPoint(XCoordinate=deconstruct_23.XComponent, YCoordinate=0, ZCoordinate=0)

curve_middle_25 = CurveMiddle(Curve=interpolate_73.Curve)
point_on_curve_24 = PointOnCurve(interpolate_75.Curve, parameter=0.78)
end_points_49 = EndPoints(Curve=interpolate_73.Curve)  # -> Start, End
end_points_50 = EndPoints(Curve=interpolate_74.Curve)  # -> Start, End
deconstruct_24 = Deconstruct(Point=point_on_curve_24)  # -> XComponent, YComponent, ZComponent
construct_point_125 = ConstructPoint(XCoordinate=0, YCoordinate=deconstruct_24.YComponent, ZCoordinate=0)
construct_point_126 = ConstructPoint(XCoordinate=deconstruct_24.XComponent, YCoordinate=0, ZCoordinate=0)

offset_curve_15 = OffsetCurve(Curve=interpolate_57.Curve, Plane=PlaneXY(0, 0, 0), Distance=".03", BothSides=Toggle(True), Kinks=0, CapType=1)
line_43 = Line(StartPoint=construct_point_114, EndPoint=point_on_curve_18)
line_44 = Line(StartPoint=construct_point_113, EndPoint=point_on_curve_18)
boundary_surfaces_15 = BoundarySurfaces(Edges=offset_curve_15)
curve_16 = Curve(interpolate_57.Curve)

offset_curve_16 = OffsetCurve(Curve=interpolate_60.Curve, Plane=PlaneXY(0, 0, 0), Distance=".03", BothSides=Toggle(True), Kinks=0, CapType=1)
line_45 = Line(StartPoint=construct_point_116, EndPoint=point_on_curve_19)
line_46 = Line(StartPoint=construct_point_115, EndPoint=point_on_curve_19)
boundary_surfaces_16 = BoundarySurfaces(Edges=offset_curve_16)
curve_17 = Curve(interpolate_60.Curve)

offset_curve_17 = OffsetCurve(Curve=interpolate_63.Curve, Plane=PlaneXY(0, 0, 0), Distance=".03", BothSides=Toggle(True), Kinks=0, CapType=1)
line_47 = Line(StartPoint=construct_point_118, EndPoint=point_on_curve_20)
line_48 = Line(StartPoint=construct_point_117, EndPoint=point_on_curve_20)
boundary_surfaces_17 = BoundarySurfaces(Edges=offset_curve_17)
curve_18 = Curve(interpolate_63.Curve)

offset_curve_18 = OffsetCurve(Curve=interpolate_66.Curve, Plane=PlaneXY(0, 0, 0), Distance=".03", BothSides=Toggle(True), Kinks=0, CapType=1)
line_49 = Line(StartPoint=construct_point_120, EndPoint=point_on_curve_21)
line_50 = Line(StartPoint=construct_point_119, EndPoint=point_on_curve_21)
boundary_surfaces_18 = BoundarySurfaces(Edges=offset_curve_18)
curve_19 = Curve(interpolate_66.Curve)

offset_curve_19 = OffsetCurve(Curve=interpolate_69.Curve, Plane=PlaneXY(0, 0, 0), Distance=".03", BothSides=Toggle(True), Kinks=0, CapType=1)
line_51 = Line(StartPoint=construct_point_122, EndPoint=point_on_curve_22)
line_52 = Line(StartPoint=construct_point_121, EndPoint=point_on_curve_22)
boundary_surfaces_19 = BoundarySurfaces(Edges=offset_curve_19)
curve_20 = Curve(interpolate_69.Curve)

offset_curve_20 = OffsetCurve(Curve=interpolate_72.Curve, Plane=PlaneXY(0, 0, 0), Distance=".03", BothSides=Toggle(True), Kinks=0, CapType=1)
line_53 = Line(StartPoint=construct_point_124, EndPoint=point_on_curve_23)
line_54 = Line(StartPoint=construct_point_123, EndPoint=point_on_curve_23)
boundary_surfaces_20 = BoundarySurfaces(Edges=offset_curve_20)
curve_21 = Curve(interpolate_72.Curve)

offset_curve_21 = OffsetCurve(Curve=interpolate_75.Curve, Plane=PlaneXY(0, 0, 0), Distance=".03", BothSides=Toggle(True), Kinks=0, CapType=1)
line_55 = Line(StartPoint=construct_point_126, EndPoint=point_on_curve_24)
line_56 = Line(StartPoint=construct_point_125, EndPoint=point_on_curve_24)
boundary_surfaces_21 = BoundarySurfaces(Edges=offset_curve_21)
curve_22 = Curve(interpolate_75.Curve)

# ----
# S(x) = 1/(x - 1)
number_slider_82 = Slider(4, range=0..14)  # disabled
number_slider_83 = Slider(100, range=0..100)  # disabled
negative_23 = Negative(Value=number_slider_82)  # disabled
construct_domain_29 = ConstructDomain(DomainStart=negative_23, DomainEnd=number_slider_82)  # disabled
panel_117 = Panel("1")  # disabled
number_slider_84 = Slider(0, range=0..10)  # disabled
range_30 = Range(Domain=construct_domain_29, Steps=number_slider_83)  # disabled
smaller_than = SmallerThan(FirstNumber=range_30, SecondNumber=panel_117)  # -> SmallerThan, OrEqualTo; disabled
larger_than = LargerThan(FirstNumber=range_30, SecondNumber=panel_117)  # -> LargerThan, OrEqualTo; disabled
cull_pattern = CullPattern(List=range_30, CullPattern=larger_than.LargerThan)  # disabled
cull_pattern_2 = CullPattern(List=range_30, CullPattern=smaller_than.SmallerThan)  # disabled
xz_plane = XZPlane(Origin=Point(0, 0, 0))  # disabled
panel_118 = Panel(".12")  # disabled
panel_119 = Panel(".06")  # disabled
panel_120 = Panel("y         ")  # disabled
panel_121 = Panel("x")  # disabled

expression_25 = Expression(x=cull_pattern, A=panel_117, B=number_slider_84, Expression="1/(x - 1)")  # disabled
panel_122 = Panel("""    
     y = S(x)""")  # disabled
panel_123 = Panel("S(x)     ")  # disabled

expression_26 = Expression(x=cull_pattern_2, A=panel_117, B=number_slider_84, Expression="1/(x - 1)")  # disabled

construct_point_127 = ConstructPoint(XCoordinate=cull_pattern, YCoordinate=expression_25, ZCoordinate=0)  # disabled
construct_point_128 = ConstructPoint(XCoordinate=expression_25, YCoordinate=0, ZCoordinate=0)  # disabled
construct_point_129 = ConstructPoint(XCoordinate=cull_pattern_2, YCoordinate=expression_26, ZCoordinate=0)  # disabled
construct_point_130 = ConstructPoint(XCoordinate=0, YCoordinate=expression_26, ZCoordinate=0)  # disabled
interpolate_76 = Interpolate(Vertices=construct_point_129, Degree=3, Periodic=False, KnotStyle=1)  # -> Curve, Length, Domain; disabled
interpolate_77 = Interpolate(Vertices=construct_point_128, Degree=3, Periodic=False, KnotStyle=1)  # -> Curve, Length, Domain; disabled
interpolate_78 = Interpolate(Vertices=construct_point_130, Degree=3, Periodic=False, KnotStyle=1)  # -> Curve, Length, Domain; disabled
interpolate_79 = Interpolate(Vertices=construct_point_127, Degree=3, Periodic=False, KnotStyle=1)  # -> Curve, Length, Domain; disabled
mirror = Mirror(Geometry=interpolate_78.Curve, Plane=xz_plane)  # -> Geometry, Transform; disabled
point_on_curve_25 = PointOnCurve(interpolate_79.Curve, parameter=0.858)  # disabled
point_on_curve_26 = PointOnCurve(interpolate_77.Curve, parameter=0.868)  # disabled
point_on_curve_27 = PointOnCurve(mirror.Geometry, parameter=0.128)  # disabled
end_points_51 = EndPoints(Curve=interpolate_79.Curve)  # -> Start, End; disabled
end_points_52 = EndPoints(Curve=interpolate_77.Curve)  # -> Start, End; disabled
end_points_53 = EndPoints(Curve=interpolate_76.Curve)  # -> Start, End; disabled
deconstruct_25 = Deconstruct(Point=graft(point_on_curve_25))  # -> XComponent, YComponent, ZComponent; disabled
construct_point_131 = ConstructPoint(XCoordinate=deconstruct_25.XComponent, YCoordinate=0, ZCoordinate=0)  # disabled
construct_point_132 = ConstructPoint(XCoordinate=0, YCoordinate=deconstruct_25.YComponent, ZCoordinate=0)  # disabled
offset_curve_22 = OffsetCurve(
    Curve=[interpolate_79.Curve, interpolate_76.Curve],
    Plane=PlaneXY(0, 0, 0),
    Distance=panel_119,
    BothSides=False,
    Kinks=0,
    CapType=1)  # disabled
line_57 = Line(StartPoint=construct_point_132, EndPoint=point_on_curve_25)  # disabled
line_58 = Line(StartPoint=construct_point_131, EndPoint=point_on_curve_25)  # disabled
boundary_surfaces_22 = BoundarySurfaces(Edges=offset_curve_22)  # disabled
text_tag_3d_65 = TextTag3D(Location=point_on_curve_27, Text=panel_120, Size=panel_118, Justification=6)  # disabled
text_tag_3d_66 = TextTag3D(Location=point_on_curve_25, Text=panel_122, Size=panel_118, Justification=7)  # disabled
text_tag_3d_67 = TextTag3D(Location=construct_point_132, Text=panel_123, Size=panel_118, Justification=6)  # disabled
text_tag_3d_68 = TextTag3D(Location=[construct_point_131, point_on_curve_26], Text=panel_121, Size=panel_118, Justification=7)  # disabled

number_slider_85 = Slider(-4, range=-4..4.001)  # disabled
number_slider_86 = Slider(4, range=0..4)  # disabled
A_3 = Slider(0.1, range=0..0.1)  # disabled
number_slider_87 = Slider(1, range=0..10)  # disabled
panel_124 = Panel("1")  # disabled
panel_125 = Panel(".12")  # disabled
panel_126 = Panel(".06")  # disabled
panel_127 = Panel("     y    ")  # disabled
panel_128 = Panel("x")  # disabled
panel_129 = Panel("x")  # disabled

# ----
# k(x) = |x|
number_slider_88 = Slider(-4, range=-4..4.001)  # disabled
number_slider_89 = Slider(4, range=0..4)  # disabled
construct_domain_30 = ConstructDomain(DomainStart=number_slider_88, DomainEnd=number_slider_89)  # disabled
A_4 = Slider(0.1, range=0..0.1)  # disabled
number_slider_90 = Slider(0, range=0..10)  # disabled
range_31 = Range(Domain=construct_domain_30, Steps=10)  # disabled
panel_130 = Panel("1")  # disabled
construct_point_133 = ConstructPoint(XCoordinate=range_31, YCoordinate=0, ZCoordinate=0)  # disabled
interpolate_80 = Interpolate(Vertices=construct_point_133, Degree=3, Periodic=False, KnotStyle=1)  # -> Curve, Length, Domain; disabled
curve_middle_26 = CurveMiddle(Curve=interpolate_80.Curve)  # disabled
end_points_54 = EndPoints(Curve=interpolate_80.Curve)  # -> Start, End; disabled
panel_131 = Panel(".12")  # disabled
panel_132 = Panel(".06")  # disabled
panel_133 = Panel("     y    ")  # disabled
panel_134 = Panel("x")  # disabled
panel_135 = Panel("x")  # disabled
text_tag_3d_69 = TextTag3D(Location=end_points_54.End, Text=panel_134, Size=panel_131, Justification=7)  # disabled

expression_27 = Expression(x=range_31, A=panel_130, B=number_slider_90, Expression="A*abs(x) + B")  # disabled
panel_136 = Panel("1")  # disabled
panel_137 = Panel("""    
     y = k(x)""")  # disabled
panel_138 = Panel("k(x)     ")  # disabled

construct_point_134 = ConstructPoint(XCoordinate=range_31, YCoordinate=expression_27, ZCoordinate=0)  # disabled
construct_point_135 = ConstructPoint(XCoordinate=0, YCoordinate=expression_27, ZCoordinate=0)  # disabled
interpolate_81 = Interpolate(Vertices=construct_point_134, Degree=panel_136, Periodic=False, KnotStyle=1)  # -> Curve, Length, Domain; disabled
interpolate_82 = Interpolate(Vertices=construct_point_135, Degree=3, Periodic=False, KnotStyle=1)  # -> Curve, Length, Domain; disabled
point_on_curve_28 = PointOnCurve(interpolate_81.Curve, parameter=0.912)  # disabled
end_points_55 = EndPoints(Curve=interpolate_81.Curve)  # -> Start, End; disabled
end_points_56 = EndPoints(Curve=interpolate_82.Curve)  # -> Start, End; disabled
deconstruct_26 = Deconstruct(Point=graft(point_on_curve_28))  # -> XComponent, YComponent, ZComponent; disabled
construct_point_136 = ConstructPoint(XCoordinate=0, YCoordinate=deconstruct_26.YComponent, ZCoordinate=0)  # disabled
construct_point_137 = ConstructPoint(XCoordinate=deconstruct_26.XComponent, YCoordinate=0, ZCoordinate=0)  # disabled
line_59 = Line(StartPoint=construct_point_136, EndPoint=point_on_curve_28)  # disabled
line_60 = Line(StartPoint=construct_point_137, EndPoint=point_on_curve_28)  # disabled
line_61 = Line(StartPoint=end_points_54.Start, EndPoint=end_points_55.Start)  # disabled
line_62 = Line(StartPoint=end_points_56.Start, EndPoint=end_points_55.Start)  # disabled
line_63 = Line(StartPoint=end_points_54.End, EndPoint=end_points_55.End)  # disabled
line_64 = Line(StartPoint=end_points_56.End, EndPoint=end_points_55.End)  # disabled
offset_curve_23 = OffsetCurve(Curve=interpolate_81.Curve, Plane=PlaneXY(0, 0, 0), Distance=panel_132, BothSides=False, Kinks=0, CapType=1)  # disabled
boundary_surfaces_23 = BoundarySurfaces(Edges=offset_curve_23)  # disabled
text_tag_3d_70 = TextTag3D(Location=end_points_56.End, Text=panel_133, Size=panel_131, Justification=6)  # disabled
text_tag_3d_71 = TextTag3D(Location=point_on_curve_28, Text=panel_137, Size=panel_131, Justification=7)  # disabled
text_tag_3d_72 = TextTag3D(Location=construct_point_136, Text=panel_138, Size=panel_131, Justification=6)  # disabled
text_tag_3d_73 = TextTag3D(Location=construct_point_137, Text=panel_135, Size=panel_131, Justification=7)  # disabled

# ----
# g(x) = x²
# for -1 <= x < 2
panel_139 = Panel("-1")  # disabled
panel_140 = Panel("2")  # disabled
panel_141 = Panel("""    
     y = g(x)""")  # disabled
panel_142 = Panel("g(x)     ")  # disabled

construct_domain_31 = ConstructDomain(DomainStart=panel_139, DomainEnd=panel_140)  # disabled
range_32 = Range(Domain=construct_domain_31, Steps=10)  # disabled
construct_point_138 = ConstructPoint(XCoordinate=range_32, YCoordinate=0, ZCoordinate=0)  # disabled
interpolate_83 = Interpolate(Vertices=construct_point_138, Degree=3, Periodic=False, KnotStyle=1)  # -> Curve, Length, Domain; disabled
curve_middle_27 = CurveMiddle(Curve=interpolate_83.Curve)  # disabled
end_points_57 = EndPoints(Curve=interpolate_83.Curve)  # -> Start, End; disabled
text_tag_3d_74 = TextTag3D(Location=end_points_57.End, Text=panel_128, Size=panel_125, Justification=7)  # disabled

expression_28 = Expression(x=range_32, A=panel_124, B=number_slider_87, Expression="A*x^2 + B")  # disabled

construct_point_139 = ConstructPoint(XCoordinate=range_32, YCoordinate=expression_28, ZCoordinate=0)  # disabled
construct_point_140 = ConstructPoint(XCoordinate=0, YCoordinate=expression_28, ZCoordinate=0)  # disabled
interpolate_84 = Interpolate(Vertices=construct_point_139, Degree=3, Periodic=False, KnotStyle=1)  # -> Curve, Length, Domain; disabled
interpolate_85 = Interpolate(Vertices=construct_point_140, Degree=3, Periodic=False, KnotStyle=1)  # -> Curve, Length, Domain; disabled
point_on_curve_29 = PointOnCurve(interpolate_84.Curve, parameter=0.814)  # disabled
end_points_58 = EndPoints(Curve=interpolate_84.Curve)  # -> Start, End; disabled
end_points_59 = EndPoints(Curve=interpolate_85.Curve)  # -> Start, End; disabled
deconstruct_27 = Deconstruct(Point=graft(point_on_curve_29))  # -> XComponent, YComponent, ZComponent; disabled
construct_point_141 = ConstructPoint(XCoordinate=0, YCoordinate=deconstruct_27.YComponent, ZCoordinate=0)  # disabled
construct_point_142 = ConstructPoint(XCoordinate=deconstruct_27.XComponent, YCoordinate=0, ZCoordinate=0)  # disabled
line_65 = Line(StartPoint=construct_point_141, EndPoint=point_on_curve_29)  # disabled
line_66 = Line(StartPoint=construct_point_142, EndPoint=point_on_curve_29)  # disabled
line_67 = Line(StartPoint=end_points_57.Start, EndPoint=end_points_58.Start)  # disabled
line_68 = Line(StartPoint=end_points_59.Start, EndPoint=end_points_58.Start)  # disabled
line_69 = Line(StartPoint=end_points_57.End, EndPoint=end_points_58.End)  # disabled
line_70 = Line(StartPoint=end_points_59.End, EndPoint=end_points_58.End)  # disabled
offset_curve_24 = OffsetCurve(Curve=interpolate_84.Curve, Plane=PlaneXY(0, 0, 0), Distance=panel_126, BothSides=False, Kinks=0, CapType=1)  # disabled
boundary_surfaces_24 = BoundarySurfaces(Edges=offset_curve_24)  # disabled
text_tag_3d_75 = TextTag3D(Location=end_points_59.End, Text=panel_127, Size=panel_125, Justification=6)  # disabled
text_tag_3d_76 = TextTag3D(Location=point_on_curve_29, Text=panel_141, Size=panel_125, Justification=7)  # disabled
text_tag_3d_77 = TextTag3D(Location=construct_point_141, Text=panel_142, Size=panel_125, Justification=6)  # disabled
text_tag_3d_78 = TextTag3D(Location=construct_point_142, Text=panel_129, Size=panel_125, Justification=7)  # disabled

circle = Circle(Plane=end_points_58.Start, Radius=panel_125)  # disabled
boundary_surfaces_25 = BoundarySurfaces(Edges=circle)  # disabled
circle_2 = Circle(Plane=end_points_58.End, Radius=panel_125)  # disabled

# ----
# y  = x/|x| = {1 if x > 0, -1 if x > 0}
number_slider_91 = Slider(0.001, range=0.001..4)  # disabled
number_slider_92 = Slider(4, range=0..4)  # disabled
negative_24 = Negative(Value=number_slider_91)  # disabled
negative_25 = Negative(Value=number_slider_92)  # disabled
construct_domain_32 = ConstructDomain(DomainStart=number_slider_91, DomainEnd=number_slider_92)  # disabled
construct_domain_33 = ConstructDomain(DomainStart=negative_24, DomainEnd=negative_25)  # disabled
number_slider_93 = Slider(100, range=0..1000000)  # disabled
panel_143 = Panel("2")  # disabled
A_5 = Slider(0.1, range=0..0.1)  # disabled
number_slider_94 = Slider(0, range=0..10)  # disabled
division = Division(A=number_slider_93, B=panel_143)  # disabled
range_33 = Range(Domain=[construct_domain_32, construct_domain_33], Steps=number_slider_93)  # disabled
panel_144 = Panel("1")  # disabled
cull_index = CullIndex(List=range_33, Indices=division, Wrap=True)  # disabled
construct_point_143 = ConstructPoint(XCoordinate=range_33, YCoordinate=0, ZCoordinate=0)  # disabled
interpolate_86 = Interpolate(Vertices=construct_point_143, Degree=3, Periodic=False, KnotStyle=1)  # -> Curve, Length, Domain; disabled
curve_middle_28 = CurveMiddle(Curve=interpolate_86.Curve)  # disabled
end_points_60 = EndPoints(Curve=interpolate_86.Curve)  # -> Start, End; disabled
panel_145 = Panel(".12")  # disabled
panel_146 = Panel(".06")  # disabled
panel_147 = Panel("     y    ")  # disabled
panel_148 = Panel("x")  # disabled
panel_149 = Panel("x")  # disabled
text_tag_3d_79 = TextTag3D(Location=end_points_60.End, Text=panel_148, Size=panel_145, Justification=7)  # disabled

# ----
# y  = √x
number_slider_95 = Slider(-4, range=-4..4.001)  # disabled
number_slider_96 = Slider(4, range=0..4)  # disabled
# the Signum Function:
# - Latin for "sign"
# the value of sgn x indicates whether x is positive
# or negative
# - the domain of sgn consists of all real numbers
# except zero
# - ero is not regarded as positive or negative
# but the range of sgn consists of only two numbers
# -1 and 1
# see graph of sgn below:
number_slider_97 = Slider(100, range=0..100)  # disabled
construct_domain_34 = ConstructDomain(DomainStart=number_slider_95, DomainEnd=number_slider_96)  # disabled
A_6 = Slider(0.1, range=0..0.1)  # disabled
number_slider_98 = Slider(0, range=0..10)  # disabled
range_34 = Range(Domain=construct_domain_34, Steps=number_slider_97)  # disabled
panel_150 = Panel("1")  # disabled
construct_point_144 = ConstructPoint(XCoordinate=range_34, YCoordinate=0, ZCoordinate=0)  # disabled
interpolate_87 = Interpolate(Vertices=construct_point_144, Degree=3, Periodic=False, KnotStyle=1)  # -> Curve, Length, Domain; disabled
curve_middle_29 = CurveMiddle(Curve=interpolate_87.Curve)  # disabled
end_points_61 = EndPoints(Curve=interpolate_87.Curve)  # -> Start, End; disabled
panel_151 = Panel(".12")  # disabled
panel_152 = Panel(".06")  # disabled
panel_153 = Panel("     y    ")  # disabled
panel_154 = Panel("x")  # disabled
panel_155 = Panel("x")  # disabled
text_tag_3d_80 = TextTag3D(Location=end_points_61.End, Text=panel_154, Size=panel_151, Justification=7)  # disabled

expression_29 = Expression(x=range_34, A=panel_150, B=number_slider_98, Expression="A*Sqrt(x) + B")  # disabled
panel_156 = Panel("""    
     y = Sqrt(x)""")  # disabled
panel_157 = Panel("Sqrt(x)     ")  # disabled

construct_point_145 = ConstructPoint(XCoordinate=range_34, YCoordinate=expression_29, ZCoordinate=0)  # disabled
construct_point_146 = ConstructPoint(XCoordinate=0, YCoordinate=expression_29, ZCoordinate=0)  # disabled
interpolate_88 = Interpolate(Vertices=construct_point_145, Degree=3, Periodic=False, KnotStyle=1)  # -> Curve, Length, Domain; disabled
interpolate_89 = Interpolate(Vertices=construct_point_146, Degree=3, Periodic=False, KnotStyle=1)  # -> Curve, Length, Domain; disabled
point_on_curve_30 = PointOnCurve(interpolate_88.Curve, parameter=0.73)  # disabled
end_points_62 = EndPoints(Curve=interpolate_88.Curve)  # -> Start, End; disabled
end_points_63 = EndPoints(Curve=interpolate_89.Curve)  # -> Start, End; disabled
deconstruct_28 = Deconstruct(Point=graft(point_on_curve_30))  # -> XComponent, YComponent, ZComponent; disabled
panel_158 = Panel(point_on_curve_30)  # disabled
construct_point_147 = ConstructPoint(XCoordinate=0, YCoordinate=deconstruct_28.YComponent, ZCoordinate=0)  # disabled
construct_point_148 = ConstructPoint(XCoordinate=deconstruct_28.XComponent, YCoordinate=0, ZCoordinate=0)  # disabled
line_71 = Line(StartPoint=construct_point_147, EndPoint=point_on_curve_30)  # disabled
line_72 = Line(StartPoint=construct_point_148, EndPoint=point_on_curve_30)  # disabled
line_73 = Line(StartPoint=end_points_61.Start, EndPoint=end_points_62.Start)  # disabled
line_74 = Line(StartPoint=end_points_63.Start, EndPoint=end_points_62.Start)  # disabled
line_75 = Line(StartPoint=end_points_61.End, EndPoint=end_points_62.End)  # disabled
line_76 = Line(StartPoint=end_points_63.End, EndPoint=end_points_62.End)  # disabled
offset_curve_25 = OffsetCurve(Curve=interpolate_88.Curve, Plane=PlaneXY(0, 0, 0), Distance=panel_152, BothSides=False, Kinks=0, CapType=1)  # disabled
boundary_surfaces_26 = BoundarySurfaces(Edges=offset_curve_25)  # disabled
# Operations on Functions:
# - like numbers, functions can be added, subtracted,
# multiplied, and devided (except when the
# denominator is 0)
# to produce new functions
# - If ƒ and g are functions, then for every x
#  that belongs to both ƒ and g we define:
# 
# (ƒ + g)(x) = ƒ(x) + g(x)
# (ƒ - g)(x) = ƒ(x) - g(x)
# (ƒg)(x) = ƒ(x)g(x)
# (ƒ/g)(x) = ƒ(x)/g(x) where g(x) != 0
# 
# if c is a real number then
# (cƒ)(x) = cf(x)
# 
# be watchful of domains when performing operations
# - since D(ƒ) = [-1, ∞) and D(g) = (-∞, 0)∪(0,∞),
# therefore we have
# D(ƒ + g) = D(ƒ - g) = D(ƒ * g)= [-1, 0)∪(0,∞)
# and
# D(ƒ / g)= [-1, 0)∪(0, 1)∪(1, ∞)
# note g(0) is not defined
# 
# There is another method, called composition,
# by which functions can be combined to form new functions
# 
# Composition of Functions:
# - the composition of two functions ƒ and g is another function,
# denoted ƒ ⚬ g(x) = ƒ(g(x))
# for every x for which ƒ(g(x)) makes sense.
# Thus D(ƒ ⚬ g) consists of all numbers
# x in D(g) such that g(x) is in D(ƒ)
text_tag_3d_81 = TextTag3D(Location=end_points_63.End, Text=panel_153, Size=panel_151, Justification=6)  # disabled
text_tag_3d_82 = TextTag3D(Location=point_on_curve_30, Text=panel_156, Size=panel_151, Justification=7)  # disabled
text_tag_3d_83 = TextTag3D(Location=construct_point_147, Text=panel_157, Size=panel_151, Justification=6)  # disabled
text_tag_3d_84 = TextTag3D(Location=construct_point_148, Text=panel_155, Size=panel_151, Justification=7)  # disabled

# ----
# more complicated functions have serious drawbacks
# when having to complete laborious computations
# "reasonable curves"
# ƒ(x) = x^(2/3)
number_slider_99 = Slider(0.001, range=0.001..4)  # disabled
# By using a scientific calculator
# we can calculate approx values
# If we plot these values and try to draw a curve through them
# we may miss the cusp
# (an infinitely sharp point) at the origin
# Usless we calculate near x = 0
# we would likely miss a very important feature
# By using calculus we will not miss these features
# and without having to calculate many coordinates
number_slider_100 = Slider(4, range=0..4)  # disabled
negative_26 = Negative(Value=number_slider_100)  # disabled
negative_27 = Negative(Value=number_slider_99)  # disabled
construct_domain_35 = ConstructDomain(DomainStart=negative_26, DomainEnd=negative_27)  # disabled
construct_domain_36 = ConstructDomain(DomainStart=number_slider_99, DomainEnd=number_slider_100)  # disabled
number_slider_101 = Slider(28, range=0..100)  # disabled
A_7 = Slider(0.1, range=0..0.1)  # disabled
number_slider_102 = Slider(0, range=0..10)  # disabled
panel_159 = Panel("1")  # disabled
range_35 = Range(Domain=construct_domain_35, Steps=number_slider_101)  # disabled
range_36 = Range(Domain=construct_domain_36, Steps=number_slider_101)  # disabled
construct_point_149 = ConstructPoint(XCoordinate=range_36, YCoordinate=0, ZCoordinate=0)  # disabled
interpolate_90 = Interpolate(Vertices=construct_point_149, Degree=3, Periodic=False, KnotStyle=1)  # -> Curve, Length, Domain; disabled
curve_middle_30 = CurveMiddle(Curve=interpolate_90.Curve)  # disabled
end_points_64 = EndPoints(Curve=interpolate_90.Curve)  # -> Start, End; disabled
panel_160 = Panel(".12")  # disabled
boolean_toggle_14 = BooleanToggle(True)  # disabled
panel_161 = Panel(".03")  # disabled
panel_162 = Panel("     y    ")  # disabled
panel_163 = Panel("x")  # disabled
panel_164 = Panel("x")  # disabled
text_tag_3d_85 = TextTag3D(Location=end_points_64.End, Text=panel_163, Size=panel_160, Justification=7)  # disabled

expression_30 = Expression(x=cull_index, A=panel_144, B=number_slider_94, Expression="A*(x/abs(x)) + B")  # disabled
panel_165 = Panel("""    
     y = x/|x|""")  # disabled
panel_166 = Panel("x/|x|      ")  # disabled

expression_31 = Expression(x=range_36, A=panel_159, B=number_slider_102, Expression="A*(x^(2/3)) + B")  # disabled
reverse_list = ReverseList(List=range_35)  # disabled
panel_167 = Panel("""    
     ƒ(x) = x^(2/3)""")  # disabled
panel_168 = Panel("x^(2/3)")  # disabled

construct_point_150 = ConstructPoint(XCoordinate=cull_index, YCoordinate=expression_30, ZCoordinate=0)  # disabled
interpolate_91 = Interpolate(Vertices=construct_point_150, Degree=3, Periodic=False, KnotStyle=1)  # -> Curve, Length, Domain; disabled
construct_point_151 = ConstructPoint(XCoordinate=0, YCoordinate=expression_30, ZCoordinate=0)  # disabled
interpolate_92 = Interpolate(Vertices=construct_point_151, Degree=3, Periodic=False, KnotStyle=1)  # -> Curve, Length, Domain; disabled
point_on_curve_31 = PointOnCurve(interpolate_91.Curve, parameter=0.523)  # disabled
end_points_65 = EndPoints(Curve=interpolate_91.Curve)  # -> Start, End; disabled
end_points_66 = EndPoints(Curve=interpolate_92.Curve)  # -> Start, End; disabled
deconstruct_29 = Deconstruct(Point=graft(point_on_curve_31))  # -> XComponent, YComponent, ZComponent; disabled
panel_169 = Panel(point_on_curve_31)  # disabled
construct_point_152 = ConstructPoint(XCoordinate=0, YCoordinate=deconstruct_29.YComponent, ZCoordinate=0)  # disabled
construct_point_153 = ConstructPoint(XCoordinate=deconstruct_29.XComponent, YCoordinate=0, ZCoordinate=0)  # disabled
line_77 = Line(StartPoint=construct_point_152, EndPoint=point_on_curve_31)  # disabled
line_78 = Line(StartPoint=construct_point_153, EndPoint=point_on_curve_31)  # disabled
line_79 = Line(StartPoint=end_points_60.Start, EndPoint=end_points_65.Start)  # disabled
line_80 = Line(StartPoint=end_points_66.Start, EndPoint=end_points_65.Start)  # disabled
line_81 = Line(StartPoint=end_points_60.End, EndPoint=end_points_65.End)  # disabled
line_82 = Line(StartPoint=end_points_66.End, EndPoint=end_points_65.End)  # disabled
offset_curve_26 = OffsetCurve(Curve=interpolate_91.Curve, Plane=PlaneXY(0, 0, 0), Distance=panel_146, BothSides=False, Kinks=0, CapType=1)  # disabled
boundary_surfaces_27 = BoundarySurfaces(Edges=offset_curve_26)  # disabled
text_tag_3d_86 = TextTag3D(Location=end_points_66.End, Text=panel_147, Size=panel_145, Justification=6)  # disabled
text_tag_3d_87 = TextTag3D(Location=point_on_curve_31, Text=panel_165, Size=panel_145, Justification=7)  # disabled
text_tag_3d_88 = TextTag3D(Location=construct_point_152, Text=panel_166, Size=panel_145, Justification=6)  # disabled
text_tag_3d_89 = TextTag3D(Location=construct_point_153, Text=panel_149, Size=panel_145, Justification=7)  # disabled

curve_23 = Curve(interpolate_91.Curve)  # disabled
dispatch = Dispatch(List=flatten(curve_23), DispatchPattern=[True, False])  # -> ListA, ListB; disabled
end_points_67 = EndPoints(Curve=dispatch.ListA)  # -> Start, End; disabled
end_points_68 = EndPoints(Curve=dispatch.ListB)  # -> Start, End; disabled

circle_3 = Circle(Plane=end_points_68.Start, Radius=panel_145)  # disabled
circle_4 = Circle(Plane=end_points_67.Start, Radius=panel_145)  # disabled

construct_point_154 = ConstructPoint(XCoordinate=range_36, YCoordinate=expression_31, ZCoordinate=0)  # disabled
construct_point_155 = ConstructPoint(XCoordinate=reverse_list, YCoordinate=expression_31, ZCoordinate=0)  # disabled
interpolate_93 = Interpolate(Vertices=construct_point_155, Degree=3, Periodic=False, KnotStyle=1)  # -> Curve, Length, Domain; disabled
interpolate_94 = Interpolate(Vertices=construct_point_154, Degree=3, Periodic=False, KnotStyle=1)  # -> Curve, Length, Domain; disabled
construct_point_156 = ConstructPoint(XCoordinate=0, YCoordinate=expression_31, ZCoordinate=0)  # disabled
interpolate_95 = Interpolate(Vertices=construct_point_156, Degree=3, Periodic=False, KnotStyle=1)  # -> Curve, Length, Domain; disabled
point_on_curve_32 = PointOnCurve(interpolate_94.Curve, parameter=0.523)  # disabled
end_points_69 = EndPoints(Curve=interpolate_94.Curve)  # -> Start, End; disabled
end_points_70 = EndPoints(Curve=interpolate_95.Curve)  # -> Start, End; disabled
deconstruct_30 = Deconstruct(Point=graft(point_on_curve_32))  # -> XComponent, YComponent, ZComponent; disabled
panel_170 = Panel(point_on_curve_32)  # disabled
construct_point_157 = ConstructPoint(XCoordinate=0, YCoordinate=deconstruct_30.YComponent, ZCoordinate=0)  # disabled
construct_point_158 = ConstructPoint(XCoordinate=deconstruct_30.XComponent, YCoordinate=0, ZCoordinate=0)  # disabled
line_83 = Line(StartPoint=construct_point_157, EndPoint=point_on_curve_32)  # disabled
line_84 = Line(StartPoint=construct_point_158, EndPoint=point_on_curve_32)  # disabled
line_85 = Line(StartPoint=end_points_64.Start, EndPoint=end_points_69.Start)  # disabled
line_86 = Line(StartPoint=end_points_70.Start, EndPoint=end_points_69.Start)  # disabled
line_87 = Line(StartPoint=end_points_64.End, EndPoint=end_points_69.End)  # disabled
line_88 = Line(StartPoint=end_points_70.End, EndPoint=end_points_69.End)  # disabled
offset_curve_27 = OffsetCurve(
    Curve=[interpolate_93.Curve, interpolate_94.Curve],
    Plane=PlaneXY(0, 0, 0),
    Distance=panel_161,
    BothSides=boolean_toggle_14,
    Kinks=0,
    CapType=1)  # disabled
boundary_surfaces_28 = BoundarySurfaces(Edges=offset_curve_27)  # disabled
text_tag_3d_90 = TextTag3D(Location=end_points_70.End, Text=panel_162, Size=panel_160, Justification=6)  # disabled
text_tag_3d_91 = TextTag3D(Location=point_on_curve_32, Text=panel_167, Size=panel_160, Justification=7)  # disabled
text_tag_3d_92 = TextTag3D(Location=construct_point_157, Text=panel_168, Size=panel_160, Justification=6)  # disabled
text_tag_3d_93 = TextTag3D(Location=construct_point_158, Text=panel_164, Size=panel_160, Justification=7)  # disabled

curve_24 = Curve([interpolate_93.Curve, interpolate_94.Curve])  # disabled
dispatch_2 = Dispatch(List=flatten(curve_24), DispatchPattern=[True, False])  # -> ListA, ListB; disabled
end_points_71 = EndPoints(Curve=dispatch_2.ListA)  # -> Start, End; disabled
end_points_72 = EndPoints(Curve=dispatch_2.ListB)  # -> Start, End; disabled

circle_5 = Circle(Plane=end_points_72.Start, Radius=panel_160)  # disabled
circle_6 = Circle(Plane=end_points_71.Start, Radius=panel_160)  # disabled

# ----
# ƒ ◦ g(x) = ƒ(g(x)) = Sqrt(g(x) = Sqrt(x + 1)
# D(ƒ ◦ g) = [-1, ∞)
number_slider_103 = Slider(4, range=0..4)  # disabled
# ƒ(x) = Sqrt(x) and g(x) = x + 1
# we can calculate the following compositions:
panel_171 = Panel("-1")  # disabled
construct_domain_37 = ConstructDomain(DomainStart=panel_171, DomainEnd=number_slider_103)  # disabled
number_slider_104 = Slider(100, range=0..100)  # disabled
number_slider_105 = Slider(1, range=0..10)  # disabled
A_8 = Slider(0.1, range=0..0.1)  # disabled
number_slider_106 = Slider(0, range=-5..5)  # disabled
range_37 = Range(Domain=construct_domain_37, Steps=number_slider_104)  # disabled
panel_172 = Panel("1")  # disabled
construct_point_159 = ConstructPoint(XCoordinate=range_37, YCoordinate=0, ZCoordinate=0)  # disabled
interpolate_96 = Interpolate(Vertices=construct_point_159, Degree=3, Periodic=False, KnotStyle=1)  # -> Curve, Length, Domain; disabled
curve_middle_31 = CurveMiddle(Curve=interpolate_96.Curve)  # disabled
end_points_73 = EndPoints(Curve=interpolate_96.Curve)  # -> Start, End; disabled
panel_173 = Panel(".12")  # disabled
boolean_toggle_15 = BooleanToggle(True)  # disabled
panel_174 = Panel(".03")  # disabled
panel_175 = Panel("     y    ")  # disabled
panel_176 = Panel("x")  # disabled
panel_177 = Panel("x")  # disabled
text_tag_3d_94 = TextTag3D(Location=end_points_73.End, Text=panel_176, Size=panel_173, Justification=7)  # disabled

# ----
# ƒ ◦ ƒ(x) = ƒ(ƒ(x)) = Sqrt(ƒ(x)) = Sqrt(Sqrt(x)) = x^(1/4)
# D(ƒ ◦ ƒ) = [0, ∞)
number_slider_107 = Slider(4, range=0..4)  # disabled
panel_178 = Panel("-1")  # disabled
construct_domain_38 = ConstructDomain(DomainStart=panel_178, DomainEnd=number_slider_107)  # disabled
number_slider_108 = Slider(100, range=0..100)  # disabled
number_slider_109 = Slider(1, range=0..10)  # disabled
A_9 = Slider(0.1, range=0..0.1)  # disabled
number_slider_110 = Slider(0, range=-5..5)  # disabled
range_38 = Range(Domain=construct_domain_38, Steps=number_slider_108)  # disabled
construct_point_160 = ConstructPoint(XCoordinate=range_38, YCoordinate=0, ZCoordinate=0)  # disabled
interpolate_97 = Interpolate(Vertices=construct_point_160, Degree=3, Periodic=False, KnotStyle=1)  # -> Curve, Length, Domain; disabled
curve_middle_32 = CurveMiddle(Curve=interpolate_97.Curve)  # disabled
end_points_74 = EndPoints(Curve=interpolate_97.Curve)  # -> Start, End; disabled
panel_180 = Panel(".12")  # disabled
boolean_toggle_16 = BooleanToggle(True)  # disabled
panel_181 = Panel(".03")  # disabled
panel_182 = Panel("     y    ")  # disabled
panel_183 = Panel("x")  # disabled
panel_184 = Panel("x")  # disabled
text_tag_3d_95 = TextTag3D(Location=end_points_74.End, Text=panel_183, Size=panel_180, Justification=7)  # disabled

# ----
# g ◦ g(x) = g(g(x)) = g(x) + 1 = (x + 1) + 1 = x + 2
# D(g ◦ g) = IR
number_slider_111 = Slider(4, range=0..4)  # disabled
panel_185 = Panel("-1")  # disabled
number_slider_112 = Slider(100, range=0..100)  # disabled
number_slider_113 = Slider(1, range=0..10)  # disabled
A_10 = Slider(0.1, range=0..0.1)  # disabled
number_slider_114 = Slider(0, range=-5..5)  # disabled
panel_187 = Panel(".12")  # disabled
boolean_toggle_17 = BooleanToggle(True)  # disabled
panel_188 = Panel(".03")  # disabled
panel_189 = Panel("     y    ")  # disabled
panel_190 = Panel("x")  # disabled
panel_191 = Panel("x")  # disabled

negative_28 = Negative(Value=number_slider_111)  # disabled

# ----
# g ◦ ƒ  ◦ g(x) = g(ƒ(g(x))) = ƒ(g(x)) + 1 = Sqrt(x + 1) + 1
# D(g ◦ ƒ  ◦ g(x)) = (-1, ∞)
number_slider_115 = Slider(4, range=0..4)  # disabled
panel_192 = Panel("-1")  # disabled
construct_domain_39 = ConstructDomain(DomainStart=panel_192, DomainEnd=number_slider_115)  # disabled
number_slider_116 = Slider(100, range=0..100)  # disabled
number_slider_117 = Slider(1, range=0..10)  # disabled
A_11 = Slider(0.1, range=0..0.1)  # disabled
number_slider_118 = Slider(0, range=-5..5)  # disabled
range_39 = Range(Domain=construct_domain_39, Steps=number_slider_116)  # disabled
construct_point_161 = ConstructPoint(XCoordinate=range_39, YCoordinate=0, ZCoordinate=0)  # disabled
interpolate_98 = Interpolate(Vertices=construct_point_161, Degree=3, Periodic=False, KnotStyle=1)  # -> Curve, Length, Domain; disabled
curve_middle_33 = CurveMiddle(Curve=interpolate_98.Curve)  # disabled
end_points_75 = EndPoints(Curve=interpolate_98.Curve)  # -> Start, End; disabled
panel_194 = Panel(".12")  # disabled
boolean_toggle_18 = BooleanToggle(True)  # disabled
panel_195 = Panel(".03")  # disabled
panel_196 = Panel("     y    ")  # disabled
panel_197 = Panel("x")  # disabled
panel_198 = Panel("x")  # disabled
text_tag_3d_96 = TextTag3D(Location=end_points_75.End, Text=panel_197, Size=panel_194, Justification=7)  # disabled

# ----
# g ◦ ƒ(x) = g(ƒ(x)) = ƒ(x) + 1 = Sqrt(x) + 1
# D(g ◦ ƒ) = [0, ∞)
number_slider_119 = Slider(4, range=0..4)  # disabled
panel_199 = Panel("0")  # disabled
construct_domain_40 = ConstructDomain(DomainStart=panel_199, DomainEnd=number_slider_119)  # disabled
number_slider_120 = Slider(100, range=0..100)  # disabled
number_slider_121 = Slider(0.64, range=0..10)  # disabled
A_12 = Slider(0.1, range=0..0.1)  # disabled
number_slider_122 = Slider(0, range=-5..5)  # disabled
range_40 = Range(Domain=construct_domain_40, Steps=number_slider_120)  # disabled
construct_point_162 = ConstructPoint(XCoordinate=range_40, YCoordinate=0, ZCoordinate=0)  # disabled
interpolate_99 = Interpolate(Vertices=construct_point_162, Degree=3, Periodic=False, KnotStyle=1)  # -> Curve, Length, Domain; disabled
curve_middle_34 = CurveMiddle(Curve=interpolate_99.Curve)  # disabled
end_points_76 = EndPoints(Curve=interpolate_99.Curve)  # -> Start, End; disabled
panel_201 = Panel(".12")  # disabled
boolean_toggle_19 = BooleanToggle(True)  # disabled
panel_202 = Panel(".03")  # disabled
panel_203 = Panel("     y    ")  # disabled
panel_204 = Panel("x")  # disabled
panel_205 = Panel("x")  # disabled
text_tag_3d_97 = TextTag3D(Location=end_points_76.End, Text=panel_204, Size=panel_201, Justification=7)  # disabled

construct_domain_41 = ConstructDomain(DomainStart=negative_28, DomainEnd=number_slider_111)  # disabled
range_41 = Range(Domain=construct_domain_41, Steps=number_slider_112)  # disabled
construct_point_163 = ConstructPoint(XCoordinate=range_41, YCoordinate=0, ZCoordinate=0)  # disabled
interpolate_100 = Interpolate(Vertices=construct_point_163, Degree=3, Periodic=False, KnotStyle=1)  # -> Curve, Length, Domain; disabled
curve_middle_35 = CurveMiddle(Curve=interpolate_100.Curve)  # disabled
end_points_77 = EndPoints(Curve=interpolate_100.Curve)  # -> Start, End; disabled
text_tag_3d_98 = TextTag3D(Location=end_points_77.End, Text=panel_190, Size=panel_187, Justification=7)  # disabled

expression_32 = Expression(x=range_41, A=number_slider_113, Expression="A * (x + 2)")  # disabled
curve_25 = Curve()  # disabled
dispatch_3 = Dispatch(List=flatten(curve_25), DispatchPattern=[True, False])  # -> ListA, ListB; disabled
end_points_78 = EndPoints(Curve=dispatch_3.ListA)  # -> Start, End; disabled
end_points_79 = EndPoints(Curve=dispatch_3.ListB)  # -> Start, End; disabled
panel_206 = Panel("""    
     g ◦ g(x) = A * (x + 2)""")  # disabled
panel_207 = Panel("A * (x + 2)")  # disabled

construct_point_164 = ConstructPoint(XCoordinate=range_41, YCoordinate=expression_32, ZCoordinate=0)  # disabled
interpolate_101 = Interpolate(Vertices=construct_point_164, Degree=3, Periodic=False, KnotStyle=1)  # -> Curve, Length, Domain; disabled
construct_point_165 = ConstructPoint(XCoordinate=0, YCoordinate=expression_32, ZCoordinate=0)  # disabled
interpolate_102 = Interpolate(Vertices=construct_point_165, Degree=3, Periodic=False, KnotStyle=1)  # -> Curve, Length, Domain; disabled
point_on_curve_33 = PointOnCurve(interpolate_101.Curve, parameter=0.711)  # disabled
end_points_80 = EndPoints(Curve=interpolate_101.Curve)  # -> Start, End; disabled
end_points_81 = EndPoints(Curve=interpolate_102.Curve)  # -> Start, End; disabled
deconstruct_31 = Deconstruct(Point=graft(point_on_curve_33))  # -> XComponent, YComponent, ZComponent; disabled
panel_208 = Panel(point_on_curve_33)  # disabled
construct_point_166 = ConstructPoint(XCoordinate=0, YCoordinate=deconstruct_31.YComponent, ZCoordinate=0)  # disabled
construct_point_167 = ConstructPoint(XCoordinate=deconstruct_31.XComponent, YCoordinate=0, ZCoordinate=0)  # disabled
line_89 = Line(StartPoint=construct_point_166, EndPoint=point_on_curve_33)  # disabled
line_90 = Line(StartPoint=construct_point_167, EndPoint=point_on_curve_33)  # disabled
line_91 = Line(StartPoint=end_points_77.Start, EndPoint=end_points_80.Start)  # disabled
line_92 = Line(StartPoint=end_points_81.Start, EndPoint=end_points_80.Start)  # disabled
line_93 = Line(StartPoint=end_points_77.End, EndPoint=end_points_80.End)  # disabled
line_94 = Line(StartPoint=end_points_81.End, EndPoint=end_points_80.End)  # disabled
offset_curve_28 = OffsetCurve(Curve=interpolate_101.Curve, Plane=PlaneXY(0, 0, 0), Distance=panel_188, BothSides=boolean_toggle_17, Kinks=0, CapType=1)  # disabled
boundary_surfaces_29 = BoundarySurfaces(Edges=offset_curve_28)  # disabled
circle_7 = Circle(Plane=end_points_79.Start, Radius=panel_187)  # disabled
text_tag_3d_99 = TextTag3D(Location=end_points_81.End, Text=panel_189, Size=panel_187, Justification=6)  # disabled
text_tag_3d_100 = TextTag3D(Location=point_on_curve_33, Text=panel_206, Size=panel_187, Justification=7)  # disabled
text_tag_3d_101 = TextTag3D(Location=construct_point_166, Text=panel_207, Size=panel_187, Justification=6)  # disabled
text_tag_3d_102 = TextTag3D(Location=construct_point_167, Text=panel_191, Size=panel_187, Justification=7)  # disabled
circle_8 = Circle(Plane=end_points_78.Start, Radius=panel_187)  # disabled

expression_33 = Expression(x=range_37, A=number_slider_105, Expression="A * (Sqrt(x + 1))")  # disabled
panel_209 = Panel("""    
     ƒ ◦ g(x) = A * (Sqrt(x + 1))""")  # disabled
panel_210 = Panel("A * (Sqrt(x + 1))")  # disabled

expression_34 = Expression(x=range_38, A=number_slider_109, Expression="A * (Sqrt(Sqrt(x)))")  # disabled
dispatch_4 = Dispatch(DispatchPattern=[True, False])  # -> ListA, ListB; disabled
end_points_82 = EndPoints(Curve=dispatch_4.ListB)  # -> Start, End; disabled
panel_211 = Panel("""    
     ƒ ◦ ƒ(x) = A * (x^(1/4))""")  # disabled
panel_212 = Panel("A * ((Sqrt(Sqrt(x)))")  # disabled

expression_35 = Expression(x=range_40, A=number_slider_121, Expression="A * (Sqrt(x) + 1)")  # disabled
dispatch_5 = Dispatch(DispatchPattern=[True, False])  # -> ListA, ListB; disabled
end_points_83 = EndPoints(Curve=dispatch_5.ListB)  # -> Start, End; disabled
panel_213 = Panel("""    
     g ◦ ƒ(x) = A * (Sqrt(x) + 1)""")  # disabled
panel_214 = Panel("A * (Sqrt(x) + 1)")  # disabled

expression_36 = Expression(x=range_39, A=number_slider_117, Expression="A * (Sqrt(x + 1) + 1)")  # disabled
panel_215 = Panel("""    
     g ◦ f ◦ g(x) = A * (Sqrt(x + 1) + 1)""")  # disabled
panel_216 = Panel("A * (Sqrt(x + 1) + 1)")  # disabled

construct_point_168 = ConstructPoint(XCoordinate=range_37, YCoordinate=expression_33, ZCoordinate=0)  # disabled
interpolate_103 = Interpolate(Vertices=construct_point_168, Degree=3, Periodic=False, KnotStyle=1)  # -> Curve, Length, Domain; disabled
construct_point_169 = ConstructPoint(XCoordinate=0, YCoordinate=expression_33, ZCoordinate=0)  # disabled
interpolate_104 = Interpolate(Vertices=construct_point_169, Degree=3, Periodic=False, KnotStyle=1)  # -> Curve, Length, Domain; disabled
point_on_curve_34 = PointOnCurve(interpolate_103.Curve, parameter=1)  # disabled
end_points_84 = EndPoints(Curve=interpolate_103.Curve)  # -> Start, End; disabled
end_points_85 = EndPoints(Curve=interpolate_104.Curve)  # -> Start, End; disabled
deconstruct_32 = Deconstruct(Point=graft(point_on_curve_34))  # -> XComponent, YComponent, ZComponent; disabled
panel_217 = Panel(point_on_curve_34)  # disabled
construct_point_170 = ConstructPoint(XCoordinate=0, YCoordinate=deconstruct_32.YComponent, ZCoordinate=0)  # disabled
construct_point_171 = ConstructPoint(XCoordinate=deconstruct_32.XComponent, YCoordinate=0, ZCoordinate=0)  # disabled
line_95 = Line(StartPoint=construct_point_170, EndPoint=point_on_curve_34)  # disabled
line_96 = Line(StartPoint=construct_point_171, EndPoint=point_on_curve_34)  # disabled
line_97 = Line(StartPoint=end_points_73.Start, EndPoint=end_points_84.Start)  # disabled
line_98 = Line(StartPoint=end_points_85.Start, EndPoint=end_points_84.Start)  # disabled
line_99 = Line(StartPoint=end_points_73.End, EndPoint=end_points_84.End)  # disabled
line_100 = Line(StartPoint=end_points_85.End, EndPoint=end_points_84.End)  # disabled
offset_curve_29 = OffsetCurve(Curve=interpolate_103.Curve, Plane=PlaneXY(0, 0, 0), Distance=panel_174, BothSides=boolean_toggle_15, Kinks=0, CapType=1)  # disabled
boundary_surfaces_30 = BoundarySurfaces(Edges=offset_curve_29)  # disabled
text_tag_3d_103 = TextTag3D(Location=end_points_85.End, Text=panel_175, Size=panel_173, Justification=6)  # disabled
text_tag_3d_104 = TextTag3D(Location=point_on_curve_34, Text=panel_209, Size=panel_173, Justification=7)  # disabled
text_tag_3d_105 = TextTag3D(Location=construct_point_170, Text=panel_210, Size=panel_173, Justification=6)  # disabled
text_tag_3d_106 = TextTag3D(Location=construct_point_171, Text=panel_177, Size=panel_173, Justification=7)  # disabled

curve_26 = Curve(interpolate_103.Curve)  # disabled
dispatch_6 = Dispatch(List=flatten(curve_26), DispatchPattern=[True, False])  # -> ListA, ListB; disabled
end_points_86 = EndPoints(Curve=dispatch_6.ListB)  # -> Start, End; disabled
end_points_87 = EndPoints(Curve=curve_26)  # -> Start, End; disabled

circle_9 = Circle(Plane=end_points_86.Start, Radius=panel_173)  # disabled
circle_10 = Circle(Plane=end_points_87.Start, Radius=panel_173)  # disabled
# if H(x) = (1 - x)/(1 + x)
# calculate H ◦ H(x) and specify its domain
# 
# H ◦ H(x) = (1 - H(x))/(1 + H(x)) =
# 
# (1 - ((1 - x)/(1 + x)) / (1 + ((1 - x)/(1 + x))) =
# 
# (1 + x - 1 + x)/(1 + x + 1 - x) = x,
# 
# forvided that x != -1
# the domain of H ◦ H(x) is
# (-∞, -1) U (-1, ∞) because H(x) is not
# defined for x = -1, neither is H(H(x))
boundary_surfaces_31 = BoundarySurfaces(Edges=circle_10)  # disabled

construct_point_172 = ConstructPoint(XCoordinate=range_40, YCoordinate=expression_35, ZCoordinate=0)  # disabled
interpolate_105 = Interpolate(Vertices=construct_point_172, Degree=3, Periodic=False, KnotStyle=1)  # -> Curve, Length, Domain; disabled
construct_point_173 = ConstructPoint(XCoordinate=0, YCoordinate=expression_35, ZCoordinate=0)  # disabled
interpolate_106 = Interpolate(Vertices=construct_point_173, Degree=3, Periodic=False, KnotStyle=1)  # -> Curve, Length, Domain; disabled
point_on_curve_35 = PointOnCurve(interpolate_105.Curve, parameter=1)  # disabled
end_points_88 = EndPoints(Curve=interpolate_105.Curve)  # -> Start, End; disabled
end_points_89 = EndPoints(Curve=interpolate_106.Curve)  # -> Start, End; disabled
deconstruct_33 = Deconstruct(Point=graft(point_on_curve_35))  # -> XComponent, YComponent, ZComponent; disabled
panel_218 = Panel(point_on_curve_35)  # disabled
construct_point_174 = ConstructPoint(XCoordinate=0, YCoordinate=deconstruct_33.YComponent, ZCoordinate=0)  # disabled
construct_point_175 = ConstructPoint(XCoordinate=deconstruct_33.XComponent, YCoordinate=0, ZCoordinate=0)  # disabled
line_101 = Line(StartPoint=construct_point_174, EndPoint=point_on_curve_35)  # disabled
line_102 = Line(StartPoint=construct_point_175, EndPoint=point_on_curve_35)  # disabled
line_103 = Line(StartPoint=end_points_76.Start, EndPoint=end_points_88.Start)  # disabled
line_104 = Line(StartPoint=end_points_89.Start, EndPoint=end_points_88.Start)  # disabled
line_105 = Line(StartPoint=end_points_76.End, EndPoint=end_points_88.End)  # disabled
line_106 = Line(StartPoint=end_points_89.End, EndPoint=end_points_88.End)  # disabled
circle_11 = Circle(Plane=end_points_83.Start, Radius=panel_201)  # disabled
offset_curve_30 = OffsetCurve(Curve=interpolate_105.Curve, Plane=PlaneXY(0, 0, 0), Distance=panel_202, BothSides=boolean_toggle_19, Kinks=0, CapType=1)  # disabled
boundary_surfaces_32 = BoundarySurfaces(Edges=offset_curve_30)  # disabled
text_tag_3d_107 = TextTag3D(Location=end_points_89.End, Text=panel_203, Size=panel_201, Justification=6)  # disabled
text_tag_3d_108 = TextTag3D(Location=point_on_curve_35, Text=panel_213, Size=panel_201, Justification=7)  # disabled
text_tag_3d_109 = TextTag3D(Location=construct_point_174, Text=panel_214, Size=panel_201, Justification=6)  # disabled
text_tag_3d_110 = TextTag3D(Location=construct_point_175, Text=panel_205, Size=panel_201, Justification=7)  # disabled

curve_27 = Curve(interpolate_105.Curve)  # disabled
end_points_90 = EndPoints(Curve=curve_27)  # -> Start, End; disabled

circle_12 = Circle(Plane=end_points_90.Start, Radius=panel_201)  # disabled
boundary_surfaces_33 = BoundarySurfaces(Edges=circle_12)  # disabled

construct_point_176 = ConstructPoint(XCoordinate=range_38, YCoordinate=expression_34, ZCoordinate=0)  # disabled
interpolate_107 = Interpolate(Vertices=construct_point_176, Degree=3, Periodic=False, KnotStyle=1)  # -> Curve, Length, Domain; disabled
construct_point_177 = ConstructPoint(XCoordinate=0, YCoordinate=expression_34, ZCoordinate=0)  # disabled
interpolate_108 = Interpolate(Vertices=construct_point_177, Degree=3, Periodic=False, KnotStyle=1)  # -> Curve, Length, Domain; disabled
point_on_curve_36 = PointOnCurve(interpolate_107.Curve, parameter=0.596)  # disabled
end_points_91 = EndPoints(Curve=interpolate_107.Curve)  # -> Start, End; disabled
end_points_92 = EndPoints(Curve=interpolate_108.Curve)  # -> Start, End; disabled
deconstruct_34 = Deconstruct(Point=graft(point_on_curve_36))  # -> XComponent, YComponent, ZComponent; disabled
panel_219 = Panel(point_on_curve_36)  # disabled
construct_point_178 = ConstructPoint(XCoordinate=0, YCoordinate=deconstruct_34.YComponent, ZCoordinate=0)  # disabled
construct_point_179 = ConstructPoint(XCoordinate=deconstruct_34.XComponent, YCoordinate=0, ZCoordinate=0)  # disabled
line_107 = Line(StartPoint=construct_point_178, EndPoint=point_on_curve_36)  # disabled
line_108 = Line(StartPoint=construct_point_179, EndPoint=point_on_curve_36)  # disabled
line_109 = Line(StartPoint=end_points_74.Start, EndPoint=end_points_91.Start)  # disabled
line_110 = Line(StartPoint=end_points_92.Start, EndPoint=end_points_91.Start)  # disabled
line_111 = Line(StartPoint=end_points_74.End, EndPoint=end_points_91.End)  # disabled
line_112 = Line(StartPoint=end_points_92.End, EndPoint=end_points_91.End)  # disabled
circle_13 = Circle(Plane=end_points_82.Start, Radius=panel_180)  # disabled
offset_curve_31 = OffsetCurve(Curve=interpolate_107.Curve, Plane=PlaneXY(0, 0, 0), Distance=panel_181, BothSides=boolean_toggle_16, Kinks=0, CapType=1)  # disabled
# Odd and Even Functions:
# - graphs of a function will have certain kinds of symetry
# - the simplest kind  relates the value of
# ƒ at -1 to its value at x
# 
# Suppose that -x belongs to D(ƒ)
# we say that ƒ is an odd function if
# ƒ(-x) = -ƒ(x) for every x in D(ƒ)
# we say that ƒ is an even function if
# ƒ(-x) = ƒ(x) for every x in D(ƒ)
# 
# Odd powers of x such as x, x^3, x^5,...,x^(-1), x^(-3),... are odd functions
# even powers are even functions
# The absolute value function |x| is an even function
# any function which depends only on x^2
# is an even function of x
# 
# Note:
# the graph of an odd function is symetric about the origin
# a line drawn from any point on the graph
# passing through the origin will come to
# another point on the graph
# 
# the graph of an even functon is symetric about the y-axis
# a perpendicular line drawn from any point
# on the graph perpendicular to the y-axis will continue the same distance to another
# point on the graph
# 
# Note that an odd function defined at x = 0
# must vanish (=0) there
# because f(0) = f(-0) = -f(0) implies
# 2ƒ(0) = 0, and so ƒ(0) = 0
boundary_surfaces_34 = BoundarySurfaces(Edges=offset_curve_31)  # disabled
text_tag_3d_111 = TextTag3D(Location=end_points_92.End, Text=panel_182, Size=panel_180, Justification=6)  # disabled
text_tag_3d_112 = TextTag3D(Location=point_on_curve_36, Text=panel_211, Size=panel_180, Justification=7)  # disabled
text_tag_3d_113 = TextTag3D(Location=construct_point_178, Text=panel_212, Size=panel_180, Justification=6)  # disabled
text_tag_3d_114 = TextTag3D(Location=construct_point_179, Text=panel_184, Size=panel_180, Justification=7)  # disabled

curve_28 = Curve(interpolate_107.Curve)  # disabled
end_points_93 = EndPoints(Curve=curve_28)  # -> Start, End; disabled

circle_14 = Circle(Plane=end_points_93.Start, Radius=panel_180)  # disabled
boundary_surfaces_35 = BoundarySurfaces(Edges=circle_14)  # disabled

construct_point_180 = ConstructPoint(XCoordinate=range_39, YCoordinate=expression_36, ZCoordinate=0)  # disabled
interpolate_109 = Interpolate(Vertices=construct_point_180, Degree=3, Periodic=False, KnotStyle=1)  # -> Curve, Length, Domain; disabled
construct_point_181 = ConstructPoint(XCoordinate=0, YCoordinate=expression_36, ZCoordinate=0)  # disabled
interpolate_110 = Interpolate(Vertices=construct_point_181, Degree=3, Periodic=False, KnotStyle=1)  # -> Curve, Length, Domain; disabled
point_on_curve_37 = PointOnCurve(interpolate_109.Curve, parameter=0.862)  # disabled
end_points_94 = EndPoints(Curve=interpolate_109.Curve)  # -> Start, End; disabled
end_points_95 = EndPoints(Curve=interpolate_110.Curve)  # -> Start, End; disabled
deconstruct_35 = Deconstruct(Point=graft(point_on_curve_37))  # -> XComponent, YComponent, ZComponent; disabled
panel_220 = Panel(point_on_curve_37)  # disabled
construct_point_182 = ConstructPoint(XCoordinate=0, YCoordinate=deconstruct_35.YComponent, ZCoordinate=0)  # disabled
construct_point_183 = ConstructPoint(XCoordinate=deconstruct_35.XComponent, YCoordinate=0, ZCoordinate=0)  # disabled
line_113 = Line(StartPoint=construct_point_182, EndPoint=point_on_curve_37)  # disabled
line_114 = Line(StartPoint=construct_point_183, EndPoint=point_on_curve_37)  # disabled
line_115 = Line(StartPoint=end_points_75.Start, EndPoint=end_points_94.Start)  # disabled
line_116 = Line(StartPoint=end_points_95.Start, EndPoint=end_points_94.Start)  # disabled
line_117 = Line(StartPoint=end_points_75.End, EndPoint=end_points_94.End)  # disabled
line_118 = Line(StartPoint=end_points_95.End, EndPoint=end_points_94.End)  # disabled
offset_curve_32 = OffsetCurve(Curve=interpolate_109.Curve, Plane=PlaneXY(0, 0, 0), Distance=panel_195, BothSides=boolean_toggle_18, Kinks=0, CapType=1)  # disabled
boundary_surfaces_36 = BoundarySurfaces(Edges=offset_curve_32)  # disabled
text_tag_3d_115 = TextTag3D(Location=end_points_95.End, Text=panel_196, Size=panel_194, Justification=6)  # disabled
text_tag_3d_116 = TextTag3D(Location=point_on_curve_37, Text=panel_215, Size=panel_194, Justification=7)  # disabled
text_tag_3d_117 = TextTag3D(Location=construct_point_182, Text=panel_216, Size=panel_194, Justification=6)  # disabled
text_tag_3d_118 = TextTag3D(Location=construct_point_183, Text=panel_198, Size=panel_194, Justification=7)  # disabled

curve_29 = Curve(interpolate_109.Curve)  # disabled
dispatch_7 = Dispatch(List=flatten(curve_29), DispatchPattern=[True, False])  # -> ListA, ListB; disabled
end_points_96 = EndPoints(Curve=curve_29)  # -> Start, End; disabled
end_points_97 = EndPoints(Curve=dispatch_7.ListB)  # -> Start, End; disabled

circle_15 = Circle(Plane=end_points_97.Start, Radius=panel_194)  # disabled
circle_16 = Circle(Plane=end_points_96.Start, Radius=panel_194)  # disabled

# ----
# ƒ ◦ g(x) = ƒ(g(x)) = Sqrt(g(x) = Sqrt(x + 1)
# D(ƒ ◦ g) = [-1, ∞)
number_slider_123 = Slider(4, range=0..4)  # disabled
number_slider_124 = Slider(1.934, range=-5..5)  # disabled
negative_29 = Negative(Value=number_slider_123)  # disabled
construct_domain_42 = ConstructDomain(DomainStart=negative_29, DomainEnd=number_slider_124)  # disabled
construct_domain_43 = ConstructDomain(DomainStart=number_slider_124, DomainEnd=number_slider_123)  # disabled
number_slider_125 = Slider(100, range=0..100)  # disabled
number_slider_126 = Slider(1, range=0..10)  # disabled
range_42 = Range(Domain=construct_domain_43, Steps=number_slider_125)  # disabled
range_43 = Range(Domain=construct_domain_42, Steps=number_slider_125)  # disabled
construct_point_184 = ConstructPoint(XCoordinate=range_43, YCoordinate=0, ZCoordinate=0)  # disabled
construct_point_185 = ConstructPoint(XCoordinate=range_42, YCoordinate=0, ZCoordinate=0)  # disabled
interpolate_111 = Interpolate(Vertices=construct_point_184, Degree=3, Periodic=False, KnotStyle=1)  # -> Curve, Length, Domain; disabled
interpolate_112 = Interpolate(Vertices=construct_point_185, Degree=3, Periodic=False, KnotStyle=1)  # -> Curve, Length, Domain; disabled
curve_middle_36 = CurveMiddle(Curve=interpolate_111.Curve)  # disabled
end_points_98 = EndPoints(Curve=interpolate_111.Curve)  # -> Start, End; disabled
curve_middle_37 = CurveMiddle(Curve=interpolate_112.Curve)  # disabled
end_points_99 = EndPoints(Curve=interpolate_112.Curve)  # -> Start, End; disabled
panel_223 = Panel(".12")  # disabled
boolean_toggle_20 = BooleanToggle(True)  # disabled
panel_224 = Panel(".12")  # disabled
boolean_toggle_21 = BooleanToggle(True)  # disabled
panel_225 = Panel(".03")  # disabled
panel_226 = Panel(".03")  # disabled
panel_227 = Panel("     y    ")  # disabled
panel_228 = Panel("x")  # disabled
panel_229 = Panel("x")  # disabled
panel_230 = Panel("     y    ")  # disabled
panel_231 = Panel("x")  # disabled
panel_232 = Panel("x")  # disabled
text_tag_3d_119 = TextTag3D(Location=end_points_98.End, Text=panel_228, Size=panel_223, Justification=7)  # disabled
text_tag_3d_120 = TextTag3D(Location=end_points_99.End, Text=panel_231, Size=panel_224, Justification=7)  # disabled

expression_37 = Expression(x=range_43, A=number_slider_126, Expression="A * x")  # disabled
expression_38 = Expression(x=range_42, A=number_slider_126, Expression="A * x")  # disabled
panel_233 = Panel("""    
     H(x) = A * x""")  # disabled
panel_234 = Panel("A * x")  # disabled
panel_235 = Panel("""    
     H(x) = A * x""")  # disabled
panel_236 = Panel("A * x")  # disabled

construct_point_186 = ConstructPoint(XCoordinate=range_43, YCoordinate=expression_37, ZCoordinate=0)  # disabled
construct_point_187 = ConstructPoint(XCoordinate=range_42, YCoordinate=expression_38, ZCoordinate=0)  # disabled
interpolate_113 = Interpolate(Vertices=construct_point_186, Degree=3, Periodic=False, KnotStyle=1)  # -> Curve, Length, Domain; disabled
interpolate_114 = Interpolate(Vertices=construct_point_187, Degree=3, Periodic=False, KnotStyle=1)  # -> Curve, Length, Domain; disabled
construct_point_188 = ConstructPoint(XCoordinate=0, YCoordinate=expression_37, ZCoordinate=0)  # disabled
construct_point_189 = ConstructPoint(XCoordinate=0, YCoordinate=expression_38, ZCoordinate=0)  # disabled
interpolate_115 = Interpolate(Vertices=construct_point_188, Degree=3, Periodic=False, KnotStyle=1)  # -> Curve, Length, Domain; disabled
interpolate_116 = Interpolate(Vertices=construct_point_189, Degree=3, Periodic=False, KnotStyle=1)  # -> Curve, Length, Domain; disabled
point_on_curve_38 = PointOnCurve(interpolate_113.Curve, parameter=0.629)  # disabled
point_on_curve_39 = PointOnCurve(interpolate_114.Curve, parameter=0.629)  # disabled
end_points_100 = EndPoints(Curve=interpolate_113.Curve)  # -> Start, End; disabled
end_points_101 = EndPoints(Curve=interpolate_115.Curve)  # -> Start, End; disabled
end_points_102 = EndPoints(Curve=interpolate_114.Curve)  # -> Start, End; disabled
end_points_103 = EndPoints(Curve=interpolate_116.Curve)  # -> Start, End; disabled
deconstruct_36 = Deconstruct(Point=graft(point_on_curve_38))  # -> XComponent, YComponent, ZComponent; disabled
panel_237 = Panel(point_on_curve_38)  # disabled
deconstruct_37 = Deconstruct(Point=graft(point_on_curve_39))  # -> XComponent, YComponent, ZComponent; disabled
panel_238 = Panel(point_on_curve_39)  # disabled
construct_point_190 = ConstructPoint(XCoordinate=0, YCoordinate=deconstruct_36.YComponent, ZCoordinate=0)  # disabled
construct_point_191 = ConstructPoint(XCoordinate=deconstruct_36.XComponent, YCoordinate=0, ZCoordinate=0)  # disabled
construct_point_192 = ConstructPoint(XCoordinate=0, YCoordinate=deconstruct_37.YComponent, ZCoordinate=0)  # disabled
construct_point_193 = ConstructPoint(XCoordinate=deconstruct_37.XComponent, YCoordinate=0, ZCoordinate=0)  # disabled
line_119 = Line(StartPoint=construct_point_190, EndPoint=point_on_curve_38)  # disabled
line_120 = Line(StartPoint=construct_point_191, EndPoint=point_on_curve_38)  # disabled
line_121 = Line(StartPoint=end_points_98.Start, EndPoint=end_points_100.Start)  # disabled
line_122 = Line(StartPoint=end_points_101.Start, EndPoint=end_points_100.Start)  # disabled
line_123 = Line(StartPoint=end_points_98.End, EndPoint=end_points_100.End)  # disabled
line_124 = Line(StartPoint=end_points_101.End, EndPoint=end_points_100.End)  # disabled
line_125 = Line(StartPoint=construct_point_192, EndPoint=point_on_curve_39)  # disabled
line_126 = Line(StartPoint=construct_point_193, EndPoint=point_on_curve_39)  # disabled
line_127 = Line(StartPoint=end_points_99.Start, EndPoint=end_points_102.Start)  # disabled
line_128 = Line(StartPoint=end_points_103.End, EndPoint=end_points_102.End)  # disabled
line_129 = Line(StartPoint=end_points_103.Start, EndPoint=end_points_102.Start)  # disabled
line_130 = Line(StartPoint=end_points_99.End, EndPoint=end_points_102.End)  # disabled
offset_curve_33 = OffsetCurve(Curve=interpolate_113.Curve, Plane=PlaneXY(0, 0, 0), Distance=panel_225, BothSides=boolean_toggle_20, Kinks=0, CapType=1)  # disabled
offset_curve_34 = OffsetCurve(Curve=interpolate_114.Curve, Plane=PlaneXY(0, 0, 0), Distance=panel_226, BothSides=boolean_toggle_21, Kinks=0, CapType=1)  # disabled
boundary_surfaces_37 = BoundarySurfaces(Edges=offset_curve_33)  # disabled
text_tag_3d_121 = TextTag3D(Location=end_points_101.End, Text=panel_227, Size=panel_223, Justification=6)  # disabled
text_tag_3d_122 = TextTag3D(Location=point_on_curve_38, Text=panel_233, Size=panel_223, Justification=7)  # disabled
text_tag_3d_123 = TextTag3D(Location=construct_point_190, Text=panel_234, Size=panel_223, Justification=6)  # disabled
text_tag_3d_124 = TextTag3D(Location=construct_point_191, Text=panel_229, Size=panel_223, Justification=7)  # disabled
boundary_surfaces_38 = BoundarySurfaces(Edges=offset_curve_34)  # disabled
text_tag_3d_125 = TextTag3D(Location=end_points_103.End, Text=panel_230, Size=panel_224, Justification=6)  # disabled
text_tag_3d_126 = TextTag3D(Location=point_on_curve_39, Text=panel_235, Size=panel_224, Justification=7)  # disabled
text_tag_3d_127 = TextTag3D(Location=construct_point_192, Text=panel_236, Size=panel_224, Justification=6)  # disabled
text_tag_3d_128 = TextTag3D(Location=construct_point_193, Text=panel_232, Size=panel_224, Justification=7)  # disabled

curve_30 = Curve(interpolate_113.Curve)  # disabled
dispatch_8 = Dispatch(List=flatten(curve_30), DispatchPattern=[True, False])  # -> ListA, ListB; disabled
curve_31 = Curve(interpolate_114.Curve)  # disabled
dispatch_9 = Dispatch(List=flatten(curve_31), DispatchPattern=[True, False])  # -> ListA, ListB; disabled
end_points_104 = EndPoints(Curve=dispatch_8.ListB)  # -> Start, End; disabled
end_points_105 = EndPoints(Curve=curve_30)  # -> Start, End; disabled
end_points_106 = EndPoints(Curve=dispatch_9.ListB)  # -> Start, End; disabled
end_points_107 = EndPoints(Curve=curve_31)  # -> Start, End; disabled

circle_17 = Circle(Plane=end_points_104.Start, Radius=panel_223)  # disabled
circle_18 = Circle(Plane=end_points_106.Start, Radius=panel_224)  # disabled
circle_19 = Circle(Plane=end_points_105.End, Radius=panel_223)  # disabled
circle_20 = Circle(Plane=end_points_107.Start, Radius=panel_224)  # disabled

number_slider_127 = Slider(4, range=0..4)  # disabled
number_slider_128 = Slider(24, range=0..100)  # disabled
panel_239 = Panel("2")  # disabled

negative_30 = Negative(Value=number_slider_127)  # disabled

construct_domain_44 = ConstructDomain(DomainStart=negative_30, DomainEnd=panel_239)  # disabled
# ƒ(x) = Sqrt(2 - x)
range_44 = Range(Domain=construct_domain_44, Steps=number_slider_128)  # disabled

number_slider_129 = Slider(1, range=0..10)  # disabled
number_slider_130 = Slider(0, range=0..10)  # disabled
expression_39 = Expression(x=range_44, A=number_slider_129, B=number_slider_130, Expression="A * (Sqrt(2 - x))")  # disabled
panel_240 = Panel("""A * (Sqrt(2 - x))
       """)  # disabled

construct_point_194 = ConstructPoint(XCoordinate=range_44, YCoordinate=0, ZCoordinate=0)  # disabled
construct_point_195 = ConstructPoint(XCoordinate=0, YCoordinate=range_44, ZCoordinate=0)  # disabled
construct_point_196 = ConstructPoint(XCoordinate=range_44, YCoordinate=expression_39, ZCoordinate=0)  # disabled
interpolate_117 = Interpolate(Vertices=construct_point_194, Degree=3, Periodic=False, KnotStyle=1)  # -> Curve, Length, Domain; disabled
interpolate_118 = Interpolate(Vertices=construct_point_195, Degree=3, Periodic=False, KnotStyle=1)  # -> Curve, Length, Domain; disabled
interpolate_119 = Interpolate(Vertices=construct_point_196, Degree=3, Periodic=False, KnotStyle=1)  # -> Curve, Length, Domain; disabled

curve_middle_38 = CurveMiddle(Curve=interpolate_117.Curve)  # disabled
point_on_curve_40 = PointOnCurve(interpolate_119.Curve, parameter=0.229)  # disabled
end_points_108 = EndPoints(Curve=interpolate_117.Curve)  # -> Start, End; disabled
end_points_109 = EndPoints(Curve=interpolate_118.Curve)  # -> Start, End; disabled
deconstruct_38 = Deconstruct(Point=point_on_curve_40)  # -> XComponent, YComponent, ZComponent; disabled
construct_point_197 = ConstructPoint(XCoordinate=0, YCoordinate=deconstruct_38.YComponent, ZCoordinate=0)  # disabled
construct_point_198 = ConstructPoint(XCoordinate=deconstruct_38.XComponent, YCoordinate=0, ZCoordinate=0)  # disabled

boolean_toggle_22 = BooleanToggle(True)  # disabled
panel_241 = Panel(".03")  # disabled
offset_curve_35 = OffsetCurve(Curve=interpolate_119.Curve, Plane=PlaneXY(0, 0, 0), Distance=panel_241, BothSides=boolean_toggle_22, Kinks=0, CapType=1)  # disabled
line_131 = Line(StartPoint=construct_point_198, EndPoint=point_on_curve_40)  # disabled
boundary_surfaces_39 = BoundarySurfaces(Edges=offset_curve_35)  # disabled
line_132 = Line(StartPoint=construct_point_197, EndPoint=point_on_curve_40)  # disabled
curve_32 = Curve(interpolate_119.Curve)  # disabled

panel_242 = Panel("      ƒ(x) = ")  # disabled
panel_243 = Panel("x")  # disabled
panel_244 = Panel("0         ")  # disabled
concatenate_13 = Concatenate(FragmentA=panel_242, FragmentB=panel_240)  # disabled
panel_245 = Panel(".12")  # disabled
text_tag_3d_129 = TextTag3D(Location=point_on_curve_40, Text=concatenate_13, Size=panel_245, Justification=7)  # disabled
text_tag_3d_130 = TextTag3D(Location=construct_point_197, Text=panel_240, Size=panel_245, Justification=1)  # disabled
text_tag_3d_131 = TextTag3D(Location=construct_point_198, Text=panel_243, Size=panel_245, Justification=7)  # disabled
text_tag_3d_132 = TextTag3D(Location=curve_middle_38, Text=panel_244, Size=panel_245, Justification=3)  # disabled

panel_246 = Panel("      ƒ(x) = ")  # disabled
panel_247 = Panel("x")  # disabled
panel_248 = Panel("y    ")  # disabled
panel_249 = Panel("x")  # disabled
panel_250 = Panel("0         ")  # disabled
panel_251 = Panel(".12")  # disabled
text_tag_3d_133 = TextTag3D(Location=construct_point_38, Text=panel_21, Size=panel_251, Justification=1)  # disabled
text_tag_3d_134 = TextTag3D(Location=end_points_8.End, Text=panel_248, Size=panel_251, Justification=6)  # disabled
text_tag_3d_135 = TextTag3D(Location=end_points_7.End, Text=panel_247, Size=panel_251, Justification=7)  # disabled
text_tag_3d_136 = TextTag3D(Location=construct_point_39, Text=panel_249, Size=panel_251, Justification=7)  # disabled
text_tag_3d_137 = TextTag3D(Location=curve_middle_4, Text=panel_250, Size=panel_251, Justification=3)  # disabled

concatenate_14 = Concatenate(FragmentA=panel_246, FragmentB=panel_21)  # disabled

text_tag_3d_138 = TextTag3D(Location=point_on_curve_3, Text=concatenate_14, Size=panel_251, Justification=7)  # disabled

panel_252 = Panel("""    
     ƒ(x) = """)  # disabled
panel_253 = Panel("x")  # disabled
panel_254 = Panel("y    ")  # disabled
panel_255 = Panel("x")  # disabled
panel_256 = Panel("0         ")  # disabled
panel_257 = Panel(".12")  # disabled
text_tag_3d_139 = TextTag3D(Location=construct_point_40, Text=panel_23, Size=panel_257, Justification=1)  # disabled
text_tag_3d_140 = TextTag3D(Location=end_points_10.End, Text=panel_254, Size=panel_257, Justification=6)  # disabled
text_tag_3d_141 = TextTag3D(Location=end_points_9.End, Text=panel_253, Size=panel_257, Justification=7)  # disabled
text_tag_3d_142 = TextTag3D(Location=construct_point_41, Text=panel_255, Size=panel_257, Justification=7)  # disabled
text_tag_3d_143 = TextTag3D(Location=curve_middle_5, Text=panel_256, Size=panel_257, Justification=3)  # disabled

concatenate_15 = Concatenate(FragmentA=panel_252, FragmentB=panel_23)  # disabled

text_tag_3d_144 = TextTag3D(Location=point_on_curve_4, Text=concatenate_15, Size=panel_257, Justification=7)  # disabled

panel_258 = Panel("      ƒ(x) = ")  # disabled
panel_259 = Panel("x")  # disabled
panel_260 = Panel("y    ")  # disabled
panel_261 = Panel("x")  # disabled
panel_262 = Panel("0         ")  # disabled
panel_263 = Panel(".12")  # disabled
text_tag_3d_145 = TextTag3D(Location=construct_point_44, Text=panel_24, Size=panel_263, Justification=1)  # disabled
text_tag_3d_146 = TextTag3D(Location=end_points_14.End, Text=panel_260, Size=panel_263, Justification=6)  # disabled
text_tag_3d_147 = TextTag3D(Location=end_points_13.End, Text=panel_259, Size=panel_263, Justification=7)  # disabled
text_tag_3d_148 = TextTag3D(Location=construct_point_45, Text=panel_261, Size=panel_263, Justification=7)  # disabled
text_tag_3d_149 = TextTag3D(Location=curve_middle_7, Text=panel_262, Size=panel_263, Justification=3)  # disabled

concatenate_16 = Concatenate(FragmentA=panel_258, FragmentB=panel_24)  # disabled

text_tag_3d_150 = TextTag3D(Location=point_on_curve_6, Text=concatenate_16, Size=panel_263, Justification=7)  # disabled

# ----
# watch for complex numbers
number_slider_131 = Slider(0.02, range=-4..4)
square_5 = Square(Value=number_slider_131)
subtraction_6 = Subtraction(A="4", B=square_5)
square_root_3 = SquareRoot(Value=subtraction_6)

division_2 = Division(A="1", B=square_root_3)

panel_264 = Panel(division_2)

panel_265 = Panel("""    
     ƒ(x) = """)
text_tag_3d_151 = TextTag3D(Location=construct_point_115, Text=panel_112, Size=".12", Justification=1)
text_tag_3d_152 = TextTag3D(Location=end_points_40.End, Text="y    ", Size=".12", Justification=6)
text_tag_3d_153 = TextTag3D(Location=end_points_39.End, Text="x", Size=".12", Justification=7)
text_tag_3d_154 = TextTag3D(Location=construct_point_116, Text="x", Size=".12", Justification=7)
text_tag_3d_155 = TextTag3D(Location=curve_middle_20, Text="0         ", Size=".12", Justification=3)

concatenate_17 = Concatenate(FragmentA=panel_265, FragmentB=panel_112)

text_tag_3d_156 = TextTag3D(Location=point_on_curve_19, Text=concatenate_17, Size=".12", Justification=7)

panel_266 = Panel("""    
     ƒ(x) = """)
text_tag_3d_157 = TextTag3D(Location=end_points_38.End, Text="y    ", Size=".12", Justification=6)
text_tag_3d_158 = TextTag3D(Location=end_points_37.End, Text="x", Size=".12", Justification=7)
text_tag_3d_159 = TextTag3D(Location=construct_point_114, Text="x", Size=".12", Justification=7)
text_tag_3d_160 = TextTag3D(Location=curve_middle_19, Text="0         ", Size=".12", Justification=3)

concatenate_18 = Concatenate(FragmentA=panel_266, FragmentB="   A * (abs(x) + abs(x - B))")

text_tag_3d_161 = TextTag3D(Location=point_on_curve_18, Text=concatenate_18, Size=".12", Justification=7)

panel_267 = Panel("""    
     ƒ(x) = """)
text_tag_3d_162 = TextTag3D(Location=construct_point_117, Text=panel_113, Size=".12", Justification=1)
text_tag_3d_163 = TextTag3D(Location=end_points_42.End, Text="y    ", Size=".12", Justification=6)
text_tag_3d_164 = TextTag3D(Location=end_points_41.End, Text="x", Size=".12", Justification=7)
text_tag_3d_165 = TextTag3D(Location=construct_point_118, Text="x", Size=".12", Justification=7)
text_tag_3d_166 = TextTag3D(Location=curve_middle_21, Text="0         ", Size=".12", Justification=3)

concatenate_19 = Concatenate(FragmentA=panel_267, FragmentB=panel_113)

text_tag_3d_167 = TextTag3D(Location=point_on_curve_20, Text=concatenate_19, Size=".12", Justification=7)

panel_268 = Panel("""    
     ƒ(x) = """)
text_tag_3d_168 = TextTag3D(Location=end_points_44.End, Text="y    ", Size=".12", Justification=6)
text_tag_3d_169 = TextTag3D(Location=end_points_43.End, Text="x", Size=".12", Justification=7)
text_tag_3d_170 = TextTag3D(Location=construct_point_120, Text="x", Size=".12", Justification=7)
text_tag_3d_171 = TextTag3D(Location=curve_middle_22, Text="0         ", Size=".12", Justification=3)

concatenate_20 = Concatenate(FragmentA=panel_268, FragmentB="   A * abs(x^2 - 1)")

text_tag_3d_172 = TextTag3D(Location=point_on_curve_21, Text=concatenate_20, Size=".12", Justification=7)

panel_269 = Panel("""    
     ƒ(x) = """)
text_tag_3d_173 = TextTag3D(Location=construct_point_121, Text=panel_115, Size=".12", Justification=1)
text_tag_3d_174 = TextTag3D(Location=end_points_46.End, Text="y    ", Size=".12", Justification=6)
text_tag_3d_175 = TextTag3D(Location=end_points_45.End, Text="x", Size=".12", Justification=7)
text_tag_3d_176 = TextTag3D(Location=construct_point_122, Text="x", Size=".12", Justification=7)
text_tag_3d_177 = TextTag3D(Location=curve_middle_23, Text="0         ", Size=".12", Justification=3)

concatenate_21 = Concatenate(FragmentA=panel_269, FragmentB=panel_115)

text_tag_3d_178 = TextTag3D(Location=point_on_curve_22, Text=concatenate_21, Size=".12", Justification=7)

panel_270 = Panel("""    
     ƒ(x) = """)
text_tag_3d_179 = TextTag3D(Location=construct_point_123, Text=panel_114, Size=".12", Justification=1)
text_tag_3d_180 = TextTag3D(Location=end_points_48.End, Text="y    ", Size=".12", Justification=6)
text_tag_3d_181 = TextTag3D(Location=end_points_47.End, Text="x", Size=".12", Justification=7)
text_tag_3d_182 = TextTag3D(Location=construct_point_124, Text="x", Size=".12", Justification=7)
text_tag_3d_183 = TextTag3D(Location=curve_middle_24, Text="0         ", Size=".12", Justification=3)

concatenate_22 = Concatenate(FragmentA=panel_270, FragmentB=panel_114)

text_tag_3d_184 = TextTag3D(Location=point_on_curve_23, Text=concatenate_22, Size=".12", Justification=7)

panel_271 = Panel("""    
     ƒ(x) = """)
text_tag_3d_185 = TextTag3D(Location=end_points_50.End, Text="y    ", Size=".12", Justification=6)
text_tag_3d_186 = TextTag3D(Location=end_points_49.End, Text="x", Size=".12", Justification=7)
text_tag_3d_187 = TextTag3D(Location=construct_point_126, Text="x", Size=".12", Justification=7)
text_tag_3d_188 = TextTag3D(Location=curve_middle_25, Text="0         ", Size=".12", Justification=3)

concatenate_23 = Concatenate(FragmentA=panel_271, FragmentB="   A * 1/(Sqrt(4 - x^2))")

text_tag_3d_189 = TextTag3D(Location=point_on_curve_24, Text=concatenate_23, Size=".12", Justification=7)
