# Grasshopper definition 030_inverse_functions.gh (Grasshopper 1.0.7)
# plug-ins: HAL for Grasshopper, Pufferfish

# 1.4
# One-to-One Functions and Inverse Functions:
# 
# - a function ƒ is one-to-one if ƒ(x₁) != ƒ(x₂)
# whenever x₁ and x₂ belong to the domain
# of ƒ and x₁ != x₂
# A one-to-one function is also said to be
# invertivle and its inverse function
# ƒ-1, is defined as follows:
# for every y in the range of ƒ,
# ƒ-1(y) is the unique element x in the domain
# of ƒ such that y = ƒ(x)
# 
# Note:
# Do not confuse inverse functions with recipricals,
# ƒ-1(x) does not mean 1/ƒ(x)
# 
# for a one-to-one function ƒ,
# the two equations y = ƒ(x) and x = ƒ-1(y) are equyivalent,
# they say the same thing
# for example:
# y = x + 1 and x = y -1 are equivalent
# Inverse Functions:
# Given any function ƒ and any number
# x in its domain
# there exists exactly one number y in its range
# such that y = ƒ(x)
# and
# given any y point in its range
# there exists one x in its domain
# such that y = ƒ(x)
# This is, a horizontal line through y meets
# the graph of ƒ at exactly one point
# Such a function ƒ is said to be
# one-to-one
# 
# If ƒ is one-to-one, then each y in the range
# determines a unique x in the domain
# so the equation y = ƒ(x) can be solved for
# x as a function of y: x = ƒ–1(y)
# The function that we have denoted ƒ-1 is called
# the inverse of ƒ
# Here is a formal definition of these concepts:
sessionsettings = SessionSettings()

# ----
# Equivalent Definition of Inverse Functions:
# y = ƒ-1(x) ⇔ x = ƒ(y)
# ⇔ "means if and only if"
# informally, the same as
# observe the domain of ƒ-1 is the range of ƒ and vice versa
# 
# Domain and Range of Inverse Functions:
# D(ƒ-1) = R(ƒ), R(ƒ-1) = D(ƒ)
# also the inverse of the inverse of the function is that function
# y = (ƒ-1)^(-1)(x) ⇔ x = ƒ-1(y) ⇔ y = ƒ(x)
# x-axis and y-axis
xy_plane = XYPlane(Origin=Point(0, 0, 0))
range = Range(Domain="5", Steps=10)
construct_point = ConstructPoint(XCoordinate=range, YCoordinate=0, ZCoordinate=0)
construct_point_2 = ConstructPoint(XCoordinate=0, YCoordinate=range, ZCoordinate=0)
list_item = ListItem(List=construct_point, Index=0, Wrap=True)  # -> Item1, Item
list_item_2 = ListItem(List=construct_point_2, Index=0, Wrap=True)  # -> Item1, Item
construct_point_3 = ConstructPoint(XCoordinate=0, YCoordinate=0, ZCoordinate=0)
vector_2pt = Vector2Pt(PointA=list_item.Item, PointB=list_item.Item1, Unitize=False)  # -> Vector, Length
vector_2pt_2 = Vector2Pt(PointA=list_item_2.Item, PointB=list_item_2.Item1, Unitize=False)  # -> Vector, Length
negative = Negative(Value=vector_2pt.Vector)
negative_2 = Negative(Value=vector_2pt_2.Vector)
vector_display = VectorDisplay(Anchor=construct_point_3, Vector=vector_2pt.Vector)
vector_display_2 = VectorDisplay(Anchor=construct_point_3, Vector=negative)
vector_display_3 = VectorDisplay(Anchor=construct_point_3, Vector=vector_2pt_2.Vector)
vector_display_4 = VectorDisplay(Anchor=construct_point_3, Vector=negative_2)

# ----
# Cancellation Identities for Inverse Functions:
# 
# Let S be any set of real numbers
# The identiy function on S is the function Is defined by:
# Is(x) = x for all x in S
# the cancellation identities say that the compositions
# ƒoƒ-1 and ƒ-1oƒ are the identity function on the range
# of ƒ and the domain of ƒ-1 respectively
# 
# ƒoƒ-1(x) = IR(f), ƒ-1oƒ(x) = ID(f)
# 
# since the points (x, y) and (y, x) in the Cartesian plane are
# mirror images in the line y = x,
# it follows that the curves y = ƒ(x) and x = ƒ(y)
# (that is, y ƒ-1(x)) are also mirror images of
# one another in that line
# 
# Graphs of Inverse Functions:
# the graph of ƒ-1 is the mirror image of the
# graph of the ƒ in the line y = x
number_slider = Slider(16, range=0..100)
# Identity Function: ƒ(x) = x
number_slider_2 = Slider(4, range=0..4)
negative_3 = Negative(Value=number_slider_2)
construct_domain = ConstructDomain(DomainStart=negative_3, DomainEnd=number_slider_2)
range_2 = Range(Domain=construct_domain, Steps=number_slider)

panel = Panel(""" 
     x""")
expression = Expression(x=range_2, A=Slider(1, range=0..10), B=Slider(0, range=0..10), Expression="x")

construct_point_4 = ConstructPoint(XCoordinate=range_2, YCoordinate=expression, ZCoordinate=0)
construct_point_5 = ConstructPoint(XCoordinate=range_2, YCoordinate=0, ZCoordinate=0)
construct_point_6 = ConstructPoint(XCoordinate=0, YCoordinate=range_2, ZCoordinate=0)
interpolate = Interpolate(Vertices=construct_point_5, Degree=3, Periodic=False, KnotStyle=1)  # -> Curve, Length, Domain
interpolate_2 = Interpolate(Vertices=construct_point_6, Degree=3, Periodic=False, KnotStyle=1)  # -> Curve, Length, Domain
interpolate_3 = Interpolate(Vertices=construct_point_4, Degree=3, Periodic=False, KnotStyle=1)  # -> Curve, Length, Domain

curve_middle = CurveMiddle(Curve=interpolate.Curve)
point_on_curve = PointOnCurve(interpolate_3.Curve, parameter=0.815)
end_points = EndPoints(Curve=interpolate.Curve)  # -> Start, End
end_points_2 = EndPoints(Curve=interpolate_2.Curve)  # -> Start, End
deconstruct = Deconstruct(Point=point_on_curve)  # -> XComponent, YComponent, ZComponent
construct_point_7 = ConstructPoint(XCoordinate=0, YCoordinate=deconstruct.YComponent, ZCoordinate=0)
construct_point_8 = ConstructPoint(XCoordinate=deconstruct.XComponent, YCoordinate=0, ZCoordinate=0)

line = Line(StartPoint=construct_point_8, EndPoint=point_on_curve)
# If f(x) = 3x -5 is invertible
# then 3x₁ - 5 = 3x₂ - 5
# so 3(x₁ + x₂) = 0
# and x₁ = x₂
# Therefore f is invertible
# If y = f-1(x), then
# x = f(y) = 3y - 5, so
# y = ( x +5)/3, hence,
# f-1(x) = (x + 5)/3
line_2 = Line(StartPoint=construct_point_7, EndPoint=point_on_curve)
curve = Curve(interpolate_3.Curve)

number_slider_3 = Slider(16, range=0..100)  # disabled
number_slider_4 = Slider(4, range=0..4)  # disabled
negative_4 = Negative(Value=number_slider_4)  # disabled
construct_domain_2 = ConstructDomain(DomainStart=negative_4, DomainEnd=number_slider_4)  # disabled
range_3 = Range(Domain=construct_domain_2, Steps=number_slider_3)  # disabled

number_slider_5 = Slider(16, range=0..100)  # disabled
number_slider_6 = Slider(4, range=0..4)  # disabled
negative_5 = Negative(Value=number_slider_6)  # disabled
construct_domain_3 = ConstructDomain(DomainStart=negative_5, DomainEnd=number_slider_6)  # disabled
range_4 = Range(Domain=construct_domain_3, Steps=number_slider_5)  # disabled

# ----
# ƒ(x) = 3 * x - 5
number_slider_7 = Slider(1, range=0..10)  # disabled
number_slider_8 = Slider(0, range=0..10)  # disabled
panel_2 = Panel(""" 
     3 * x - 5""")  # disabled
expression_2 = Expression(x=range_3, A=number_slider_7, B=number_slider_8, Expression="3 * x - 5")  # disabled

# ----
# ƒ-1(x) = (x + 5)/3
number_slider_9 = Slider(1, range=0..10)  # disabled
number_slider_10 = Slider(0, range=0..10)  # disabled
panel_3 = Panel(""" 
     (x + 5)/3""")  # disabled
expression_3 = Expression(x=range_4, A=number_slider_9, B=number_slider_10, Expression="(x + 5)/3")  # disabled

construct_point_9 = ConstructPoint(XCoordinate=range_3, YCoordinate=expression_2, ZCoordinate=0)  # disabled
construct_point_10 = ConstructPoint(XCoordinate=range_3, YCoordinate=0, ZCoordinate=0)  # disabled
construct_point_11 = ConstructPoint(XCoordinate=0, YCoordinate=range_3, ZCoordinate=0)  # disabled
interpolate_4 = Interpolate(Vertices=construct_point_10, Degree=3, Periodic=False, KnotStyle=1)  # -> Curve, Length, Domain; disabled
interpolate_5 = Interpolate(Vertices=construct_point_11, Degree=3, Periodic=False, KnotStyle=1)  # -> Curve, Length, Domain; disabled
interpolate_6 = Interpolate(Vertices=construct_point_9, Degree=3, Periodic=False, KnotStyle=1)  # -> Curve, Length, Domain; disabled

construct_point_12 = ConstructPoint(XCoordinate=range_4, YCoordinate=expression_3, ZCoordinate=0)  # disabled
construct_point_13 = ConstructPoint(XCoordinate=range_4, YCoordinate=0, ZCoordinate=0)  # disabled
construct_point_14 = ConstructPoint(XCoordinate=0, YCoordinate=range_4, ZCoordinate=0)  # disabled
interpolate_7 = Interpolate(Vertices=construct_point_13, Degree=3, Periodic=False, KnotStyle=1)  # -> Curve, Length, Domain; disabled
interpolate_8 = Interpolate(Vertices=construct_point_14, Degree=3, Periodic=False, KnotStyle=1)  # -> Curve, Length, Domain; disabled
interpolate_9 = Interpolate(Vertices=construct_point_12, Degree=3, Periodic=False, KnotStyle=1)  # -> Curve, Length, Domain; disabled

curve_middle_2 = CurveMiddle(Curve=interpolate_4.Curve)  # disabled
point_on_curve_2 = PointOnCurve(interpolate_6.Curve, parameter=0.815)  # disabled
end_points_3 = EndPoints(Curve=interpolate_4.Curve)  # -> Start, End; disabled
end_points_4 = EndPoints(Curve=interpolate_5.Curve)  # -> Start, End; disabled
deconstruct_2 = Deconstruct(Point=point_on_curve_2)  # -> XComponent, YComponent, ZComponent; disabled
construct_point_15 = ConstructPoint(XCoordinate=0, YCoordinate=deconstruct_2.YComponent, ZCoordinate=0)  # disabled
construct_point_16 = ConstructPoint(XCoordinate=deconstruct_2.XComponent, YCoordinate=0, ZCoordinate=0)  # disabled

curve_middle_3 = CurveMiddle(Curve=interpolate_7.Curve)  # disabled
point_on_curve_3 = PointOnCurve(interpolate_9.Curve, parameter=0.196)  # disabled
end_points_5 = EndPoints(Curve=interpolate_7.Curve)  # -> Start, End; disabled
end_points_6 = EndPoints(Curve=interpolate_8.Curve)  # -> Start, End; disabled
deconstruct_3 = Deconstruct(Point=point_on_curve_3)  # -> XComponent, YComponent, ZComponent; disabled
construct_point_17 = ConstructPoint(XCoordinate=0, YCoordinate=deconstruct_3.YComponent, ZCoordinate=0)  # disabled
construct_point_18 = ConstructPoint(XCoordinate=deconstruct_3.XComponent, YCoordinate=0, ZCoordinate=0)  # disabled

boolean_toggle = BooleanToggle(True)  # disabled
panel_4 = Panel(".03")  # disabled
offset_curve = OffsetCurve(Curve=interpolate_6.Curve, Plane=PlaneXY(0, 0, 0), Distance=panel_4, BothSides=boolean_toggle, Kinks=0, CapType=1)  # disabled
line_3 = Line(StartPoint=construct_point_16, EndPoint=point_on_curve_2)  # disabled
line_4 = Line(StartPoint=construct_point_15, EndPoint=point_on_curve_2)  # disabled
boundary_surfaces = BoundarySurfaces(Edges=offset_curve)  # disabled
curve_2 = Curve(interpolate_6.Curve)  # disabled

boolean_toggle_2 = BooleanToggle(True)  # disabled
panel_5 = Panel(".03")  # disabled
offset_curve_2 = OffsetCurve(Curve=interpolate_9.Curve, Plane=PlaneXY(0, 0, 0), Distance=panel_5, BothSides=boolean_toggle_2, Kinks=0, CapType=1)  # disabled
line_5 = Line(StartPoint=construct_point_18, EndPoint=point_on_curve_3)  # disabled
line_6 = Line(StartPoint=construct_point_17, EndPoint=point_on_curve_3)  # disabled
boundary_surfaces_2 = BoundarySurfaces(Edges=offset_curve_2)  # disabled
curve_3 = Curve(interpolate_9.Curve)  # disabled

number_slider_11 = Slider(16, range=0..100)  # disabled
number_slider_12 = Slider(4, range=0..4)  # disabled
# If f(x) = Sqrt(2 * x + 1) is invertible
# then
# Sqrt(2* x₁ + 1) =  Sqrt(2* x₂ + 1)
# implies x₁ = x₂, thus ƒ is invertible
# Then y = ƒ-1(x) = (x^2 - 1)/2
panel_6 = Panel("-.5")  # disabled
construct_domain_4 = ConstructDomain(DomainStart=panel_6, DomainEnd=number_slider_12)  # disabled
range_5 = Range(Domain=construct_domain_4, Steps=number_slider_11)  # disabled

number_slider_13 = Slider(16, range=0..100)  # disabled
number_slider_14 = Slider(4, range=0..4)  # disabled
panel_7 = Panel("0")  # disabled
construct_domain_5 = ConstructDomain(DomainStart=panel_7, DomainEnd=number_slider_14)  # disabled
range_6 = Range(Domain=construct_domain_5, Steps=number_slider_13)  # disabled

number_slider_15 = Slider(0, range=0..10)  # disabled
# ƒ(x) =Sqrt(2 * x +1)
number_slider_16 = Slider(1, range=0..10)  # disabled
panel_8 = Panel(""" 
     Sqrt(2 * x +1)""")  # disabled
expression_4 = Expression(x=range_5, A=number_slider_16, B=number_slider_15, Expression="Sqrt(2 * x +1)")  # disabled

# ----
# ƒ-1(x) = (x^2 - 1)/2
number_slider_17 = Slider(1, range=0..10)  # disabled
number_slider_18 = Slider(0, range=0..10)  # disabled
panel_9 = Panel(""" 
     (x^2 - 1)/2""")  # disabled
expression_5 = Expression(x=range_6, A=number_slider_17, B=number_slider_18, Expression="(x^2 - 1)/2")  # disabled

construct_point_19 = ConstructPoint(XCoordinate=range_5, YCoordinate=expression_4, ZCoordinate=0)  # disabled
construct_point_20 = ConstructPoint(XCoordinate=range_5, YCoordinate=0, ZCoordinate=0)  # disabled
construct_point_21 = ConstructPoint(XCoordinate=0, YCoordinate=range_5, ZCoordinate=0)  # disabled
interpolate_10 = Interpolate(Vertices=construct_point_20, Degree=3, Periodic=False, KnotStyle=1)  # -> Curve, Length, Domain; disabled
interpolate_11 = Interpolate(Vertices=construct_point_21, Degree=3, Periodic=False, KnotStyle=1)  # -> Curve, Length, Domain; disabled
interpolate_12 = Interpolate(Vertices=construct_point_19, Degree=3, Periodic=False, KnotStyle=1)  # -> Curve, Length, Domain; disabled

construct_point_22 = ConstructPoint(XCoordinate=range_6, YCoordinate=expression_5, ZCoordinate=0)  # disabled
construct_point_23 = ConstructPoint(XCoordinate=range_6, YCoordinate=0, ZCoordinate=0)  # disabled
construct_point_24 = ConstructPoint(XCoordinate=0, YCoordinate=range_6, ZCoordinate=0)  # disabled
interpolate_13 = Interpolate(Vertices=construct_point_23, Degree=3, Periodic=False, KnotStyle=1)  # -> Curve, Length, Domain; disabled
interpolate_14 = Interpolate(Vertices=construct_point_24, Degree=3, Periodic=False, KnotStyle=1)  # -> Curve, Length, Domain; disabled
interpolate_15 = Interpolate(Vertices=construct_point_22, Degree=3, Periodic=False, KnotStyle=1)  # -> Curve, Length, Domain; disabled

curve_middle_4 = CurveMiddle(Curve=interpolate_10.Curve)  # disabled
point_on_curve_4 = PointOnCurve(interpolate_12.Curve, parameter=0.815)  # disabled
end_points_7 = EndPoints(Curve=interpolate_10.Curve)  # -> Start, End; disabled
end_points_8 = EndPoints(Curve=interpolate_11.Curve)  # -> Start, End; disabled
deconstruct_4 = Deconstruct(Point=point_on_curve_4)  # -> XComponent, YComponent, ZComponent; disabled
construct_point_25 = ConstructPoint(XCoordinate=0, YCoordinate=deconstruct_4.YComponent, ZCoordinate=0)  # disabled
construct_point_26 = ConstructPoint(XCoordinate=deconstruct_4.XComponent, YCoordinate=0, ZCoordinate=0)  # disabled

curve_middle_5 = CurveMiddle(Curve=interpolate_13.Curve)  # disabled
point_on_curve_5 = PointOnCurve(interpolate_15.Curve, parameter=0.563)  # disabled
end_points_9 = EndPoints(Curve=interpolate_13.Curve)  # -> Start, End; disabled
end_points_10 = EndPoints(Curve=interpolate_14.Curve)  # -> Start, End; disabled
deconstruct_5 = Deconstruct(Point=point_on_curve_5)  # -> XComponent, YComponent, ZComponent; disabled
construct_point_27 = ConstructPoint(XCoordinate=0, YCoordinate=deconstruct_5.YComponent, ZCoordinate=0)  # disabled
construct_point_28 = ConstructPoint(XCoordinate=deconstruct_5.XComponent, YCoordinate=0, ZCoordinate=0)  # disabled

boolean_toggle_3 = BooleanToggle(True)  # disabled
panel_10 = Panel(".03")  # disabled
offset_curve_3 = OffsetCurve(Curve=interpolate_12.Curve, Plane=PlaneXY(0, 0, 0), Distance=panel_10, BothSides=boolean_toggle_3, Kinks=0, CapType=1)  # disabled
line_7 = Line(StartPoint=construct_point_26, EndPoint=point_on_curve_4)  # disabled
line_8 = Line(StartPoint=construct_point_25, EndPoint=point_on_curve_4)  # disabled
# Self-Inverse Functions:
# - a function is said to be self-inverse if ƒ-1 = ƒ,
# that is, if ƒ(ƒ(x) = x for every x in the domain of ƒ
# 
# the function ƒ(x) = 1/x is self-inverse
# the graph of a self-inverse function must be
# its own mirror image in the y = x line and
# so must be symetric about that line
# Conversely, any function whose graph is symetric
# about the lint y = x is self-inverse
boundary_surfaces_3 = BoundarySurfaces(Edges=offset_curve_3)  # disabled
curve_4 = Curve(interpolate_12.Curve)  # disabled

boolean_toggle_4 = BooleanToggle(True)  # disabled
panel_11 = Panel(".03")  # disabled
offset_curve_4 = OffsetCurve(Curve=interpolate_15.Curve, Plane=PlaneXY(0, 0, 0), Distance=panel_11, BothSides=boolean_toggle_4, Kinks=0, CapType=1)  # disabled
line_9 = Line(StartPoint=construct_point_28, EndPoint=point_on_curve_5)  # disabled
line_10 = Line(StartPoint=construct_point_27, EndPoint=point_on_curve_5)  # disabled
boundary_surfaces_4 = BoundarySurfaces(Edges=offset_curve_4)  # disabled
curve_5 = Curve(interpolate_15.Curve)  # disabled

number_slider_19 = Slider(16, range=0..100)  # disabled
number_slider_20 = Slider(4, range=0..4)  # disabled
panel_12 = Panel("0")  # disabled
construct_domain_6 = ConstructDomain(DomainStart=panel_12, DomainEnd=number_slider_20)  # disabled
range_7 = Range(Domain=construct_domain_6, Steps=number_slider_19)  # disabled

number_slider_21 = Slider(0, range=0..10)  # disabled
# ƒ(x) = ƒ-1(x) = 1/x
number_slider_22 = Slider(1, range=0..10)  # disabled
panel_13 = Panel(""" 
     1/x""")  # disabled
expression_6 = Expression(x=range_7, A=number_slider_22, B=number_slider_21, Expression="1/x")  # disabled

construct_point_29 = ConstructPoint(XCoordinate=range_7, YCoordinate=expression_6, ZCoordinate=0)  # disabled
construct_point_30 = ConstructPoint(XCoordinate=range_7, YCoordinate=0, ZCoordinate=0)  # disabled
construct_point_31 = ConstructPoint(XCoordinate=0, YCoordinate=range_7, ZCoordinate=0)  # disabled
interpolate_16 = Interpolate(Vertices=construct_point_30, Degree=3, Periodic=False, KnotStyle=1)  # -> Curve, Length, Domain; disabled
interpolate_17 = Interpolate(Vertices=construct_point_31, Degree=3, Periodic=False, KnotStyle=1)  # -> Curve, Length, Domain; disabled
interpolate_18 = Interpolate(Vertices=construct_point_29, Degree=3, Periodic=False, KnotStyle=1)  # -> Curve, Length, Domain; disabled

curve_middle_6 = CurveMiddle(Curve=interpolate_16.Curve)  # disabled
point_on_curve_6 = PointOnCurve(interpolate_18.Curve, parameter=0.815)  # disabled
end_points_11 = EndPoints(Curve=interpolate_16.Curve)  # -> Start, End; disabled
end_points_12 = EndPoints(Curve=interpolate_17.Curve)  # -> Start, End; disabled
deconstruct_6 = Deconstruct(Point=point_on_curve_6)  # -> XComponent, YComponent, ZComponent; disabled
construct_point_32 = ConstructPoint(XCoordinate=0, YCoordinate=deconstruct_6.YComponent, ZCoordinate=0)  # disabled
construct_point_33 = ConstructPoint(XCoordinate=deconstruct_6.XComponent, YCoordinate=0, ZCoordinate=0)  # disabled

boolean_toggle_5 = BooleanToggle(True)  # disabled
panel_14 = Panel(".03")  # disabled
offset_curve_5 = OffsetCurve(Curve=interpolate_18.Curve, Plane=PlaneXY(0, 0, 0), Distance=panel_14, BothSides=boolean_toggle_5, Kinks=0, CapType=1)  # disabled
line_11 = Line(StartPoint=construct_point_33, EndPoint=point_on_curve_6)  # disabled
line_12 = Line(StartPoint=construct_point_32, EndPoint=point_on_curve_6)  # disabled
boundary_surfaces_5 = BoundarySurfaces(Edges=offset_curve_5)  # disabled
curve_6 = Curve(interpolate_18.Curve)  # disabled

number_slider_23 = Slider(16, range=0..100)  # disabled
number_slider_24 = Slider(4, range=0..4)  # disabled
panel_15 = Panel("0")  # disabled
construct_domain_7 = ConstructDomain(DomainStart=panel_15, DomainEnd=number_slider_24)  # disabled
range_8 = Range(Domain=construct_domain_7, Steps=number_slider_23)  # disabled

# ----
# ƒ-1(x) = Sqrt(x)
number_slider_25 = Slider(1, range=0..10)  # disabled
number_slider_26 = Slider(0, range=0..10)  # disabled
panel_16 = Panel(""" 
     Sqrt(x)""")  # disabled
expression_7 = Expression(x=range_8, A=number_slider_25, B=number_slider_26, Expression="Sqrt(x)")  # disabled

construct_point_34 = ConstructPoint(XCoordinate=range_8, YCoordinate=expression_7, ZCoordinate=0)  # disabled
construct_point_35 = ConstructPoint(XCoordinate=range_8, YCoordinate=0, ZCoordinate=0)  # disabled
construct_point_36 = ConstructPoint(XCoordinate=0, YCoordinate=range_8, ZCoordinate=0)  # disabled
interpolate_19 = Interpolate(Vertices=construct_point_35, Degree=3, Periodic=False, KnotStyle=1)  # -> Curve, Length, Domain; disabled
interpolate_20 = Interpolate(Vertices=construct_point_36, Degree=3, Periodic=False, KnotStyle=1)  # -> Curve, Length, Domain; disabled
interpolate_21 = Interpolate(Vertices=construct_point_34, Degree=3, Periodic=False, KnotStyle=1)  # -> Curve, Length, Domain; disabled

curve_middle_7 = CurveMiddle(Curve=interpolate_19.Curve)  # disabled
point_on_curve_7 = PointOnCurve(interpolate_21.Curve, parameter=0.563)  # disabled
end_points_13 = EndPoints(Curve=interpolate_19.Curve)  # -> Start, End; disabled
end_points_14 = EndPoints(Curve=interpolate_20.Curve)  # -> Start, End; disabled
deconstruct_7 = Deconstruct(Point=point_on_curve_7)  # -> XComponent, YComponent, ZComponent; disabled
construct_point_37 = ConstructPoint(XCoordinate=0, YCoordinate=deconstruct_7.YComponent, ZCoordinate=0)  # disabled
construct_point_38 = ConstructPoint(XCoordinate=deconstruct_7.XComponent, YCoordinate=0, ZCoordinate=0)  # disabled

boolean_toggle_6 = BooleanToggle(True)  # disabled
panel_17 = Panel(".03")  # disabled
offset_curve_6 = OffsetCurve(Curve=interpolate_21.Curve, Plane=PlaneXY(0, 0, 0), Distance=panel_17, BothSides=boolean_toggle_6, Kinks=0, CapType=1)  # disabled
line_13 = Line(StartPoint=construct_point_38, EndPoint=point_on_curve_7)  # disabled
line_14 = Line(StartPoint=construct_point_37, EndPoint=point_on_curve_7)  # disabled
boundary_surfaces_6 = BoundarySurfaces(Edges=offset_curve_6)  # disabled
curve_7 = Curve(interpolate_21.Curve)  # disabled

construct_domain_8 = ConstructDomain(DomainStart="0", DomainEnd=Slider(4, range=0..4))
range_9 = Range(Domain=construct_domain_8, Steps=Slider(16, range=0..100))

# ----
# ƒ-1(x) = Sqrt(x)
number_slider_27 = Slider(1, range=0..10)
panel_18 = Panel(""" 
     Sqrt(x)""")
expression_8 = Expression(x=range_9, A=number_slider_27, B=Slider(0, range=0..10), Expression="Sqrt(x)")

construct_point_39 = ConstructPoint(XCoordinate=range_9, YCoordinate=expression_8, ZCoordinate=0)
construct_point_40 = ConstructPoint(XCoordinate=range_9, YCoordinate=0, ZCoordinate=0)
construct_point_41 = ConstructPoint(XCoordinate=0, YCoordinate=range_9, ZCoordinate=0)
interpolate_22 = Interpolate(Vertices=construct_point_40, Degree=3, Periodic=False, KnotStyle=1)  # -> Curve, Length, Domain
interpolate_23 = Interpolate(Vertices=construct_point_41, Degree=3, Periodic=False, KnotStyle=1)  # -> Curve, Length, Domain
interpolate_24 = Interpolate(Vertices=construct_point_39, Degree=3, Periodic=False, KnotStyle=1)  # -> Curve, Length, Domain

curve_middle_8 = CurveMiddle(Curve=interpolate_22.Curve)
point_on_curve_8 = PointOnCurve(interpolate_24.Curve, parameter=0.563)
end_points_15 = EndPoints(Curve=interpolate_22.Curve)  # -> Start, End
end_points_16 = EndPoints(Curve=interpolate_23.Curve)  # -> Start, End
deconstruct_8 = Deconstruct(Point=point_on_curve_8)  # -> XComponent, YComponent, ZComponent
construct_point_42 = ConstructPoint(XCoordinate=0, YCoordinate=deconstruct_8.YComponent, ZCoordinate=0)
construct_point_43 = ConstructPoint(XCoordinate=deconstruct_8.XComponent, YCoordinate=0, ZCoordinate=0)

offset_curve_7 = OffsetCurve(Curve=interpolate_24.Curve, Plane=PlaneXY(0, 0, 0), Distance=".03", BothSides=Toggle(True), Kinks=0, CapType=1)
line_15 = Line(StartPoint=construct_point_43, EndPoint=point_on_curve_8)
line_16 = Line(StartPoint=construct_point_42, EndPoint=point_on_curve_8)
boundary_surfaces_7 = BoundarySurfaces(Edges=offset_curve_7)
curve_8 = Curve(interpolate_24.Curve)

panel_19 = Panel("""    
     ƒ(x) = """)
text_tag_3d = TextTag3D(Location=construct_point_7, Text=panel, Size=".12", Justification=1)
text_tag_3d_2 = TextTag3D(Location=end_points_2.End, Text="y    ", Size=".12", Justification=6)
text_tag_3d_3 = TextTag3D(Location=end_points.End, Text="x", Size=".12", Justification=7)
text_tag_3d_4 = TextTag3D(Location=construct_point_8, Text="x", Size=".12", Justification=7)
text_tag_3d_5 = TextTag3D(Location=curve_middle, Text="0         ", Size=".12", Justification=3)

concatenate = Concatenate(FragmentA=panel_19, FragmentB=panel)

text_tag_3d_6 = TextTag3D(Location=point_on_curve, Text=concatenate, Size=".12", Justification=7)

panel_20 = Panel("""    
     ƒ(x) = """)  # disabled
panel_21 = Panel("x")  # disabled
panel_22 = Panel("y    ")  # disabled
panel_23 = Panel("x")  # disabled
panel_24 = Panel("0         ")  # disabled
panel_25 = Panel(".12")  # disabled
text_tag_3d_7 = TextTag3D(Location=construct_point_15, Text=panel_2, Size=panel_25, Justification=1)  # disabled
text_tag_3d_8 = TextTag3D(Location=end_points_4.End, Text=panel_22, Size=panel_25, Justification=6)  # disabled
text_tag_3d_9 = TextTag3D(Location=end_points_3.End, Text=panel_21, Size=panel_25, Justification=7)  # disabled
text_tag_3d_10 = TextTag3D(Location=construct_point_16, Text=panel_23, Size=panel_25, Justification=7)  # disabled
text_tag_3d_11 = TextTag3D(Location=curve_middle_2, Text=panel_24, Size=panel_25, Justification=3)  # disabled

concatenate_2 = Concatenate(FragmentA=panel_20, FragmentB=panel_2)  # disabled

text_tag_3d_12 = TextTag3D(Location=point_on_curve_2, Text=concatenate_2, Size=panel_25, Justification=7)  # disabled

panel_26 = Panel("""    
     ƒ-1(x) = """)  # disabled
panel_27 = Panel("y    ")  # disabled
panel_28 = Panel("x")  # disabled
panel_29 = Panel("x")  # disabled
panel_30 = Panel("0         ")  # disabled
panel_31 = Panel(".12")  # disabled
text_tag_3d_13 = TextTag3D(Location=construct_point_17, Text=panel_3, Size=panel_31, Justification=1)  # disabled
text_tag_3d_14 = TextTag3D(Location=end_points_6.End, Text=panel_27, Size=panel_31, Justification=6)  # disabled
text_tag_3d_15 = TextTag3D(Location=end_points_5.End, Text=panel_28, Size=panel_31, Justification=7)  # disabled
text_tag_3d_16 = TextTag3D(Location=construct_point_18, Text=panel_29, Size=panel_31, Justification=7)  # disabled
text_tag_3d_17 = TextTag3D(Location=curve_middle_3, Text=panel_30, Size=panel_31, Justification=3)  # disabled

concatenate_3 = Concatenate(FragmentA=panel_26, FragmentB=panel_3)  # disabled

text_tag_3d_18 = TextTag3D(Location=point_on_curve_3, Text=concatenate_3, Size=panel_31, Justification=7)  # disabled

panel_32 = Panel("""    
     ƒ(x) = """)  # disabled
panel_33 = Panel("y    ")  # disabled
panel_34 = Panel("x")  # disabled
panel_35 = Panel("x")  # disabled
panel_36 = Panel("0         ")  # disabled
panel_37 = Panel(".12")  # disabled
text_tag_3d_19 = TextTag3D(Location=construct_point_25, Text=panel_8, Size=panel_37, Justification=1)  # disabled
text_tag_3d_20 = TextTag3D(Location=end_points_8.End, Text=panel_33, Size=panel_37, Justification=6)  # disabled
text_tag_3d_21 = TextTag3D(Location=end_points_7.End, Text=panel_34, Size=panel_37, Justification=7)  # disabled
text_tag_3d_22 = TextTag3D(Location=construct_point_26, Text=panel_35, Size=panel_37, Justification=7)  # disabled
text_tag_3d_23 = TextTag3D(Location=curve_middle_4, Text=panel_36, Size=panel_37, Justification=3)  # disabled

concatenate_4 = Concatenate(FragmentA=panel_32, FragmentB=panel_8)  # disabled

text_tag_3d_24 = TextTag3D(Location=point_on_curve_4, Text=concatenate_4, Size=panel_37, Justification=7)  # disabled

panel_38 = Panel("""    
     ƒ-1(x) = """)  # disabled
panel_39 = Panel("y    ")  # disabled
panel_40 = Panel("x")  # disabled
panel_41 = Panel("x")  # disabled
panel_42 = Panel("0         ")  # disabled
panel_43 = Panel(".12")  # disabled
text_tag_3d_25 = TextTag3D(Location=construct_point_27, Text=panel_9, Size=panel_43, Justification=1)  # disabled
text_tag_3d_26 = TextTag3D(Location=end_points_10.End, Text=panel_39, Size=panel_43, Justification=6)  # disabled
text_tag_3d_27 = TextTag3D(Location=end_points_9.End, Text=panel_40, Size=panel_43, Justification=7)  # disabled
text_tag_3d_28 = TextTag3D(Location=construct_point_28, Text=panel_41, Size=panel_43, Justification=7)  # disabled
text_tag_3d_29 = TextTag3D(Location=curve_middle_5, Text=panel_42, Size=panel_43, Justification=3)  # disabled

concatenate_5 = Concatenate(FragmentA=panel_38, FragmentB=panel_9)  # disabled

text_tag_3d_30 = TextTag3D(Location=point_on_curve_5, Text=concatenate_5, Size=panel_43, Justification=7)  # disabled

number_slider_28 = Slider(16, range=0..100)  # disabled
number_slider_29 = Slider(4, range=0..4)  # disabled
panel_44 = Panel("0")  # disabled

negative_6 = Negative(Value=number_slider_29)  # disabled

construct_domain_9 = ConstructDomain(DomainStart=negative_6, DomainEnd=panel_44)  # disabled
range_10 = Range(Domain=construct_domain_9, Steps=number_slider_28)  # disabled

number_slider_30 = Slider(0, range=0..10)  # disabled
# ƒ(x) = ƒ-1(x) = 1/x
number_slider_31 = Slider(1, range=0..10)  # disabled
panel_45 = Panel(""" 
     1/x""")  # disabled
expression_9 = Expression(x=range_10, A=number_slider_31, B=number_slider_30, Expression="1/x")  # disabled

construct_point_44 = ConstructPoint(XCoordinate=range_10, YCoordinate=expression_9, ZCoordinate=0)  # disabled
construct_point_45 = ConstructPoint(XCoordinate=range_10, YCoordinate=0, ZCoordinate=0)  # disabled
construct_point_46 = ConstructPoint(XCoordinate=0, YCoordinate=range_10, ZCoordinate=0)  # disabled
interpolate_25 = Interpolate(Vertices=construct_point_45, Degree=3, Periodic=False, KnotStyle=1)  # -> Curve, Length, Domain; disabled
interpolate_26 = Interpolate(Vertices=construct_point_46, Degree=3, Periodic=False, KnotStyle=1)  # -> Curve, Length, Domain; disabled
interpolate_27 = Interpolate(Vertices=construct_point_44, Degree=3, Periodic=False, KnotStyle=1)  # -> Curve, Length, Domain; disabled

curve_middle_9 = CurveMiddle(Curve=interpolate_25.Curve)  # disabled
point_on_curve_9 = PointOnCurve(interpolate_27.Curve, parameter=0.815)  # disabled
end_points_17 = EndPoints(Curve=interpolate_25.Curve)  # -> Start, End; disabled
end_points_18 = EndPoints(Curve=interpolate_26.Curve)  # -> Start, End; disabled
deconstruct_9 = Deconstruct(Point=point_on_curve_9)  # -> XComponent, YComponent, ZComponent; disabled
construct_point_47 = ConstructPoint(XCoordinate=0, YCoordinate=deconstruct_9.YComponent, ZCoordinate=0)  # disabled
construct_point_48 = ConstructPoint(XCoordinate=deconstruct_9.XComponent, YCoordinate=0, ZCoordinate=0)  # disabled

boolean_toggle_7 = BooleanToggle(True)  # disabled
panel_46 = Panel(".03")  # disabled
offset_curve_8 = OffsetCurve(Curve=interpolate_27.Curve, Plane=PlaneXY(0, 0, 0), Distance=panel_46, BothSides=boolean_toggle_7, Kinks=0, CapType=1)  # disabled
line_17 = Line(StartPoint=construct_point_48, EndPoint=point_on_curve_9)  # disabled
line_18 = Line(StartPoint=construct_point_47, EndPoint=point_on_curve_9)  # disabled
# Inverting Non One-to-One Functions:
# many important functions like the trigonometric functions
# are not one-to-one on their whole domains
# -it is still possible to define their inverse for such a function
# but we have to restrict the domain of the function
# artificially so that the restricted function is one-to-one
# - consider ƒ(x) = x^2
# Unrestricted, its domain is the whole IR line
# and it is not one-to-one
# since ƒ(-a) = ƒ(a) for any a
# - let's define new function F(x) equal to ƒ(x
# but having a smaller domain
# so that it is one-to-one
# - use interval [0, ∞) as the domain of F:
# 
# F(x) = x^2 for 0 <= x <= ∞
# 
# The graph of F is the right half of the parabola y = x^2,
# the graph of ƒ
# F is one-to-one  so has an inverse F-1,
# If y = F-1(x) then x = F(x) = y^2 and y >= 0
# thus y = Sqrt(x)
# Hence F-1(x) = Sqrt(x)
# 
# This will be used extensively when we invert
# the trigonometric fucntions
boundary_surfaces_8 = BoundarySurfaces(Edges=offset_curve_8)  # disabled
curve_9 = Curve(interpolate_27.Curve)  # disabled

panel_47 = Panel("""    
     ƒ(x) = """)  # disabled
panel_48 = Panel("y    ")  # disabled
panel_49 = Panel("x")  # disabled
panel_50 = Panel("x")  # disabled
panel_51 = Panel("0         ")  # disabled
panel_52 = Panel(".12")  # disabled
text_tag_3d_31 = TextTag3D(Location=construct_point_47, Text=panel_45, Size=panel_52, Justification=1)  # disabled
text_tag_3d_32 = TextTag3D(Location=end_points_18.End, Text=panel_48, Size=panel_52, Justification=6)  # disabled
text_tag_3d_33 = TextTag3D(Location=end_points_17.End, Text=panel_49, Size=panel_52, Justification=7)  # disabled
text_tag_3d_34 = TextTag3D(Location=construct_point_48, Text=panel_50, Size=panel_52, Justification=7)  # disabled
text_tag_3d_35 = TextTag3D(Location=curve_middle_9, Text=panel_51, Size=panel_52, Justification=3)  # disabled

concatenate_6 = Concatenate(FragmentA=panel_47, FragmentB=panel_45)  # disabled

text_tag_3d_36 = TextTag3D(Location=point_on_curve_9, Text=concatenate_6, Size=panel_52, Justification=7)  # disabled

panel_53 = Panel("""    
     ƒ(x) = """)  # disabled
panel_54 = Panel("y    ")  # disabled
panel_55 = Panel("x")  # disabled
panel_56 = Panel("x")  # disabled
panel_57 = Panel("0         ")  # disabled
panel_58 = Panel(".12")  # disabled
text_tag_3d_37 = TextTag3D(Location=construct_point_32, Text=panel_13, Size=panel_58, Justification=1)  # disabled
text_tag_3d_38 = TextTag3D(Location=end_points_12.End, Text=panel_54, Size=panel_58, Justification=6)  # disabled
text_tag_3d_39 = TextTag3D(Location=end_points_11.End, Text=panel_55, Size=panel_58, Justification=7)  # disabled
text_tag_3d_40 = TextTag3D(Location=construct_point_33, Text=panel_56, Size=panel_58, Justification=7)  # disabled
text_tag_3d_41 = TextTag3D(Location=curve_middle_6, Text=panel_57, Size=panel_58, Justification=3)  # disabled

concatenate_7 = Concatenate(FragmentA=panel_53, FragmentB=panel_13)  # disabled

text_tag_3d_42 = TextTag3D(Location=point_on_curve_6, Text=concatenate_7, Size=panel_58, Justification=7)  # disabled

number_slider_32 = Slider(2.232, range=0..4)  # disabled
number_slider_33 = Slider(16, range=0..100)  # disabled

negative_7 = Negative(Value=number_slider_32)  # disabled

construct_domain_10 = ConstructDomain(DomainStart=negative_7, DomainEnd=number_slider_32)  # disabled
range_11 = Range(Domain=construct_domain_10, Steps=number_slider_33)  # disabled

number_slider_34 = Slider(0, range=0..10)  # disabled
# ƒ(x) =x^2
number_slider_35 = Slider(1, range=0..10)  # disabled
panel_59 = Panel(""" 
     x^2""")  # disabled
expression_10 = Expression(x=range_11, A=number_slider_35, B=number_slider_34, Expression="x^2")  # disabled

construct_point_49 = ConstructPoint(XCoordinate=range_11, YCoordinate=expression_10, ZCoordinate=0)  # disabled
construct_point_50 = ConstructPoint(XCoordinate=range_11, YCoordinate=0, ZCoordinate=0)  # disabled
construct_point_51 = ConstructPoint(XCoordinate=0, YCoordinate=range_11, ZCoordinate=0)  # disabled
interpolate_28 = Interpolate(Vertices=construct_point_50, Degree=3, Periodic=False, KnotStyle=1)  # -> Curve, Length, Domain; disabled
interpolate_29 = Interpolate(Vertices=construct_point_51, Degree=3, Periodic=False, KnotStyle=1)  # -> Curve, Length, Domain; disabled
interpolate_30 = Interpolate(Vertices=construct_point_49, Degree=3, Periodic=False, KnotStyle=1)  # -> Curve, Length, Domain; disabled

curve_middle_10 = CurveMiddle(Curve=interpolate_28.Curve)  # disabled
point_on_curve_10 = PointOnCurve(interpolate_30.Curve, parameter=0.885)  # disabled
end_points_19 = EndPoints(Curve=interpolate_28.Curve)  # -> Start, End; disabled
end_points_20 = EndPoints(Curve=interpolate_29.Curve)  # -> Start, End; disabled
deconstruct_10 = Deconstruct(Point=point_on_curve_10)  # -> XComponent, YComponent, ZComponent; disabled
construct_point_52 = ConstructPoint(XCoordinate=0, YCoordinate=deconstruct_10.YComponent, ZCoordinate=0)  # disabled
construct_point_53 = ConstructPoint(XCoordinate=deconstruct_10.XComponent, YCoordinate=0, ZCoordinate=0)  # disabled

boolean_toggle_8 = BooleanToggle(True)  # disabled
panel_60 = Panel(".03")  # disabled
offset_curve_9 = OffsetCurve(Curve=interpolate_30.Curve, Plane=PlaneXY(0, 0, 0), Distance=panel_60, BothSides=boolean_toggle_8, Kinks=0, CapType=1)  # disabled
line_19 = Line(StartPoint=construct_point_53, EndPoint=point_on_curve_10)  # disabled
line_20 = Line(StartPoint=construct_point_52, EndPoint=point_on_curve_10)  # disabled
boundary_surfaces_9 = BoundarySurfaces(Edges=offset_curve_9)  # disabled
curve_10 = Curve(interpolate_30.Curve)  # disabled

panel_61 = Panel("""    
     ƒ(x) = """)  # disabled
panel_62 = Panel("x")  # disabled
panel_63 = Panel("y    ")  # disabled
panel_64 = Panel("x")  # disabled
panel_65 = Panel("0         ")  # disabled
panel_66 = Panel(".12")  # disabled
text_tag_3d_43 = TextTag3D(Location=construct_point_52, Text=panel_59, Size=panel_66, Justification=1)  # disabled
text_tag_3d_44 = TextTag3D(Location=end_points_20.End, Text=panel_63, Size=panel_66, Justification=6)  # disabled
text_tag_3d_45 = TextTag3D(Location=end_points_19.End, Text=panel_62, Size=panel_66, Justification=7)  # disabled
text_tag_3d_46 = TextTag3D(Location=construct_point_53, Text=panel_64, Size=panel_66, Justification=7)  # disabled
text_tag_3d_47 = TextTag3D(Location=curve_middle_10, Text=panel_65, Size=panel_66, Justification=3)  # disabled

concatenate_8 = Concatenate(FragmentA=panel_61, FragmentB=panel_59)  # disabled

text_tag_3d_48 = TextTag3D(Location=point_on_curve_10, Text=concatenate_8, Size=panel_66, Justification=7)  # disabled

panel_67 = Panel("""    
     ƒ-1(x) = """)  # disabled
panel_68 = Panel("x")  # disabled
panel_69 = Panel("y    ")  # disabled
panel_70 = Panel("x")  # disabled
panel_71 = Panel("0         ")  # disabled
panel_72 = Panel(".12")  # disabled
text_tag_3d_49 = TextTag3D(Location=construct_point_37, Text=panel_16, Size=panel_72, Justification=1)  # disabled
text_tag_3d_50 = TextTag3D(Location=end_points_14.End, Text=panel_69, Size=panel_72, Justification=6)  # disabled
text_tag_3d_51 = TextTag3D(Location=end_points_13.End, Text=panel_68, Size=panel_72, Justification=7)  # disabled
text_tag_3d_52 = TextTag3D(Location=construct_point_38, Text=panel_70, Size=panel_72, Justification=7)  # disabled
text_tag_3d_53 = TextTag3D(Location=curve_middle_7, Text=panel_71, Size=panel_72, Justification=3)  # disabled

concatenate_9 = Concatenate(FragmentA=panel_67, FragmentB=panel_16)  # disabled

text_tag_3d_54 = TextTag3D(Location=point_on_curve_7, Text=concatenate_9, Size=panel_72, Justification=7)  # disabled

# ----
# Exercises:
number_slider_36 = Slider(2.232, range=0..4)

negative_8 = Negative(Value=number_slider_36)

construct_domain_11 = ConstructDomain(DomainStart=negative_8, DomainEnd=number_slider_36)
range_12 = Range(Domain=construct_domain_11, Steps=Slider(16, range=0..100))

# ----
# ƒ(x) =x^2
number_slider_37 = Slider(1, range=0..10)
panel_73 = Panel(""" 
     x^2""")
expression_11 = Expression(x=range_12, A=number_slider_37, B=Slider(0, range=0..10), Expression="x^2")

construct_point_54 = ConstructPoint(XCoordinate=range_12, YCoordinate=expression_11, ZCoordinate=0)
construct_point_55 = ConstructPoint(XCoordinate=range_12, YCoordinate=0, ZCoordinate=0)
construct_point_56 = ConstructPoint(XCoordinate=0, YCoordinate=range_12, ZCoordinate=0)
interpolate_31 = Interpolate(Vertices=construct_point_55, Degree=3, Periodic=False, KnotStyle=1)  # -> Curve, Length, Domain
interpolate_32 = Interpolate(Vertices=construct_point_56, Degree=3, Periodic=False, KnotStyle=1)  # -> Curve, Length, Domain
interpolate_33 = Interpolate(Vertices=construct_point_54, Degree=3, Periodic=False, KnotStyle=1)  # -> Curve, Length, Domain

curve_middle_11 = CurveMiddle(Curve=interpolate_31.Curve)
point_on_curve_11 = PointOnCurve(interpolate_33.Curve, parameter=0.885)
end_points_21 = EndPoints(Curve=interpolate_31.Curve)  # -> Start, End
end_points_22 = EndPoints(Curve=interpolate_32.Curve)  # -> Start, End
deconstruct_11 = Deconstruct(Point=point_on_curve_11)  # -> XComponent, YComponent, ZComponent
construct_point_57 = ConstructPoint(XCoordinate=0, YCoordinate=deconstruct_11.YComponent, ZCoordinate=0)
construct_point_58 = ConstructPoint(XCoordinate=deconstruct_11.XComponent, YCoordinate=0, ZCoordinate=0)

offset_curve_10 = OffsetCurve(Curve=interpolate_33.Curve, Plane=PlaneXY(0, 0, 0), Distance=".03", BothSides=Toggle(True), Kinks=0, CapType=1)
line_21 = Line(StartPoint=construct_point_58, EndPoint=point_on_curve_11)
line_22 = Line(StartPoint=construct_point_57, EndPoint=point_on_curve_11)
boundary_surfaces_10 = BoundarySurfaces(Edges=offset_curve_10)
curve_11 = Curve(interpolate_33.Curve)

panel_74 = Panel("""    
     ƒ(x) = """)
text_tag_3d_55 = TextTag3D(Location=construct_point_57, Text=panel_73, Size=".12", Justification=1)
text_tag_3d_56 = TextTag3D(Location=end_points_22.End, Text="y    ", Size=".12", Justification=6)
text_tag_3d_57 = TextTag3D(Location=end_points_21.End, Text="x", Size=".12", Justification=7)
text_tag_3d_58 = TextTag3D(Location=construct_point_58, Text="x", Size=".12", Justification=7)
text_tag_3d_59 = TextTag3D(Location=curve_middle_11, Text="0         ", Size=".12", Justification=3)

concatenate_10 = Concatenate(FragmentA=panel_74, FragmentB=panel_73)

text_tag_3d_60 = TextTag3D(Location=point_on_curve_11, Text=concatenate_10, Size=".12", Justification=7)

panel_75 = Panel("""    
     ƒ-1(x) = """)
text_tag_3d_61 = TextTag3D(Location=construct_point_42, Text=panel_18, Size=".12", Justification=1)
text_tag_3d_62 = TextTag3D(Location=end_points_16.End, Text="y    ", Size=".12", Justification=6)
text_tag_3d_63 = TextTag3D(Location=end_points_15.End, Text="x", Size=".12", Justification=7)
text_tag_3d_64 = TextTag3D(Location=construct_point_43, Text="x", Size=".12", Justification=7)
text_tag_3d_65 = TextTag3D(Location=curve_middle_8, Text="0         ", Size=".12", Justification=3)

concatenate_11 = Concatenate(FragmentA=panel_75, FragmentB=panel_18)

text_tag_3d_66 = TextTag3D(Location=point_on_curve_8, Text=concatenate_11, Size=".12", Justification=7)
