# Grasshopper definition 032_limits_1.5.gh (Grasshopper 1.0.7)
# plug-ins: AviaryHoopoeGH, AviaryMacawGH, Bifocals, Pufferfish

# ----
# Limits
# lim ƒ(x) = lim (x^2 - 1)/(x - 1) = 2
# x ->1       x ->1
panel = Panel("5")  # disabled
# 1.5
# Limits
# The concept of limit is the cornerstone of calculus
# Consider the function
# ƒ(x) = (x^2  - 1)/(x - 1)
# ƒ is defined for all reall mumbers
# x except x = 1
# D(ƒ) = (-∞,1)U((1,∞)
# also, for any x != 1 we can simplify for ƒ(x)
# by factoring the common factors
# ƒ(x) = x + 1 , for x != 1
negative = Negative(Value=panel)  # disabled
number_slider = Slider(100, range=0..100)  # disabled
construct_domain = ConstructDomain(DomainStart=negative, DomainEnd=panel)  # disabled
panel_2 = Panel(".999999999")  # disabled
panel_3 = Panel("1")  # disabled
multiplication = Multiplication(A=panel_2, B=panel_3)  # disabled
range = Range(Domain=construct_domain, Steps=number_slider)  # disabled
expression = Expression(x=multiplication, Expression="(x^2 - 1)/(x - 1)")  # disabled
expression_2 = Expression(x=panel_3, Expression="(x + 1)")  # disabled
expression_3 = Expression(x=range, Expression="(x^2 - 1)/(x - 1)")  # disabled
construct_point = ConstructPoint(XCoordinate=range, YCoordinate=expression_3, ZCoordinate=0)  # disabled
construct_point_2 = ConstructPoint(XCoordinate=panel_3, YCoordinate=expression, ZCoordinate=0)  # disabled
construct_point_3 = ConstructPoint(XCoordinate=panel_3, YCoordinate=expression_2, ZCoordinate=0)  # disabled
panel_4 = Panel(".12")  # disabled
interpolate = Interpolate(Vertices=construct_point, Degree=3, Periodic=False, KnotStyle=1)  # -> Curve, Length, Domain; disabled
circle = Circle(Plane=construct_point_3, Radius=panel_4)  # disabled
curve = Curve(circle)  # disabled
merge = Merge(Data1=interpolate.Curve, Data2=curve)  # disabled

# ----
# Create a bmp or svg
geometry = Geometry(merge)  # disabled
# The function ƒ approaches limit L as x
# approaches a, and we write
# lim ƒ(x) = L
# x ->a
# if ƒ(x) is defined for all x nearby (on either side)
# the point a, except possibly a itself
# and if ƒ approached arbitrarily close
# to L as x approaches a.
panel_5 = Panel("5")  # disabled
dispatch = Dispatch(List=flatten(geometry), DispatchPattern=[True, False])  # -> ListA, ListB; disabled
negative_2 = Negative(Value=panel_5)  # disabled
panel_6 = Panel("1")  # disabled
construct_domain_2 = ConstructDomain(DomainStart=negative_2, DomainEnd=panel_5)  # disabled
negative_3 = Negative(Value=panel_6)  # disabled
curve_2 = Curve([dispatch.ListA, dispatch.ListB])  # disabled
rectangle = Rectangle(Plane=PlaneXY(0, 0, 0), XSize=construct_domain_2, YSize=construct_domain_2, Radius=0)  # -> Rectangle, Length; disabled
vector_xyz = VectorXYZ(XComponent=panel_6, YComponent=0, ZComponent=0)  # -> Vector, Length; disabled
vector_xyz_2 = VectorXYZ(XComponent=negative_3, YComponent=0, ZComponent=0)  # -> Vector, Length; disabled
vector_xyz_3 = VectorXYZ(XComponent=0, YComponent=panel_6, ZComponent=0)  # -> Vector, Length; disabled
vector_xyz_4 = VectorXYZ(XComponent=0, YComponent=negative_3, ZComponent=0)  # -> Vector, Length; disabled
construct_point_4 = ConstructPoint(XCoordinate=0, YCoordinate=0, ZCoordinate=0)  # disabled
trim_with_region = TrimWithRegion(Curve=curve_2, Region=rectangle.Rectangle)  # -> Inside, Outside; disabled
number_slider_2 = Slider(0.01, range=0..0.1)  # disabled
explode = Explode(Curve=rectangle.Rectangle, Recursive=True)  # -> Segments, Vertices; disabled
panel_7 = Panel(".01")  # disabled
amplitude = Amplitude(Vector=[vector_xyz.Vector, vector_xyz_3.Vector, vector_xyz_4.Vector, vector_xyz_2.Vector], Amplitude=panel_5)  # disabled
negative_4 = Negative(Value=number_slider_2)  # disabled
offset_curve = OffsetCurve(Curve=[trim_with_region.Inside, explode.Segments], Distance=number_slider_2, Corners=1)  # disabled
offset_curve_2 = OffsetCurve(Curve=[trim_with_region.Inside, explode.Segments], Distance=negative_4, Corners=1)  # disabled
loft = Loft(
    Curves=[offset_curve, offset_curve_2],
    Options={Adjust=False, Closed=False, LoftEnds=0, LoftSimp=0, LoftType=0, Rebuild=10, Refit=0.01})  # disabled
number_slider_3 = Slider(24, range=0..100)  # disabled
geometry_2 = Geometry(loft)  # disabled
brep_to_shape = BrepToShape(Brep=flatten(geometry_2))  # disabled
number_slider_4 = Slider(96, range=0..100)  # disabled
compose_drawing = ComposeDrawing(
    Shapes=brep_to_shape,
    Boundary=rectangle.Rectangle,
    Width=number_slider_3,
    Height=number_slider_3,
    Backround=RGBA(255, 255, 255, 0))  # disabled
view_drawing = ViewDrawing(Drawing=compose_drawing)  # disabled
drawing_to_bitmap = DrawingToBitmap(Drawing=compose_drawing, PPI=number_slider_4)  # disabled
boolean_toggle = BooleanToggle(False)  # disabled
export_bitmap = ExportBitmap(Image=drawing_to_bitmap, Extention=0, Save=boolean_toggle)  # disabled
export_svg = ExportSVG(Drawing=compose_drawing, Save=False)  # disabled
point_on_curve = PointOnCurve(dispatch.ListB, parameter=0.775)  # disabled
panel_8 = Panel(export_bitmap)  # disabled
panel_9 = Panel(export_svg)  # disabled
text_tag_3d = TextTag3D(Location=point_on_curve, Size=1, Justification=1)  # disabled
vector_display = VectorDisplay(Anchor=construct_point_4, Vector=amplitude)  # disabled
geometry_3 = Geometry(loft)  # disabled

# ----
# Limits
# lim ƒ(x) = lim x/|x| = {1, if x > 0  , hence Does Not Exist
# x ->0       x ->0          -1, if x < 0}
panel_10 = Panel("5")
# Formal Definition of Limit:
# Suppose that there exists numbers a, b, c
# with b < a < c such that ƒ is
# defined on the interval (b, a)
# and on the interval (a, c).
# suppose that there exists a real number L
# with the following property:
# corresponding to any positive real
# number c, there exists another positive
# real number d (which depends on c)
# such that
# |ƒ(x) - L| < c whenever 0 < |x - a| < d.
# then we say that the limit of ƒ(x)
# as x approaches a is L
# and we write
# lim ƒ(x) = L
# x->a
negative_5 = Negative(Value=panel_10)
construct_domain_3 = ConstructDomain(DomainStart=negative_5, DomainEnd=panel_10)
range_2 = Range(Domain=construct_domain_3, Steps=Slider(100, range=0..100))
negative_6 = Negative(Value="0")
smaller_than = SmallerThan(FirstNumber=range_2, SecondNumber=negative_6)  # -> SmallerThan, OrEqualTo
larger_than = LargerThan(FirstNumber=range_2, SecondNumber="0")  # -> LargerThan, OrEqualTo
negative_7 = Negative(Value="1")
cull_pattern = CullPattern(List=range_2, CullPattern=larger_than.LargerThan)
cull_pattern_2 = CullPattern(List=range_2, CullPattern=smaller_than.SmallerThan)
construct_point_5 = ConstructPoint(XCoordinate=0, YCoordinate="1", ZCoordinate=0)
construct_point_6 = ConstructPoint(XCoordinate=0, YCoordinate=negative_7, ZCoordinate=0)
expression_4 = Expression(x=cull_pattern_2, Expression="x/Abs(x)")
expression_5 = Expression(x=cull_pattern, Expression="x/Abs(x)")
circle_2 = Circle(Plane=[construct_point_5, construct_point_6], Radius=".12")
construct_point_7 = ConstructPoint(XCoordinate=cull_pattern, YCoordinate=graft(expression_5), ZCoordinate=0)
construct_point_8 = ConstructPoint(XCoordinate=cull_pattern_2, YCoordinate=graft(expression_4), ZCoordinate=0)
curve_3 = Curve(circle_2)
polyline = PolyLine(Vertices=flatten(construct_point_7), Closed=False)
polyline_2 = PolyLine(Vertices=flatten(construct_point_8), Closed=False)
# 1.6
# Extensions of Limit Concepts:
merge_2 = Merge(Data1=polyline, Data2=curve_3, Data3=polyline_2)

# ----
# Create a bmp or svg
geometry_4 = Geometry(flatten(merge_2))
negative_8 = Negative(Value="5")
negative_9 = Negative(Value="1")
construct_domain_4 = ConstructDomain(DomainStart=negative_8, DomainEnd="5")
vector_xyz_5 = VectorXYZ(XComponent="1", YComponent=0, ZComponent=0)  # -> Vector, Length
vector_xyz_6 = VectorXYZ(XComponent=negative_9, YComponent=0, ZComponent=0)  # -> Vector, Length
vector_xyz_7 = VectorXYZ(XComponent=0, YComponent="1", ZComponent=0)  # -> Vector, Length
vector_xyz_8 = VectorXYZ(XComponent=0, YComponent=negative_9, ZComponent=0)  # -> Vector, Length
construct_point_9 = ConstructPoint(XCoordinate=0, YCoordinate=0, ZCoordinate=0)
rectangle_2 = Rectangle(Plane=PlaneXY(0, 0, 0), XSize=construct_domain_4, YSize=construct_domain_4, Radius=0)  # -> Rectangle, Length
amplitude_2 = Amplitude(Vector=[vector_xyz_5.Vector, vector_xyz_7.Vector, vector_xyz_8.Vector, vector_xyz_6.Vector], Amplitude="5")
number_slider_5 = Slider(24, range=0..100)
vector_display_2 = VectorDisplay(Anchor=construct_point_9, Vector=amplitude_2)
geometry_5 = Geometry()

explode_tree = ExplodeTree(Data=graft(geometry_4))  # -> Branch0, Branch1, Branch2, Branch3
offset_curve_3 = OffsetCurve(Curve=[explode_tree.Branch1, explode_tree.Branch2], Distance="0.01", Corners=1)
offset_curve_4 = OffsetCurve(
    Curve=[explode_tree.Branch0, explode_tree.Branch3],
    Plane=PlaneXY(0, 0, 0),
    Distance="0.01",
    BothSides=Toggle(False),
    Kinks=0,
    CapType=1)
boundary_surfaces = BoundarySurfaces(Edges=offset_curve_4)
curve_4 = Curve(reparameterize(explode_tree.Branch0))
rebuild_curve = RebuildCurve(Curve=curve_4, Count="2", Tangents=False)

geometry_6 = Geometry([boundary_surfaces, offset_curve_3, rectangle_2.Rectangle])
brep_to_shape_2 = BrepToShape(Brep=flatten(geometry_6))
compose_drawing_2 = ComposeDrawing(
    Shapes=brep_to_shape_2,
    Boundary=rectangle_2.Rectangle,
    Width=number_slider_5,
    Height=number_slider_5,
    Backround=RGBA(255, 255, 255, 0))
view_drawing_2 = ViewDrawing(Drawing=compose_drawing_2)
drawing_to_bitmap_2 = DrawingToBitmap(Drawing=compose_drawing_2, PPI=Slider(96, range=0..100))
export_bitmap_2 = ExportBitmap(Image=drawing_to_bitmap_2, Extention=0, Save=Toggle(False))
export_svg_2 = ExportSVG(Drawing=compose_drawing_2, Save=False)
point_on_curve_2 = PointOnCurve(rebuild_curve, parameter=0.639)
panel_11 = Panel(export_bitmap_2)
panel_12 = Panel(export_svg_2)
text_tag_3d_2 = TextTag3D(Location=point_on_curve_2, Text="y = f(x)", Size=Slider(0.5, range=0..1), Justification=1)
