# Grasshopper definition 033_limits_extension_concepts_1.6.gh (Grasshopper 1.0.7)
# plug-ins: AviaryHoopoeGH, AviaryMacawGH, Bifocals, Pufferfish

# ----
# Limits
# lim ƒ(x) = lim (x^2 - 1)/(x - 1) = 2
# x ->1       x ->1
panel = Panel("5")  # disabled
# 1.5
# Limits
# The concept of limit is the cornerstone of calculus
# Consider the function
# ƒ(x) = (x^2  - 1)/(x - 1)
# ƒ is defined for all reall mumbers
# x except x = 1
# D(ƒ) = (-∞,1)U((1,∞)
# also, for any x != 1 we can simplify for ƒ(x)
# by factoring the common factors
# ƒ(x) = x + 1 , for x != 1
negative = Negative(Value=panel)  # disabled
number_slider = Slider(100, range=0..100)  # disabled
construct_domain = ConstructDomain(DomainStart=negative, DomainEnd=panel)  # disabled
panel_2 = Panel(".999999999")  # disabled
panel_3 = Panel("1")  # disabled
multiplication = Multiplication(A=panel_2, B=panel_3)  # disabled
range = Range(Domain=construct_domain, Steps=number_slider)  # disabled
expression = Expression(x=multiplication, Expression="(x^2 - 1)/(x - 1)")  # disabled
expression_2 = Expression(x=panel_3, Expression="(x + 1)")  # disabled
expression_3 = Expression(x=range, Expression="(x^2 - 1)/(x - 1)")  # disabled
construct_point = ConstructPoint(XCoordinate=range, YCoordinate=expression_3, ZCoordinate=0)  # disabled
construct_point_2 = ConstructPoint(XCoordinate=panel_3, YCoordinate=expression, ZCoordinate=0)  # disabled
construct_point_3 = ConstructPoint(XCoordinate=panel_3, YCoordinate=expression_2, ZCoordinate=0)  # disabled
panel_4 = Panel(".12")  # disabled
interpolate = Interpolate(Vertices=construct_point, Degree=3, Periodic=False, KnotStyle=1)  # -> Curve, Length, Domain; disabled
circle = Circle(Plane=construct_point_3, Radius=panel_4)  # disabled
curve = Curve(circle)  # disabled
merge = Merge(Data1=interpolate.Curve, Data2=curve)  # disabled

# ----
# Create a bmp or svg
geometry = Geometry(merge)  # disabled
# The function ƒ approaches limit L as x
# approaches a, and we write
# lim ƒ(x) = L
# x ->a
# if ƒ(x) is defined for all x nearby (on either side)
# the point a, except possibly a itself
# and if ƒ approached arbitrarily close
# to L as x approaches a.
panel_5 = Panel("5")  # disabled
dispatch = Dispatch(List=flatten(geometry), DispatchPattern=[True, False])  # -> ListA, ListB; disabled
negative_2 = Negative(Value=panel_5)  # disabled
panel_6 = Panel("1")  # disabled
construct_domain_2 = ConstructDomain(DomainStart=negative_2, DomainEnd=panel_5)  # disabled
negative_3 = Negative(Value=panel_6)  # disabled
curve_2 = Curve([dispatch.ListA, dispatch.ListB])  # disabled
rectangle = Rectangle(Plane=PlaneXY(0, 0, 0), XSize=construct_domain_2, YSize=construct_domain_2, Radius=0)  # -> Rectangle, Length; disabled
vector_xyz = VectorXYZ(XComponent=panel_6, YComponent=0, ZComponent=0)  # -> Vector, Length; disabled
vector_xyz_2 = VectorXYZ(XComponent=negative_3, YComponent=0, ZComponent=0)  # -> Vector, Length; disabled
vector_xyz_3 = VectorXYZ(XComponent=0, YComponent=panel_6, ZComponent=0)  # -> Vector, Length; disabled
vector_xyz_4 = VectorXYZ(XComponent=0, YComponent=negative_3, ZComponent=0)  # -> Vector, Length; disabled
construct_point_4 = ConstructPoint(XCoordinate=0, YCoordinate=0, ZCoordinate=0)  # disabled
trim_with_region = TrimWithRegion(Curve=curve_2, Region=rectangle.Rectangle)  # -> Inside, Outside; disabled
number_slider_2 = Slider(0.01, range=0..0.1)  # disabled
explode = Explode(Curve=rectangle.Rectangle, Recursive=True)  # -> Segments, Vertices; disabled
panel_7 = Panel(".01")  # disabled
amplitude = Amplitude(Vector=[vector_xyz.Vector, vector_xyz_3.Vector, vector_xyz_4.Vector, vector_xyz_2.Vector], Amplitude=panel_5)  # disabled
negative_4 = Negative(Value=number_slider_2)  # disabled
offset_curve = OffsetCurve(Curve=[trim_with_region.Inside, explode.Segments], Distance=number_slider_2, Corners=1)  # disabled
offset_curve_2 = OffsetCurve(Curve=[trim_with_region.Inside, explode.Segments], Distance=negative_4, Corners=1)  # disabled
loft = Loft(
    Curves=[offset_curve, offset_curve_2],
    Options={Adjust=False, Closed=False, LoftEnds=0, LoftSimp=0, LoftType=0, Rebuild=10, Refit=0.01})  # disabled
number_slider_3 = Slider(24, range=0..100)  # disabled
geometry_2 = Geometry(loft)  # disabled
brep_to_shape = BrepToShape(Brep=flatten(geometry_2))  # disabled
number_slider_4 = Slider(96, range=0..100)  # disabled
compose_drawing = ComposeDrawing(
    Shapes=brep_to_shape,
    Boundary=rectangle.Rectangle,
    Width=number_slider_3,
    Height=number_slider_3,
    Backround=RGBA(255, 255, 255, 0))  # disabled
view_drawing = ViewDrawing(Drawing=compose_drawing)  # disabled
drawing_to_bitmap = DrawingToBitmap(Drawing=compose_drawing, PPI=number_slider_4)  # disabled
boolean_toggle = BooleanToggle(False)  # disabled
export_bitmap = ExportBitmap(Image=drawing_to_bitmap, Extention=0, Save=boolean_toggle)  # disabled
export_svg = ExportSVG(Drawing=compose_drawing, Save=False)  # disabled
point_on_curve = PointOnCurve(dispatch.ListB, parameter=0.775)  # disabled
panel_8 = Panel(export_bitmap)  # disabled
panel_9 = Panel(export_svg)  # disabled
text_tag_3d = TextTag3D(Location=point_on_curve, Size=1, Justification=1)  # disabled
vector_display = VectorDisplay(Anchor=construct_point_4, Vector=amplitude)  # disabled
geometry_3 = Geometry(loft)  # disabled

# ----
# Limits
# lim ƒ(x) = lim x/|x| = {1, if x > 0  , hence Does Not Exist
# x ->0       x ->0          -1, if x < 0}
panel_10 = Panel("5")  # disabled
# Formal Definition of Limit:
# Suppose that there exists numbers a, b, c
# with b < a < c such that ƒ is
# defined on the interval (b, a)
# and on the interval (a, c).
# suppose that there exists a real number L
# with the following property:
# corresponding to any positive real
# number c, there exists another positive
# real number d (which depends on c)
# such that
# |ƒ(x) - L| < c whenever 0 < |x - a| < d.
# then we say that the limit of ƒ(x)
# as x approaches a is L
# and we write
# lim ƒ(x) = L
# x->a
negative_5 = Negative(Value=panel_10)  # disabled
number_slider_5 = Slider(100, range=0..100)  # disabled
construct_domain_3 = ConstructDomain(DomainStart=negative_5, DomainEnd=panel_10)  # disabled
panel_11 = Panel("0")  # disabled
panel_12 = Panel("1")  # disabled
range_2 = Range(Domain=construct_domain_3, Steps=number_slider_5)  # disabled
negative_6 = Negative(Value=panel_11)  # disabled
smaller_than = SmallerThan(FirstNumber=range_2, SecondNumber=negative_6)  # -> SmallerThan, OrEqualTo; disabled
larger_than = LargerThan(FirstNumber=range_2, SecondNumber=panel_11)  # -> LargerThan, OrEqualTo; disabled
negative_7 = Negative(Value=panel_12)  # disabled
cull_pattern = CullPattern(List=range_2, CullPattern=larger_than.LargerThan)  # disabled
cull_pattern_2 = CullPattern(List=range_2, CullPattern=smaller_than.SmallerThan)  # disabled
construct_point_5 = ConstructPoint(XCoordinate=0, YCoordinate=panel_12, ZCoordinate=0)  # disabled
construct_point_6 = ConstructPoint(XCoordinate=0, YCoordinate=negative_7, ZCoordinate=0)  # disabled
expression_4 = Expression(x=cull_pattern_2, Expression="x/Abs(x)")  # disabled
expression_5 = Expression(x=cull_pattern, Expression="x/Abs(x)")  # disabled
panel_13 = Panel(".12")  # disabled
circle_2 = Circle(Plane=[construct_point_5, construct_point_6], Radius=panel_13)  # disabled
construct_point_7 = ConstructPoint(XCoordinate=cull_pattern, YCoordinate=graft(expression_5), ZCoordinate=0)  # disabled
construct_point_8 = ConstructPoint(XCoordinate=cull_pattern_2, YCoordinate=graft(expression_4), ZCoordinate=0)  # disabled
curve_3 = Curve(circle_2)  # disabled
polyline = PolyLine(Vertices=flatten(construct_point_7), Closed=False)  # disabled
polyline_2 = PolyLine(Vertices=flatten(construct_point_8), Closed=False)  # disabled
# 1.6
# Extensions of Limit Concepts:
# i. one sided limits
# ii. limits at infinity
# iii. infinite limits
# One-Sided Limits
# We argued the the Siugnum function does not exist
# because sgn x approaches different values
# (1 or -1) as x approaches (0 from the left and the right)
# but one sided limits do exist
# lim sgn x = 1
# x->0+
# lim sgn x = -1
# x->0-
# Left and Right Limits:
# WE say that the function ƒ has a right and left limit
# L/M as x approaches a
# provided ƒ(x) is defined on the interval
# (a, b) for some b > a and  ƒ(x)
# approaches arbitrarily close to L/M
# as x decreases/increases towards a
# lim ƒ(x) = L
# x->a+
# lim ƒ(x) = M
# x->a-
merge_2 = Merge(Data1=polyline, Data2=curve_3, Data3=polyline_2)  # disabled

# ----
# Create a bmp or svg
geometry_4 = Geometry(flatten(merge_2))  # disabled
panel_14 = Panel("0.01")  # disabled
boolean_toggle_2 = BooleanToggle(False)  # disabled
explode_tree = ExplodeTree(Data=graft(geometry_4))  # -> Branch0, Branch1, Branch2, Branch3; disabled
panel_15 = Panel("5")  # disabled
offset_curve_3 = OffsetCurve(Curve=[explode_tree.Branch1, explode_tree.Branch2], Distance=panel_14, Corners=1)  # disabled
offset_curve_4 = OffsetCurve(
    Curve=[explode_tree.Branch0, explode_tree.Branch3],
    Plane=PlaneXY(0, 0, 0),
    Distance=panel_14,
    BothSides=boolean_toggle_2,
    Kinks=0,
    CapType=1)  # disabled
negative_8 = Negative(Value=panel_15)  # disabled
panel_16 = Panel("1")  # disabled
negative_9 = Negative(Value=panel_16)  # disabled
construct_domain_4 = ConstructDomain(DomainStart=negative_8, DomainEnd=panel_15)  # disabled
vector_xyz_5 = VectorXYZ(XComponent=panel_16, YComponent=0, ZComponent=0)  # -> Vector, Length; disabled
vector_xyz_6 = VectorXYZ(XComponent=negative_9, YComponent=0, ZComponent=0)  # -> Vector, Length; disabled
vector_xyz_7 = VectorXYZ(XComponent=0, YComponent=panel_16, ZComponent=0)  # -> Vector, Length; disabled
vector_xyz_8 = VectorXYZ(XComponent=0, YComponent=negative_9, ZComponent=0)  # -> Vector, Length; disabled
construct_point_9 = ConstructPoint(XCoordinate=0, YCoordinate=0, ZCoordinate=0)  # disabled
boundary_surfaces = BoundarySurfaces(Edges=offset_curve_4)  # disabled
rectangle_2 = Rectangle(Plane=PlaneXY(0, 0, 0), XSize=construct_domain_4, YSize=construct_domain_4, Radius=0)  # -> Rectangle, Length; disabled
amplitude_2 = Amplitude(Vector=[vector_xyz_5.Vector, vector_xyz_7.Vector, vector_xyz_8.Vector, vector_xyz_6.Vector], Amplitude=panel_15)  # disabled
geometry_5 = Geometry([boundary_surfaces, offset_curve_3, rectangle_2.Rectangle])  # disabled
number_slider_6 = Slider(24, range=0..100)  # disabled
brep_to_shape_2 = BrepToShape(Brep=flatten(geometry_5))  # disabled
number_slider_7 = Slider(96, range=0..100)  # disabled
compose_drawing_2 = ComposeDrawing(
    Shapes=brep_to_shape_2,
    Boundary=rectangle_2.Rectangle,
    Width=number_slider_6,
    Height=number_slider_6,
    Backround=RGBA(255, 255, 255, 0))  # disabled
view_drawing_2 = ViewDrawing(Drawing=compose_drawing_2)  # disabled
curve_4 = Curve(reparameterize(explode_tree.Branch0))  # disabled
drawing_to_bitmap_2 = DrawingToBitmap(Drawing=compose_drawing_2, PPI=number_slider_7)  # disabled
boolean_toggle_3 = BooleanToggle(False)  # disabled
panel_17 = Panel("2")  # disabled
rebuild_curve = RebuildCurve(Curve=curve_4, Count=panel_17, Tangents=False)  # disabled
export_bitmap_2 = ExportBitmap(Image=drawing_to_bitmap_2, Extention=0, Save=boolean_toggle_3)  # disabled
export_svg_2 = ExportSVG(Drawing=compose_drawing_2, Save=False)  # disabled
point_on_curve_2 = PointOnCurve(rebuild_curve, parameter=0.639)  # disabled
number_slider_8 = Slider(0.5, range=0..1)  # disabled
panel_18 = Panel(export_bitmap_2)  # disabled
panel_19 = Panel(export_svg_2)  # disabled
panel_20 = Panel("y = f(x)")  # disabled
text_tag_3d_2 = TextTag3D(Location=point_on_curve_2, Text=panel_20, Size=number_slider_8, Justification=1)  # disabled
vector_display_2 = VectorDisplay(Anchor=construct_point_9, Vector=amplitude_2)  # disabled
geometry_6 = Geometry(geometry_5)  # disabled

# ----
# Let [x] denote the greatest integer that does not exceed x
# then if n is an integer
# lim  [x] = n
# x->n+
# lim  [x] = n - 1
# x->n-
# if a is not an integer, then
# n < a < n + 1 for some integer
# and
# lim  [x] = lim  [x] =  lim  [x] = n
# x->a+     x->a-       x->a
# The graph of y = [x] is the following
# lim ƒ(x) = L if and only if
# x->a
# lim ƒx) = L = lim ƒ(x)
# x->a+           x->a-
# otherwise if they are not equal
# then the lim
# does not exist
panel_21 = Panel("5")  # disabled
negative_10 = Negative(Value=panel_21)  # disabled
panel_22 = Panel("2")  # disabled
construct_domain_5 = ConstructDomain(DomainStart=negative_10, DomainEnd=panel_21)  # disabled
multiplication_2 = Multiplication(A=panel_21, B=panel_22)  # disabled
range_3 = Range(Domain=construct_domain_5, Steps=multiplication_2)  # disabled
expression_6 = Expression(x=range_3, Expression="x-1")  # disabled
expression_7 = Expression(x=range_3, Expression="x")  # disabled
construct_point_10 = ConstructPoint(XCoordinate=expression_6, YCoordinate=range_3, ZCoordinate=0)  # disabled
construct_point_11 = ConstructPoint(XCoordinate=expression_7, YCoordinate=range_3, ZCoordinate=0)  # disabled
line = Line(StartPoint=construct_point_11, EndPoint=construct_point_10)  # disabled
merge_3 = Merge(Data1=line)  # disabled

# ----
# Create a bmp or svg
panel_23 = Panel("5")  # disabled
geometry_7 = Geometry(merge_3)  # disabled
negative_11 = Negative(Value=panel_23)  # disabled
panel_24 = Panel(".05")  # disabled
panel_25 = Panel(".1")  # disabled
construct_domain_6 = ConstructDomain(DomainStart=negative_11, DomainEnd=panel_23)  # disabled
unit_y = UnitY(Factor=panel_24)  # disabled
entwine = Entwine(Branch00=construct_point_11, Branch01=construct_point_10, FlattenInputs=True)  # disabled
rectangle_3 = Rectangle(Plane=PlaneXY(0, 0, 0), XSize=construct_domain_6, YSize=construct_domain_6, Radius=0)  # -> Rectangle, Length; disabled
move = Move(Geometry=geometry_7, Motion=unit_y)  # -> graft(Geometry), Transform; disabled
circle_3 = Circle(Plane=entwine, Radius=panel_25)  # disabled
panel_26 = Panel("1")  # disabled
negative_12 = Negative(Value=panel_26)  # disabled
offset_curve_5 = OffsetCurve(Curve=rectangle_3.Rectangle, Distance=panel_24, Corners=1)  # disabled
curve_5 = Curve(graft(geometry_7))  # disabled
flip_matrix = FlipMatrix(Data=circle_3)  # disabled
vector_xyz_9 = VectorXYZ(XComponent=panel_26, YComponent=0, ZComponent=0)  # -> Vector, Length; disabled
vector_xyz_10 = VectorXYZ(XComponent=negative_12, YComponent=0, ZComponent=0)  # -> Vector, Length; disabled
vector_xyz_11 = VectorXYZ(XComponent=0, YComponent=panel_26, ZComponent=0)  # -> Vector, Length; disabled
vector_xyz_12 = VectorXYZ(XComponent=0, YComponent=negative_12, ZComponent=0)  # -> Vector, Length; disabled
construct_point_12 = ConstructPoint(XCoordinate=0, YCoordinate=0, ZCoordinate=0)  # disabled
loft_2 = Loft(
    Curves=flatten([offset_curve_5, rectangle_3.Rectangle]),
    Options={Adjust=False, Closed=False, LoftEnds=0, LoftSimp=0, LoftType=0, Rebuild=10, Refit=0.01})  # disabled
loft_3 = Loft(
    Curves=[curve_5, move.Geometry],
    Options={Adjust=False, Closed=False, LoftEnds=0, LoftSimp=0, LoftType=0, Rebuild=10, Refit=0.01})  # disabled
dispatch_2 = Dispatch(List=flip_matrix, DispatchPattern=[True, False])  # -> ListA, ListB; disabled
geometry_8 = Geometry(dispatch_2.ListA)  # disabled
dispatch_3 = Dispatch(List=geometry_8, DispatchPattern=[True, False])  # -> ListA, ListB; disabled
amplitude_3 = Amplitude(Vector=[vector_xyz_9.Vector, vector_xyz_11.Vector, vector_xyz_12.Vector, vector_xyz_10.Vector], Amplitude=panel_23)  # disabled
area = Area(Geometry=dispatch_3.ListA)  # -> Area, Centroid; disabled
surface = Surface(dispatch_2.ListB)  # disabled
panel_27 = Panel(".9")  # disabled
scale = Scale(Geometry=dispatch_3.ListA, Center=area.Centroid, Factor=panel_27)  # -> Geometry, Transform; disabled
loft_4 = Loft(
    Curves=[dispatch_3.ListA, scale.Geometry],
    Options={Adjust=False, Closed=False, LoftEnds=0, LoftSimp=0, LoftType=0, Rebuild=10, Refit=0.01})  # disabled
geometry_9 = Geometry([loft_3, loft_2, surface, loft_4])  # disabled
number_slider_9 = Slider(24, range=0..100)  # disabled
brep_to_shape_3 = BrepToShape(Brep=flatten(geometry_9))  # disabled
compose_drawing_3 = ComposeDrawing(
    Shapes=brep_to_shape_3,
    Boundary=rectangle_3.Rectangle,
    Width=number_slider_9,
    Height=number_slider_9,
    Backround=RGBA(255, 255, 255, 0))  # disabled
number_slider_10 = Slider(96, range=0..100)  # disabled
curve_6 = Curve(geometry_7)  # disabled
view_drawing_3 = ViewDrawing(Drawing=compose_drawing_3)  # disabled
number_slider_11 = Slider(100, range=0..100)  # disabled
curve_7 = Curve(reparameterize(curve_6))  # disabled
drawing_to_bitmap_3 = DrawingToBitmap(Drawing=compose_drawing_3, PPI=number_slider_10)  # disabled
boolean_toggle_4 = BooleanToggle(False)  # disabled
panel_28 = Panel("2")  # disabled
rebuild_curve_2 = RebuildCurve(Curve=curve_7, Count=number_slider_11, Tangents=False)  # disabled
export_bitmap_3 = ExportBitmap(Image=drawing_to_bitmap_3, Extention=0, Save=boolean_toggle_4)  # disabled
export_svg_3 = ExportSVG(Drawing=compose_drawing_3, Save=False)  # disabled
number_slider_12 = Slider(9, range=0..10)  # disabled
point_on_curve_3 = PointOnCurve(rebuild_curve_2, parameter=0.889)  # disabled
number_slider_13 = Slider(0.5, range=0..1)  # disabled
panel_29 = Panel(export_bitmap_3)  # disabled
panel_30 = Panel(export_svg_3)  # disabled
panel_31 = Panel("   y = f(x)")  # disabled
list_item = ListItem(List=flatten(point_on_curve_3), Index=number_slider_12, Wrap=True)  # disabled
text_tag_3d_3 = TextTag3D(Location=list_item, Text=panel_31, Size=number_slider_13, Justification=1)  # disabled
vector_display_3 = VectorDisplay(Anchor=construct_point_12, Vector=amplitude_3)  # disabled
geometry_10 = Geometry(geometry_9)  # disabled

# ----
# Wickerson Studios Funk
trigger = Trigger(Interval=100, TimerInterval=100, Target=data_recorder)  # disabled
panel_32 = Panel("0")  # disabled
data_recorder = DataRecorder(panel_32, DataLimit=-10, RecordData=True)  # disabled
number_slider_14 = Slider(2.917, range=0..10)  # disabled
number_slider_15 = Slider(2.566, range=0..10)  # disabled
number_slider_16 = Slider(3.639, range=0..10)  # disabled
number_slider_17 = Slider(10, range=0..10)  # disabled
list_length = ListLength(List=data_recorder)  # disabled
cosine = Cosine(Value=list_length)  # disabled
sine = Sine(Value=list_length)  # disabled
multiplication_3 = Multiplication(A=cosine, B=number_slider_17)  # disabled
multiplication_4 = Multiplication(A=cosine, B=number_slider_16)  # disabled
multiplication_5 = Multiplication(A=sine, B=number_slider_14)  # disabled

number_slider_18 = Slider(3, range=0..10)  # disabled

# ----
# ƒ(x) = (1 + x)/(x - A*(x^3))
panel_33 = Panel("5")  # disabled
negative_13 = Negative(Value=panel_33)  # disabled
construct_domain_7 = ConstructDomain(DomainStart=negative_13, DomainEnd=panel_33)  # disabled
range_4 = Range(Domain=construct_domain_7, Steps=10)  # disabled
expression_8 = Expression(x=range_4, A=number_slider_18, Expression="(1 + x)/(x - A*(x^3))")  # disabled
construct_point_13 = ConstructPoint(XCoordinate=range_4, YCoordinate=expression_8, ZCoordinate=0)  # disabled
interpolate_2 = Interpolate(Vertices=construct_point_13, Degree=3, Periodic=False, KnotStyle=1)  # -> Curve, Length, Domain; disabled

# ----
# Vector Grid
panel_34 = Panel("1")  # disabled
negative_14 = Negative(Value=panel_34)  # disabled
vector_xyz_13 = VectorXYZ(XComponent=panel_34, YComponent=0, ZComponent=0)  # -> Vector, Length; disabled
vector_xyz_14 = VectorXYZ(XComponent=negative_14, YComponent=0, ZComponent=0)  # -> Vector, Length; disabled
vector_xyz_15 = VectorXYZ(XComponent=0, YComponent=panel_34, ZComponent=0)  # -> Vector, Length; disabled
vector_xyz_16 = VectorXYZ(XComponent=0, YComponent=negative_14, ZComponent=0)  # -> Vector, Length; disabled
# Limits at Infinity and Negative Infinity:
# 
# If a function ƒ is defined on the  interval
# of the form (a, ∞) and if ƒ(x) approaches
# arbitrarily close to L as x increases through
# arbitrarily large positive numbers
# then we say that ƒ(x) tands to the limit L
# as x tends to infinity, we write
# lim ƒ(x) = L
# x->∞
# similarily,
# If a function ƒ is defined on the  interval
# of the form (-∞, a) and if ƒ(x) approaches
# arbitrarily close to M as x decreases through
# arbitrarily large negative numbers
# then we say that ƒ(x) tands to the limit M
# as x tends to negative  infinity, we write
# lim ƒ(x) = M
# x->-∞
# 
# *note
# we can multiply numerators and denomerators
#  by the highest power oof x in the denominator
construct_point_14 = ConstructPoint(XCoordinate=0, YCoordinate=0, ZCoordinate=0)  # disabled
amplitude_4 = Amplitude(Vector=[vector_xyz_13.Vector, vector_xyz_15.Vector, vector_xyz_16.Vector, vector_xyz_14.Vector], Amplitude=panel_33)  # disabled
vector_display_4 = VectorDisplay(Anchor=construct_point_14, Vector=amplitude_4)  # disabled

# ----
# Wickerson Studios Funk
trigger_2 = Trigger(Interval=50, TimerInterval=50, Target=data_recorder_2)  # disabled
panel_35 = Panel("0")  # disabled
data_recorder_2 = DataRecorder(panel_35, DataLimit=-10, RecordData=True)  # disabled
number_slider_19 = Slider(0.752, range=0..10)  # disabled
number_slider_20 = Slider(4.255, range=0..10)  # disabled
number_slider_21 = Slider(4.955, range=0..10)  # disabled
number_slider_22 = Slider(1.852, range=0..10)  # disabled
list_length_2 = ListLength(List=data_recorder_2)  # disabled
cosine_2 = Cosine(Value=list_length_2)  # disabled
sine_2 = Sine(Value=list_length_2)  # disabled
multiplication_6 = Multiplication(A=cosine_2, B=number_slider_22)  # disabled
multiplication_7 = Multiplication(A=cosine_2, B=number_slider_21)  # disabled
multiplication_8 = Multiplication(A=sine_2, B=number_slider_19)  # disabled
expression_9 = Expression(x=range_4, a=multiplication_8, b=number_slider_20, c=multiplication_7, Expression="(c + a*x)/(x - b*(x^3))")  # disabled

number_slider_23 = Slider(14, range=0..100)  # disabled
number_slider_24 = Slider(5, range=1..11)  # disabled

# ----
# ƒ(x) = (Sqrt(x)*(x + 1)*(x^2 + 1))/(((2*Sqrt(x) + 3)^2)*((1 - Sqrt(x))^5))
# limit as x approaches ∞ = -1/4
negative_15 = Negative(Value=number_slider_23)  # disabled
number_slider_25 = Slider(6, range=0..10)  # disabled
construct_domain_8 = ConstructDomain(DomainStart=negative_15, DomainEnd=number_slider_23)  # disabled
range_5 = Range(Domain=construct_domain_8, Steps=10)  # disabled
expression_10 = Expression(x=range_5, k=number_slider_24, Expression=" (Sqrt(x)*(x + 1)*(x^2 + 1))/(((2*Sqrt(x) + 3)^2)*((1 - Sqrt(x))^k))")  # disabled
construct_point_15 = ConstructPoint(XCoordinate=expression_10, YCoordinate=range_5, ZCoordinate=0)  # disabled
interpolate_3 = Interpolate(Vertices=construct_point_15, Degree=3, Periodic=False, KnotStyle=1)  # -> Curve, Length, Domain; disabled

number_slider_26 = Slider(0.435, range=0..1)  # disabled

# ----
# Wickerson Studios Funk
trigger_3 = Trigger(Interval=50, TimerInterval=50, Target=data_recorder_3)  # disabled
panel_36 = Panel("0")  # disabled
data_recorder_3 = DataRecorder(panel_36, DataLimit=-10, RecordData=True)  # disabled
number_slider_27 = Slider(3.166, range=0..10)  # disabled
list_length_3 = ListLength(List=data_recorder_3)  # disabled
sine_3 = Sine(Value=list_length_3)  # disabled
multiplication_9 = Multiplication(A=sine_3, B=number_slider_27)  # disabled
multiplication_10 = Multiplication(A=sine_3, B=number_slider_26)  # disabled
expression_11 = Expression(
    x=range_5,
    a=multiplication_10,
    b=multiplication_10,
    c=multiplication_9,
    d=multiplication_10,
    Expression="(Sqrt(x)*(b*(x + 1))*(a*(x^2 + 1)))/(((2*Sqrt(x) + c)^2)*((d - Sqrt(x))^5))")  # disabled

# ----
# graph to brep
geometry_11 = Geometry(interpolate_2.Curve)  # disabled
panel_37 = Panel(".05")  # disabled
offset_curve_6 = OffsetCurve(Curve=geometry_11, Distance=panel_37, Corners=1)  # disabled
curve_8 = Curve(graft(geometry_11))  # disabled
loft_5 = Loft(
    Curves=[curve_8, offset_curve_6],
    Options={Adjust=False, Closed=False, LoftEnds=0, LoftSimp=0, LoftType=0, Rebuild=10, Refit=0.01})  # disabled

# ----
# grid to brep
panel_38 = Panel("5")  # disabled
negative_16 = Negative(Value=panel_38)  # disabled
construct_domain_9 = ConstructDomain(DomainStart=negative_16, DomainEnd=panel_38)  # disabled
rectangle_4 = Rectangle(Plane=PlaneXY(0, 0, 0), XSize=construct_domain_9, YSize=construct_domain_9, Radius=0)  # -> Rectangle, Length; disabled
offset_curve_7 = OffsetCurve(Curve=rectangle_4.Rectangle, Distance=panel_37, Corners=1)  # disabled
loft_6 = Loft(
    Curves=flatten([offset_curve_7, rectangle_4.Rectangle]),
    Options={Adjust=False, Closed=False, LoftEnds=0, LoftSimp=0, LoftType=0, Rebuild=10, Refit=0.01})  # disabled

# ----
# graph to brep
geometry_12 = Geometry(interpolate_3.Curve)  # disabled
panel_39 = Panel(".05")  # disabled
offset_curve_8 = OffsetCurve(Curve=geometry_12, Distance=panel_39, Corners=1)  # disabled
curve_9 = Curve(graft(geometry_12))  # disabled
loft_7 = Loft(
    Curves=[curve_9, offset_curve_8],
    Options={Adjust=False, Closed=False, LoftEnds=0, LoftSimp=0, LoftType=0, Rebuild=10, Refit=0.01})  # disabled

# ----
# grid to brep
panel_40 = Panel("5")  # disabled
negative_17 = Negative(Value=panel_40)  # disabled
construct_domain_10 = ConstructDomain(DomainStart=negative_17, DomainEnd=panel_40)  # disabled
rectangle_5 = Rectangle(Plane=PlaneXY(0, 0, 0), XSize=construct_domain_10, YSize=construct_domain_10, Radius=0)  # -> Rectangle, Length; disabled
offset_curve_9 = OffsetCurve(Curve=rectangle_5.Rectangle, Distance=panel_39, Corners=1)  # disabled
loft_8 = Loft(
    Curves=flatten([offset_curve_9, rectangle_5.Rectangle]),
    Options={Adjust=False, Closed=False, LoftEnds=0, LoftSimp=0, LoftType=0, Rebuild=10, Refit=0.01})  # disabled

# ----
# Create a bmp or svg
geometry_13 = Geometry([loft_5, loft_6])  # disabled
brep_to_shape_4 = BrepToShape(Brep=flatten(geometry_13))  # disabled
number_slider_28 = Slider(96, range=0..100)  # disabled
panel_41 = Panel("24")  # disabled
compose_drawing_4 = ComposeDrawing(
    Shapes=brep_to_shape_4,
    Boundary=rectangle_4.Rectangle,
    Width=panel_41,
    Height=panel_41,
    Backround=RGBA(255, 255, 255, 0))  # disabled
drawing_to_bitmap_4 = DrawingToBitmap(Drawing=compose_drawing_4, PPI=number_slider_28)  # disabled
boolean_toggle_5 = BooleanToggle(False)  # disabled
view_drawing_4 = ViewDrawing(Drawing=compose_drawing_4)  # disabled
export_bitmap_4 = ExportBitmap(Image=drawing_to_bitmap_4, Extention=0, Save=boolean_toggle_5)  # disabled
export_svg_4 = ExportSVG(Drawing=compose_drawing_4, Save=False)  # disabled
panel_42 = Panel(export_bitmap_4)  # disabled
panel_43 = Panel(export_svg_4)  # disabled

# ----
# Create a bmp or svg
geometry_14 = Geometry([loft_7, loft_8])  # disabled
brep_to_shape_5 = BrepToShape(Brep=flatten(geometry_14))  # disabled
number_slider_29 = Slider(96, range=0..100)  # disabled
panel_44 = Panel("24")  # disabled
compose_drawing_5 = ComposeDrawing(
    Shapes=brep_to_shape_5,
    Boundary=rectangle_5.Rectangle,
    Width=panel_44,
    Height=panel_44,
    Backround=RGBA(255, 255, 255, 0))  # disabled
drawing_to_bitmap_5 = DrawingToBitmap(Drawing=compose_drawing_5, PPI=number_slider_29)  # disabled
boolean_toggle_6 = BooleanToggle(False)  # disabled
view_drawing_5 = ViewDrawing(Drawing=compose_drawing_5)  # disabled
export_bitmap_5 = ExportBitmap(Image=drawing_to_bitmap_5, Extention=0, Save=boolean_toggle_6)  # disabled
export_svg_5 = ExportSVG(Drawing=compose_drawing_5, Save=False)  # disabled
panel_45 = Panel(export_bitmap_5)  # disabled
panel_46 = Panel(export_svg_5)  # disabled

# ----
# Visualization
number_slider_30 = Slider(100, range=0..100)  # disabled
curve_10 = Curve(reparameterize(geometry_11))  # disabled
rebuild_curve_3 = RebuildCurve(Curve=curve_10, Count=number_slider_30, Tangents=False)  # disabled
number_slider_31 = Slider(9, range=0..10)  # disabled
point_on_curve_4 = PointOnCurve(rebuild_curve_3, parameter=0.849)  # disabled
number_slider_32 = Slider(0.5, range=0..1)  # disabled
panel_47 = Panel("   y = f(x)")  # disabled
list_item_2 = ListItem(List=flatten(point_on_curve_4), Index=number_slider_31, Wrap=True)  # disabled
text_tag_3d_4 = TextTag3D(Location=list_item_2, Text=panel_47, Size=number_slider_32, Justification=1)  # disabled
geometry_15 = Geometry(geometry_13)  # disabled

# ----
# Visualization
number_slider_33 = Slider(100, range=0..100)  # disabled
curve_11 = Curve(reparameterize(geometry_12))  # disabled
rebuild_curve_4 = RebuildCurve(Curve=curve_11, Count=number_slider_33, Tangents=False)  # disabled
number_slider_34 = Slider(9, range=0..10)  # disabled
point_on_curve_5 = PointOnCurve(rebuild_curve_4, parameter=1)  # disabled
number_slider_35 = Slider(0.5, range=0..1)  # disabled
panel_48 = Panel("   y = f(x)")  # disabled
list_item_3 = ListItem(List=flatten(point_on_curve_5), Index=number_slider_34, Wrap=True)  # disabled
text_tag_3d_5 = TextTag3D(Location=list_item_3, Text=panel_48, Size=number_slider_35, Justification=1)  # disabled
geometry_16 = Geometry(geometry_14)  # disabled

number_slider_36 = Slider(14, range=0..100)  # disabled

# ----
# Find two limits:
# lim  (Sqrt(x^3 + x) -x) and lim  (Sqrt(x^3 + x) -x)
# x->∞                                    x->-∞
# an algebraic trick is needed to render the limit obvious:
# we multiply the num and denom by
# the conjugate expression
# Sqrt(x^3 + x)  + x
# and solve for
# lim  (Sqrt(x^3 + x) -x)  = 1/2
# x->∞
# *note
# here Sqrt(x^2) = x because x > 0 as x->∞
# lim  (Sqrt(x^3 + x) -x)  = 1/2
# x->-∞
# may look similar but it is not!
# for negative x both term  in the expression
# are positive so we are now dealing with
# a sum rather thatn a difference
# of funcrtions with large values.
# Therefore, the limit does not exist
# The function becomes infinite as x->-∞
# lim  (Sqrt(x^3 + x) -x)  Does Not Exist
# x->-∞
# ƒ(x) = (Sqrt(x^2 + x) - x)
negative_18 = Negative(Value=number_slider_36)  # disabled
construct_domain_11 = ConstructDomain(DomainStart=negative_18, DomainEnd=number_slider_36)  # disabled
number_slider_37 = Slider(1, range=0..10)  # disabled
range_6 = Range(Domain=construct_domain_11, Steps=10)  # disabled
expression_12 = Expression(x=range_6, a=number_slider_37, Expression=" (Sqrt(x^2 + x) - a*x)")  # disabled
construct_point_16 = ConstructPoint(XCoordinate=range_6, YCoordinate=expression_12, ZCoordinate=0)  # disabled
interpolate_4 = Interpolate(Vertices=construct_point_16, Degree=3, Periodic=False, KnotStyle=1)  # -> Curve, Length, Domain; disabled

# ----
# Wickerson Studios Funk
trigger_4 = Trigger(Interval=50, TimerInterval=50, Target=data_recorder_4)  # disabled
panel_49 = Panel("0")  # disabled
data_recorder_4 = DataRecorder(panel_49, DataLimit=-10, RecordData=True)  # disabled
number_slider_38 = Slider(2.905, range=0..10)  # disabled
number_slider_39 = Slider(0.239, range=0..1)  # disabled
list_length_4 = ListLength(List=data_recorder_4)  # disabled
sine_4 = Sine(Value=list_length_4)  # disabled
multiplication_11 = Multiplication(A=sine_4, B=number_slider_39)  # disabled
multiplication_12 = Multiplication(A=sine_4, B=number_slider_38)  # disabled
expression_13 = Expression(x=range_6, a=multiplication_11, b=number_slider_39, c=multiplication_12, Expression=" (Sqrt(b*(x^2) + c*x) - a*x)")  # disabled

# ----
# graph to brep
geometry_17 = Geometry(interpolate_4.Curve)  # disabled
panel_50 = Panel(".05")  # disabled
offset_curve_10 = OffsetCurve(Curve=geometry_17, Distance=panel_50, Corners=1)  # disabled
curve_12 = Curve(graft(geometry_17))  # disabled
loft_9 = Loft(
    Curves=[curve_12, offset_curve_10],
    Options={Adjust=False, Closed=False, LoftEnds=0, LoftSimp=0, LoftType=0, Rebuild=10, Refit=0.01})  # disabled

# ----
# grid to brep
panel_51 = Panel("5")  # disabled
negative_19 = Negative(Value=panel_51)  # disabled
construct_domain_12 = ConstructDomain(DomainStart=negative_19, DomainEnd=panel_51)  # disabled
rectangle_6 = Rectangle(Plane=PlaneXY(0, 0, 0), XSize=construct_domain_12, YSize=construct_domain_12, Radius=0)  # -> Rectangle, Length; disabled
offset_curve_11 = OffsetCurve(Curve=rectangle_6.Rectangle, Distance=panel_50, Corners=1)  # disabled
loft_10 = Loft(
    Curves=flatten([offset_curve_11, rectangle_6.Rectangle]),
    Options={Adjust=False, Closed=False, LoftEnds=0, LoftSimp=0, LoftType=0, Rebuild=10, Refit=0.01})  # disabled

# ----
# Create a bmp or svg
geometry_18 = Geometry([loft_9, loft_10])  # disabled
brep_to_shape_6 = BrepToShape(Brep=flatten(geometry_18))  # disabled
number_slider_40 = Slider(96, range=0..100)  # disabled
panel_52 = Panel("24")  # disabled
compose_drawing_6 = ComposeDrawing(
    Shapes=brep_to_shape_6,
    Boundary=rectangle_6.Rectangle,
    Width=panel_52,
    Height=panel_52,
    Backround=RGBA(255, 255, 255, 0))  # disabled
drawing_to_bitmap_6 = DrawingToBitmap(Drawing=compose_drawing_6, PPI=number_slider_40)  # disabled
boolean_toggle_7 = BooleanToggle(False)  # disabled
view_drawing_6 = ViewDrawing(Drawing=compose_drawing_6)  # disabled
export_bitmap_6 = ExportBitmap(Image=drawing_to_bitmap_6, Extention=0, Save=boolean_toggle_7)  # disabled
export_svg_6 = ExportSVG(Drawing=compose_drawing_6, Save=False)  # disabled
panel_53 = Panel(export_bitmap_6)  # disabled
panel_54 = Panel(export_svg_6)  # disabled

# ----
# Visualization
number_slider_41 = Slider(100, range=0..100)  # disabled
curve_13 = Curve(reparameterize(geometry_17))  # disabled
rebuild_curve_5 = RebuildCurve(Curve=curve_13, Count=number_slider_41, Tangents=False)  # disabled
number_slider_42 = Slider(9, range=0..10)  # disabled
point_on_curve_6 = PointOnCurve(rebuild_curve_5, parameter=1)  # disabled
number_slider_43 = Slider(0.5, range=0..1)  # disabled
panel_55 = Panel("   y = f(x)")  # disabled
list_item_4 = ListItem(List=flatten(point_on_curve_6), Index=number_slider_42, Wrap=True)  # disabled
text_tag_3d_6 = TextTag3D(Location=list_item_4, Text=panel_55, Size=number_slider_43, Justification=1)  # disabled
geometry_19 = Geometry(geometry_18)  # disabled

# ----
# The function ƒ(x) = Sqrt(1 - x^2),
# is defined on the interval [-1, 1]
# evidently ƒ(-1) = ƒ(1) = 0
# if -1 < a < 1 then
# lim ƒ(x) = Sqrt(1 - a^2) = ƒ(a)
# x->a
# however, ƒ has only a right limit at -1
# and a left-hand limit at 1
# lim ƒ(x) = 0
# x->-1+
# lim ƒ(x) = 0
# x->1-
# lim ƒ(x) = lim x/|x| = {1, if x > 0  , hence Does Not Exist
# x ->0       x ->0          -1, if x < 0}
panel_56 = Panel("5")  # disabled
negative_20 = Negative(Value=panel_56)  # disabled
number_slider_44 = Slider(374, range=0..1000)  # disabled
construct_domain_13 = ConstructDomain(DomainStart=negative_20, DomainEnd=panel_56)  # disabled
number_slider_45 = Slider(10, range=0..100)  # disabled
range_7 = Range(Domain=construct_domain_13, Steps=number_slider_44)  # disabled
expression_14 = Expression(x=range_7, y=number_slider_45, Expression="Sqrt(y-x^2)")  # disabled

expression_15 = Expression(x=range_7, Expression="Sqrt(9-x^2)")  # disabled

construct_point_17 = ConstructPoint(XCoordinate=range_7, YCoordinate=expression_15, ZCoordinate=0)  # disabled
point = Point(construct_point_17)  # disabled
polyline_3 = PolyLine(Vertices=point, Closed=False)  # disabled
merge_4 = Merge(Data1=polyline_3)  # disabled

# ----
# Create a bmp or svg
geometry_20 = Geometry(merge_4)  # disabled
panel_57 = Panel("5")  # disabled
negative_21 = Negative(Value=panel_57)  # disabled
panel_58 = Panel(".05")  # disabled
panel_59 = Panel("1")  # disabled
negative_22 = Negative(Value=panel_59)  # disabled
construct_domain_14 = ConstructDomain(DomainStart=negative_21, DomainEnd=panel_57)  # disabled
vector_xyz_17 = VectorXYZ(XComponent=panel_59, YComponent=0, ZComponent=0)  # -> Vector, Length; disabled
vector_xyz_18 = VectorXYZ(XComponent=negative_22, YComponent=0, ZComponent=0)  # -> Vector, Length; disabled
vector_xyz_19 = VectorXYZ(XComponent=0, YComponent=panel_59, ZComponent=0)  # -> Vector, Length; disabled
vector_xyz_20 = VectorXYZ(XComponent=0, YComponent=negative_22, ZComponent=0)  # -> Vector, Length; disabled
construct_point_18 = ConstructPoint(XCoordinate=0, YCoordinate=0, ZCoordinate=0)  # disabled
rectangle_7 = Rectangle(Plane=PlaneXY(0, 0, 0), XSize=construct_domain_14, YSize=construct_domain_14, Radius=0)  # -> Rectangle, Length; disabled
offset_curve_12 = OffsetCurve(Curve=geometry_20, Distance=panel_58, Corners=1)  # disabled
offset_curve_13 = OffsetCurve(Curve=rectangle_7.Rectangle, Distance=panel_58, Corners=1)  # disabled
amplitude_5 = Amplitude(Vector=[vector_xyz_17.Vector, vector_xyz_19.Vector, vector_xyz_20.Vector, vector_xyz_18.Vector], Amplitude=panel_57)  # disabled
loft_11 = Loft(
    Curves=flatten([offset_curve_13, rectangle_7.Rectangle]),
    Options={Adjust=False, Closed=False, LoftEnds=0, LoftSimp=0, LoftType=0, Rebuild=10, Refit=0.01})  # disabled
loft_12 = Loft(
    Curves=flatten([geometry_20, offset_curve_12]),
    Options={Adjust=False, Closed=False, LoftEnds=0, LoftSimp=0, LoftType=0, Rebuild=10, Refit=0.01})  # disabled
geometry_21 = Geometry([loft_12, loft_11])  # disabled
number_slider_46 = Slider(24, range=0..100)  # disabled
brep_to_shape_7 = BrepToShape(Brep=flatten(geometry_21))  # disabled
compose_drawing_7 = ComposeDrawing(
    Shapes=brep_to_shape_7,
    Boundary=rectangle_7.Rectangle,
    Width=number_slider_46,
    Height=number_slider_46,
    Backround=RGBA(255, 255, 255, 0))  # disabled
number_slider_47 = Slider(96, range=0..100)  # disabled
curve_14 = Curve(geometry_20)  # disabled
view_drawing_7 = ViewDrawing(Drawing=compose_drawing_7)  # disabled
number_slider_48 = Slider(100, range=0..100)  # disabled
curve_15 = Curve(reparameterize(curve_14))  # disabled
drawing_to_bitmap_7 = DrawingToBitmap(Drawing=compose_drawing_7, PPI=number_slider_47)  # disabled
boolean_toggle_8 = BooleanToggle(False)  # disabled
rebuild_curve_6 = RebuildCurve(Curve=curve_15, Count=number_slider_48, Tangents=False)  # disabled
export_bitmap_7 = ExportBitmap(Image=drawing_to_bitmap_7, Extention=0, Save=boolean_toggle_8)  # disabled
export_svg_7 = ExportSVG(Drawing=compose_drawing_7, Save=False)  # disabled
point_on_curve_7 = PointOnCurve(rebuild_curve_6, parameter=0.889)  # disabled
number_slider_49 = Slider(0.5, range=0..1)  # disabled
panel_61 = Panel(export_bitmap_7)  # disabled
panel_62 = Panel(export_svg_7)  # disabled
panel_63 = Panel("   y = f(x)")  # disabled
text_tag_3d_7 = TextTag3D(Location=point_on_curve_7, Text=panel_63, Size=number_slider_49, Justification=7)  # disabled
vector_display_5 = VectorDisplay(Anchor=construct_point_18, Vector=amplitude_5)  # disabled
geometry_22 = Geometry(geometry_21)  # disabled

# ----
# Vector Grid
panel_64 = Panel("1")  # disabled
negative_23 = Negative(Value=panel_64)  # disabled
vector_xyz_21 = VectorXYZ(XComponent=panel_64, YComponent=0, ZComponent=0)  # -> Vector, Length; disabled
vector_xyz_22 = VectorXYZ(XComponent=negative_23, YComponent=0, ZComponent=0)  # -> Vector, Length; disabled
vector_xyz_23 = VectorXYZ(XComponent=0, YComponent=panel_64, ZComponent=0)  # -> Vector, Length; disabled
vector_xyz_24 = VectorXYZ(XComponent=0, YComponent=negative_23, ZComponent=0)  # -> Vector, Length; disabled
# Limits at Infinity:
# If a function ƒ is defined on the whole real line
# or on a semi-infinite interval
# of the form (a, ∞) or (-∞, a)
# it is appropriate to ask what happens to the
# values ƒ(x) as x becomes very large positively
# or negatively towards ∞ and -∞
# Consider the function
# ƒ(x) = (4*(x^2 - 1))/(2*(x^2 + 5))
# as x becomes large either pos or neg
# both the nominator and denominator become large
# to see this devide both the nom and denom by x^2
# vadil for x != 0
# 
# lim ƒ(x) = 2 , lim ƒ(x) = 2
# x->∞              x->-∞
# 
# y = 2 is a horizontal asymptote for the graph ƒ
# these are straight lines to which
# the graphs approach arbitrarily close
# as they recede very far away from the origin
construct_point_19 = ConstructPoint(XCoordinate=0, YCoordinate=0, ZCoordinate=0)  # disabled

# ----
# ƒ(x) = (4*(x^2 - 1))/(2*(x^2 + 5))
panel_65 = Panel("5")  # disabled
negative_24 = Negative(Value=panel_65)  # disabled
construct_domain_15 = ConstructDomain(DomainStart=negative_24, DomainEnd=panel_65)  # disabled
range_8 = Range(Domain=construct_domain_15, Steps=10)  # disabled
expression_16 = Expression(x=range_8, Expression="(4*(x^2 - 1))/(2*(x^2 + 5))")  # disabled

# ----
# Wickerson Studios Funk
trigger_5 = Trigger(Interval=50, TimerInterval=50, Target=data_recorder_5)  # disabled
panel_66 = Panel("0")  # disabled
data_recorder_5 = DataRecorder(panel_66, DataLimit=-10, RecordData=True)  # disabled
list_length_5 = ListLength(List=data_recorder_5)  # disabled
number_slider_50 = Slider(3.402, range=0..10)  # disabled
number_slider_51 = Slider(5.849, range=0..10)  # disabled
number_slider_52 = Slider(7.834, range=0..10)  # disabled
number_slider_53 = Slider(0.752, range=0..10)  # disabled
sine_5 = Sine(Value=list_length_5)  # disabled
cosine_3 = Cosine(Value=list_length_5)  # disabled
multiplication_13 = Multiplication(A=cosine_3, B=number_slider_50)  # disabled
multiplication_14 = Multiplication(A=sine_5, B=number_slider_53)  # disabled
multiplication_15 = Multiplication(A=cosine_3, B=number_slider_52)  # disabled
expression_17 = Expression(
    x=range_8,
    a=multiplication_14,
    b=number_slider_51,
    c=multiplication_15,
    d=multiplication_13,
    Expression="(a*(x^2 - c))/(b*(x^2 + d))")  # disabled

amplitude_6 = Amplitude(Vector=[vector_xyz_21.Vector, vector_xyz_23.Vector, vector_xyz_24.Vector, vector_xyz_22.Vector], Amplitude=panel_65)  # disabled
vector_display_6 = VectorDisplay(Anchor=construct_point_19, Vector=amplitude_6)  # disabled

construct_point_20 = ConstructPoint(XCoordinate=range_8, YCoordinate=expression_17, ZCoordinate=0)  # disabled
interpolate_5 = Interpolate(Vertices=construct_point_20, Degree=3, Periodic=False, KnotStyle=1)  # -> Curve, Length, Domain; disabled

# ----
# graph to brep
geometry_23 = Geometry(interpolate_5.Curve)  # disabled
panel_67 = Panel(".05")  # disabled
offset_curve_14 = OffsetCurve(Curve=geometry_23, Distance=panel_67, Corners=1)  # disabled
curve_16 = Curve(graft(geometry_23))  # disabled
loft_13 = Loft(
    Curves=[curve_16, offset_curve_14],
    Options={Adjust=False, Closed=False, LoftEnds=0, LoftSimp=0, LoftType=0, Rebuild=10, Refit=0.01})  # disabled

# ----
# grid to brep
panel_68 = Panel("5")  # disabled
negative_25 = Negative(Value=panel_68)  # disabled
construct_domain_16 = ConstructDomain(DomainStart=negative_25, DomainEnd=panel_68)  # disabled
rectangle_8 = Rectangle(Plane=PlaneXY(0, 0, 0), XSize=construct_domain_16, YSize=construct_domain_16, Radius=0)  # -> Rectangle, Length; disabled
offset_curve_15 = OffsetCurve(Curve=rectangle_8.Rectangle, Distance=panel_67, Corners=1)  # disabled
loft_14 = Loft(
    Curves=flatten([offset_curve_15, rectangle_8.Rectangle]),
    Options={Adjust=False, Closed=False, LoftEnds=0, LoftSimp=0, LoftType=0, Rebuild=10, Refit=0.01})  # disabled

# ----
# Create a bmp or svg
geometry_24 = Geometry([loft_13, loft_14])  # disabled
brep_to_shape_8 = BrepToShape(Brep=flatten(geometry_24))  # disabled
number_slider_54 = Slider(96, range=0..100)  # disabled
panel_69 = Panel("24")  # disabled
compose_drawing_8 = ComposeDrawing(
    Shapes=brep_to_shape_8,
    Boundary=rectangle_8.Rectangle,
    Width=panel_69,
    Height=panel_69,
    Backround=RGBA(255, 255, 255, 0))  # disabled
drawing_to_bitmap_8 = DrawingToBitmap(Drawing=compose_drawing_8, PPI=number_slider_54)  # disabled
boolean_toggle_9 = BooleanToggle(False)  # disabled
view_drawing_8 = ViewDrawing(Drawing=compose_drawing_8)  # disabled
export_bitmap_8 = ExportBitmap(Image=drawing_to_bitmap_8, Extention=0, Save=boolean_toggle_9)  # disabled
export_svg_8 = ExportSVG(Drawing=compose_drawing_8, Save=False)  # disabled
panel_70 = Panel(export_bitmap_8)  # disabled
panel_71 = Panel(export_svg_8)  # disabled

# ----
# Visualization
number_slider_55 = Slider(100, range=0..100)  # disabled
curve_17 = Curve(reparameterize(geometry_23))  # disabled
rebuild_curve_7 = RebuildCurve(Curve=curve_17, Count=number_slider_55, Tangents=False)  # disabled
number_slider_56 = Slider(9, range=0..10)  # disabled
point_on_curve_8 = PointOnCurve(rebuild_curve_7, parameter=0.779)  # disabled
number_slider_57 = Slider(0.5, range=0..1)  # disabled
panel_72 = Panel("   y = f(x)")  # disabled
list_item_5 = ListItem(List=flatten(point_on_curve_8), Index=number_slider_56, Wrap=True)  # disabled
text_tag_3d_8 = TextTag3D(Location=list_item_5, Text=panel_72, Size=number_slider_57, Justification=1)  # disabled
geometry_25 = Geometry(geometry_24)  # disabled

# ----
# ƒ(x) = (A*x)/(Sqrt(x^2 + 1))
panel_73 = Panel("5")  # disabled
negative_26 = Negative(Value=panel_73)  # disabled
construct_domain_17 = ConstructDomain(DomainStart=negative_26, DomainEnd=panel_73)  # disabled
number_slider_58 = Slider(1, range=0..10)  # disabled
range_9 = Range(Domain=construct_domain_17, Steps=10)  # disabled
expression_18 = Expression(x=range_9, A=number_slider_58, Expression="(A*x)/(Sqrt(x^2 + 1))")  # disabled

expression_19 = Expression(x=range_9, a=multiplication_5, b=multiplication_4, c=multiplication_3, Expression="(a*x)/(Sqrt(b*(x^2) + c))")  # disabled

construct_point_21 = ConstructPoint(XCoordinate=range_9, YCoordinate=expression_19, ZCoordinate=0)  # disabled
interpolate_6 = Interpolate(Vertices=construct_point_21, Degree=3, Periodic=False, KnotStyle=1)  # -> Curve, Length, Domain; disabled

# ----
# graph to brep
geometry_26 = Geometry(interpolate_6.Curve)  # disabled
panel_74 = Panel(".05")  # disabled
offset_curve_16 = OffsetCurve(Curve=geometry_26, Distance=panel_74, Corners=1)  # disabled
curve_18 = Curve(graft(geometry_26))  # disabled
loft_15 = Loft(
    Curves=[curve_18, offset_curve_16],
    Options={Adjust=False, Closed=False, LoftEnds=0, LoftSimp=0, LoftType=0, Rebuild=10, Refit=0.01})  # disabled

# ----
# grid to brep
panel_75 = Panel("5")  # disabled
negative_27 = Negative(Value=panel_75)  # disabled
construct_domain_18 = ConstructDomain(DomainStart=negative_27, DomainEnd=panel_75)  # disabled
rectangle_9 = Rectangle(Plane=PlaneXY(0, 0, 0), XSize=construct_domain_18, YSize=construct_domain_18, Radius=0)  # -> Rectangle, Length; disabled
offset_curve_17 = OffsetCurve(Curve=rectangle_9.Rectangle, Distance=panel_74, Corners=1)  # disabled
loft_16 = Loft(
    Curves=flatten([offset_curve_17, rectangle_9.Rectangle]),
    Options={Adjust=False, Closed=False, LoftEnds=0, LoftSimp=0, LoftType=0, Rebuild=10, Refit=0.01})  # disabled

# ----
# Create a bmp or svg
geometry_27 = Geometry([loft_15, loft_16])  # disabled
brep_to_shape_9 = BrepToShape(Brep=flatten(geometry_27))  # disabled
number_slider_59 = Slider(96, range=0..100)  # disabled
panel_76 = Panel("24")  # disabled
compose_drawing_9 = ComposeDrawing(
    Shapes=brep_to_shape_9,
    Boundary=rectangle_9.Rectangle,
    Width=panel_76,
    Height=panel_76,
    Backround=RGBA(255, 255, 255, 0))  # disabled
drawing_to_bitmap_9 = DrawingToBitmap(Drawing=compose_drawing_9, PPI=number_slider_59)  # disabled
boolean_toggle_10 = BooleanToggle(False)  # disabled
view_drawing_9 = ViewDrawing(Drawing=compose_drawing_9)  # disabled
export_bitmap_9 = ExportBitmap(Image=drawing_to_bitmap_9, Extention=0, Save=boolean_toggle_10)  # disabled
export_svg_9 = ExportSVG(Drawing=compose_drawing_9, Save=False)  # disabled
panel_77 = Panel(export_bitmap_9)  # disabled
panel_78 = Panel(export_svg_9)  # disabled

# ----
# Visualization
number_slider_60 = Slider(100, range=0..100)  # disabled
curve_19 = Curve(reparameterize(geometry_26))  # disabled
rebuild_curve_8 = RebuildCurve(Curve=curve_19, Count=number_slider_60, Tangents=False)  # disabled
number_slider_61 = Slider(9, range=0..10)  # disabled
point_on_curve_9 = PointOnCurve(rebuild_curve_8, parameter=1)  # disabled
number_slider_62 = Slider(0.5, range=0..1)  # disabled
panel_79 = Panel("   y = f(x)")  # disabled
list_item_6 = ListItem(List=flatten(point_on_curve_9), Index=number_slider_61, Wrap=True)  # disabled
text_tag_3d_9 = TextTag3D(Location=list_item_6, Text=panel_79, Size=number_slider_62, Justification=1)  # disabled
geometry_28 = Geometry(geometry_27)  # disabled

# ----
# ƒ(x) = (1/(x^2)
number_slider_63 = Slider(5, range=0..10)  # disabled
# Infinite Limits:
# Consider the function ƒ(x) = 1/x^2
# as x approaches ) from either side
# the values of ƒ(x) grow larger and larger
# so the limit of ƒ(x) as x approaches
# 0 Does Not Exist
# It is convenient to write
# lim ƒ(x) = lim 1/x^2 = ∞
# x->0         x->0
negative_28 = Negative(Value=number_slider_63)  # disabled
panel_80 = Panel("0")  # disabled
construct_domain_19 = ConstructDomain(DomainStart=negative_28, DomainEnd=panel_80)  # disabled
construct_domain_20 = ConstructDomain(DomainStart=panel_80, DomainEnd=number_slider_63)  # disabled
number_slider_64 = Slider(753, range=0..1000)  # disabled
range_10 = Range(Domain=construct_domain_20, Steps=number_slider_64)  # disabled
range_11 = Range(Domain=construct_domain_19, Steps=number_slider_64)  # disabled
number_slider_65 = Slider(1, range=0..10)  # disabled

# ----
# Wickerson Studios Funk
# Note
# we are not saying that the lim exists
# infinity is not a real number
# rather, we are saying that the
# limit does not exist
# because 1/x^2 becomes arbitrarily large
# near x->0
trigger_6 = Trigger(Interval=50, TimerInterval=50, Target=data_recorder_6)  # disabled
panel_81 = Panel("0")  # disabled
data_recorder_6 = DataRecorder(panel_81, DataLimit=-10, RecordData=True)  # disabled
number_slider_66 = Slider(2.905, range=0..10)  # disabled
list_length_6 = ListLength(List=data_recorder_6)  # disabled
number_slider_67 = Slider(0.239, range=0..1)  # disabled
sine_6 = Sine(Value=list_length_6)  # disabled
multiplication_16 = Multiplication(A=sine_6, B=number_slider_67)  # disabled
multiplication_17 = Multiplication(A=sine_6, B=number_slider_66)  # disabled
expression_20 = Expression(x=range_10, a=multiplication_16, b=number_slider_67, Expression="b/(a*x^2)")  # disabled

expression_21 = Expression(x=range_11, a=multiplication_16, b=number_slider_67, Expression="b/(a*x^2)")  # disabled

expression_22 = Expression(x=range_11, k=expression_21, Expression="1/x^2")  # disabled
expression_23 = Expression(x=range_10, k=expression_20, Expression="1/x^2")  # disabled
construct_point_22 = ConstructPoint(XCoordinate=range_10, YCoordinate=expression_23, ZCoordinate=0)  # disabled
construct_point_23 = ConstructPoint(XCoordinate=range_11, YCoordinate=expression_22, ZCoordinate=0)  # disabled
interpolate_7 = Interpolate(Vertices=construct_point_22, Degree=3, Periodic=False, KnotStyle=1)  # -> Curve, Length, Domain; disabled
interpolate_8 = Interpolate(Vertices=construct_point_23, Degree=3, Periodic=False, KnotStyle=1)  # -> Curve, Length, Domain; disabled
entwine_2 = Entwine(Branch00=interpolate_8.Curve, Branch01=interpolate_7.Curve, FlattenInputs=True)  # disabled

# ----
# graph to brep
geometry_29 = Geometry(entwine_2)  # disabled
panel_82 = Panel(".05")  # disabled
offset_curve_18 = OffsetCurve(Curve=geometry_29, Distance=panel_82, Corners=1)  # disabled
curve_20 = Curve(graft(geometry_29))  # disabled
loft_17 = Loft(
    Curves=[curve_20, offset_curve_18],
    Options={Adjust=False, Closed=False, LoftEnds=0, LoftSimp=0, LoftType=0, Rebuild=10, Refit=0.01})  # disabled

# ----
# grid to brep
panel_83 = Panel("5")  # disabled
negative_29 = Negative(Value=panel_83)  # disabled
construct_domain_21 = ConstructDomain(DomainStart=negative_29, DomainEnd=panel_83)  # disabled
rectangle_10 = Rectangle(Plane=PlaneXY(0, 0, 0), XSize=construct_domain_21, YSize=construct_domain_21, Radius=0)  # -> Rectangle, Length; disabled
offset_curve_19 = OffsetCurve(Curve=rectangle_10.Rectangle, Distance=panel_82, Corners=1)  # disabled
loft_18 = Loft(
    Curves=flatten([offset_curve_19, rectangle_10.Rectangle]),
    Options={Adjust=False, Closed=False, LoftEnds=0, LoftSimp=0, LoftType=0, Rebuild=10, Refit=0.01})  # disabled

# ----
# Create a bmp or svg
geometry_30 = Geometry([loft_17, loft_18])  # disabled
brep_to_shape_10 = BrepToShape(Brep=flatten(geometry_30))  # disabled
number_slider_68 = Slider(96, range=0..100)  # disabled
panel_84 = Panel("24")  # disabled
compose_drawing_10 = ComposeDrawing(
    Shapes=brep_to_shape_10,
    Boundary=rectangle_10.Rectangle,
    Width=panel_84,
    Height=panel_84,
    Backround=RGBA(255, 255, 255, 0))  # disabled
drawing_to_bitmap_10 = DrawingToBitmap(Drawing=compose_drawing_10, PPI=number_slider_68)  # disabled
boolean_toggle_11 = BooleanToggle(False)  # disabled
view_drawing_10 = ViewDrawing(Drawing=compose_drawing_10)  # disabled
export_bitmap_10 = ExportBitmap(Image=drawing_to_bitmap_10, Extention=0, Save=boolean_toggle_11)  # disabled
export_svg_10 = ExportSVG(Drawing=compose_drawing_10, Save=False)  # disabled
panel_85 = Panel(export_bitmap_10)  # disabled
panel_86 = Panel(export_svg_10)  # disabled

# ----
# Visualization
number_slider_69 = Slider(100, range=0..100)  # disabled
curve_21 = Curve(reparameterize(geometry_29))  # disabled
rebuild_curve_9 = RebuildCurve(Curve=curve_21, Count=number_slider_69, Tangents=False)  # disabled
number_slider_70 = Slider(9, range=0..10)  # disabled
point_on_curve_10 = PointOnCurve(rebuild_curve_9, parameter=1)  # disabled
number_slider_71 = Slider(0.5, range=0..1)  # disabled
panel_87 = Panel("   y = f(x)")  # disabled
list_item_7 = ListItem(List=flatten(point_on_curve_10), Index=number_slider_70, Wrap=True)  # disabled
# (Sqrt(a*x^3 - b*x))
# (b*x - y)/(a*x^2 - i* y^2)
# (Abs(b*x - y))/(a*x^2 - i* y^2)
# (a*x^2 - b)/(Abs(b*x +c))
# (a*x - c)/(Abs(b*x + d))
# (c - b*x)/(a*x^k)
# k is an integer > 3 [4]
# (n*x + c*x^2 + *x^k)/(m + b*x^2 + a*x^3)
# k is an integer > 3 [5]
# Specific Equations
# (Sqrt(x^2 + 2*x) - Sqrt(x^2 - 2*x))
# as the limit of x->-∞
# (Sqrt(x^2 - 2*x) - x)
# ((x)/(x + 1) -  (x)/(x - 1))
# (x*(Sqrt(x + 1))*(1 - Sqrt(2x + 3)))/(7 - 6x + 4x^2)
# (Sqrt(x^2 - 2*x) + x)
# (Sqrt(x^2 + 2*x) - Sqrt(x^2 - 2*x))
# as the limit of x->∞
text_tag_3d_10 = TextTag3D(Location=list_item_7, Text=panel_87, Size=number_slider_71, Justification=1)  # disabled
# Infinite Limits:
# IF ƒ(x) is positive and becomes arbitrarily large
# as x approaches arbitrarily close to the
# value a then we say that ƒ(x) tends to infinity
# as x approaches a, and we wrote,
# lim ƒ(x)  = ∞
# x->a
# similarily,
# IF ƒ(x) is negativeand becomes arbitrarily large
# as x approaches arbitrarily close to the
# value a then we say that ƒ(x) tends to negative infinity
# as x approaches a, and we wrote,
# lim ƒ(x)  = -∞
# x->a
# 
# Teh definition can be extended to
# right and left limit situations
# we can now assert that
# lim (Sqrt(x^2 + x) - x) = ∞
# x->∞
# Wickerson Rules for Variables:
# solving liomits for ƒ(x)
# 
# use k as an integer for higher order exponents
# use a and/or i and/or m  for square/cube exponent
# use b and/or j and/or n  for square/x component
# use c and d as constant variables
# add additional variables m, n, p, q when possible
# FINAL FORM FOR C# IN VISUAL STUDIO
# 
# (A*x^2 + B*x + C)/(D*x^2 + E*x + F)
# (b*x^2 - d)/(a*x^3 + c)
# (Sqrt(c - a*x))
# (a*x + c)/(b*x + d)
# (b*x + c)/(a*x^2 + n*x + d)
# (a*x^2 - c)/(d - b*x^2)
# (b*x - c)/(d - a*x^2)
# 1/(Abs(a*x - b))
# 1/(b + a*x)
# (b*x)/((c - a*x)^3)
# (a*x^3 - c*x^2 + m)/(n + d*x - b*x^3)
# (Sqrt(a*x^2 - b*x^k))
# k is an integer > 3 [5]
# (b*x)/(Sqrt(c - a*x^2))
# (a*x + c*Sqrt(b*x))/(m - d*x)
# (a*x - m)/(Sqrt(c*x^2 + b*x + n)
geometry_31 = Geometry(geometry_30)  # disabled
